# Grasshopper definition ANALYSIS_Arch with tension bar.gh (Grasshopper 1.0.7)
# plug-ins: Karamba3D

# Beskrivelse: OC Engineering Grasshopper Template.
# Grafisk standard ses herunder.
# Højre klik på farve og sæt den til standard, grupper herefter og sæt kommentarer på gruppen.
# 
# 
# BESKRIVELSE AF SCRIPT:
# Script der udfører konstruktionsanalyse vha. karamba 3d
# 
# TEORI:
# bla bla.
# 
# INPUT:
# bla bla.
# 
# OUTPUT:
# bla bla.
gældende_udgivelsesdato_og_version = Panel("20.03.2023 - 01.00.00.00")
# Tilføjelser ændringer der kan implementeres: - Lav pænere mm.
revisions_historik = Panel("20.03.2023 - 01.00.00.00 - første udgivelse offentligt")
udviklet_af = Panel("Daniel Bo Olesen")
projekt = Panel("SagsNr - SagsNavn")
image_sampler = ImageSampler(Filter="Colour", Interpolate=True, Umax=842, Umin=1, Vmax=595, Vmin=1, Wrap=1)

# ---- group: TENSION BEAMS RAISED / Input
radius_m = Slider(31.48, range=0..250)
amount_of_tension_beams = Panel("4")

# ---- group: Input
# Amount of elements in model for Karamba3D "free" is max 20
# Radius is 18 m
# Span is 18 m
# for the "Stephans buen"
# Set length setting in Rhino to Unit m
span_m = Slider(18, range=0..40)
radius_m_2 = Slider(18, range=0..40)
amount_of_beams_at_arch = Panel("13")

# ---- group: TENSION BEAMS RAISED / Generate arch, rotate and move it
multiplication = Multiplication(A=radius_m, B=2)
xz_plane = XZPlane(Origin=Point(0, 0, 0))
division = Division(A=span_m, B=multiplication)
arcsine = ArcSine(Value=division)
multiplication_2 = Multiplication(A=arcsine, B=2)
arc = Arc(Plane=xz_plane, Radius=radius_m, Angle=multiplication_2)  # -> Arc, Length
rotate = Rotate(Geometry=arc.Arc, Angle=expr("(pi-x)/2", multiplication_2), Plane=xz_plane)  # -> Geometry, Transform
end_points = EndPoints(Curve=rotate.Geometry)  # -> Start, End
deconstruct = Deconstruct(Point=end_points.End)  # -> XComponent, YComponent, ZComponent
vector_xyz = VectorXYZ(XComponent=0, YComponent=0, ZComponent=expr("x*-1", deconstruct.ZComponent))  # -> Vector, Length
move = Move(Geometry=rotate.Geometry, Motion=vector_xyz.Vector)  # -> Geometry, Transform

# ---- group: Generate arch, rotateand move it
# Then θ, the angle between the radii going to the two points is given by
# θ=2×sin−1(D/2R)
# 
# Hvor D er spænd og R er radius, forudsætter punkter er i linje med hinanden
multiplication_3 = Multiplication(A=radius_m_2, B=2)
division_2 = Division(A=span_m, B=multiplication_3)
arcsine_2 = ArcSine(Value=division_2)
xz_plane_2 = XZPlane(Origin=Point(0, 0, 0))
multiplication_4 = Multiplication(A=arcsine_2, B=2)
arc_2 = Arc(Plane=xz_plane_2, Radius=radius_m_2, Angle=multiplication_4)  # -> Arc, Length
rotate_2 = Rotate(Geometry=arc_2.Arc, Angle=expr("(pi-x)/2", multiplication_4), Plane=xz_plane_2)  # -> Geometry, Transform
end_points_2 = EndPoints(Curve=rotate_2.Geometry)  # -> Start, End
deconstruct_2 = Deconstruct(Point=end_points_2.End)  # -> XComponent, YComponent, ZComponent
vector_xyz_2 = VectorXYZ(XComponent=0, YComponent=0, ZComponent=expr("x*-1", deconstruct_2.ZComponent))  # -> Vector, Length
move_2 = Move(Geometry=rotate_2.Geometry, Motion=vector_xyz_2.Vector)  # -> Geometry, Transform

# ---- group: TENSION BEAMS RAISED / tension beams
divide_curve = DivideCurve(Curve=move.Geometry, Count=amount_of_tension_beams, Kinks=False)  # -> Points, Tangents, Parameters
shift_list = ShiftList(List=divide_curve.Points, Shift=1, Wrap=False)
line = Line(StartPoint=divide_curve.Points, EndPoint=shift_list)

# ---- group: TENSION BEAMS RAISED / vertical tension beams
panel = Panel("""-1
0""")
divide_curve_2 = DivideCurve(Curve=move_2.Geometry, Count=amount_of_tension_beams, Kinks=False)  # -> Points, Tangents, Parameters
cull_index = CullIndex(List=divide_curve_2.Points, Indices=panel, Wrap=True)
cull_index_2 = CullIndex(List=divide_curve.Points, Indices=panel, Wrap=True)
line_2 = Line(StartPoint=cull_index, EndPoint=cull_index_2)

# ---- group: tension beams straight
end_points_3 = EndPoints(Curve=move_2.Geometry)  # -> Start, End
line_3 = Line(StartPoint=end_points_3.Start, EndPoint=end_points_3.End)

# ---- group: Arch beams
divide_curve_3 = DivideCurve(Curve=move_2.Geometry, Count=amount_of_beams_at_arch, Kinks=False)  # -> Points, Tangents, Parameters
shift_list_2 = ShiftList(List=divide_curve_3.Points, Shift=1, Wrap=False)
line_4 = Line(StartPoint=divide_curve_3.Points, EndPoint=shift_list_2)

# ----
tension_beam_raised_and_in_segments = Relay([line_2, line])

# ---- group: input Arch beams
material_selection_karamba3d = MaterialSelectionKaramba3D(menu=[dropdown(4), dropdown(5)])
height_flange_cm = Slider(15, range=0..150)
web_thickness_cm = Slider(7.5, range=0..150)
width_cm = Slider(30, range=0..150)
height_cm = Slider(80, range=0..150)
panel_2 = Panel("Arch")
cross_section_karamba3d = CrossSectionKaramba3D(
    FamilyNameOfCrossSection="DefaultCroSec",
    Material=material_selection_karamba3d,
    Height_cm=height_cm,
    UpperFlangeWidth_cm=width_cm,
    LowerFlangeWidth_cm=width_cm,
    UpperFlangeThickness_cm=height_flange_cm,
    LowerFlangeThickness_cm=height_flange_cm,
    WebThickness_cm=web_thickness_cm,
    FilletRadius_cm=0,
    mode="I")
line_to_beam_karamba3d = LineToBeamKaramba3D(
    Line=line_4,
    Color=ColourSwatch(SwatchColor=RGB(5, 5, 5)),
    Identifier=panel_2,
    CrossSection=cross_section_karamba3d,
    New=True,
    Remove=True,
    LimitDistance_m=0.005,
    Bending=True,
    SetBucklingLength=True,
    ToPolylineMaxAngle=0.03,
    ToPolylineTolerance=0.01,
    ToPolylineMaxEdgeLength=0.25)  # -> Element, Points, Info

# ---- group: input Loads
# concentrated force in kN, forces are applied to arch beams
# Block load, evenly distributed force in kN/m, forces are applied to arch beams
panel_3 = Panel("0")
position_relative_to_element = Slider(0.5, range=0..5)
start_position_relative_to_element = Slider(0, range=0..1)
end_position_relative_to_element = Slider(1, range=0..1)
construct_point = ConstructPoint(XCoordinate="0", YCoordinate=panel_3, ZCoordinate="-5")
construct_point_2 = ConstructPoint(XCoordinate="0", YCoordinate="0", ZCoordinate="-10.9")
beam_loads_karamba3d = BeamLoadsKaramba3D(
    BeamIdentifier=panel_2,
    LoadCase="0",
    ForceVector=construct_point_2,
    TStart=start_position_relative_to_element,
    TEnd=end_position_relative_to_element,
    mode="Block",
    menu=[buttons(on, off, off)])
beam_loads_karamba3d_2 = BeamLoadsKaramba3D(
    BeamIdentifier=panel_2,
    LoadCase="0",
    ForceVector=construct_point,
    TPosition=position_relative_to_element,
    mode="Concentrated",
    menu=[buttons(off, on)])

# ---- group: input Supports
# Start side, bottom main support
# End side, bottom main support
xz_plane_3 = XZPlane(Origin=Point(0, 0, 0))
support_karamba3d = SupportKaramba3D(PosInd=end_points_3.Start, PlaneOfReference=xz_plane_3, menu=[buttons(off, on, on, off, off, off)])
support_karamba3d_2 = SupportKaramba3D(PosInd=end_points_3.End, PlaneOfReference=xz_plane_3, menu=[buttons(on, on, on, on, on, off)])

# ----
shift_paths = ShiftPaths(Data=tension_beam_raised_and_in_segments, Offset=-1)
bending = BooleanToggle(False)

# ---- group: input tension beam
diameter_tension_rood_cm = Slider(3.8, range=0..25)
material_selection_karamba3d_2 = MaterialSelectionKaramba3D(menu=[dropdown(1), dropdown(2)])
division_3 = Division(A=diameter_tension_rood_cm, B=2)
cross_section_karamba3d_2 = CrossSectionKaramba3D(
    FamilyNameOfCrossSection="DefaultCroSec",
    Material=material_selection_karamba3d_2,
    Diameter_cm=diameter_tension_rood_cm,
    WallThickness_cm=division_3,
    mode="Circular Hollow")
line_to_beam_karamba3d_2 = LineToBeamKaramba3D(
    Line=[shift_paths, line_3],
    Color=ColourSwatch(SwatchColor=RGB(0, 0, 0)),
    Identifier="tension",
    CrossSection=cross_section_karamba3d_2,
    New=True,
    Remove=True,
    LimitDistance_m=0.005,
    Bending=bending,
    SetBucklingLength=False,
    ToPolylineMaxAngle=0.03,
    ToPolylineTolerance=0.01,
    ToPolylineMaxEdgeLength=0.25)  # -> Element, Points, Info

# ----
shift_paths_2 = ShiftPaths(Data=line_to_beam_karamba3d.Element, Offset="-1")
support_karamba3d_3 = SupportKaramba3D(PosInd=cull_index_2, menu=[buttons(off, on, off, off, off, off)])
support_karamba3d_4 = SupportKaramba3D(PosInd=cull_index, menu=[buttons(on, on, on, off, off, off)])
element_karamba3d = ElementKaramba3D(flatten([line_to_beam_karamba3d_2.Element, shift_paths_2]))
support_karamba3d_5 = SupportKaramba3D(flatten([support_karamba3d, support_karamba3d_2, support_karamba3d_4, support_karamba3d_3]))
assemble_model_karamba3d = AssembleModelKaramba3D(
    Elem=element_karamba3d,
    Support=support_karamba3d_5,
    Load=[beam_loads_karamba3d_2, beam_loads_karamba3d],
    LimitDistance_m=0.005)  # -> Model, Info, Mass_kg, CenterOfGravity, LoadCaseNames
analyze_karamba3d = AnalyzeKaramba3D(Model=assemble_model_karamba3d.Model)  # -> CalculatedModel, MaximumDisplacement_cm, ResultingForceOfGravity_kN, ElasticEnergyChange_kNm
model_view_karamba3d = ModelViewKaramba3D(Model=analyze_karamba3d.CalculatedModel, ResultFactors=1, ResultCase=-1)  # -> Model, DeformedMesh, DeformedAxes, DeformedModel
panel_4 = Panel(analyze_karamba3d.MaximumDisplacement_cm)
panel_5 = Panel(analyze_karamba3d.ResultingForceOfGravity_kN)
panel_6 = Panel(analyze_karamba3d.ElasticEnergyChange_kNm)
beam_view_karamba3d = BeamViewKaramba3D(Model=model_view_karamba3d.Model)  # -> Model, MeshesOfRenderedBeams, DeformedBeamAxes, LegendColors, LegendTags
reaction_forces_karamba3d = ReactionForcesKaramba3D(AnalyzedModel=model_view_karamba3d.Model)  # -> AnalyzedModel, ReactionForces_kN, ReactionMoments_kNm, SupportPosition, SumOfReactionForces_kN, SumOfReactionMoments_kNm
beam_forces_karamba3d = BeamForcesKaramba3D(AnalyzedModel=model_view_karamba3d.Model, Ts=[0, 1])  # -> AnalyzedModel, NormalForce_kN, ShearForceVz_kN, ShearForceVy_kN, TorsionalMomentMt_kNm, BendingMomentMy_kNm, BendingMomentMz_kNm
bounds = Bounds(Numbers=flatten(beam_forces_karamba3d.NormalForce_kN))
bounds_2 = Bounds(Numbers=flatten(beam_forces_karamba3d.ShearForceVz_kN))
bounds_3 = Bounds(Numbers=flatten(beam_forces_karamba3d.BendingMomentMy_kNm))
deconstruct_domain = DeconstructDomain(Domain=flatten(reaction_forces_karamba3d.ReactionMoments_kNm))  # -> Start, End
deconstruct_domain_2 = DeconstructDomain(Domain=flatten(reaction_forces_karamba3d.ReactionForces_kN))  # -> Start, End
panel_7 = Panel(reaction_forces_karamba3d.ReactionForces_kN)
deconstruct_domain_3 = DeconstructDomain(Domain=bounds)  # -> Start, End
deconstruct_domain_4 = DeconstructDomain(Domain=bounds_2)  # -> Start, End
min = Panel(deconstruct_domain.Start)
min_2 = Panel(deconstruct_domain_2.Start)
deconstruct_domain_5 = DeconstructDomain(Domain=bounds_3)  # -> Start, End
max = Panel(deconstruct_domain.End)
max_2 = Panel(deconstruct_domain_2.End)
min_3 = Panel(deconstruct_domain_3.Start)
min_4 = Panel(deconstruct_domain_4.Start)
min_5 = Panel(deconstruct_domain_5.Start)
max_3 = Panel(deconstruct_domain_3.End)
max_4 = Panel(deconstruct_domain_4.End)
max_5 = Panel(deconstruct_domain_5.End)
