# Grasshopper definition ANALYSIS_Slope HyperbolicRamp not precise.gh (Grasshopper 1.0.7)

# Beskrivelse: OC Engineering Grasshopper Template.
# Grafisk standard ses herunder.
# Højre klik på farve og sæt den til standard, grupper herefter og sæt kommentarer på gruppen.
# 
# 
# BESKRIVELSE AF SCRIPT:
# Script der bruges til at analyserer hældning på en ramper der følger en hyperbolsk form
# 
# TEORI:
# bla bla.
# 
# INPUT:
# bla bla.
# 
# OUTPUT:
# bla bla.
gældende_udgivelsesdato_og_version = Panel("20.03.2023 - 01.00.00.00")
# Tilføjelser ændringer der kan implementeres: - Opsætning mm.
# - lav om til engelsk
revisions_historik = Panel("20.03.2023 - 01.00.00.00 - første udgivelse offentligt")
udviklet_af = Panel("Daniel Bo Olesen")
projekt = Panel("SagsNr - SagsNavn")
image_sampler = ImageSampler(Filter="Colour", Interpolate=True, Umax=842, Umin=1, Vmax=595, Vmin=1, Wrap=1)

# ---- group: Settings
height = Slider(35, range=10..100)
diameter = Slider(32, range=10..60)
number_slider = Slider(128.2, range=0..170)

# ---- group: Curve samples
period = DigitScroller(Scroller_Digits=12, Scroller_Prefix="Period", Scroller_Radix=9, Scroller_Value=13.5)
samples = Slider(464, range=10..1000)
division = Division(A=samples, B=period)
range = Range(Domain=Domain(0, 1), Steps=expr("x-1", samples))
range_2 = Range(Domain=Domain(0, 1), Steps=division)
cull_i = CullIndex(List=range_2, Indices=0, Wrap=False)  # -> flatten(List)
repeat = RepeatData(Data=cull_i, Length=samples)
pt = ConstructPoint(XCoordinate=repeat, YCoordinate=range, ZCoordinate=0)

# ---- group: Hyperboloid
pt_2 = ConstructPoint(XCoordinate=expr("0.5 * x", diameter), YCoordinate=0, ZCoordinate=0)
Z = UnitZ(Factor=height)
move = Move(Geometry=pt_2, Motion=Z)  # -> Geometry, Transform
rotate = Rotate(Geometry=move.Geometry, Angle=degrees(number_slider), Plane=PlaneXY(0, 0, 0))  # -> Geometry, Transform
ln = Line(StartPoint=pt_2, EndPoint=rotate.Geometry)
revsrf = Revolution(Curve=ln, Axis=Line((0, 0, 0), (0, 0, 5)), Domain=Domain(0, 6.283185307))

# ---- group: Spiral
eval = EvaluateSurface(Surface=reparameterize(revsrf), Point=pt, CorrectFrame=True)  # -> Point, Normal, Frame
intcrv = Interpolate(Vertices=eval.Point, Degree=3, Periodic=False, KnotStyle=1)  # -> Curve, Length, Domain

# ---- group: Slope analysis
divide = DivideCurve(Curve=intcrv.Curve, Count=1000, Kinks=False)  # -> Points, Tangents, Parameters
devec = DeconstructVector(Vector=divide.Tangents)  # -> XComponent, YComponent, ZComponent
graph = QuickGraph(devec.ZComponent, SortOrder=0)
