# Grasshopper definition ANALYSIS_Slope HyperbolicRamp precise.gh (Grasshopper 1.0.7)

# Description: OC Engineering Grasshopper Template.
# Graphic standard seen underneath
# Rightclick a colour and set to standard, there after group and comment on the group
# 
# 
# DESCRIPTION OF THE SCRIPT:
# Analysis of a ramp or curve running along a hyporboloid structure
# 
# THEORY:
# bla bla.
# 
# INPUT:
# bla bla.
# 
# OUTPUT:
# bla bla.
current_revision_data_and_version = Panel("20.03.2023 - 01.00.00.00")
# Developed by: Unknown - the big internet
project = Panel("SagsNr - SagsNavn")
image_sampler = ImageSampler(Filter="Colour", Interpolate=True, Umax=842, Umin=1, Vmax=595, Vmin=1, Wrap=1)
# Revision history: FILL OUT if not managed through .git
# Todos: FILL OUT if not managed through .git
total_number_of_winds = Slider(8, range=0..20)
_1_2_total_height = Slider(80, range=0..100)
small_radius = Slider(25, range=0..100)
large_radius = Slider(50, range=0..100)
division = Division(A=total_number_of_winds, B=2)
division_2 = Division(A=large_radius, B=small_radius)
number_slider = Slider(600, range=0..2000)
pi = Number(3.141592654)
# Calculate a constant based on the two radii and the winding number.
# The fancy expression is another form of inverse cosh because
# Grasshopper does not have its own.
# We need this constant so the spiral in the xy plane fits between the two radii.
expression = Expression(x=division_2, Expression="ln(x + sqrt(x^2 -1))")
multiplication = Multiplication(A=total_number_of_winds, B=pi)
range = Range(Domain=Domain(0, 1), Steps=number_slider)
# Generate the hyperbolic cosh function to make a spiral in the xy plane.
# The points on the spiral are then projected onto the top half of the hyperboloid.
division_3 = Division(A=expression, B=multiplication)
X = UnitX(Factor=1)

dom = ConstructDomain(DomainStart=small_radius, DomainEnd=large_radius)
expression_2 = Expression(x=_1_2_total_height, y=division_2, Expression="x/sqrt((y)^2 -1)")
range_2 = Range(Domain=dom, Steps=number_slider)
# Generate 1/2 of the hyperboloid, then  rotate it 180 degrees in the xy plane and then join the two halves.
division_4 = Division(A=range_2, B=small_radius)
expression_3 = Expression(x=division_4, y=expression_2, Expression="y*sqrt((x^2 -1))")
pt = ConstructPoint(XCoordinate=range_2, YCoordinate=0, ZCoordinate=expression_3)
intcrv = Interpolate(Vertices=pt, Degree=3, Periodic=False, KnotStyle=1)  # -> Curve, Length, Domain
Z = UnitZ(Factor=1)
line = LineSDL(Start=Z, Direction=Vector(0, 0, 1), Length=1)
revsrf = Revolution(Curve=intcrv.Curve, Axis=line, Domain=Domain(0, 6.283185307))
rot3d = Rotate3D(Geometry=revsrf, Angle=3.141592654, Center=Point(0, 0, 0), Axis=X)  # -> Geometry, Transform
join = BrepJoin(Breps=[revsrf, rot3d.Geometry])  # -> Breps, Closed

multiplication_2 = Multiplication(A=range, B=multiplication)
expression_4 = Expression(x=multiplication_2, y=small_radius, z=division_3, Expression="y*cosh(z*x)")
division_5 = Division(A=expression_4, B=small_radius)
pt_2 = PointCylindrical(BasePlane=PlaneXY(0, 0, 0), Angle=multiplication_2, Radius=expression_4, Elevation=0)
expression_5 = Expression(x=division_5, y=expression_2, Expression="y*sqrt((x^2 -1))")
intcrv_2 = Interpolate(Vertices=pt_2, Degree=3, Periodic=False, KnotStyle=1)  # -> Curve, Length, Domain
pt_3 = PointCylindrical(BasePlane=PlaneXY(0, 0, 0), Angle=multiplication_2, Radius=expression_4, Elevation=expression_5)
# Join the projected curve and its rotated version to get a
# spiral along the entire hyperboloid
intcrv_3 = Interpolate(Vertices=pt_3, Degree=3, Periodic=False, KnotStyle=1)  # -> Curve, Length, Domain

rot3d_2 = Rotate3D(Geometry=intcrv_3.Curve, Angle=3.141592654, Center=Point(0, 0, 0), Axis=X)  # -> Geometry, Transform
join_2 = JoinCurves(Curves=[rot3d_2.Geometry, intcrv_3.Curve], Preserve=False)
pipe = Pipe(Curve=join_2, Radius=1, Caps=0)

divide = DivideCurve(Curve=join_2, Count=1000, Kinks=False)  # -> Points, Tangents, Parameters
devec = DeconstructVector(Vector=divide.Tangents)  # -> XComponent, YComponent, ZComponent
bnd = Bounds(Numbers=devec.ZComponent)
bar_graph = BarGraph(devec.ZComponent, BarColor=RGB(255, 0, 90))
# The variation in slope is quite small!
graph = QuickGraph(devec.ZComponent, SortOrder=0)
panel = Panel(bnd)
