# Grasshopper definition BHoMToRobot.gh (Grasshopper 1.0.7)
# plug-ins: BH.UI.Grasshopper, LunchBox, Human, EleFront, MetaHopper

developed_by = Panel("Daniel Bo Olesen")
# Description: OC Engineering Grasshopper Template.
# Graphic standard seen underneath
# Rightclick a colour and set to standard, there after group and comment on the group
# 
# 
# DESCRIPTION OF THE SCRIPT:
# Script der bruges i hops, oploades til GitHub så der er mulighed for at dele hops med flere brugere, da der bruges et link af http.... typen, hvormed den ikke er bruger bestemt i form af en specifik sti.
# 
# THEORY:
# bla bla.
# 
# INPUT:
# bla bla.
# 
# OUTPUT:
# bla bla.
current_revision_data_and_version = Panel("15.03.2023 - 01.00.00.00")
project = Panel("SagsNr - SagsNavn")
image_sampler = ImageSampler(Filter="Colour", Interpolate=True, Umax=842, Umin=1, Vmax=595, Vmin=1, Wrap=1)
# GH TOOLS
panel = Panel(""" Use shift+ctrl+B to search in BHoM
BHoM bruger Si grundenheder, dvs. meter, newton, Pa osv.""")

# ---- group: Modify all panels
get_objects_of_same_type = GetObjectsOfSameType(Objects=panel)
set_panel_properties = SetPanelProperties(Panel=get_objects_of_same_type, Color=ColourSwatch(SwatchColor=RGB(255, 255, 255)))

# ---- group: Create scripple on group by name
# preview
# OBS
# big group
# Revision history: FILL OUT if not managed through .git
# 15.03.2023 - 01.00.00.00 - første udgivelse
# Todos: FILL OUT if not managed through .git
# - Indbyg udbøjning formel
boolean_toggle = BooleanToggle(True)
label_groups = LabelGroups(Run=boolean_toggle)

# ---- group: Modify group colors, scheme colors preset
# Output
# Input
# data
group_colors = ValueList({"Output": "184,82,204 (150)", "Input": "56,245,255 (150)", "Data": "128,128,128 (150)", "Geometry": "182,204,102 (150)", "preview": "252,210,159 (150)", "OBS": "255,140,140 (150)", "Big group": "255,255,255 (150)"}, selected="Big group")
set_group_properties = SetGroupProperties(Group="Grasshopper.Kernel.Types.GH_ObjectWrapper", Color=group_colors)

# ---- group: Modify line types
# Layout and group design
line_type = ValueList({"Normal": 0, "Faint": 1, "Hidden": 2}, selected="Hidden")
control_wire_display = ControlWireDisplay(WireDisplay=line_type, AllObjects_Object=[last_typer_bhom_list, alle_last_typer_navne, vælg_lasttype_3])

# ---- group: Apply best practice to group
# geometry
boolean_toggle_2 = BooleanToggle(True)
best_practicizer = BestPracticizer(Activate=boolean_toggle_2)

# ----
wire_display_toggle = WireDisplayToggle(ShowHiddenWires=Toggle(False))

# ---- group: RSA Settings
designcode_steel = DesignCode_Steel(
    {"Default": 0, "BS5950": 1, "BS5950_2000": 2, "BS_EN_1993_1_2005_NA_2008_A1_2014": 3, "ANSI_AISC_360_10": 4}, selected="BS_EN_1993_1_2005_NA_2008_A1_2014",
    Component="BH.oM.Adapters.Robot.DesignCode_Steel",
    Selection=3)
savebeforeclose = BooleanToggle(False)
materialdb = MaterialDB(
    {"American": 0, "British": 1, "Eurocode": 2}, selected="Eurocode",
    Component="BH.oM.Adapters.Robot.MaterialDB",
    Selection=2)
sectiondb = SectionDB({"UKST": 0, "AISC": 1}, selected="UKST", Component="BH.oM.Adapters.Robot.SectionDB", Selection=0)
designcode_steel_2 = Data(designcode_steel)
savebeforeclose_2 = Data(savebeforeclose)
materialdb_2 = Data(materialdb)
sectiondb_2 = Data(sectiondb)

# ---- group: OPEN/CLOSE RSA
# CONNECTORS
open_activate_rsa = BooleanToggle(False)
close_rsa = BooleanToggle(False)
open_activate_rsa_2 = Data(open_activate_rsa)
close_rsa_2 = Data(close_rsa)

# ---- group: 3d grid settings
# GEOMETRY, GH
x_grid_afstand_m = Slider(10.7, range=0..100)
y_grid_afstand_m = Slider(10.54, range=0..100)
x_antal_grid = Slider(3, range=1..25)
y_antal_grid = Slider(6, range=1..25)
etage_højde_m = Slider(4.5, range=0.5..10)
# Alle nodes/punkter/streger
antal_etager = Slider(3, range=1..10)
x_grid_afstand_m_2 = Data(x_grid_afstand_m)
y_grid_afstand_m_2 = Data(y_grid_afstand_m)
etage_højde_m_2 = Data(etage_højde_m)
antal_etager_2 = Data(antal_etager)
x_antal_grid_2 = Data(x_antal_grid)
y_antal_grid_2 = Data(y_antal_grid)

# ---- group: Alle nodes/punkter / Grid x/y akse
x_size = Data(x_grid_afstand_m_2)
y_size = Data(y_grid_afstand_m_2)
x_count = Data(x_antal_grid_2)
y_count = Data(y_antal_grid_2)
rectangle = Rectangle(Plane=PlaneXY(0, 0, 0), XSize=x_size, YSize=y_size, Radius=0)  # -> Rectangle, Length
point = Point(X=0, Y=0, Z=0, Component="BH.oM.Geometry.Point")
rectangular_array = RectangularArray(Geometry=point, Cell=rectangle.Rectangle, XCount=x_count, YCount=y_count)  # -> Geometry, Transform
geometry = Data(rectangular_array.Geometry)

# ---- group: Alle nodes/punkter / etager (n grid på z akse)
count = Data(antal_etager_2)
step = Data(etage_højde_m_2)
series = Series(Start=step, Step=step, Count=count)
unit_z = UnitZ(Factor=series)
graft_tree = GraftTree(Tree=unit_z, IncludeEmptyLists=True, IncludeNullItems=True)
move = Move(Geometry=rectangular_array.Geometry, Motion=graft_tree)  # -> Geometry, Transform
geometry_2 = Data(move.Geometry)

# ---- group: Alle nodes/punkter / Sets manipulation til søjler nodes
_0_x = Data(geometry)
tree = Data(geometry_2)
param_viewer = ParamViewer(tree)
shift_list = ShiftList(List=param_viewer, Shift=-1, Wrap=False)
tree_branch = TreeBranch(Tree=tree, Path=shift_list, MaintainPaths=True)
entwine = Entwine(Branch0X=_0_x, Branch1X=tree_branch, FlattenInputs=False)
result = Data(entwine)

# ---- group: Alle nodes/punkter / Sets manipulation til bjælker nodes
u_count = Data(y_antal_grid_2)
v_divisions = Data(x_antal_grid_2)
points = Data(geometry_2)
surface_from_points = SurfaceFromPoints(Points=points, UCount=u_count, Interpolate=True)
grid_structure = GridStructure(Surface=surface_from_points, UDivisions=expr("x-1", u_count), VDivisions=expr("x-1", v_divisions))  # -> StructureLines, StructureNodes
end_points = EndPoints(Curve=grid_structure.StructureLines)  # -> Start, End
surface = Data(surface_from_points)
start = Data(end_points.Start)
end = Data(end_points.End)

# ---- group: BHoM object, structural members / Element type 1, søjler / Profil
ipe = IPE(
    {"IPE 600": 0, "IPE 550": 1, "IPE 500": 2, "IPE 450": 3, "IPE 400": 4, "IPE 360": 5, "IPE 330": 6, "IPE 300": 7, "IPE 270": 8, "IPE 240": 9, "IPE 220": 10, "IPE 200": 11, "IPE 180": 12, "IPE 160": 13, "IPE 140": 14, "IPE 120": 15, "IPE 100": 16, "IPE 80": 17}, selected="IPE 500",
    Component="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",
    Selection=2)
he = HE(
    {"HE 1000 M": 0, "HE 1000 B": 1, "HE 1000 A": 2, "HE 900 M": 3, "HE 900 B": 4, "HE 900 A": 5, "HE 800 M": 6, "HE 800 B": 7, "HE 800 A": 8, "HE 700 M": 9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}, selected="HE 1000 M",
    Component="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",
    Selection=0)
upe = UPE(
    {"UPE 330": 0, "UPE 300": 1, "UPE 270": 2, "UPE 240": 3, "UPE 220": 4, "UPE 200": 5, "UPE 180": 6, "UPE 160": 7, "UPE 140": 8, "UPE 120": 9, "UPE 100": 10, "UPE 80": 11}, selected="UPE 330",
    Component="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",
    Selection=0)
rhs = RHS(
    {"RHS50x30x3.2": 0, "RHS50x30x3.6": 1, "RHS50x30x4.0": 2, "RHS50x30x5.0": 3, "RHS50x30x6.3": 4, "RHS60x40x3.2": 5, "RHS60x40x3.6": 6, "RHS60x40x4.0": 7, "RHS60x40x5.0": 8, "RHS60x40x6.3": 9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}, selected="RHS50x30x3.2",
    Component="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",
    Selection=0)
steel = Steel(
    {"S235": 0, "S275": 1, "S355": 2, "S450": 3}, selected="S235",
    Component="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",
    Selection=0)
steel_2 = Data(steel)
profil = Data(ipe)

# ---- group: BHoM object, structural members / Element type 1, søjler / Releases
barreleasefixfix = BarReleaseFixFix(Name="FixFix", Component="{ .BarReleaseFixFix")
barreleasepinpin = BarReleasePinPin(Name="PinPin", Component="{ .BarReleasePinPin")
barreleasepinslip = BarReleasePinSlip(Name="PinSlip", Component="{ .BarReleasePinSlip")
pinpin = Data(barreleasepinpin)
fixfix = Data(barreleasefixfix)
pinslip = Data(barreleasepinslip)
release = Data(pinpin)  # disabled

# ---- group: BHoM object, structural members / Element type 1, søjler / Supports
fixconstraint6dof = FixConstraint6DOF(Component="{ .FixConstraint6DOF")
pinconstraint6dof = PinConstraint6DOF(Component="{ .PinConstraint6DOF")
pinned = Data(pinconstraint6dof)
fixed = Data(fixconstraint6dof)
support = Data(pinned)

# ---- group: BHoM object, structural members / Element type 2, Bjælker / Profil, element 2
ipe_2 = IPE(
    {"IPE 600": 0, "IPE 550": 1, "IPE 500": 2, "IPE 450": 3, "IPE 400": 4, "IPE 360": 5, "IPE 330": 6, "IPE 300": 7, "IPE 270": 8, "IPE 240": 9, "IPE 220": 10, "IPE 200": 11, "IPE 180": 12, "IPE 160": 13, "IPE 140": 14, "IPE 120": 15, "IPE 100": 16, "IPE 80": 17}, selected="IPE 500",
    Component="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",
    Selection=2)
he_2 = HE(
    {"HE 1000 M": 0, "HE 1000 B": 1, "HE 1000 A": 2, "HE 900 M": 3, "HE 900 B": 4, "HE 900 A": 5, "HE 800 M": 6, "HE 800 B": 7, "HE 800 A": 8, "HE 700 M": 9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}, selected="HE 1000 M",
    Component="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",
    Selection=0)
upe_2 = UPE(
    {"UPE 330": 0, "UPE 300": 1, "UPE 270": 2, "UPE 240": 3, "UPE 220": 4, "UPE 200": 5, "UPE 180": 6, "UPE 160": 7, "UPE 140": 8, "UPE 120": 9, "UPE 100": 10, "UPE 80": 11}, selected="UPE 330",
    Component="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",
    Selection=0)
rhs_2 = RHS(
    {"RHS50x30x3.2": 0, "RHS50x30x3.6": 1, "RHS50x30x4.0": 2, "RHS50x30x5.0": 3, "RHS50x30x6.3": 4, "RHS60x40x3.2": 5, "RHS60x40x3.6": 6, "RHS60x40x4.0": 7, "RHS60x40x5.0": 8, "RHS60x40x6.3": 9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}, selected="RHS50x30x3.2",
    Component="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",
    Selection=0)
steel_3 = Steel(
    {"S235": 0, "S275": 1, "S355": 2, "S450": 3}, selected="S235",
    Component="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",
    Selection=0)
steel_4 = Data(steel_3)
profil_2 = Data(ipe_2)

# ---- group: BHoM object, structural members / Element type 2, Bjælker / Releases, element 2
barreleasefixfix_2 = BarReleaseFixFix(Name="FixFix", Component="{ .BarReleaseFixFix")
barreleasepinpin_2 = BarReleasePinPin(Name="PinPin", Component="{ .BarReleasePinPin")
barreleasepinslip_2 = BarReleasePinSlip(Name="PinSlip", Component="{ .BarReleasePinSlip")
fixfix_2 = Data(barreleasefixfix_2)
pinpin_2 = Data(barreleasepinpin_2)
pinslip_2 = Data(barreleasepinslip_2)
release_2 = Data(pinpin_2)

# ---- group: BHoM object, structural members / Element type 2, Bjælker
navn_på_object_type_2_bjælker = Data("Bjælke")

# ---- group: BHoM object, structural members / Element type 3, skiver
tykkelse_m = Slider(0.24, range=0..1)
concrete = Concrete(
    {"C12/15": 0, "C16/20": 1, "C20/25": 2, "C25/30": 3, "C30/37": 4, "C35/45": 5, "C40/50": 6, "C45/55": 7, "C50/60": 8, "C55/67": 9, "C60/75": 10, "C70/85": 11, "C80/95": 12, "C90/105": 13}, selected="C25/30",
    Component="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",
    Selection=3)
concrete_2 = Data(concrete)
tykkelse_m_2 = Data(tykkelse_m)
navn = Data("C25/C30 beton 240mm")

# ---- group: BHoM object, structural members / Element type 1, søjler
# OBJECTS SET-UP, BHoM
panel_2 = Panel("Søjle")
navn_på_object_type_1_søjler = Data(panel_2)

# ---- group: BHoM object, structural members / Element type 1, Søjler
startnode = Data(result)
endnode = Data(geometry_2)
value = Data(steel_2)
profil_3 = Data(profil)
release_3 = Data(release)
name = Data(navn_på_object_type_1_søjler)
setpropertyvalue = SetPropertyValue(Obj=profil_3, PropName="Material", Value=value, Component="{ .SetPropertyValue")
bar = Bar(
    StartNode=startnode,
    EndNode=endnode,
    SectionProperty=setpropertyvalue,
    OrientationAngle=0,
    Release=release_3,
    FEAType="{ \"_t\" : \"System.Enum\", \"TypeName\" : { \"_t\" : \"System.Type\", \"Name\" : \"BH.oM.Structure.Elements.BarFEAType\", \"_bhomVersion\" : \"6.3\" }, \"Value\" : \"Flexural\", \"_bhomVersion\" : \"6.3\" }",
    Name=name,
    Component="BH.oM.Structure.Elements.Bar")
bhom_søjler = Data(bar)

# ---- group: BHoM object, structural members / Element type 2, Bjælker
name_2 = Data(navn_på_object_type_2_bjælker)
value_2 = Data(steel_4)
release_4 = Data(release_2)
profil_4 = Data(profil_2)
startnode_2 = Data(start)
endnode_2 = Data(end)
setpropertyvalue_2 = SetPropertyValue(Obj=profil_4, PropName="Material", Value=value_2, Component="{ .SetPropertyValue")
bar_2 = Bar(
    StartNode=startnode_2,
    EndNode=endnode_2,
    SectionProperty=setpropertyvalue_2,
    OrientationAngle=0,
    Release=release_4,
    FEAType="{ \"_t\" : \"System.Enum\", \"TypeName\" : { \"_t\" : \"System.Type\", \"Name\" : \"BH.oM.Structure.Elements.BarFEAType\", \"_bhomVersion\" : \"6.3\" }, \"Value\" : \"Flexural\", \"_bhomVersion\" : \"6.3\" }",
    Name=name_2,
    Component="BH.oM.Structure.Elements.Bar")
bhom_bjælke = Data(bar_2)

# ---- group: BHoM object, structural members / Element type 3, Skiver
thickness = Data(tykkelse_m_2)
material = Data(concrete_2)
surface_2 = Data(surface)
name_3 = Data(navn)
constantthickness = ConstantThickness(
    Name=name_3,
    Thickness=thickness,
    Material=material,
    PanelType="{ \"_t\" : \"System.Enum\", \"TypeName\" : { \"_t\" : \"System.Type\", \"Name\" : \"BH.oM.Structure.SurfaceProperties.PanelType\", \"_bhomVersion\" : \"6.3\" }, \"Value\" : \"Slab\", \"_bhomVersion\" : \"6.3\" }",
    Component="BH.oM.Structure.SurfaceProperties.ConstantThickness")
panel_3 = Panel(Surface=surface_2, Property=constantthickness, Name=name_3, Tolerance=1e-06, Component="{ .Panel")
bhom_panel = Data(panel_3)

# ---- group: BHoM object, structural members / Element type 1, Søjler / Søjle Understøtninger
position = Data(geometry)
support_2 = Data(support)
node = Node(Position=position, Support=support_2, Component="BH.oM.Structure.Elements.Node")
bhom_understøtning = Data(node)

# ---- group: BHoM object, structural members
merge = Merge(Data1=bhom_søjler, Data2=bhom_understøtning, Data3=bhom_bjælke, Data4=bhom_panel)
bhom_objects_structural_members = Data(merge)

# ---- group: REVIT TEST
familyloadsettings = FamilyLoadSettings(OverwriteFamily=True, OverwriteParameterValues=True, Component="{ .FamilyLoadSettings")
mappingsettings = MappingSettings(Component="{ .MappingSettings")
connectionsettings = ConnectionSettings(PushPort=14128, PullPort=14129, MaxMinutesToWait=10, Component="{ .ConnectionSettings")
revitsettings = RevitSettings(
    ConnectionSettings=connectionsettings,
    FamilyLoadSettings=familyloadsettings,
    MappingSettings=mappingsettings,
    DistanceTolerance=1e-06,
    AngleTolerance=1e-06,
    Component="BH.oM.Adapters.Revit.Settings.RevitSettings")
explode = Explode(Object=bhom_søjler, Component="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")  # -> StartNode, EndNode, SectionProperty, OrientationAngle, Release, FEAType, Support, Offset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
revitadapter = RevitAdapter(RevitSettings=revitsettings, Active=Toggle(True), Component="{ ..ctor")
rectangleprofile = RectangleProfile(Height="0.5", Width="0.5", CornerRadius=0, Component="{ .RectangleProfile")
material_2 = Material(Density=nan, Component="BH.oM.Physical.Materials.Material")
line = Line(StartPoint=explode.StartNode, EndPoint=explode.EndNode)
constantframingproperty = ConstantFramingProperty(
    Profile=rectangleprofile,
    Material=material_2,
    OrientationAngle=0,
    Name="testbjælke2",
    Component="{ .ConstantFramingProperty")
column = Column(Location=line, Property=constantframingproperty, Name="søjler", Component="BH.oM.Physical.Elements.Column")

# ---- group: BHoM object, structural loads / Last typer/cases / Last typer
# Last typer/cases
# Use superDead for dead load in RSA
panel_4 = Panel("""Egenlast
Nyttelast
Snelast
Vindlast
Seismisklast
Ulykkeslast
Islast""")
loadnature = LoadNature(
    {"Dead": 0, "SuperDead": 1, "Live": 2, "Wind": 3, "Seismic": 4, "Temperature": 5, "Snow": 6, "Accidental": 7, "Prestress": 8, "Notional": 9, "Other": 10}, selected="SuperDead",
    Component="BH.oM.Structure.Loads.LoadNature",
    Selection=1)
loadnature_2 = LoadNature(
    {"Dead": 0, "SuperDead": 1, "Live": 2, "Wind": 3, "Seismic": 4, "Temperature": 5, "Snow": 6, "Accidental": 7, "Prestress": 8, "Notional": 9, "Other": 10}, selected="Seismic",
    Component="BH.oM.Structure.Loads.LoadNature",
    Selection=4)
loadnature_3 = LoadNature(
    {"Dead": 0, "SuperDead": 1, "Live": 2, "Wind": 3, "Seismic": 4, "Temperature": 5, "Snow": 6, "Accidental": 7, "Prestress": 8, "Notional": 9, "Other": 10}, selected="Live",
    Component="BH.oM.Structure.Loads.LoadNature",
    Selection=2)
loadnature_4 = LoadNature(
    {"Dead": 0, "SuperDead": 1, "Live": 2, "Wind": 3, "Seismic": 4, "Temperature": 5, "Snow": 6, "Accidental": 7, "Prestress": 8, "Notional": 9, "Other": 10}, selected="Snow",
    Component="BH.oM.Structure.Loads.LoadNature",
    Selection=6)
loadnature_5 = LoadNature(
    {"Dead": 0, "SuperDead": 1, "Live": 2, "Wind": 3, "Seismic": 4, "Temperature": 5, "Snow": 6, "Accidental": 7, "Prestress": 8, "Notional": 9, "Other": 10}, selected="Wind",
    Component="BH.oM.Structure.Loads.LoadNature",
    Selection=3)
loadnature_6 = LoadNature(
    {"Dead": 0, "SuperDead": 1, "Live": 2, "Wind": 3, "Seismic": 4, "Temperature": 5, "Snow": 6, "Accidental": 7, "Prestress": 8, "Notional": 9, "Other": 10}, selected="Accidental",
    Component="BH.oM.Structure.Loads.LoadNature",
    Selection=7)
loadnature_7 = LoadNature(
    {"Dead": 0, "SuperDead": 1, "Live": 2, "Wind": 3, "Seismic": 4, "Temperature": 5, "Snow": 6, "Accidental": 7, "Prestress": 8, "Notional": 9, "Other": 10}, selected="Other",
    Component="BH.oM.Structure.Loads.LoadNature",
    Selection=10)
loadnature_8 = Data(loadnature)
loadnature_9 = Data(loadnature_3)
loadnature_10 = Data(loadnature_4)
loadnature_11 = Data(loadnature_5)
loadnature_12 = Data(loadnature_2)
loadnature_13 = Data(loadnature_6)
loadnature_14 = Data(loadnature_7)
name_4 = Data(panel_4)

# ---- group: BHoM object, structural loads / Last typer/cases / Last typer (case)
d1 = Data(loadnature_8)
d2 = Data(loadnature_9)
d3 = Data(loadnature_10)
d4 = Data(loadnature_11)
d5 = Data(loadnature_12)
d6 = Data(loadnature_13)
d7 = Data(loadnature_14)
names = Data(name_4)
list_length = ListLength(List=names)
merge_2 = Merge(Data1=d1, Data2=d2, Data3=d3, Data4=d4, Data5=d5, Data6=d6, Data7=d7)
series_2 = Series(Start=1, Step=1, Count=list_length)
loadcase = Loadcase(Name=names, Nature=merge_2, Number=series_2, Component="BH.oM.Structure.Loads.Loadcase")
explode_2 = Explode(Object=loadcase, Component="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")  # -> Name, Nature, Number, BHoM_Guid, Fragments, Tags, CustomData
bhom_loadtypes = Data(loadcase)
# INITIAL PUSH/PULL
loadtypename = Data(explode_2.Name)

# ---- group: BHoM object, structural loads / Loads / Area uniform load
bhom_objects_with_the_load = Data(bhom_panel)
vælg_lasttype = Data(loadtypename)
bhom_objects_with_the_load_2 = Data(bhom_objects_with_the_load)
vælg_lasttype_2 = Data(vælg_lasttype)
# Loads
vælg_lasttype_3 = Data(vælg_lasttype_2)
bhom_objects_with_the_load_3 = Data(flatten(bhom_objects_with_the_load_2))
x_positiv_opadgående = Slider(0, range=-10000..10000)
z_positiv_opadgående = Slider(-2500, range=-10000..10000)
y_positiv_mod_højre = Slider(0, range=-10000..10000)
vælg_lasttype_4 = ItemSelector(
    vælg_lasttype_3,
    {"Egenlast", "Nyttelast", "Snelast", "Vindlast", "Seismisklast", "Ulykkeslast", "Islast"}, selected="Egenlast")
loadaxis = LoadAxis({"Global": 0, "Local": 1}, selected="Global", Component="BH.oM.Structure.Loads.LoadAxis", Selection=0)
projected = BooleanToggle(False)
number = Number(expr("x*10^-3", z_positiv_opadgående))
kn_m_2 = Panel(number)
x_positiv_opadgående_2 = Data(x_positiv_opadgående)
z_positiv_opadgående_2 = Data(z_positiv_opadgående)
y_positiv_mod_højre_2 = Data(y_positiv_mod_højre)
vælg_lasttype_5 = Data(vælg_lasttype_4)
projected_2 = Data(projected)
navn_2 = Data("GkDæk")
loadaxis_2 = Data(loadaxis)
bhom_objects_with_the_load_4 = Data(bhom_objects_with_the_load_3)
z_positiv_opadgående_3 = Data(z_positiv_opadgående_2)
x_positiv_opadgående_3 = Data(x_positiv_opadgående_2)
y_positiv_mod_højre_3 = Data(y_positiv_mod_højre_2)
vælg_lasttype_6 = Data(vælg_lasttype_5)
projected_3 = Data(projected_2)
loadaxis_3 = Data(loadaxis_2)
navn_3 = Data(navn_2)
bhom_objects_with_the_load_5 = Data(bhom_objects_with_the_load_4)
z_positiv_opadgående_4 = Data(z_positiv_opadgående_3)
x_positiv_opadgående_4 = Data(x_positiv_opadgående_3)
y_positiv_mod_højre_4 = Data(y_positiv_mod_højre_3)
vælg_lasttype_7 = Data(vælg_lasttype_6)
projected_4 = Data(projected_3)
loadaxis_4 = Data(loadaxis_3)
navn_4 = Data(navn_3)

# ---- group: BHoM object, structural loads / Lastkombinationer / Last kombination 2
vælg_lasttype_8 = Data(loadtypename)
vælg_lasttype_9 = ItemSelector(
    vælg_lasttype_8,
    {"Egenlast", "Nyttelast", "Snelast", "Vindlast", "Seismisklast", "Ulykkeslast", "Islast"}, selected=["Egenlast", "Nyttelast"])
panel_5 = Panel("""1.0
1.5""")
valgte_lasttyper = Data(vælg_lasttype_9)
last_komb_navn = Data("Dom q")
last_komb_nr = Data("10")
faktorer = Data(panel_5)

# ---- group: BHoM object, structural loads / Lastkombinationer / Last kombination 1
vælg_lasttype_10 = Data(loadtypename)
# Lastkombinationer
vælg_lasttype_11 = ItemSelector(
    vælg_lasttype_10,
    {"Egenlast", "Nyttelast", "Snelast", "Vindlast", "Seismisklast", "Ulykkeslast", "Islast"}, selected=["Egenlast", "Nyttelast"])
panel_6 = Panel("""1.2
1.0""")
valgte_lasttyper_2 = Data(vælg_lasttype_11)
last_komb_navn_2 = Data("Dom G")
last_komb_nr_2 = Data("10")
faktorer_2 = Data(panel_6)

# ---- group: BHoM object, structural loads / Loads / line uniform load
vælg_lasttype_12 = Data(loadtypename)
bhom_objects_with_the_load_6 = Data(flatten(bhom_bjælke))
x_positiv_opadgående_5 = Slider(0, range=-10000..10000)
z_positiv_opadgående_5 = Slider(-2500, range=-10000..10000)
y_positiv_mod_højre_5 = Slider(0, range=-10000..10000)
vælg_lasttype_13 = ItemSelector(
    vælg_lasttype_12,
    {"Egenlast", "Nyttelast", "Snelast", "Vindlast", "Seismisklast", "Ulykkeslast", "Islast"}, selected="Egenlast")
loadaxis_5 = LoadAxis({"Global": 0, "Local": 1}, selected="Global", Component="BH.oM.Structure.Loads.LoadAxis", Selection=0)
projected_5 = BooleanToggle(False)
number_2 = Number(expr("x*10^-3", z_positiv_opadgående_5))
panel_7 = Panel(number_2)
x_positiv_opadgående_6 = Data(x_positiv_opadgående_5)
z_positiv_opadgående_6 = Data(z_positiv_opadgående_5)
y_positiv_mod_højre_6 = Data(y_positiv_mod_højre_5)
vælg_lasttype_14 = Data(vælg_lasttype_13)
projected_6 = Data(projected_5)
navn_5 = Data("Gkbjælker")
loadaxis_6 = Data(loadaxis_5)

# ---- group: BHoM object, structural loads / Lastkombinationer / last kombination 2
bhom_lasttyper = Data(bhom_loadtypes)
name_5 = Data(last_komb_navn)
lastkomb_nr = Data(last_komb_nr)
alle_lasttyper_navne = Data(panel_4)
factors = Data(faktorer)
valgte_last_typer_navne = Data(valgte_lasttyper)
member_index = MemberIndex(Set=alle_lasttyper_navne, Member=valgte_last_typer_navne)  # -> Index, Count
shift_paths = ShiftPaths(Data=member_index.Index, Offset=-1)
list_item = ListItem(List=bhom_lasttyper, Index=shift_paths, Wrap=True)
loadcombination = LoadCombination(
    Name=name_5,
    Number=lastkomb_nr,
    Cases=list_item,
    Factors=factors,
    ExcludeZeroFactorCases=True,
    Component="{ .LoadCombination")
comb = Data(loadcombination)

# ---- group: BHoM object, structural loads / Lastkombinationer / last kombination 1
bhom_lasttyper_2 = Data(bhom_loadtypes)
lastkomb_nr_2 = Data(last_komb_nr_2)
valgte_last_typer_navne_2 = Data(valgte_lasttyper_2)
alle_lasttyper_navne_2 = Data(panel_4)
factors_2 = Data(faktorer_2)
name_6 = Data(last_komb_navn_2)
member_index_2 = MemberIndex(Set=alle_lasttyper_navne_2, Member=valgte_last_typer_navne_2)  # -> Index, Count
shift_paths_2 = ShiftPaths(Data=member_index_2.Index, Offset=-1)
list_item_2 = ListItem(List=bhom_lasttyper_2, Index=shift_paths_2, Wrap=True)
loadcombination_2 = LoadCombination(
    Name=name_6,
    Number=lastkomb_nr_2,
    Cases=list_item_2,
    Factors=factors_2,
    ExcludeZeroFactorCases=True,
    Component="{ .LoadCombination")
comb_2 = Data(loadcombination_2)

# ---- group: REVIT TEST / Push initial objects to revit
pushtype = PushType(
    {"FullPush": 0, "CreateOnly": 1, "CreateNonExisting": 2, "UpdateOnly": 3, "UpdateOrCreateOnly": 4, "DeleteThenCreate": 5, "AdapterDefault": 6}, selected="DeleteThenCreate",
    Component="BH.oM.Adapter.PushType",
    Selection=5)
entwine_2 = Entwine(Branch00=column, FlattenInputs=True)
boolean_toggle_3 = BooleanToggle(True)
push = Push(Adapter=revitadapter, Objects=flatten(entwine_2), PushType=pushtype, Active=Button(), Component="{ .Push")  # -> Objects, Success

# ----
# Result Controls
scalefactorgraphicresult = Slider(19.691, range=0..50)
loadcase_to_view = Panel("3")
loadcasedeformation = Text(loadcase_to_view)
# BarResults
scalefactordeformation = Number(scalefactorgraphicresult)

createtype = CreateType(Component="BH.oM.Adapters.Robot.RobotId")

steeldesigncode = Data(designcode_steel_2)
materialdatabase = Data(materialdb_2)
sectiondatabase = Data(sectiondb_2)
active = Data(close_rsa_2)
savebeforeclose_3 = Data(savebeforeclose_2)
active_2 = Data(open_activate_rsa_2)

# ---- group: Adaptor, connects to and initiate robot
databasesettings = DatabaseSettings(
    MaterialDatabase=materialdatabase,
    SectionDatabase=sectiondatabase,
    SteelDesignCode=steeldesigncode,
    Component="BH.oM.Adapters.Robot.DatabaseSettings")
robotconfig = RobotConfig(
    AdvancedSettings="{ \"_t\" : \"BH.oM.Adapters.Robot.AdvancedSettings\", \"readBarsByQuery\" : false, \"readNodesByQuery\" : false, \"BHoM_Guid\" : \"e24b4d1d-c0a7-440e-84bb-91a955be535a\", \"_bhomVersion\" : \"6.3\" }",
    DatabaseSettings=databasesettings,
    InteractiveSettings="{ \"_t\" : \"BH.oM.Adapters.Robot.InteractiveSettings\", \"IsInteractive\" : false, \"IsVisible\" : true, \"BHoM_Guid\" : \"b2458cad-84c6-4c2c-afdd-a2fbc9e98cfd\", \"_bhomVersion\" : \"6.3\" }",
    Component="BH.oM.Adapters.Robot.RobotConfig")
robotadapter = RobotAdapter(RobotConfig=robotconfig, Active=active_2, Component="{ ..ctor")

# ---- group: Close RSA
exit = Exit(SaveBeforeClose=savebeforeclose_3, Component="BH.oM.Adapter.Commands.Exit")
execute = Execute(Adapter=robotadapter, Command=exit, Active=active, Component="{ .Execute")  # -> Output, Success

# ----
robotadaptor = Data(robotadapter)

# ---- group: Execute to run analyse command
analyse = Analyse(Component="BH.oM.Adapter.Commands.Analyse")
execute_2 = Execute(Adapter=robotadaptor, Command=analyse, Active=Toggle(False), Component="{ .Execute")  # -> Output, Success

# ----
# REVIEW
# Read results
# Loadcases
# Request
# Loadcases
createtype_2 = CreateType(Component="BH.oM.Structure.Loads.Loadcase")
filterrequest = FilterRequest(Type=createtype_2, Component="{ .FilterRequest")
# Pull
adapter = Data(robotadaptor)
pull = Pull(
    Adapter=adapter,
    Request=filterrequest,
    PullType="{ \"_t\" : \"System.Enum\", \"TypeName\" : { \"_t\" : \"System.Type\", \"Name\" : \"BH.oM.Adapter.PullType\", \"_bhomVersion\" : \"6.3\" }, \"Value\" : \"AdapterDefault\", \"_bhomVersion\" : \"6.3\" }",
    Active=Toggle(True),
    Component="{ .Pull")
loadcases = BHoMObject(
    pull,
    ObjectType="{ \"_t\" : \"System.Type\", \"Name\" : \"System.Object, mscorlib, Version=4.0.0.0, Culture=neutral, PublicKeyToken=b77a5c561934e089\", \"_bhomVersion\" : \"6.3\" }",
    m_ForcePreview=False,
    m_MaxItemsPreview=10000)
loadcases_2 = BHoMObject(
    loadcases,
    ObjectType="{ \"_t\" : \"System.Type\", \"Name\" : \"System.Object, mscorlib, Version=4.0.0.0, Culture=neutral, PublicKeyToken=b77a5c561934e089\", \"_bhomVersion\" : \"6.3\" }",
    m_ForcePreview=False,
    m_MaxItemsPreview=10000)
# Visualisation and inspection
explode_3 = Explode(Object=loadcases_2, Component="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")  # -> Name, Nature, Number, BHoM_Guid, Fragments, Tags, CustomData
panel_8 = Panel(explode_3.Name)
# RESULTS
panel_9 = Panel(explode_3.Number)

# ----
# BarDeformation
panel_10 = Panel("""1
2
3""")
barresulttype = BarResultType(
    {"BarForce": 0, "BarDeformation": 1, "BarStress": 2, "BarStrain": 3, "BarDisplacement": 4, "BarModeShape": 5}, selected="BarDeformation",
    Component="BH.oM.Structure.Requests.BarResultType",
    Selection=1)
divisiontype = DivisionType(
    {"EvenlyDistributed": 0, "ExtremeValues": 1}, selected="EvenlyDistributed",
    Component="BH.oM.Structure.Requests.DivisionType",
    Selection=0)
barresultrequest = BarResultRequest(
    ResultType=barresulttype,
    DivisionType=divisiontype,
    Divisions=Slider(20, range=0..100),
    Cases=loadcasedeformation,
    Component="BH.oM.Structure.Requests.BarResultRequest")
adapter_2 = Data(robotadaptor)
pull_2 = Pull(
    Adapter=adapter_2,
    Request=barresultrequest,
    PullType="{ \"_t\" : \"System.Enum\", \"TypeName\" : { \"_t\" : \"System.Type\", \"Name\" : \"BH.oM.Adapter.PullType\", \"_bhomVersion\" : \"6.3\" }, \"Value\" : \"AdapterDefault\", \"_bhomVersion\" : \"6.3\" }",
    Active=Toggle(False),
    Component="{ .Pull")
result_2 = BHIObject(
    pull_2,
    ObjectType="{ \"_t\" : \"System.Type\", \"Name\" : \"System.Object, mscorlib, Version=4.0.0.0, Culture=neutral, PublicKeyToken=b77a5c561934e089\", \"_bhomVersion\" : \"6.3\" }",
    m_ForcePreview=False,
    m_MaxItemsPreview=10000)
result_3 = BHIObject(
    result_2,
    ObjectType="{ \"_t\" : \"System.Type\", \"Name\" : \"System.Object, mscorlib, Version=4.0.0.0, Culture=neutral, PublicKeyToken=b77a5c561934e089\", \"_bhomVersion\" : \"6.3\" }",
    m_ForcePreview=True,
    m_MaxItemsPreview=10000)

# ----
# BarStrain
barresulttype_2 = BarResultType(
    {"BarForce": 0, "BarDeformation": 1, "BarStress": 2, "BarStrain": 3, "BarDisplacement": 4, "BarModeShape": 5}, selected="BarStrain",
    Component="BH.oM.Structure.Requests.BarResultType",
    Selection=3)  # disabled
divisiontype_2 = DivisionType(
    {"EvenlyDistributed": 0, "ExtremeValues": 1}, selected="EvenlyDistributed",
    Component="BH.oM.Structure.Requests.DivisionType",
    Selection=0)  # disabled
number_slider = Slider(8, range=0..100)  # disabled
barresultrequest_2 = BarResultRequest(
    ResultType=barresulttype_2,
    DivisionType=divisiontype_2,
    Divisions=number_slider,
    Component="BH.oM.Structure.Requests.BarResultRequest")  # disabled
toggle = BooleanToggle(False)  # disabled
adapter_3 = Data(robotadaptor)  # disabled
pull_3 = Pull(
    Adapter=adapter_3,
    Request=barresultrequest_2,
    PullType="{ \"_t\" : \"System.Enum\", \"TypeName\" : { \"_t\" : \"System.Type\", \"Name\" : \"BH.oM.Adapter.PullType\", \"_bhomVersion\" : \"6.3\" }, \"Value\" : \"AdapterDefault\", \"_bhomVersion\" : \"6.3\" }",
    Active=toggle,
    Component="{ .Pull")  # disabled
result_4 = BHIObject(
    pull_3,
    ObjectType="{ \"_t\" : \"System.Type\", \"Name\" : \"System.Object, mscorlib, Version=4.0.0.0, Culture=neutral, PublicKeyToken=b77a5c561934e089\", \"_bhomVersion\" : \"6.3\" }",
    m_ForcePreview=False,
    m_MaxItemsPreview=10000)  # disabled
result_5 = BHIObject(
    result_4,
    ObjectType="{ \"_t\" : \"System.Type\", \"Name\" : \"System.Object, mscorlib, Version=4.0.0.0, Culture=neutral, PublicKeyToken=b77a5c561934e089\", \"_bhomVersion\" : \"6.3\" }",
    m_ForcePreview=False,
    m_MaxItemsPreview=10000)  # disabled

# ----
# BarDeformation
panel_11 = Panel("""1
2
3""")
barresulttype_3 = BarResultType(
    {"BarForce": 0, "BarDeformation": 1, "BarStress": 2, "BarStrain": 3, "BarDisplacement": 4, "BarModeShape": 5}, selected="BarDeformation",
    Component="BH.oM.Structure.Requests.BarResultType",
    Selection=1)
divisiontype_3 = DivisionType(
    {"EvenlyDistributed": 0, "ExtremeValues": 1}, selected="EvenlyDistributed",
    Component="BH.oM.Structure.Requests.DivisionType",
    Selection=0)
barresultrequest_3 = BarResultRequest(
    ResultType=barresulttype_3,
    DivisionType=divisiontype_3,
    Divisions=Slider(20, range=0..100),
    Cases=loadcasedeformation,
    Component="BH.oM.Structure.Requests.BarResultRequest")
adapter_4 = Data(robotadaptor)
pull_4 = Pull(
    Adapter=adapter_4,
    Request=barresultrequest_3,
    PullType="{ \"_t\" : \"System.Enum\", \"TypeName\" : { \"_t\" : \"System.Type\", \"Name\" : \"BH.oM.Adapter.PullType\", \"_bhomVersion\" : \"6.3\" }, \"Value\" : \"AdapterDefault\", \"_bhomVersion\" : \"6.3\" }",
    Active=Toggle(False),
    Component="{ .Pull")
result_6 = BHIObject(
    pull_4,
    ObjectType="{ \"_t\" : \"System.Type\", \"Name\" : \"System.Object, mscorlib, Version=4.0.0.0, Culture=neutral, PublicKeyToken=b77a5c561934e089\", \"_bhomVersion\" : \"6.3\" }",
    m_ForcePreview=False,
    m_MaxItemsPreview=10000)
result_7 = BHIObject(
    result_6,
    ObjectType="{ \"_t\" : \"System.Type\", \"Name\" : \"System.Object, mscorlib, Version=4.0.0.0, Culture=neutral, PublicKeyToken=b77a5c561934e089\", \"_bhomVersion\" : \"6.3\" }",
    m_ForcePreview=True,
    m_MaxItemsPreview=10000)

# ----
# BarStress
barresulttype_4 = BarResultType(
    {"BarForce": 0, "BarDeformation": 1, "BarStress": 2, "BarStrain": 3, "BarDisplacement": 4, "BarModeShape": 5}, selected="BarStress",
    Component="BH.oM.Structure.Requests.BarResultType",
    Selection=2)
divisiontype_4 = DivisionType(
    {"EvenlyDistributed": 0, "ExtremeValues": 1}, selected="EvenlyDistributed",
    Component="BH.oM.Structure.Requests.DivisionType",
    Selection=0)
barresultrequest_4 = BarResultRequest(
    ResultType=barresulttype_4,
    DivisionType=divisiontype_4,
    Divisions=Slider(37, range=0..100),
    Cases=loadcasedeformation,
    Component="BH.oM.Structure.Requests.BarResultRequest")
adapter_5 = Data(robotadaptor)
pull_5 = Pull(
    Adapter=adapter_5,
    Request=barresultrequest_4,
    PullType="{ \"_t\" : \"System.Enum\", \"TypeName\" : { \"_t\" : \"System.Type\", \"Name\" : \"BH.oM.Adapter.PullType\", \"_bhomVersion\" : \"6.3\" }, \"Value\" : \"AdapterDefault\", \"_bhomVersion\" : \"6.3\" }",
    Active=Toggle(True),
    Component="{ .Pull")
result_8 = BHIObject(
    pull_5,
    ObjectType="{ \"_t\" : \"System.Type\", \"Name\" : \"System.Object, mscorlib, Version=4.0.0.0, Culture=neutral, PublicKeyToken=b77a5c561934e089\", \"_bhomVersion\" : \"6.3\" }",
    m_ForcePreview=False,
    m_MaxItemsPreview=10000)
result_9 = BHIObject(
    result_8,
    ObjectType="{ \"_t\" : \"System.Type\", \"Name\" : \"System.Object, mscorlib, Version=4.0.0.0, Culture=neutral, PublicKeyToken=b77a5c561934e089\", \"_bhomVersion\" : \"6.3\" }",
    m_ForcePreview=False,
    m_MaxItemsPreview=10000)

# ----
# Bar
createtype_3 = CreateType(Component="BH.oM.Structure.Elements.Bar")
filterrequest_2 = FilterRequest(Type=createtype_3, Component="{ .FilterRequest")
adapter_6 = Data(robotadaptor)
pull_6 = Pull(
    Adapter=adapter_6,
    Request=filterrequest_2,
    PullType="{ \"_t\" : \"System.Enum\", \"TypeName\" : { \"_t\" : \"System.Type\", \"Name\" : \"BH.oM.Adapter.PullType\", \"_bhomVersion\" : \"6.3\" }, \"Value\" : \"AdapterDefault\", \"_bhomVersion\" : \"6.3\" }",
    Active=Toggle(True),
    Component="{ .Pull")
bars = BHoMObject(
    pull_6,
    ObjectType="{ \"_t\" : \"System.Type\", \"Name\" : \"System.Object, mscorlib, Version=4.0.0.0, Culture=neutral, PublicKeyToken=b77a5c561934e089\", \"_bhomVersion\" : \"6.3\" }",
    m_ForcePreview=False,
    m_MaxItemsPreview=10000)
bars_2 = BHoMObject(
    bars,
    ObjectType="{ \"_t\" : \"System.Type\", \"Name\" : \"System.Object, mscorlib, Version=4.0.0.0, Culture=neutral, PublicKeyToken=b77a5c561934e089\", \"_bhomVersion\" : \"6.3\" }",
    m_ForcePreview=False,
    m_MaxItemsPreview=10000)
localaxis = LocalAxis(bhom=bars_2)
panel_12 = Panel("LocalAxis")

# ----
# Bar
createtype_4 = CreateType(Component="BH.oM.Structure.Elements.Bar")
filterrequest_3 = FilterRequest(Type=createtype_4, Component="{ .FilterRequest")
adapter_7 = Data(robotadaptor)
pull_7 = Pull(
    Adapter=adapter_7,
    Request=filterrequest_3,
    PullType="{ \"_t\" : \"System.Enum\", \"TypeName\" : { \"_t\" : \"System.Type\", \"Name\" : \"BH.oM.Adapter.PullType\", \"_bhomVersion\" : \"6.3\" }, \"Value\" : \"AdapterDefault\", \"_bhomVersion\" : \"6.3\" }",
    Active=Toggle(True),
    Component="{ .Pull")
bars_3 = BHoMObject(
    pull_7,
    ObjectType="{ \"_t\" : \"System.Type\", \"Name\" : \"System.Object, mscorlib, Version=4.0.0.0, Culture=neutral, PublicKeyToken=b77a5c561934e089\", \"_bhomVersion\" : \"6.3\" }",
    m_ForcePreview=False,
    m_MaxItemsPreview=10000)
bars_4 = BHoMObject(
    bars_3,
    ObjectType="{ \"_t\" : \"System.Type\", \"Name\" : \"System.Object, mscorlib, Version=4.0.0.0, Culture=neutral, PublicKeyToken=b77a5c561934e089\", \"_bhomVersion\" : \"6.3\" }",
    m_ForcePreview=False,
    m_MaxItemsPreview=10000)
localaxis_2 = LocalAxis(bhom=bars_4)

# ----
# BarForce
my = BooleanToggle(True)
mz = BooleanToggle(True)
# User interaction
fx = BooleanToggle(True)
mx = BooleanToggle(True)
fy = BooleanToggle(True)
fz = BooleanToggle(True)
# Request
barresulttype_5 = BarResultType(
    {"BarForce": 0, "BarDeformation": 1, "BarStress": 2, "BarStrain": 3, "BarDisplacement": 4, "BarModeShape": 5}, selected="BarForce",
    Component="BH.oM.Structure.Requests.BarResultType",
    Selection=0)
divisiontype_5 = DivisionType(
    {"EvenlyDistributed": 0, "ExtremeValues": 1}, selected="EvenlyDistributed",
    Component="BH.oM.Structure.Requests.DivisionType",
    Selection=0)
number_slider_2 = Slider(20, range=0..100)
barresultrequest_5 = BarResultRequest(
    ResultType=barresulttype_5,
    DivisionType=divisiontype_5,
    Divisions=number_slider_2,
    Cases=loadcasedeformation,
    Component="BH.oM.Structure.Requests.BarResultRequest")
adapter_8 = Data(robotadaptor)
# Pull
pull_8 = Pull(
    Adapter=adapter_8,
    Request=barresultrequest_5,
    PullType="{ \"_t\" : \"System.Enum\", \"TypeName\" : { \"_t\" : \"System.Type\", \"Name\" : \"BH.oM.Adapter.PullType\", \"_bhomVersion\" : \"6.3\" }, \"Value\" : \"AdapterDefault\", \"_bhomVersion\" : \"6.3\" }",
    Active=Toggle(True),
    Component="{ .Pull")
# Visualisation and inspection
result_10 = BHIObject(
    pull_8,
    ObjectType="{ \"_t\" : \"System.Type\", \"Name\" : \"System.Object, mscorlib, Version=4.0.0.0, Culture=neutral, PublicKeyToken=b77a5c561934e089\", \"_bhomVersion\" : \"6.3\" }",
    m_ForcePreview=False,
    m_MaxItemsPreview=10000)
createtype_5 = CreateType(Component="BH.oM.Adapters.Robot.RobotId")
boolean = Boolean(my)
boolean_2 = Boolean(mz)
boolean_3 = Boolean(fz)
boolean_4 = Boolean(mx)
boolean_5 = Boolean(fy)
boolean_6 = Boolean(fx)
plotbarforce = PlotBarForce(
    Bars=bars_4,
    Forces=result_10,
    AdapterIdType=createtype_5,
    ScaleFactor=scalefactordeformation,
    LoadCase=loadcasedeformation,
    Fx=boolean_6,
    Fy=boolean_5,
    Fz=boolean_3,
    Mx=boolean_4,
    My=boolean,
    Mz=boolean_2,
    Component="{ .PlotBarForce")

choose_loadcase = ItemSelector(panel_9)
adapter_9 = Data(robotadaptor)
explode_4 = Explode(Object=result_9, Component="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")  # -> Axial, ShearY, ShearZ, BendingY_Top, BendingY_Bot, BendingZ_Top, BendingZ_Bot, CombAxialBendingPos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
createdictionary = CreateDictionary(Keys=explode_3.Name, Values=explode_3.Number, Component="{ .CreateDictionary")
bounds = Bounds(Numbers=explode_4.CombAxialBendingPos)
deconstruct_domain = DeconstructDomain(Domain=bounds)  # -> Start, End
gradient = Gradient(
    LowerLimit=0,
    UpperLimit=deconstruct_domain.End,
    Parameter=explode_4.CombAxialBendingPos,
    stops=[0: RGB(0, 128, 0), 0.5: RGB(255, 255, 0), 1: RGB(255, 0, 0)])
preview = CustomPreview(Geometry=bars_4, Shader=gradient)

# ---- group: BHoM object, structural loads / Loads / Area uniform load
last_typer_bhom_list = Data(bhom_loadtypes)
load_type = Data(vælg_lasttype_7)
alle_last_typer_navne = Data(panel_4)
name_7 = Data(navn_4)
x = Data(x_positiv_opadgående_4)
y = Data(y_positiv_mod_højre_4)
projected_7 = Data(projected_4)
z = Data(z_positiv_opadgående_4)
axis = Data(loadaxis_4)
member_index_3 = MemberIndex(Set=alle_last_typer_navne, Member=load_type)  # -> Index, Count
list_item_3 = ListItem(List=last_typer_bhom_list, Index=member_index_3.Index, Wrap=True)
vector = Vector(X=x, Y=y, Z=z, Component="{ .Vector")

# ---- group: BHoM object, structural loads
bhom_objects_with_the_load_7 = Data(bhom_objects_with_the_load_5)
bhom_objects_with_the_load_8 = Data(bhom_objects_with_the_load_6)

# ---- group: BHoM object, structural loads / Loads / line uniform load
last_typer_bhom_list_2 = Data(bhom_loadtypes)
alle_last_typer_navne_2 = Data(panel_4)
load_type_2 = Data(vælg_lasttype_14)
z_2 = Data(z_positiv_opadgående_6)
axis_2 = Data(loadaxis_6)
projected_8 = Data(projected_6)
name_8 = Data(navn_5)
x_2 = Data(x_positiv_opadgående_6)
y_2 = Data(y_positiv_mod_højre_6)
member_index_4 = MemberIndex(Set=alle_last_typer_navne_2, Member=load_type_2)  # -> Index, Count
bhomgroup = BHoMGroup(Elements=bhom_objects_with_the_load_8, DownCast=True, Component="{ .BHoMGroup")
vector_2 = Vector(X=x_2, Y=y_2, Z=z_2, Component="{ .Vector")
list_item_4 = ListItem(List=last_typer_bhom_list_2, Index=member_index_4.Index, Wrap=True)
baruniformlydistributedload = BarUniformlyDistributedLoad(
    Force=vector_2,
    Moment="{ \"_t\" : \"BH.oM.Geometry.Vector\", \"X\" : 0.0, \"Y\" : 0.0, \"Z\" : 0.0, \"_bhomVersion\" : \"6.3\" }",
    Loadcase=list_item_4,
    Objects=bhomgroup,
    Axis=axis_2,
    Projected=projected_8,
    Name=name_8,
    Component="BH.oM.Structure.Loads.BarUniformlyDistributedLoad")
lineudl = Data(baruniformlydistributedload)

# ---- group: BHoM object, structural loads / Loads / Area uniform load (continued)
areauniformlydistributedload = AreaUniformlyDistributedLoad(
    Loadcase=list_item_3,
    Pressure=vector,
    Objects=bhom_objects_with_the_load_7,
    Axis=axis,
    Projected=projected_7,
    Name=name_7,
    Component="{ .AreaUniformlyDistributedLoad")
areaudl = Data(areauniformlydistributedload)

# ---- group: BHoM object, structural loads (continued)
merge_3 = Merge(Data1=bhom_loadtypes, Data2=comb_2, Data3=comb, Data4=areaudl, Data5=lineudl)
structural_loads = Data(merge_3)

# ---- group: Push initial objects to robot
pushtype_2 = PushType(
    {"FullPush": 0, "CreateOnly": 1, "CreateNonExisting": 2, "UpdateOnly": 3, "UpdateOrCreateOnly": 4, "DeleteThenCreate": 5, "AdapterDefault": 6}, selected="FullPush",
    Component="BH.oM.Adapter.PushType",
    Selection=0)
entwine_3 = Entwine(Branch00=bhom_objects_structural_members, Branch01=structural_loads, FlattenInputs=True)
boolean_toggle_4 = BooleanToggle(True)
push_2 = Push(Adapter=robotadaptor, Objects=flatten(entwine_3), PushType=pushtype_2, Active=Button(), Component="{ .Push")  # -> Objects, Success

# ---- group: Push codegroups or design groups to RSA
add_bars_to_codegroup_and_apply_type = Button()
steel_5 = Steel(
    {"S235": 0, "S275": 1, "S355": 2, "S450": 3}, selected="S235",
    Component="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",
    Selection=0)
panel_14 = Panel(navn_på_object_type_1_søjler)
group_number = Panel("500")
createtype_6 = CreateType(Component="BH.oM.Structure.Elements.Bar")
filterrequest_4 = FilterRequest(Type=createtype_6, Component="{ .FilterRequest")
adapter_10 = Data(robotadaptor)
pull_9 = Pull(
    Adapter=adapter_10,
    Request=filterrequest_4,
    PullType="{ \"_t\" : \"System.Enum\", \"TypeName\" : { \"_t\" : \"System.Type\", \"Name\" : \"BH.oM.Adapter.PullType\", \"_bhomVersion\" : \"6.3\" }, \"Value\" : \"AdapterDefault\", \"_bhomVersion\" : \"6.3\" }",
    Active=push_2.Success,
    Component="{ .Pull")
filterby = FilterBy(
    Objects=pull_9,
    PropertyName="Name",
    Value=panel_14,
    IgnoreStringCase=False,
    ExactStringMatch=True,
    Component="{ .FilterBy")
explode_5 = Explode(Object=filterby, Component="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")  # -> StartNode, EndNode, SectionProperty, OrientationAngle, Release, FEAType, Support, Offset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
match_text = MatchText(Text=explode_5.Fragments, Pattern="*RobotId", Case=True)
item_index = ItemIndex(List=match_text, Item="True")
list_item_5 = ListItem(List=explode_5.Fragments, Index=item_index, Wrap=True)
pushtype_3 = PushType(
    {"FullPush": 0, "CreateOnly": 1, "CreateNonExisting": 2, "UpdateOnly": 3, "UpdateOrCreateOnly": 4, "DeleteThenCreate": 5, "AdapterDefault": 6}, selected="FullPush",
    Component="BH.oM.Adapter.PushType",
    Selection=0)

# ----
explode_6 = Explode(Object=list_item_5, Component="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")

# ---- group: Creates Member type in RSA
# OBJECTS ADJUST/DETAIL
panel_15 = Panel("PropType")
framingelementdesignproperties = FramingElementDesignProperties(
    EulerBucklingLengthCoefficientY=1,
    EulerBucklingLengthCoefficientZ=1,
    MemberLengthY=1,
    MemberLengthZ=1,
    MemberLengthYIsRelative=True,
    MemberLengthZIsRelative=True,
    Name=panel_15,
    Component="BH.oM.Adapters.Robot.FramingElementDesignProperties")

# ----
entwine_4 = Entwine(Branch00=framingelementdesignproperties, FlattenInputs=True)

# ---- group: Creates Member type in RSA (continued)
setpropertyvalue_3 = SetPropertyValue(Obj=filterby, PropName="Fragments", Value=entwine_4, Component="{ .SetPropertyValue")

# ---- group: Push codegroups or design groups to RSA (continued)
designgroup = DesignGroup(
    Number=group_number,
    MaterialName=steel_5,
    MemberIds=explode_6,
    Name=panel_14,
    Component="BH.oM.Adapters.Robot.DesignGroup")
entwine_5 = Entwine(Branch00=designgroup, FlattenInputs=True)

# ----
entwine_6 = Entwine(Branch00=setpropertyvalue_3, Branch01=entwine_5, FlattenInputs=True)

# ---- group: Push codegroups or design groups to RSA (continued)
push_3 = Push(
    Adapter=robotadaptor,
    Objects=flatten(entwine_6),
    PushType=pushtype_3,
    Active=add_bars_to_codegroup_and_apply_type,
    Component="{ .Push")  # -> Objects, Success

# ----
# FIX MIG FÆRDIGT BarForce xtremes
my_2 = BooleanToggle(False)
mz_2 = BooleanToggle(False)
fx_2 = BooleanToggle(False)
mx_2 = BooleanToggle(False)
fy_2 = BooleanToggle(False)
fz_2 = BooleanToggle(False)
absolutemaxforces = AbsoluteMaxForces(Forces=result_10, Component="{ .AbsoluteMaxForces")
createtype_7 = CreateType(Component="BH.oM.Adapters.Robot.RobotId")
boolean_7 = Boolean(mz_2)
boolean_8 = Boolean(fz_2)
boolean_9 = Boolean(mx_2)
boolean_10 = Boolean(my_2)
boolean_11 = Boolean(fx_2)
boolean_12 = Boolean(fy_2)

explode_7 = Explode(Object=absolutemaxforces, Component="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")  # -> FX, FY, FZ, MX, MY, MZ, ObjectId, ResultCase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
barresultrequest_6 = BarResultRequest(
    ResultType=barresulttype_5,
    DivisionType=divisiontype_5,
    Divisions=number_slider_2,
    Cases=loadcasedeformation,
    ObjectIds=explode_7.ObjectId,
    Component="BH.oM.Structure.Requests.BarResultRequest")
pull_10 = Pull(
    Adapter=adapter_9,
    Request=barresultrequest_6,
    PullType="{ \"_t\" : \"System.Enum\", \"TypeName\" : { \"_t\" : \"System.Type\", \"Name\" : \"BH.oM.Adapter.PullType\", \"_bhomVersion\" : \"6.3\" }, \"Value\" : \"AdapterDefault\", \"_bhomVersion\" : \"6.3\" }",
    Active=Toggle(True),
    Component="{ .Pull")
result_11 = BHIObject(
    pull_10,
    ObjectType="{ \"_t\" : \"System.Type\", \"Name\" : \"System.Object, mscorlib, Version=4.0.0.0, Culture=neutral, PublicKeyToken=b77a5c561934e089\", \"_bhomVersion\" : \"6.3\" }",
    m_ForcePreview=False,
    m_MaxItemsPreview=10000)
define_text_object = DefineTextObject(Text=explode_7.FX, Plane=result_11, DimensionStyle="Default", OutputType="Text")

plotbarforce_2 = PlotBarForce(
    Bars=bars_4,
    Forces=result_11,
    AdapterIdType=createtype_7,
    ScaleFactor=scalefactordeformation,
    LoadCase=loadcasedeformation,
    Fx=boolean_11,
    Fy=False,
    Fz=boolean_8,
    Mx=boolean_9,
    My=boolean_10,
    Mz=boolean_7,
    Component="{ .PlotBarForce")
plotbarforce_3 = PlotBarForce(
    Bars=bars_4,
    Forces=result_11,
    AdapterIdType=createtype_7,
    ScaleFactor=scalefactordeformation,
    LoadCase=loadcasedeformation,
    Fx=False,
    Fy=boolean_12,
    Fz=False,
    Mx=False,
    My=False,
    Mz=False,
    Component="{ .PlotBarForce")

# ----
# BarDisplacement
barresulttype_6 = BarResultType(
    {"BarForce": 0, "BarDeformation": 1, "BarStress": 2, "BarStrain": 3, "BarDisplacement": 4, "BarModeShape": 5}, selected="BarDisplacement",
    Component="BH.oM.Structure.Requests.BarResultType",
    Selection=4)  # disabled
divisiontype_6 = DivisionType(
    {"EvenlyDistributed": 0, "ExtremeValues": 1}, selected="EvenlyDistributed",
    Component="BH.oM.Structure.Requests.DivisionType",
    Selection=0)  # disabled
number_slider_3 = Slider(20, range=0..100)  # disabled
barresultrequest_7 = BarResultRequest(
    ResultType=barresulttype_6,
    DivisionType=divisiontype_6,
    Divisions=number_slider_3,
    Cases=loadcasedeformation,
    Component="BH.oM.Structure.Requests.BarResultRequest")  # disabled
toggle_2 = BooleanToggle(False)  # disabled
adapter_11 = Data(robotadaptor)  # disabled

barresultrequest_8 = BarResultRequest(
    ResultType=barresulttype_6,
    DivisionType=divisiontype_6,
    Divisions=number_slider_3,
    Cases=loadcasedeformation,
    Component="BH.oM.Structure.Requests.BarResultRequest")  # disabled

pull_11 = Pull(
    Adapter=adapter_11,
    Request=barresultrequest_8,
    PullType="{ \"_t\" : \"System.Enum\", \"TypeName\" : { \"_t\" : \"System.Type\", \"Name\" : \"BH.oM.Adapter.PullType\", \"_bhomVersion\" : \"6.3\" }, \"Value\" : \"AdapterDefault\", \"_bhomVersion\" : \"6.3\" }",
    Active=toggle_2,
    Component="{ .Pull")  # disabled

result_12 = BHIObject(
    pull_11,
    ObjectType="{ \"_t\" : \"System.Type\", \"Name\" : \"System.Object, mscorlib, Version=4.0.0.0, Culture=neutral, PublicKeyToken=b77a5c561934e089\", \"_bhomVersion\" : \"6.3\" }",
    m_ForcePreview=False,
    m_MaxItemsPreview=10000)  # disabled
result_13 = BHIObject(
    result_12,
    ObjectType="{ \"_t\" : \"System.Type\", \"Name\" : \"System.Object, mscorlib, Version=4.0.0.0, Culture=neutral, PublicKeyToken=b77a5c561934e089\", \"_bhomVersion\" : \"6.3\" }",
    m_ForcePreview=False,
    m_MaxItemsPreview=10000)  # disabled

# ---- group: Draw deformed shape
bars_5 = BHoMObject(
    bars_4,
    ObjectType="{ \"_t\" : \"System.Type\", \"Name\" : \"System.Object, mscorlib, Version=4.0.0.0, Culture=neutral, PublicKeyToken=b77a5c561934e089\", \"_bhomVersion\" : \"6.3\" }",
    m_ForcePreview=False,
    m_MaxItemsPreview=10000)  # disabled
loadcasedeformation_2 = Text(loadcasedeformation)  # disabled
scalefactordeformation_2 = Number(scalefactordeformation)  # disabled
swatch = ColourSwatch(SwatchColor=RGB(122, 161, 122))  # disabled

# ----
deformedshape = DeformedShape(
    Bars=bars_5,
    BarDisplacements=result_13,
    AdapterIdType=createtype,
    Loadcase=loadcasedeformation_2,
    ScaleFactor=scalefactordeformation_2,
    DrawSections=False,
    Component="{ .DeformedShape")  # disabled

# ---- group: Draw deformed shape (continued)
preview_2 = CustomPreview(Geometry=deformedshape, Shader=swatch)  # disabled

# ---- group: Draw deformed shape with sections (slow due to slow loft)
toggle_3 = BooleanToggle(True)  # disabled
loadcasedeformation_3 = Text(loadcasedeformation)  # disabled
scalefactordeformation_3 = Number(scalefactorgraphicresult)  # disabled
bars_6 = BHoMObject(
    pull_7,
    ObjectType="{ \"_t\" : \"System.Type\", \"Name\" : \"System.Object, mscorlib, Version=4.0.0.0, Culture=neutral, PublicKeyToken=b77a5c561934e089\", \"_bhomVersion\" : \"6.3\" }",
    m_ForcePreview=False,
    m_MaxItemsPreview=10000)  # disabled
swatch_2 = ColourSwatch(SwatchColor=RGB(255, 0, 0))  # disabled

# ----
deformedshape_2 = DeformedShape(
    Bars=bars_6,
    BarDisplacements=result_13,
    AdapterIdType=createtype,
    Loadcase=loadcasedeformation_3,
    ScaleFactor=scalefactordeformation_3,
    DrawSections=toggle_3,
    Component="{ .DeformedShape")  # disabled

# ---- group: Draw deformed shape with sections (slow due to slow loft) (continued)
explode_8 = Explode(Object=deformedshape_2, Component="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")  # -> simplify(Curves); disabled
loft = Loft(Curves=explode_8, Options={Adjust=False, Closed=False, LoftEnds=0, LoftSimp=0, LoftType=0, Rebuild=10, Refit=0.01})  # disabled
preview_3 = CustomPreview(Geometry=loft, Shader=swatch_2)  # disabled

# ==== cluster LocalAxis
bhom = ClusterInput()
bhom_2 = BHoMObject(
    bhom,
    ObjectType="{ \"_t\" : \"System.Type\", \"Name\" : \"System.Object, mscorlib, Version=4.0.0.0, Culture=neutral, PublicKeyToken=b77a5c561934e089\", \"_bhomVersion\" : \"6.3\" }",
    m_ForcePreview=False,
    m_MaxItemsPreview=10000)
centreline = Centreline(Bar=bhom_2, Component="{ .Centreline")
coordinatesystem = CoordinateSystem(Bar=bhom_2, Component="{ .CoordinateSystem")
crv = Curve(centreline)
eval = EvaluateLength(Curve=crv, Length=Slider(0.5, range=0..1), Normalized=True)  # -> Point, Tangent, Parameter
explode = Explode(Object=coordinatesystem, Component="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")  # -> X, Y, Z, Origin
vdisex = VectorDisplayEx(Point=eval.Point, Vector=explode.Y, Colour=ColourSwatch(SwatchColor=RGB(0, 255, 0)), Width=2)
vdisex_2 = VectorDisplayEx(Point=eval.Point, Vector=explode.X, Colour=ColourSwatch(SwatchColor=RGB(0, 0, 255)), Width=2)
vdisex_3 = VectorDisplayEx(Point=eval.Point, Vector=explode.Z, Colour=ColourSwatch(SwatchColor=RGB(255, 0, 0)), Width=2)
