# Grasshopper definition GEOMETRY_Concept cabinets with nesting for CNC.gh (Grasshopper 1.0.7)
# plug-ins: MetaHopper, Moonlight, Palette, EleFront, OpenNest

# Make custom theme using palette. in combination persistent data plugin and params view active, no need for swatch. remove the palette from the canvas and keep the settings. reinsert from params, utilities to modify, these works as user settings
palette = Palette(
    ModeCustomStandard=False,
    Component_Normal_Deselected_Fill_Color=RGB(200, 200, 200),
    Component_Normal_Deselected_Edge_Color=RGB(50, 50, 50),
    Component_Normal_Deselected_Text_Color=RGB(0, 0, 0),
    Component_Normal_Selected_Fill_Color=RGB(130, 215, 50),
    Component_Normal_Selected_Edge_Color=RGB(0, 50, 0),
    Component_Normal_Selected_Text_Color=RGB(0, 25, 0),
    Component_Hidden_Deselected_Fill_Color=RGB(140, 140, 155),
    Component_Hidden_Deselected_Edge_Color=RGB(35, 35, 35),
    Component_Hidden_Deselected_Text_Color=RGB(0, 0, 0),
    Component_Hidden_Selected_Fill_Color=RGB(80, 180, 10),
    Component_Hidden_Selected_Edge_Color=RGB(0, 35, 0),
    Component_Hidden_Selected_Text_Color=RGB(0, 25, 0),
    Component_Disabled_Deselected_Fill_Color=RGB(120, 120, 120),
    Component_Disabled_Deselected_Edge_Color=RGB(90, 90, 90),
    Component_Disabled_Deselected_Text_Color=RGB(70, 70, 70),
    Component_Disabled_Selected_Fill_Color=RGB(110, 150, 115),
    Component_Disabled_Selected_Edge_Color=RGB(40, 70, 40),
    Component_Disabled_Selected_Text_Color=RGB(75, 100, 65),
    Component_Warning_Deselected_Fill_Color=RGB(255, 140, 20),
    Component_Warning_Deselected_Edge_Color=RGB(80, 10, 0),
    Component_Warning_Deselected_Text_Color=RGB(0, 0, 0),
    Component_Warning_Selected_Fill_Color=RGB(185, 205, 0),
    Component_Warning_Selected_Edge_Color=RGB(0, 50, 0),
    Component_Warning_Selected_Text_Color=RGB(0, 0, 0),
    Component_Error_Deselected_Fill_Color=RGB(200, 0, 0),
    Component_Error_Deselected_Edge_Color=RGB(60, 0, 0),
    Component_Error_Deselected_Text_Color=RGB(0, 0, 0),
    Component_Error_Selected_Fill_Color=RGB(125, 155, 0),
    Component_Error_Selected_Edge_Color=RGB(0, 50, 0),
    Component_Error_Selected_Text_Color=RGB(255, 255, 255),
    Component_Label_Deselected_Fill_Color=RGB(50, 50, 50),
    Component_Label_Deselected_Edge_Color=RGB(0, 0, 0),
    Component_Label_Deselected_Text_Color=RGB(255, 255, 255),
    Component_Label_Selected_Fill_Color=RGB(25, 60, 25),
    Component_Label_Selected_Edge_Color=RGB(0, 35, 0),
    Component_Label_Selected_Text_Color=RGB(190, 250, 180),
    Galapagos_Deselected_Fill_Color=RGB(255, 0, 125),
    Galapagos_Deselected_Edge_Color=RGB(100, 0, 50),
    Galapagos_Selected_Fill_Color=RGB(160, 210, 30),
    Galapagos_Selected_Edge_Color=RGB(0, 50, 0),
    Wire_Normal_Color=RGBA(0, 0, 0, 150),
    Wire_Empty_Color=RGBA(255, 60, 0, 180),
    Wire_Selected_Start_Color=RGB(125, 210, 40),
    Wire_Selected_End_Color=RGBA(0, 0, 0, 50),
    Panel_Default_Color=RGB(255, 255, 255),
    Group_Default_Color=RGBA(170, 135, 225, 150),
    Canvas_Background_Color=RGB(122, 121, 119),
    Canvas_Gridline_Color=RGBA(0, 0, 0, 30),
    Canvas_Gridline_Width=150,
    Canvas_Gridline_Height=50,
    Canvas_Edge_Color=RGB(0, 0, 0),
    Canvas_Shadow_Color=RGBA(0, 0, 0, 80),
    Canvas_Shadow_Size=30,
    MonochromaticOnOff=False,
    Monochromatic_Color=RGB(212, 208, 200))
image_sampler = ImageSampler(
    FilePath="C:\Users\DBO\OC Engineering ApS\Administration - Documents\Brand og logo Carsten Skovlund\OCplan LogoFiler\OCplanLogoGraaDPI300.png",
    Filter="Colour",
    Interpolate=True,
    Umax=842,
    Umin=1,
    Vmax=595,
    Vmin=1,
    Wrap=1)
developed_by = Panel("Daniel Bo Olesen")
# Description: OCplan Grasshopper Template.
# Graphic standard seen underneath
# Rightclick a colour and set to standard, there after group and comment on the group
# 
# 
# DESCRIPTION OF THE SCRIPT:
# Prototype, for making nesting on parametric geometry for cabinet. This is not a finished script, either in relation to layout or functionality.
# 
# THEORY:
# Nesting is the process of arranging 3d geometry in 2d for machining etc. could be CNC
# 
# INPUT:
# A coordinate/point to place the element in rhino
# 
# OUTPUT:
# Some nesting, maybe dwg/dxf, or other format??
current_revision_data_and_version = Panel("15.03.2023 - 01.00.00.00")
project = Panel("SagsNr - SagsNavn")
panel = Panel(""" Use shift+ctrl+B to search in BHoM
BHoM bruger Si grundenheder, dvs. meter, newton, Pa osv.""")

# ---- group: Modify all panels
get_objects_of_same_type = GetObjectsOfSameType(Objects=panel)
set_panel_properties = SetPanelProperties(Panel=get_objects_of_same_type, Color=ColourSwatch(SwatchColor=RGB(255, 255, 255)))

# ---- group: Modify group colors, scheme colors preset
# Output
# Input
# data
group_colors = ValueList({"Output": "184,82,204 (150)", "Input": "56,245,255 (150)", "Data": "128,128,128 (150)", "Geometry": "182,204,102 (150)", "preview": "252,210,159 (150)", "OBS": "255,140,140 (150)", "Big group": "255,255,255 (150)"}, selected="Input")  # disabled
set_group_properties = SetGroupProperties(Group="Grasshopper.Kernel.Types.GH_ObjectWrapper", Color=group_colors)  # disabled

# ----
# Todos: FILL OUT if not managed through .git
# - Indbyg udbøjning formel
# persistent dataplugin allows to make fast edit to static data
# Quick connection does not work with BHoM installed
# When pod_botton is installed you can get a rhino viewport, see buttons in the ribbon
# SnappingGecko allows for snapping and placement of components fast.
sphere = Sphere(Base=PlaneXY(0, 0, 0), Radius=1)  # disabled

# ---- group: Modify line types
# Layout and group design
line_type = ValueList({"Normal": 0, "Faint": 1, "Hidden": 2}, selected="Hidden")  # disabled
control_wire_display = ControlWireDisplay(WireDisplay=line_type)  # disabled

# ---- group: Create scripple on group by name
# preview
# OBS
# big group
# Revision history: FILL OUT if not managed through .git
# 15.03.2023 - 01.00.00.00 - første udgivelse
# set darkmode on using moonlight
boolean_toggle = BooleanToggle(True)  # disabled
label_groups = LabelGroups(Run=boolean_toggle)  # disabled

# ---- group: Apply best practice to group
# geometry
boolean_toggle_2 = BooleanToggle(True)  # disabled
best_practicizer = BestPracticizer(Activate=boolean_toggle_2)  # disabled

# ----
wire_display_toggle = WireDisplayToggle(ShowHiddenWires=Toggle(False))
moonlight = Moonlight(Mode=False)
thickness_cabinet_plates = Slider(12, range=6..21)
thickness_cabinet_back_plate = Slider(6, range=6..15)
thickness_cabinet_front_plate = Slider(12, range=6..21)
gap_between_front_plate_and_cabinet = Slider(2, range=0..6)
panel_2 = Panel(" Insert point")
# Depth, configure snapping points or allow fully custom
depth_mm = Slider(407, range=100..1000)
# height, configure snapping points or allow fully custom
height_mm = Slider(171, range=100..1000)
point = Point(Point(0, 0, 0))
# width, configure snapping points or allow fully custom
width_mm = Slider(414, range=100..1000)
# offset the bottom plate from the sides
bottom_offset_from_front = Slider(0, range=0..100)
offset_backplate = Slider(8, range=0..100)
cut_depth_for_backplate = Slider(5, range=3..15)
sheet_width = Slider(1459, range=0..2500)
sheet_height = Slider(942, range=0..2500)
distance_between_elements_in_nest = Slider(45, range=0..400)
nest_seed = Slider(288, range=0..1000)
addition = Addition(A=thickness_cabinet_front_plate, B=gap_between_front_plate_and_cabinet)
vector_xyz = VectorXYZ(XComponent=0, YComponent=depth_mm, ZComponent=0)  # -> Vector, Length
subtraction = Subtraction(A=thickness_cabinet_plates, B=cut_depth_for_backplate)
subtraction_2 = Subtraction(A=width_mm, B=thickness_cabinet_plates)
addition_2 = Addition(A=addition, B=bottom_offset_from_front)
plane_normal = PlaneNormal(Origin=point, ZAxis=Vector(0, 0, 1))
construct_domain = ConstructDomain(DomainStart=0, DomainEnd=thickness_cabinet_plates)
construct_domain_2 = ConstructDomain(DomainStart=0, DomainEnd=height_mm)
construct_domain_3 = ConstructDomain(DomainStart=addition, DomainEnd=depth_mm)
construct_domain_4 = ConstructDomain(DomainStart=thickness_cabinet_plates, DomainEnd=subtraction_2)
construct_domain_5 = ConstructDomain(DomainStart=addition_2, DomainEnd=depth_mm)
subtraction_3 = Subtraction(A=height_mm, B=subtraction)
move = Move(Geometry=point, Motion=vector_xyz.Vector)  # -> Geometry, Transform
subtraction_4 = Subtraction(A=height_mm, B=thickness_cabinet_plates)
subtraction_5 = Subtraction(A=width_mm, B=thickness_cabinet_plates)
subtraction_6 = Subtraction(A=width_mm, B=subtraction)
addition_3 = Addition(A=offset_backplate, B=thickness_cabinet_back_plate)
construct_point = ConstructPoint(XCoordinate=subtraction_5, YCoordinate=0, ZCoordinate=0)
plane_normal_2 = PlaneNormal(Origin=move.Geometry, ZAxis=Vector(0, 0, 1))
rectangle = Rectangle(Plane=point, XSize=construct_domain_4, YSize=construct_domain_5, Radius=0)  # -> Rectangle, Length
construct_domain_6 = ConstructDomain(DomainStart=0, DomainEnd=thickness_cabinet_plates)
construct_point_2 = ConstructPoint(XCoordinate=0, YCoordinate=0, ZCoordinate=subtraction_4)
construct_domain_7 = ConstructDomain(DomainStart=expr("x*-1", offset_backplate), DomainEnd=expr("x*-1", addition_3))
construct_domain_8 = ConstructDomain(DomainStart=subtraction, DomainEnd=subtraction_6)
construct_domain_9 = ConstructDomain(DomainStart=subtraction, DomainEnd=subtraction_3)
rectangle_2 = Rectangle(Plane=plane_normal, XSize=construct_domain, YSize=construct_domain_3, Radius=0)  # -> Rectangle, Length
rectangle_3 = Rectangle(Plane=plane_normal_2, XSize=construct_domain_8, YSize=construct_domain_7, Radius=0)  # -> Rectangle, Length
box_rectangle = BoxRectangle(Rectangle=rectangle_2.Rectangle, Height=construct_domain_2)
move_2 = Move(Geometry=box_rectangle, Motion=construct_point)  # -> Geometry, Transform
box_rectangle_2 = BoxRectangle(Rectangle=rectangle.Rectangle, Height=construct_domain_6)
move_3 = Move(Geometry=box_rectangle_2, Motion=construct_point_2)  # -> Geometry, Transform
box_rectangle_3 = BoxRectangle(Rectangle=rectangle_3.Rectangle, Height=construct_domain_9)
evaluate_box = EvaluateBox(Box=move_3.Geometry, UParameter=0.5, VParameter=0.5, WParameter=0.5)  # -> Plane, Point, Include
entwine = Entwine(Branch00=box_rectangle, Branch01=move_2.Geometry, Branch02=box_rectangle_2, Branch03=move_3.Geometry, FlattenInputs=True)
xy_plane = XYPlane(Origin=Point(0, 0, 0))
yz_plane = YZPlane(Origin=Point(0, 0, 0))
solid_difference = SolidDifference(BrepsA=entwine, BrepsB=box_rectangle_3)
flip_plane = FlipPlane(Plane=xy_plane, ReverseX=True, ReverseY=False, SwapAxes=False)
flip_plane_2 = FlipPlane(Plane=yz_plane, ReverseX=False, ReverseY=True, SwapAxes=False)
entwine_2 = Entwine(Branch00=solid_difference, Branch01=box_rectangle_3, FlattenInputs=True)
yz_plane_2 = YZPlane(Origin=Point(0, 0, 0))
xz_plane = XZPlane(Origin=Point(0, 0, 0))
bake_objects = BakeObjects(Geometry=entwine_2, Bake=False)
entwine_3 = Entwine(
    Branch00=yz_plane_2,
    Branch01=flip_plane_2,
    Branch02=xy_plane,
    Branch03=flip_plane,
    Branch04=xz_plane,
    FlattenInputs=True)
brep = Brep(flatten(entwine_2))
pack_objects = PackObjects(Geo=flatten(brep), Plane=flatten(entwine_3), X=Slider(20, range=0..250), Y=1, Tolerabce=0)  # -> Geo, Transformation
vector_xyz_2 = VectorXYZ(XComponent=0, YComponent=expr("x*1.5", depth_mm), ZComponent=10)  # -> Vector, Length
move_4 = Move(Geometry=point, Motion=vector_xyz_2.Vector)  # -> Geometry, Transform
plane_normal_3 = PlaneNormal(Origin=move_4.Geometry, ZAxis=Vector(0, 0, 1))
rectangle_4 = Rectangle(Plane=plane_normal_3, XSize=sheet_width, YSize=sheet_height, Radius=0)  # -> Rectangle, Length
curve = Curve(rectangle_4.Rectangle)
opennest = OpenNest(
    Sheets=curve,
    Geo=pack_objects.Geo,
    Spacing=distance_between_elements_in_nest,
    Placement=1,
    Tolerance=0.1,
    Rotations=4,
    Iterations=5,
    Seed=nest_seed,
    Reset=True,
    Run=False)  # -> Sheets, Geo, ID, Transform, IDS
