# Grasshopper definition GEOMETRY_Stabilitet vægge og oplande_PancakeEmergency.gh (Grasshopper 1.0.7)
# plug-ins: LunchBox, EleFront, Human, Pancake

developed_by = Panel("Daniel Bo Olesen")
# Description: OC Engineering Grasshopper Template.
# Graphic standard seen underneath
# Rightclick a colour and set to standard, there after group and comment on the group
# 
# 
# DESCRIPTION OF THE SCRIPT:
# Script der bruges i hops, oploades til GitHub så der er mulighed for at dele hops med flere brugere, da der bruges et link af http.... typen, hvormed den ikke er bruger bestemt i form af en specifik sti.
# 
# THEORY:
# bla bla.
# 
# INPUT:
# bla bla.
# 
# OUTPUT:
# bla bla.
# Output
current_revision_data_and_version = Panel("15.03.2023 - 01.00.00.00")
# EKSTRA
# Vægge tegnes med center linjer.
# Arket er lavet for nu til 2 typer vagge, facader og indvendige vægge.
project = Panel("SagsNr - SagsNavn")
# GUIDE
# - Tag et screendump af plantegningen. Placer så der kun tegnes i første kvadrant.
# 
# - Scaler billedet, evt. "lock" det. brug unlock cmd for at åbne igen.
# 
# - Tegn stabiliserende vægge.
# - vælg curves og Sæt geometrien til curve collectionen
# - Tegn lastoplande til vægge der optager last fra etagedæk, sæt curves til curves collection hertil.
# - vælg vægge der optager last fra tagkonstruktion.
# - opsæt din sti til excel fil med data.
#  - lav excelfil
# Copy paste værdier fra excel til stabilitets mathcad ark (opret en ny tabel og navngiv manuelt, navngivning skal mathche tidligerer defineret navne)
image_sampler = ImageSampler(Filter="Colour", Interpolate=True, Umax=842, Umin=1, Vmax=595, Vmin=1, Wrap=1)
placering_ift_streg = Slider(195, range=0..1500)
tekst_størrelse = Slider(173, range=0..1500)

# ---- group: Input facader/væg type 1
# OBS, vægge vælges efter type, dvs. er der facade vægge indvendigt sættes det også her
# Todos: FILL OUT if not managed through .git
# - Indbyg udbøjning formel
højden_der_regnes_moment_for_mm = Slider(2450, range=0..5000)
vægtykkelse = Panel("145")

# ----
# Input
# data
# geometry
# preview
# OBS
# big group
# Revision history: FILL OUT if not managed through .git
# 15.03.2023 - 01.00.00.00 - første udgivelse
sti_til_excel_fil_med_data = Panel("C:\Users\DBO\OC Engineering ApS\240058 - Byggeri Og Teknik 23588 Jan Ikast - Documents\C05 Analyse\C05.1 Beregning\")

# ---- group: Input indervægge/væg type 2
# OBS, vægge vælges efter type, dvs. er der facade vægge indvendigt sættes det også her
højden_der_regnes_moment_for_mm_2 = Slider(2450, range=0..5000)
vægtykkelse_2 = Panel("95")

# ---- group: Oplande, Streger der mål sættes
# Lastoplande tegnes som streger, tegn eventuelt bjælkers spænd og brug divide cmd til at opdele i 2 stykker, split=yes.
# 
# Herefter kan der laves et join, så streger fra begge sider af f.eks vægge samles og det samlede lastoplands længde haves.
curve = Curve([<curve referenced from the Rhino model> x11])

# ----
størrelse_cirkel_geometrisk_midtpunkt = Slider(207, range=0..500)
flyt_geometrisk_tag_i_x_retning = Slider(-500, range=-500..500)
flyt_geometrisk_tag_i_y_retning = Slider(-500, range=-500..500)

# ---- group: Bake tags, ved true gøres det automatisk
boolean_toggle = BooleanToggle(True)

# ----
true_only_button = TrueOnlyButton(LastSaveLocalization="neutral,N")
create_xlsx = Button()

# ---- group: Input facader/væg type 1 / Facader X retning
curve_2 = Curve([<curve referenced from the Rhino model> x14])

# ---- group: Input facader/væg type 1 / Facader Y retning
curve_3 = Curve([<curve referenced from the Rhino model> x9])

# ----
xy_plane = XYPlane(Origin=Point(0, 0, 0))

# ---- group: Input indervægge/væg type 2 / X retning
curve_4 = Curve([<curve referenced from the Rhino model> x6])

# ---- group: Input indervægge/væg type 2 / Y retning
curve_5 = Curve([<curve referenced from the Rhino model> x8])

# ----
end_points = EndPoints(Curve=curve)  # -> Start, End

# ---- group: Facader X-retning kasser
end_points_2 = EndPoints(Curve=curve_2)  # -> Start, End
deconstruct = Deconstruct(Point=end_points_2.Start)  # -> XComponent, YComponent, ZComponent
deconstruct_2 = Deconstruct(Point=end_points_2.End)  # -> XComponent, YComponent, ZComponent
division = Division(A=vægtykkelse, B=2)
subtraction = Subtraction(A=deconstruct.YComponent, B=division)
construct_point = ConstructPoint(XCoordinate=deconstruct.XComponent, YCoordinate=subtraction, ZCoordinate=deconstruct.ZComponent)
subtraction_2 = Subtraction(A=deconstruct_2.XComponent, B=deconstruct.XComponent)
rectangle = Rectangle(Plane=construct_point, XSize=subtraction_2, YSize=vægtykkelse, Radius=0)  # -> Rectangle, Length
box_rectangle = BoxRectangle(Rectangle=rectangle.Rectangle, Height=højden_der_regnes_moment_for_mm)

# ---- group: Facader Y-retning kasser
end_points_3 = EndPoints(Curve=curve_3)  # -> Start, End
deconstruct_3 = Deconstruct(Point=end_points_3.Start)  # -> XComponent, YComponent, ZComponent
deconstruct_4 = Deconstruct(Point=end_points_3.End)  # -> XComponent, YComponent, ZComponent
division_2 = Division(A=vægtykkelse, B=2)
subtraction_3 = Subtraction(A=deconstruct_3.XComponent, B=division_2)
construct_point_2 = ConstructPoint(XCoordinate=subtraction_3, YCoordinate=deconstruct_4.YComponent, ZCoordinate=deconstruct_3.ZComponent)
subtraction_4 = Subtraction(A=deconstruct_3.YComponent, B=deconstruct_4.YComponent)
rectangle_2 = Rectangle(Plane=construct_point_2, XSize=vægtykkelse, YSize=subtraction_4, Radius=0)  # -> Rectangle, Length
box_rectangle_2 = BoxRectangle(Rectangle=rectangle_2.Rectangle, Height=højden_der_regnes_moment_for_mm)

# ---- group: indvendig X-retning kasser
end_points_4 = EndPoints(Curve=curve_4)  # -> Start, End
deconstruct_5 = Deconstruct(Point=end_points_4.Start)  # -> XComponent, YComponent, ZComponent
deconstruct_6 = Deconstruct(Point=end_points_4.End)  # -> XComponent, YComponent, ZComponent
division_3 = Division(A=vægtykkelse_2, B=2)
subtraction_5 = Subtraction(A=deconstruct_5.YComponent, B=division_3)
construct_point_3 = ConstructPoint(XCoordinate=deconstruct_5.XComponent, YCoordinate=subtraction_5, ZCoordinate=deconstruct_5.ZComponent)
subtraction_6 = Subtraction(A=deconstruct_6.XComponent, B=deconstruct_5.XComponent)
rectangle_3 = Rectangle(Plane=construct_point_3, XSize=subtraction_6, YSize=vægtykkelse_2, Radius=0)  # -> Rectangle, Length
box_rectangle_3 = BoxRectangle(Rectangle=rectangle_3.Rectangle, Height=højden_der_regnes_moment_for_mm_2)

# ---- group: indvendig Y-retning kasser
end_points_5 = EndPoints(Curve=curve_5)  # -> Start, End
deconstruct_7 = Deconstruct(Point=end_points_5.Start)  # -> XComponent, YComponent, ZComponent
deconstruct_8 = Deconstruct(Point=end_points_5.End)  # -> XComponent, YComponent, ZComponent
division_4 = Division(A=vægtykkelse_2, B=2)
subtraction_7 = Subtraction(A=deconstruct_7.XComponent, B=division_4)
construct_point_4 = ConstructPoint(XCoordinate=subtraction_7, YCoordinate=deconstruct_8.YComponent, ZCoordinate=deconstruct_7.ZComponent)
subtraction_8 = Subtraction(A=deconstruct_7.YComponent, B=deconstruct_8.YComponent)
rectangle_4 = Rectangle(Plane=construct_point_4, XSize=vægtykkelse_2, YSize=subtraction_8, Radius=0)  # -> Rectangle, Length
box_rectangle_4 = BoxRectangle(Rectangle=rectangle_4.Rectangle, Height=højden_der_regnes_moment_for_mm_2)

# ----
aligned_dimension = AlignedDimension(
    Plane=xy_plane,
    PointA=end_points.Start,
    PointB=end_points.End,
    Offset=placering_ift_streg,
    Text="{0:0}",
    Size=tekst_størrelse)
construct_point_5 = ConstructPoint(XCoordinate=29690, YCoordinate=7480, ZCoordinate=0)
sphere = Sphere(Base=construct_point_5, Radius=250)

# ---- group: Laver væg numrer
list_length = ListLength(List=[box_rectangle, box_rectangle_2, box_rectangle_3, box_rectangle_4])
series = Series(Start=1, Step=1, Count=list_length)  # -> flatten(Series)
panel = Panel(series)

# ---- group: Laver væg navne
list_length_2 = ListLength(List=box_rectangle)
list_length_3 = ListLength(List=box_rectangle_2)
list_length_4 = ListLength(List=box_rectangle_3)
list_length_5 = ListLength(List=box_rectangle_4)
entwine = Entwine(Branch00=list_length_2, Branch01=list_length_3, Branch02=list_length_4, Branch03=list_length_5, FlattenInputs=True)  # -> flatten(Result)
entwine_2 = Entwine(Branch00=".1_x", Branch01=".1_y", Branch02=".2_x", Branch03=".2_y", FlattenInputs=True)
partition_list = PartitionList(List=panel, Size=entwine)
concatenate = Concatenate(FragmentA=partition_list, FragmentB=entwine_2)

# ----
# Vælg vægge der optager egenlast fra taget
item_selector = ItemSelector(
    concatenate,
    {"1.1_x", "2.1_x", "3.1_x", "4.1_x", "5.1_x", "6.1_x", "7.1_x", "8.1_x", "9.1_x", "10.1_x"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}, selected=["1.1_x", "2.1_x", "3.1_x", "4.1_x", "5.1_x", "6.1_x", "7.1_x", "8.1_x", "9.1_x", "10.1_x", "11.1_x", "14.1_x", "15.1_y", "17.1_y"])

# ---- group: X-retning, sorterer så tegneretning i rhino er ubetydelig
entwine_3 = Entwine(
    Branch00=deconstruct.XComponent,
    Branch01=deconstruct_3.XComponent,
    Branch02=deconstruct_5.XComponent,
    Branch03=deconstruct_7.XComponent,
    FlattenInputs=True)
entwine_4 = Entwine(
    Branch00=deconstruct_2.XComponent,
    Branch01=deconstruct_4.XComponent,
    Branch02=deconstruct_6.XComponent,
    Branch03=deconstruct_8.XComponent,
    FlattenInputs=True)
round = Round(Number=entwine_4)  # -> Nearest, Floor, Ceiling
round_2 = Round(Number=entwine_3)  # -> Nearest, Floor, Ceiling

# ---- group: Y-retning, sorterer så tegneretning i rhino er ubetydelig
entwine_5 = Entwine(
    Branch00=deconstruct.YComponent,
    Branch01=deconstruct_3.YComponent,
    Branch02=deconstruct_5.YComponent,
    Branch03=deconstruct_7.YComponent,
    FlattenInputs=True)
entwine_6 = Entwine(
    Branch00=deconstruct_2.YComponent,
    Branch01=deconstruct_4.YComponent,
    Branch02=deconstruct_6.YComponent,
    Branch03=deconstruct_8.YComponent,
    FlattenInputs=True)
round_3 = Round(Number=entwine_6)  # -> Nearest, Floor, Ceiling
round_4 = Round(Number=entwine_5)  # -> Nearest, Floor, Ceiling

# ---- group: Væg geometri
deconstruct_box = DeconstructBox(Box=box_rectangle)  # -> Plane, X, Y, Z
deconstruct_box_2 = DeconstructBox(Box=box_rectangle_3)  # -> Plane, X, Y, Z
deconstruct_box_3 = DeconstructBox(Box=box_rectangle_2)  # -> Plane, X, Y, Z
deconstruct_box_4 = DeconstructBox(Box=box_rectangle_4)  # -> Plane, X, Y, Z

# ---- group: Væg geometri / Laver liste med væg tykkelse
entwine_7 = Entwine(
    Branch00=deconstruct_box.Y,
    Branch01=deconstruct_box_3.X,
    Branch02=deconstruct_box_2.Y,
    Branch03=deconstruct_box_4.X,
    FlattenInputs=True)
deconstruct_domain = DeconstructDomain(Domain=entwine_7)  # -> Start, End

# ---- group: Væg geometri / Laver liste med væg højder
entwine_8 = Entwine(
    Branch00=deconstruct_box.Z,
    Branch01=deconstruct_box_3.Z,
    Branch02=deconstruct_box_2.Z,
    Branch03=deconstruct_box_4.Z,
    FlattenInputs=True)
deconstruct_domain_2 = DeconstructDomain(Domain=entwine_8)  # -> Start, End
expression = Expression(start=deconstruct_domain_2.Start, end=deconstruct_domain_2.End, Expression="end-start")

# ---- group: X-retning, sorterer så tegneretning i rhino er ubetydelig / x_start
minimum = Minimum(A=round_2.Nearest, B=round.Nearest)

# ----
panel_2 = Panel(minimum)

# ---- group: X-retning, sorterer så tegneretning i rhino er ubetydelig / x_slut
maximum = Maximum(A=round_2.Nearest, B=round.Nearest)

# ----
panel_3 = Panel(maximum)

# ---- group: Y-retning, sorterer så tegneretning i rhino er ubetydelig / y_start
minimum_2 = Minimum(A=round_4.Nearest, B=round_3.Nearest)

# ---- group: Y-retning, sorterer så tegneretning i rhino er ubetydelig / y_slut
maximum_2 = Maximum(A=round_4.Nearest, B=round_3.Nearest)

# ---- group: liste med navn på egenlast for væg
entwine_9 = Entwine(Branch00=list_length_2, Branch01=list_length_3, FlattenInputs=True)
entwine_10 = Entwine(Branch00=list_length_4, Branch01=list_length_5, FlattenInputs=True)
repeat_data = RepeatData(Data="g_ydre", Length=entwine_9)
repeat_data_2 = RepeatData(Data="g_inder", Length=entwine_10)
entwine_11 = Entwine(Branch0X=repeat_data, Branch1X=repeat_data_2, FlattenInputs=False)

# ---- group: Laver geometrisk midtpunkt
bounds = Bounds(Numbers=flatten([maximum_2, minimum_2]))
bounds_2 = Bounds(Numbers=flatten([minimum, maximum]))
deconstruct_domain_3 = DeconstructDomain(Domain=bounds_2)  # -> Start, End
deconstruct_domain_4 = DeconstructDomain(Domain=bounds)  # -> Start, End
expression_2 = Expression(
    x_start=deconstruct_domain_3.Start,
    x_slut=deconstruct_domain_3.End,
    y_start=deconstruct_domain_4.Start,
    y_slut=deconstruct_domain_4.End,
    Expression="{(x_slut-x_start)/2+x_start,(y_slut-y_start)/2+y_start,0}")
sphere_2 = Sphere(Base=expression_2, Radius=størrelse_cirkel_geometrisk_midtpunkt)

# ---- group: Laver liste med vægge der tager last fra taget
member_index = MemberIndex(Set=concatenate, Member=item_selector)  # -> Index, Count
shift_paths = ShiftPaths(Data=member_index.Index, Offset=-1)
replace_items = ReplaceItems(List=concatenate, Item="l_tag", Indices=shift_paths, Wrap=False)
member_index_2 = MemberIndex(Set=replace_items, Member=concatenate)  # -> Index, Count
shift_paths_2 = ShiftPaths(Data=member_index_2.Index, Offset=-1)
replace_items_2 = ReplaceItems(List=replace_items, Item="0", Indices=shift_paths_2, Wrap=False)
panel_4 = Panel(replace_items_2)

# ---- group: Skriver væg navne til rhino (bake me)
entwine_12 = Entwine(Branch00=curve_2, Branch01=curve_3, Branch02=curve_4, Branch03=curve_5, FlattenInputs=True)
colour_swatch = ColourSwatch(SwatchColor=RGB(0, 60, 255))
curve_middle = CurveMiddle(Curve=entwine_12)
define_layer = DefineLayer(Name="VaegTags", Color=colour_swatch)
define_text_dot = DefineTextDot(Text=concatenate, Location=curve_middle, Font="Arial", Size=14)
define_object_attributes = DefineObjectAttributes(Name="VaegTags", Layer=define_layer, Color=colour_swatch)
bake_objects = BakeObjects(Geometry=define_text_dot, Attributes=define_object_attributes, BakeName="BakedWallTags", Bake=boolean_toggle)
panel_5 = Panel(define_text_dot)

# ---- group: Laver liste med lastoplande fra tegnet streger.
shift_paths_3 = ShiftPaths(Data=entwine_12, Offset=-1)
graft_tree = GraftTree(Tree=curve, IncludeEmptyLists=True, IncludeNullItems=True)
curve_curve = CurveCurve(CurveA=shift_paths_3, CurveB=graft_tree)  # -> Points, ParamsA, ParamsB
point = Point(curve_curve.Points)
simplify_tree = SimplifyTree(Tree=point, Front=False)
partition_list_2 = PartitionList(List=simplify_tree, Size=list_length)
trim_tree = TrimTree(Tree=partition_list_2, Depth=1)
tree_statistics = TreeStatistics(Tree=trim_tree)  # -> Paths, Length, Count
text_split = TextSplit(Text=tree_statistics.Paths, Separators=";")
length = Length(Curve=curve)
list_item = ListItem(List=text_split, Index=1, Wrap=True)
text_split_2 = TextSplit(Text=list_item, Separators="}")
round_5 = Round(Number=length)  # -> Nearest, Floor, Ceiling
list_item_2 = ListItem(List=text_split_2, Index=0, Wrap=True)  # -> flatten(Item)

# ---- group: Skriver navn til rhino, geometrisk midtpunkt
deconstruct_9 = Deconstruct(Point=expression_2)  # -> XComponent, YComponent, ZComponent
addition = Addition(A=flyt_geometrisk_tag_i_x_retning, B=deconstruct_9.XComponent)
addition_2 = Addition(A=flyt_geometrisk_tag_i_y_retning, B=deconstruct_9.YComponent)
colour_swatch_2 = ColourSwatch(SwatchColor=RGB(0, 255, 30))
construct_point_6 = ConstructPoint(XCoordinate=addition, YCoordinate=addition_2, ZCoordinate=deconstruct_9.ZComponent)
define_layer_2 = DefineLayer(Name="Tags", Color=colour_swatch_2)
define_text_dot_2 = DefineTextDot(Text="Geometrisk midtpunkt", Location=construct_point_6, Font="Arial", Size=14)
define_object_attributes_2 = DefineObjectAttributes(Name="Tags", Layer=define_layer_2, Color=colour_swatch_2)
bake_objects_2 = BakeObjects(Geometry=define_text_dot_2, Attributes=define_object_attributes_2, BakeName="AndreTags", Bake=boolean_toggle)

# ----
panel_6 = Panel(expression_2)

# ---- group: Laver liste med lastoplande fra tegnet streger. / Laver liste med vægge der tager last fra taget
replace_items_3 = ReplaceItems(List=flatten(concatenate), Item=round_5.Nearest, Indices=list_item_2, Wrap=False)
member_index_3 = MemberIndex(Set=replace_items_3, Member=flatten(concatenate))  # -> Index, Count
shift_paths_4 = ShiftPaths(Data=member_index_3.Index, Offset=-1)
replace_items_4 = ReplaceItems(List=replace_items_3, Item="0", Indices=shift_paths_4, Wrap=False)
panel_7 = Panel(replace_items_4)

# ----
entwine_13 = Entwine(
    Branch00=concatenate,
    Branch01=minimum,
    Branch02=maximum,
    Branch03=minimum_2,
    Branch04=maximum_2,
    Branch05=deconstruct_domain.End,
    Branch06=expression,
    Branch07=entwine_11,
    Branch08=replace_items_2,
    Branch09=replace_items_4,
    FlattenInputs=True)
list_length_6 = ListLength(List=entwine_13)
list_item_3 = ListItem(List=list_length_6, Index=0, Wrap=True)
tree_branch = TreeBranch(Tree=list_length_6, Path="{0;0}", MaintainPaths=True)
concatenate_2 = Concatenate(Fragment_A=sti_til_excel_fil_med_data, Fragment_B="VaegKoordinator", A=".xlsx")
entwine_14 = Entwine(
    Branch00="væg",
    Branch01="xstart",
    Branch02="xslut",
    Branch03="ystart",
    Branch04="yslut",
    Branch05="t_væg",
    Branch06="h_væg",
    Branch07="g_væg",
    Branch08="a_tag",
    Branch09="a_etage",
    FlattenInputs=True)  # -> flatten(Result)
tree_statistics_2 = TreeStatistics(Tree=entwine_13)  # -> Paths, Length, Count
list_length_7 = ListLength(List=tree_statistics_2.Paths)
panel_8 = Panel(entwine_13)
construct_matrix = ConstructMatrix(Rows=tree_branch, Columns=list_length_7, Values=entwine_13)
create_data_grid = CreateDataGrid(DataGridHeaders=entwine_14, ValueTree=entwine_13)
excel_write = ExcelWrite(
    WriteExcelData=true_only_button,
    WorkbookPath=concatenate_2,
    WorksheetName="VaegKoordinator",
    ColumnHeadings=entwine_14,
    Data=entwine_13,
    ClearSheet=False)
create_datatable = CreateDataTable(TableName="test", TableHeaders=entwine_14, ValueTree=entwine_13)
panel_9 = Panel(excel_write)
