# Grasshopper definition INTERFACE_human ui basics.gh (Grasshopper 1.0.7)
# Copyright: All rights reserved OC Engineering ApS
# plug-ins: Human UI, Human

developed_by = Panel("Daniel Bo Olesen")
# Description: OC Engineering Grasshopper Template.
# Graphic standard seen underneath
# Rightclick a colour and set to standard, there after group and comment on the group
# 
# 
# DESCRIPTION OF THE SCRIPT:
# Test with human ui
# 
# THEORY:
# bla bla.
# 
# INPUT:
# bla bla.
# 
# OUTPUT:
# bla bla.
current_revision_data_and_version = Panel("20.03.2023 - 01.00.00.00")
project = Panel("SagsNr - SagsNavn")
image_sampler = ImageSampler(Filter="Colour", Interpolate=True, Umax=842, Umin=1, Vmax=595, Vmin=1, Wrap=1)
# Revision history: FILL OUT if not managed through .git
panel = Panel("\\Mac\Home\Downloads\")
# Todos: FILL OUT if not managed through .git
radius = Slider(311.647, range=0..1000)
radius_2 = Slider(63.609, range=0..1000)
panel_2 = Panel("""Red
Blue
Yellow
Green
Pink""")
directory_contents = DirectoryContents(FolderPath=panel, Filter="*.jpg", IncludeSubfolders=False)  # -> FilePaths, FileNames
create_slider = CreateSlider(Slider=radius_2, ShowBounds=False, ShowTicks=False, ShowTooltip=False, ShowValLabel=True, showLabel=True)
create_browser = CreateBrowser(URL="https://www.oceng.dk/", Height=radius)
launch_window = LaunchWindow(Show=Toggle(True), Name="TEST HUMAN UI", Width=370, Height=400, ChildStatus=0, EnableHorizScroll=False)
value_listener = ValueListener(Elements=create_slider, SomeProperty=True)  # -> Values, Indices
create_pulldown_menu = CreatePulldownMenu(ListItems=directory_contents.FileNames, showLabel=True)
create_pulldown_menu_2 = CreatePulldownMenu(Label="colour", ListItems=panel_2, showLabel=True)
list_item = ListItem(List=directory_contents.FilePaths, Index=0, Wrap=True)
mesh_sphere = MeshSphere(Base=PlaneXY(0, 0, 0), Radius=value_listener.Values, UCount=10, VCount=20)
accent_colors = ValueList({"Amber", "Blue", "Brown", "Cobalt", "Crimson", "Cyan", "Emerald", "Green", "Indigo", "Lime", "Magenta", "Mauve", "Olive", "Orange", "Pink", "Purple", "Red", "Sienna", "Steel", "Taupe", "Teal", "Violet", "Yellow"}, selected="Blue")
value_listener_2 = ValueListener(Elements=create_pulldown_menu_2, SomeProperty=True)  # -> Values, Indices
value_listener_3 = ValueListener(Elements=create_pulldown_menu, SomeProperty=True)  # -> Values, Indices
point = Point(Point(0, 0, 0))
create_image = CreateImage(ImageSource=list_item, ImageWidth=300)
volume = Volume(Geometry=mesh_sphere)  # -> Volume, Centroid
create_label = CreateLabel(LabelText="Volume", LabelSize=12, Justification=0)
custom_preview = CustomPreview(Geometry=mesh_sphere, Material=value_listener_2.Values)
panel_3 = Panel(value_listener_2.Values)
list_item_2 = ListItem(List=directory_contents.FilePaths, Index=value_listener_3.Indices, Wrap=True)
set_window_properties = SetWindowProperties(Window=launch_window, StartingLocation=point, Theme=0, AccentColor=accent_colors, ShowTitleBar=True, ScaleFactor=1)
set_label_contents = SetLabelContents(LabelToModify=create_label, NewLabelContents=volume.Volume)
add_elements = AddElements(
    Window=launch_window,
    Elements=flatten([create_slider, create_label, create_pulldown_menu_2, create_pulldown_menu, create_image, create_browser]),
    DoVLChecking=True)  # -> AddedElements, ElementNames
set_image = SetImage(ImageToModify=create_image, NewImagePath=list_item_2)
