# Grasshopper definition INTERFACE_human ui test shapes and parameters.gh (Grasshopper 1.0.7)
# Copyright: All rights reserved OC Engineering ApS
# plug-ins: Human UI, MetaHopper

developed_by = Panel("Daniel Bo Olesen")
# Description: OC Engineering Grasshopper Template.
# Graphic standard seen underneath
# Rightclick a colour and set to standard, there after group and comment on the group
# 
# 
# DESCRIPTION OF THE SCRIPT:
# Test with geometry in human ui
# 
# THEORY:
# bla bla.
# 
# INPUT:
# bla bla.
# 
# OUTPUT:
# bla bla.
# Revision history: FILL OUT if not managed through .git
# Todos: FILL OUT if not managed through .git
current_revision_data_and_version = Panel("20.03.2023 - 01.00.00.00")
project = Panel("SagsNr - SagsNavn")
image_sampler = ImageSampler(Filter="Colour", Interpolate=True, Umax=842, Umin=1, Vmax=595, Vmin=1, Wrap=1)
get_selected_objects = GetSelectedObjects(AllObjects_Object=[X, Y, Z])  # -> ComponentObjects, ParamObjects, OtherObjects
Y = Slider(16, range=0..100)
X = Slider(7, range=0..100)
Z = Slider(10, range=0..100)
create_slider = CreateSlider(
    Slider=get_selected_objects.ParamObjects,
    ShowBounds=False,
    ShowTicks=False,
    ShowTooltip=False,
    ShowValLabel=True,
    showLabel=True)
center_box = CenterBox(Base=PlaneXY(0, 0, 0), X=X, Y=Y, Z=Z)
value_listener = ValueListener(Elements=create_slider, SomeProperty=True)  # -> Values, Indices
set_object_value = SetObjectValue(ObjectToSet=graft(get_selected_objects.ParamObjects), ValueToSet=value_listener.Values)
launch_window = LaunchWindow(Show=Toggle(True), Name="Control Window", Width=370, Height=400, ChildStatus=0, EnableHorizScroll=False)
entwine = Entwine(Branch00=create_slider, FlattenInputs=True)
add_elements = AddElements(Window=launch_window, Elements=flatten(entwine), DoVLChecking=True)  # -> AddedElements, ElementNames
