# Grasshopper definition MATERIALS_Karamba3d Material Selection.gh (Grasshopper 1.0.7)
# plug-ins: Karamba3D

# ---- group: Material selection via index. By default the Karamba material table is used.
matselect = MaterialSelectionKaramba3D(NameOrListIndexOfMaterial=Slider(20, range=0..97), menu=[dropdown(0), dropdown(0)])

# ---- group: Material selection via regular expression for the material name.
matselect_2 = MaterialSelectionKaramba3D(NameOrListIndexOfMaterial="&S2..", menu=[dropdown(0), dropdown(0)])

# ---- group: Material selection via drop-down list. Regular expression could be used for pre-selection.
panel = Panel("&S...")
matselect_3 = MaterialSelectionKaramba3D(menu=[dropdown(2), dropdown(2)])

# ---- group: Material selection via name. By default the Karamba material table is used.
matselect_4 = MaterialSelectionKaramba3D(NameOrListIndexOfMaterial="Steel", menu=[dropdown(0), dropdown(0)])

# ---- group: The default material is steel S235
# Different possibilities for selecting a material
matprops = MaterialPropertiesKaramba3D(
    FamilyOfMaterial="Steel",
    Name="S235",
    YoungsModulus_kN_cm2=21000,
    InPlaneShearModulus_kN_cm2=8076,
    TransverseShearModulus_kN_cm2=8076,
    SpecificWeight_kN_m3=78.5,
    CoefficientOfThermalExpansion_1_C=1e-05,
    TensileStrength_kN_cm2=23.5,
    CompressiveStrength_kN_cm2=-23.5,
    StrengthHypothesis="MISES",
    mode="Isotrop")

# ---- group: By default the Karamba material table is loaded
readmattable = ReadMaterialTableFromFileKaramba3D()

# ----
panel_2 = Panel(matselect)
panel_3 = Panel(matselect_4)
panel_4 = Panel(matprops)
panel_5 = Panel(matselect_2)
panel_6 = Panel(matselect_3)
item = ListItem(List=readmattable, Index=Slider(20, range=0..97), Wrap=True)
panel_7 = Panel(item)
