# Grasshopper definition MINECRAFT_Concept for setblock function.gh (Grasshopper 1.0.7)
# plug-ins: MetaHopper, LunchBox, Hops, Karamba3D, LunchBoxML

developed_by = Panel("Daniel Bo Olesen")
# Description: OC Engineering Grasshopper Template.
# Graphic standard seen underneath
# Rightclick a colour and set to standard, there after group and comment on the group
# 
# 
# DESCRIPTION OF THE SCRIPT:
# Script der bruges i hops, oploades til GitHub så der er mulighed for at dele hops med flere brugere, da der bruges et link af http.... typen, hvormed den ikke er bruger bestemt i form af en specifik sti.
# 
# THEORY:
# bla bla.
# 
# INPUT:
# bla bla.
# 
# OUTPUT:
# bla bla.
current_revision_data_and_version = Panel("15.03.2023 - 01.00.00.00")
project = Panel("SagsNr - SagsNavn")
image_sampler = ImageSampler(Filter="Colour", Interpolate=True, Umax=842, Umin=1, Vmax=595, Vmin=1, Wrap=1)
panel = Panel(""" Use shift+ctrl+B to search in BHoM
BHoM bruger Si grundenheder, dvs. meter, newton, Pa osv.""")

# ---- group: Modify all panels
get_objects_of_same_type = GetObjectsOfSameType(Objects=panel)
set_panel_properties = SetPanelProperties(Panel=get_objects_of_same_type, Color=ColourSwatch(SwatchColor=RGB(255, 255, 255)))

# ---- group: Modify group colors, scheme colors preset
# Output
# Input
# data
group_colors = ValueList({"Output": "184,82,204 (150)", "Input": "56,245,255 (150)", "Data": "128,128,128 (150)", "Geometry": "182,204,102 (150)", "preview": "252,210,159 (150)", "OBS": "255,140,140 (150)", "Big group": "255,255,255 (150)"}, selected="Input")
set_group_properties = SetGroupProperties(Group="Grasshopper.Kernel.Types.GH_ObjectWrapper", Color=group_colors)

# ---- group: Modify line types
# Layout and group design
line_type = ValueList({"Normal": 0, "Faint": 1, "Hidden": 2}, selected="Hidden")
control_wire_display = ControlWireDisplay(WireDisplay=line_type)

# ---- group: Create scripple on group by name
# preview
# OBS
# big group
# Revision history: FILL OUT if not managed through .git
# 15.03.2023 - 01.00.00.00 - første udgivelse
# Todos: FILL OUT if not managed through .git
# - Indbyg udbøjning formel
boolean_toggle = BooleanToggle(True)
label_groups = LabelGroups(
    Run=boolean_toggle,
    AllObjects_Object=[radius_øverste_flange_mm, construct_point_11, circle, , arc, yderste_mål_mm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])

# ---- group: Apply best practice to group
# geometry
boolean_toggle_2 = BooleanToggle(True)
best_practicizer = BestPracticizer(Activate=boolean_toggle_2)

# ----
wire_display_toggle = WireDisplayToggle(ShowHiddenWires=Toggle(False))

# ---- group: sphere
radius_in_m = Slider(50, range=0..50)  # disabled
group_toggle = GroupToggle(ToggleActive=True, ToggleVisible=False)  # disabled
construct_point = ConstructPoint(XCoordinate=radius_in_m, YCoordinate=radius_in_m, ZCoordinate=radius_in_m)  # disabled
sphere = Sphere(Base=construct_point, Radius=radius_in_m)  # disabled
panel_2 = Panel("1")  # disabled
panel_3 = Panel("1")  # disabled
rectangle = Rectangle(Plane=PlaneXY(0, 0, 0), XSize=panel_2, YSize=panel_2, Radius=0)  # -> Rectangle, Length; disabled
bounding_box = BoundingBox(Content=sphere, Plane=PlaneXY(0, 0, 0))  # -> Box, Box_2; disabled
deconstruct_brep = DeconstructBrep(Brep=sphere)  # -> Faces, Edges, Vertices; disabled
deconstruct_brep_2 = DeconstructBrep(Brep=bounding_box.Box)  # -> Faces, Edges, Vertices; disabled
box_rectangle = BoxRectangle(Rectangle=rectangle.Rectangle, Height=panel_2)  # disabled
sort_points = SortPoints(Points=deconstruct_brep_2.Vertices)  # -> Points, Indices; disabled
series = Series(Start=0.5, Step=1, Count=expr("x*2", radius_in_m))  # disabled
list_item = ListItem(List=sort_points.Points, Index=0, Wrap=True)  # disabled
move = Move(Geometry=box_rectangle, Motion=list_item)  # -> Geometry, Transform; disabled
unit_z = UnitZ(Factor=series)  # disabled
xy_plane = XYPlane(Origin=list_item)  # disabled
yz_plane = YZPlane(Origin=list_item)  # disabled
unit_x = UnitX(Factor=series)  # disabled
unit_y = UnitY(Factor=series)  # disabled
xz_plane = XZPlane(Origin=list_item)  # disabled
move_2 = Move(Geometry=xy_plane, Motion=unit_z)  # -> Geometry, Transform; disabled
move_3 = Move(Geometry=yz_plane, Motion=unit_x)  # -> Geometry, Transform; disabled
move_4 = Move(Geometry=xz_plane, Motion=unit_y)  # -> Geometry, Transform; disabled
brep_plane = BrepPlane(Brep=deconstruct_brep.Faces, Plane=move_2.Geometry)  # -> Curves, Points; disabled
brep_plane_2 = BrepPlane(Brep=deconstruct_brep.Faces, Plane=move_4.Geometry)  # -> Curves, Points; disabled
brep_plane_3 = BrepPlane(Brep=deconstruct_brep.Faces, Plane=move_3.Geometry)  # -> Curves, Points; disabled
divide_distance = DivideDistance(Curve=brep_plane.Curves, Distance=0.5)  # -> Points, Tangents, Parameters; disabled
divide_distance_2 = DivideDistance(Curve=brep_plane_3.Curves, Distance=0.5)  # -> Points, Tangents, Parameters; disabled
divide_distance_3 = DivideDistance(Curve=brep_plane_2.Curves, Distance=0.5)  # -> Points, Tangents, Parameters; disabled
entwine = Entwine(
    Branch00=divide_distance_3.Points,
    Branch01=divide_distance_2.Points,
    Branch02=divide_distance.Points,
    FlattenInputs=True)  # disabled

# ---- group: Spacetruss
number_slider = Slider(25, range=0..25)  # disabled
group_toggle_2 = GroupToggle(ToggleActive=True, ToggleVisible=False)  # disabled
number_slider_2 = Slider(25, range=0..75)  # disabled
number_slider_3 = Slider(30, range=0..75)  # disabled
construct_point_2 = ConstructPoint(XCoordinate=0, YCoordinate=0, ZCoordinate=number_slider)  # disabled
construct_point_3 = ConstructPoint(XCoordinate=0, YCoordinate=0, ZCoordinate=0)  # disabled
construct_point_4 = ConstructPoint(XCoordinate=0, YCoordinate=number_slider_3, ZCoordinate=number_slider)  # disabled
construct_point_5 = ConstructPoint(XCoordinate=number_slider_2, YCoordinate=0, ZCoordinate=number_slider)  # disabled
number_slider_4 = Slider(6, range=0..8)  # disabled
number_slider_5 = Slider(4, range=0..8)  # disabled
rectangle_2 = Rectangle(Plane=PlaneXY(0, 0, 0), XSize=number_slider_2, YSize=number_slider_3, Radius=0)  # -> Rectangle, Length; disabled
line = Line(StartPoint=construct_point_3, EndPoint=construct_point_2)  # disabled
line_2 = Line(StartPoint=construct_point_2, EndPoint=construct_point_5)  # disabled
line_3 = Line(StartPoint=construct_point_2, EndPoint=construct_point_4)  # disabled
entwine_2 = Entwine(Branch00=line, FlattenInputs=True)  # disabled
panel_4 = Panel("1.8")  # disabled
number_slider_6 = Slider(15, range=0..15)  # disabled
rectangular_array = RectangularArray(Geometry=entwine_2, Cell=rectangle_2.Rectangle, XCount=number_slider_5, YCount=number_slider_4)  # -> Geometry, Transform; disabled
end_points = EndPoints(Curve=rectangular_array.Geometry)  # -> Start, End; disabled
multiplication = Multiplication(A=number_slider_5, B=panel_4)  # disabled
multiplication_2 = Multiplication(A=number_slider_4, B=panel_4)  # disabled
list_length = ListLength(List=rectangular_array.Geometry)  # disabled
proximity_2d = Proximity2D(Points=end_points.End, Plane=PlaneXY(0, 0, 0), Group=5)  # -> Links, Topology; disabled
patch = Patch(Points=end_points.End, Spans=10, Flexibility=1, Trim=True)  # disabled
bounding_box_2 = BoundingBox(Content=end_points.End, Plane=PlaneXY(0, 0, 0))  # -> Box, Box_2; disabled
unit_z_2 = UnitZ(Factor=number_slider_6)  # disabled
data = Data(bounding_box_2.Box)  # disabled
move_5 = Move(Geometry=patch, Motion=unit_z_2)  # -> Geometry, Transform; disabled
sort_points_2 = SortPoints(Points=end_points.End)  # -> Points, Indices; disabled
shift_list = ShiftList(List=sort_points_2.Points, Shift=1, Wrap=True)  # disabled
round = Round(Number=multiplication)  # -> Nearest, Floor, Ceiling; disabled
round_2 = Round(Number=multiplication_2)  # -> Nearest, Floor, Ceiling; disabled
divide_length = DivideLength(Curve=rectangular_array.Geometry, Length=1)  # -> Points, Tangents, Parameters; disabled
space_truss_structure_2 = SpaceTrussStructure2(SurfaceA=patch, SurfaceB=move_5.Geometry, UDivisions=round.Nearest, VDivisions=round_2.Nearest)  # -> PrimaryLines, PrimaryLines_2, WebLines, StructureNodes; disabled
line_4 = Line(StartPoint=sort_points_2.Points, EndPoint=shift_list)  # disabled
entwine_3 = Entwine(
    Branch00=space_truss_structure_2.PrimaryLines,
    Branch01=space_truss_structure_2.PrimaryLines_2,
    Branch02=space_truss_structure_2.WebLines,
    FlattenInputs=True)  # disabled
column_points = Data(divide_length.Points)  # disabled
divide_length_2 = DivideLength(Curve=entwine_3, Length=1)  # -> Points, Tangents, Parameters; disabled
column_points_2 = Data(column_points)  # disabled
entwine_4 = Entwine(Branch00=divide_length_2.Points, Branch01=column_points_2, FlattenInputs=True)  # disabled

# ---- group: A box
number_slider_7 = Slider(50, range=0..100)  # disabled
group_toggle_3 = GroupToggle(ToggleActive=True, ToggleVisible=False)  # disabled
rectangle_3 = Rectangle(Plane=PlaneXY(0, 0, 0), XSize=number_slider_7, YSize=number_slider_7, Radius=0)  # -> Rectangle, Length; disabled
box_rectangle_2 = BoxRectangle(Rectangle=rectangle_3.Rectangle, Height=number_slider_7)  # disabled
deconstruct_brep_3 = DeconstructBrep(Brep=box_rectangle_2)  # -> Faces, Edges, Vertices; disabled
sort_points_3 = SortPoints(Points=deconstruct_brep_3.Vertices)  # -> Points, Indices; disabled
series_2 = Series(Start=0.5, Step=1, Count=expr("x*1", number_slider_7))  # disabled
list_item_2 = ListItem(List=sort_points_3.Points, Index=0, Wrap=True)  # disabled
unit_z_3 = UnitZ(Factor=series_2)  # disabled
xy_plane_2 = XYPlane(Origin=list_item_2)  # disabled
yz_plane_2 = YZPlane(Origin=list_item_2)  # disabled
unit_x_2 = UnitX(Factor=series_2)  # disabled
unit_y_2 = UnitY(Factor=series_2)  # disabled
xz_plane_2 = XZPlane(Origin=list_item_2)  # disabled
move_6 = Move(Geometry=xy_plane_2, Motion=unit_z_3)  # -> Geometry, Transform; disabled
move_7 = Move(Geometry=yz_plane_2, Motion=unit_x_2)  # -> Geometry, Transform; disabled
move_8 = Move(Geometry=xz_plane_2, Motion=unit_y_2)  # -> Geometry, Transform; disabled
brep_plane_4 = BrepPlane(Brep=box_rectangle_2, Plane=move_6.Geometry)  # -> Curves, Points; disabled
brep_plane_5 = BrepPlane(Brep=box_rectangle_2, Plane=move_8.Geometry)  # -> Curves, Points; disabled
brep_plane_6 = BrepPlane(Brep=box_rectangle_2, Plane=move_7.Geometry)  # -> Curves, Points; disabled
divide_distance_4 = DivideDistance(Curve=brep_plane_4.Curves, Distance=0.5)  # -> Points, Tangents, Parameters; disabled
divide_distance_5 = DivideDistance(Curve=brep_plane_6.Curves, Distance=0.5)  # -> Points, Tangents, Parameters; disabled
divide_distance_6 = DivideDistance(Curve=brep_plane_5.Curves, Distance=0.5)  # -> Points, Tangents, Parameters; disabled
entwine_5 = Entwine(
    Branch00=divide_distance_6.Points,
    Branch01=divide_distance_5.Points,
    Branch02=divide_distance_4.Points,
    FlattenInputs=True)  # disabled

# ---- group: Roof structure / Trækbånd / hhv. lodret og vandret mål
# hhv. lodret og vandret mål
forskyd_trækstænger_vandret_ved_vederlag = Slider(3, range=0..40)  # disabled
forskyd_trækstænger_lodret_ved_vederlag = Slider(1, range=0..40)  # disabled
forskyd_trækstænger_vandret_ved_vederlag_2 = Data(forskyd_trækstænger_vandret_ved_vederlag)  # disabled
forskyd_trækstænger_lodret_ved_vederlag_2 = Data(forskyd_trækstænger_lodret_ved_vederlag)  # disabled
forskyd_trækstænger_vandret_ved_vederlag_3 = Data(forskyd_trækstænger_vandret_ved_vederlag_2)  # disabled
forskyd_trækstænger_lodret_ved_vederlag_3 = Data(forskyd_trækstænger_lodret_ved_vederlag_2)  # disabled
forskyd_trækstænger_vandret_ved_vederlag_4 = Data(forskyd_trækstænger_vandret_ved_vederlag_3)  # disabled
forskyd_trækstænger_lodret_ved_vederlag_4 = Data(forskyd_trækstænger_lodret_ved_vederlag_3)  # disabled

# ---- group: Roof structure / Trækbånd
# Trækbånd
placering_trækbånd_i_af_sidehøjden = Slider(0.525, range=0..1)  # disabled
overgang_trækbånd_i_af_bredde_bue = Slider(0.165, range=0..1)  # disabled
skaler_stål_plader_til_trækbånd = Slider(1.449, range=0.1..2)  # disabled
overgang_trækbånd_i_af_bredde_bue_2 = Data(overgang_trækbånd_i_af_bredde_bue)  # disabled
placering_trækbånd_i_af_sidehøjden_2 = Data(placering_trækbånd_i_af_sidehøjden)  # disabled
skaler_stål_plader_til_trækbånd_2 = Data(skaler_stål_plader_til_trækbånd)  # disabled
forskyd_trækstænger_vandret_ved_vederlag_5 = Data(forskyd_trækstænger_vandret_ved_vederlag_4)  # disabled
forskyd_trækstænger_vandret_ved_vederlag_6 = Data(forskyd_trækstænger_vandret_ved_vederlag_4)  # disabled
forskyd_trækstænger_lodret_ved_vederlag_5 = Data(forskyd_trækstænger_lodret_ved_vederlag_4)  # disabled
forskyd_trækstænger_lodret_ved_vederlag_6 = Data(forskyd_trækstænger_lodret_ved_vederlag_4)  # disabled
forskyd_trækstænger_vandret_ved_vederlag_7 = Data(forskyd_trækstænger_vandret_ved_vederlag_5)  # disabled
forskyd_trækstænger_vandret_ved_vederlag_8 = Data(forskyd_trækstænger_vandret_ved_vederlag_6)  # disabled
forskyd_trækstænger_lodret_ved_vederlag_7 = Data(forskyd_trækstænger_lodret_ved_vederlag_5)  # disabled
forskyd_trækstænger_lodret_ved_vederlag_8 = Data(forskyd_trækstænger_lodret_ved_vederlag_6)  # disabled
overgang_trækbånd_i_af_bredde_bue_3 = Data(overgang_trækbånd_i_af_bredde_bue_2)  # disabled
placering_trækbånd_i_af_sidehøjden_3 = Data(placering_trækbånd_i_af_sidehøjden_2)  # disabled
skaler_stål_plader_til_trækbånd_3 = Data(skaler_stål_plader_til_trækbånd_2)  # disabled
forskyd_trækstænger_vandret_ved_vederlag_9 = Data(forskyd_trækstænger_vandret_ved_vederlag_7)  # disabled
forskyd_trækstænger_vandret_ved_vederlag_10 = Data(forskyd_trækstænger_vandret_ved_vederlag_8)  # disabled
forskyd_trækstænger_lodret_ved_vederlag_9 = Data(forskyd_trækstænger_lodret_ved_vederlag_7)  # disabled
forskyd_trækstænger_lodret_ved_vederlag_10 = Data(forskyd_trækstænger_lodret_ved_vederlag_8)  # disabled
overgang_trækbånd_i_af_bredde_bue_4 = Data(overgang_trækbånd_i_af_bredde_bue_3)  # disabled
placering_trækbånd_i_af_sidehøjden_4 = Data(placering_trækbånd_i_af_sidehøjden_3)  # disabled
skaler_stål_plader_til_trækbånd_4 = Data(skaler_stål_plader_til_trækbånd_3)  # disabled

# ---- group: sphere / metode med clash
box_array = BoxArray(
    Geometry=move.Geometry,
    Cell=move.Geometry,
    XCount=expr("x*2", radius_in_m),
    YCount=expr("x*2", radius_in_m),
    ZCount=expr("x*2", radius_in_m))  # -> Geometry, Transform; disabled
panel_5 = Panel("0.00000001")  # disabled
clash = Clash(FirstSet=deconstruct_brep.Faces, SecondSet=box_array.Geometry, Distance=panel_5, ResultLimit=10000)  # -> ClashCount, ClashPoints, ClashRadii, FirstIndex, SecondIndex; disabled
list_item_3 = ListItem(List=box_array.Geometry, Index=clash.SecondIndex, Wrap=True)  # disabled
volume = Volume(Geometry=list_item_3)  # -> Volume, Centroid; disabled

# ---- group: sphere / another method
collision_one_many = CollisionOneMany(Collider=box_array.Geometry, Obstacles=deconstruct_brep.Faces)  # -> Collision, Index; disabled
cull_pattern = CullPattern(List=box_array.Geometry, CullPattern=collision_one_many.Collision)  # disabled
volume_2 = Volume(Geometry=cull_pattern)  # -> Volume, Centroid; disabled

# ----
# umiddelbart virker det bedre at bare bruge koordinator uden de rundes af. Istedet for at lave et set, kan man bare lade minecraft sorter
number_slider_8 = Slider(6, range=0..25)  # disabled
number_slider_9 = Slider(6, range=0..25)  # disabled
number_slider_10 = Slider(0.83, range=0..25)  # disabled
number_slider_11 = Slider(32, range=0..50)  # disabled
number_slider_12 = Slider(25, range=0..25)  # disabled
number_slider_13 = Slider(8, range=0..25)  # disabled
number_slider_14 = Slider(1.027, range=0..2)  # disabled
number_slider_15 = Slider(3.11, range=0..25)  # disabled
number_slider_16 = Slider(19, range=0..100)  # disabled
number_slider_17 = Slider(5, range=0..5)  # disabled
number_slider_18 = Slider(25, range=0..25)  # disabled
_3d_supershape = _3DSupershape(
    UDivisions=number_slider_11,
    VDivisions=number_slider_12,
    MParameter=number_slider_13,
    AParameter=number_slider_14,
    BParameter=number_slider_10,
    N1Parameter=number_slider_15,
    N2Parameter=number_slider_16,
    N3Parameter=number_slider_17,
    ScaleParameter=number_slider_18,
    D1Interval=Domain(-3.141592654, 3.141592654),
    D2Interval=Domain(-1.570796327, 1.570796327))  # disabled
bounding_box_3 = BoundingBox(Content=_3d_supershape, Plane=PlaneXY(0, 0, 0))  # -> Box, Box_2; disabled
deconstruct_brep_4 = DeconstructBrep(Brep=bounding_box_3.Box)  # -> Faces, Edges, Vertices; disabled
sort_points_4 = SortPoints(Points=deconstruct_brep_4.Vertices)  # -> Points, Indices; disabled
list_length_2 = ListLength(List=sort_points_4.Points)  # disabled
list_item_4 = ListItem(List=sort_points_4.Points, Index=expr("x-1", list_length_2), Wrap=False)  # disabled
move_9 = Move(Geometry=_3d_supershape, Motion=list_item_4)  # -> Geometry, Transform; disabled
construct_point_6 = ConstructPoint(XCoordinate=0, YCoordinate=0, ZCoordinate=0)  # disabled
number_slider_19 = Slider(350, range=0..2000)  # disabled
divide_surface = DivideSurface(Surface=move_9.Geometry, UCount=number_slider_19, VCount=number_slider_19)  # -> Points, Normals, Parameters; disabled

# ---- group: Find nearest point
deconstruct = Deconstruct(Point=flatten(divide_surface.Points))  # -> XComponent, YComponent, ZComponent; disabled
round_3 = Round(Number=deconstruct.XComponent)  # -> Nearest, Floor, Ceiling; disabled
round_4 = Round(Number=deconstruct.YComponent)  # -> Nearest, Floor, Ceiling; disabled
round_5 = Round(Number=deconstruct.ZComponent)  # -> Nearest, Floor, Ceiling; disabled
construct_point_7 = ConstructPoint(XCoordinate=round_3.Nearest, YCoordinate=round_4.Nearest, ZCoordinate=round_5.Nearest)  # disabled
create_set = CreateSet(List=construct_point_7)  # -> Set, Map; disabled

# ----
unit_z_4 = UnitZ(Factor="1")
unit_y_3 = UnitY(Factor="1")
unit_x_3 = UnitX(Factor="1")

data_2 = Data([Point(69, 77, 13), Point(68, 77, 13), Point(68, 77, 12), Point(67, 77, 11), Point(66, 77, 10), Point(66, 77, 9)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])
group_toggle_4 = GroupToggle(ToggleActive=True, ToggleVisible=False)  # disabled

# ---- group: Generate .mcfunction setblock command
deconstruct_2 = Deconstruct(Point=flatten(data_2))  # -> XComponent, YComponent, ZComponent
concatenate = Concatenate(
    Fragment_A="setblock ~",
    Fragment_B=deconstruct_2.XComponent,
    A=" ~",
    B=deconstruct_2.ZComponent,
    C=" ~",
    D=deconstruct_2.YComponent,
    E=" acacia_log")
copy_paste_this_into_mcfunction_file = Panel(concatenate)

# ---- group: hyperbolig tower with ramp
# Generate 1/2 of the hyperboloid, then  rotate it 180 degrees in the xy plane and then join the two halves.
# The variation in slope is quite small!
# Join the projected curve and its rotated version to get a
# spiral along the entire hyperboloid
# Calculate a constant based on the two radii and the winding number.
# The fancy expression is another form of inverse cosh because
# Grasshopper does not have its own.
# We need this constant so the spiral in the xy plane fits between the two radii.
# Generate the hyperbolic cosh function to make a spiral in the xy plane.
# The points on the spiral are then projected onto the top half of the hyperboloid.
total_number_of_winds = Slider(8, range=0..20)  # disabled
small_radius = Slider(9.321, range=0..100)  # disabled
panel_6 = Panel("2")  # disabled
division = Division(A=total_number_of_winds, B=2)  # disabled
number_slider_20 = Slider(25, range=0..150)  # disabled
number_slider_21 = Slider(60, range=0..150)  # disabled
division_2 = Division(A=number_slider_21, B=panel_6)  # disabled
subtraction = Subtraction(A=number_slider_20, B=panel_6)  # disabled
division_3 = Division(A=subtraction, B=small_radius)  # disabled
number_slider_22 = Slider(600, range=0..2000)  # disabled
pi = Number(3.141592654)  # disabled
expression = Expression(x=division_3, Expression="ln(x + sqrt(x^2 -1))")  # disabled
multiplication_3 = Multiplication(A=total_number_of_winds, B=pi)  # disabled
hops = Hops(
    HeightM=number_slider_21,
    RadiusTopM=number_slider_20,
    RadiusBottomM=number_slider_20,
    FoundationsAmount=17,
    RotationSectionsAmount=6,
    TopBeamRadiusM=0.19149,
    ColumnsRadiusM=0.19149,
    CacheResultsInMemory=True,
    CacheSolveResults=True,
    RemoteDefinitionLocation="C:\Users\DBO\OC Engineering ApS\Ressourcer - Software and coding\Grasshopper og Rhino\GH_HopsFunctions\SHAPE_HyperbolicTowerWithColumns.gh",
    RemoteSolveVersion=(0, 1, 0),
    ShowInput_Enabled=False,
    ShowInput_Path=False,
    SynchronousSolve=True)  # -> CenterlineTopBeam, CenterLinesColumns, TopBeam, Columns; disabled
range = Range(Domain=Domain(0, 1), Steps=number_slider_22)  # disabled
division_4 = Division(A=expression, B=multiplication_3)  # disabled
divide_length_3 = DivideLength(Curve=hops.CenterlineTopBeam, Length=0.5)  # -> Points, Tangents, Parameters; disabled
divide_length_4 = DivideLength(Curve=hops.CenterLinesColumns, Length=0.5)  # -> Points, Tangents, Parameters; disabled
X = UnitX(Factor=1)  # disabled
unit_z_5 = UnitZ(Factor=division_2)  # disabled
construct_point_8 = ConstructPoint(XCoordinate=0, YCoordinate=0, ZCoordinate=0)  # disabled
number_slider_23 = Slider(3, range=0..15)  # disabled
xz_plane_3 = XZPlane(Origin=Point(0, 0, 0))  # disabled
yz_plane_3 = YZPlane(Origin=Point(0, 0, 0))  # disabled
plane_plane = PlanePlane(PlaneA=xz_plane_3, PlaneB=yz_plane_3)  # disabled
entwine_6 = Entwine(Branch00=divide_length_3.Points, Branch01=divide_length_4.Points, FlattenInputs=True)  # disabled

dom = ConstructDomain(DomainStart=small_radius, DomainEnd=subtraction)  # disabled
expression_2 = Expression(x=division_2, y=division_3, Expression="x/sqrt((y)^2 -1)")  # disabled
range_2 = Range(Domain=dom, Steps=number_slider_22)  # disabled
division_5 = Division(A=range_2, B=small_radius)  # disabled
expression_3 = Expression(x=division_5, y=expression_2, Expression="y*sqrt((x^2 -1))")  # disabled
pt = ConstructPoint(XCoordinate=range_2, YCoordinate=0, ZCoordinate=expression_3)  # disabled
intcrv = Interpolate(Vertices=pt, Degree=3, Periodic=False, KnotStyle=1)  # -> Curve, Length, Domain; disabled
Z = UnitZ(Factor=1)  # disabled
line_5 = LineSDL(Start=Z, Direction=Vector(0, 0, 1), Length=1)  # disabled
revsrf = Revolution(Curve=intcrv.Curve, Axis=line_5, Domain=Domain(0, 6.283185307))  # disabled
rot3d = Rotate3D(Geometry=revsrf, Angle=3.141592654, Center=Point(0, 0, 0), Axis=X)  # -> Geometry, Transform; disabled
join = BrepJoin(Breps=[revsrf, rot3d.Geometry])  # -> Breps, Closed; disabled

multiplication_4 = Multiplication(A=range, B=multiplication_3)  # disabled
expression_4 = Expression(x=multiplication_4, y=small_radius, z=division_4, Expression="y*cosh(z*x)")  # disabled
division_6 = Division(A=expression_4, B=small_radius)  # disabled
pt_2 = PointCylindrical(BasePlane=PlaneXY(0, 0, 0), Angle=multiplication_4, Radius=expression_4, Elevation=0)  # disabled
expression_5 = Expression(x=division_6, y=expression_2, Expression="y*sqrt((x^2 -1))")  # disabled
intcrv_2 = Interpolate(Vertices=pt_2, Degree=3, Periodic=False, KnotStyle=1)  # -> Curve, Length, Domain; disabled
pt_3 = PointCylindrical(BasePlane=PlaneXY(0, 0, 0), Angle=multiplication_4, Radius=expression_4, Elevation=expression_5)  # disabled
intcrv_3 = Interpolate(Vertices=pt_3, Degree=3, Periodic=False, KnotStyle=1)  # -> Curve, Length, Domain; disabled

rot3d_2 = Rotate3D(Geometry=intcrv_3.Curve, Angle=3.141592654, Center=Point(0, 0, 0), Axis=X)  # -> Geometry, Transform; disabled
join_2 = JoinCurves(Curves=[rot3d_2.Geometry, intcrv_3.Curve], Preserve=False)  # disabled
pipe = Pipe(Curve=join_2, Radius=1, Caps=0)  # disabled
move_10 = Move(Geometry=join_2, Motion=unit_z_5)  # -> Geometry, Transform; disabled
divide_length_5 = DivideLength(Curve=move_10.Geometry, Length=0.5)  # -> Points, Tangents, Parameters; disabled
move_away_from = MoveAwayFrom(Geometry=divide_length_5.Points, Emitter=plane_plane, Distance=expr("x*-1", number_slider_23))  # -> Geometry, Transform; disabled
line_6 = Line(StartPoint=divide_length_5.Points, EndPoint=move_away_from.Geometry)  # disabled
divide_length_6 = DivideLength(Curve=line_6, Length=0.5)  # -> Points, Tangents, Parameters; disabled

divide = DivideCurve(Curve=join_2, Count=1000, Kinks=False)  # -> Points, Tangents, Parameters; disabled
devec = DeconstructVector(Vector=divide.Tangents)  # -> XComponent, YComponent, ZComponent; disabled
bnd = Bounds(Numbers=devec.ZComponent)  # disabled
bar_graph = BarGraph(devec.ZComponent, BarColor=RGB(255, 0, 90))  # disabled
graph = QuickGraph(devec.ZComponent, SortOrder=0)  # disabled
panel_7 = Panel(bnd)  # disabled

# ---- group: Roof structure
# Spænd er 18 m
# Radius er 18m
# 
# ca. tjek op på præcise mål
# OBS: Mål er fra elementers centerlinjer.
# 
# Kan justification måske ændres??
# 
# eventuelt offset med en halv dimension
# Skal være lige antal, der placeres skråbånd på hver anden tagåse på nær de 2 yderste. angiver antal mellemrum, dvs. 20 = 21 tagåser
forskyder_knudepunkt_hvor_tværstænger_kr = Slider(0, range=0..15)  # "Forskyder knudepunkt hvor tværstænger krydser"; disabled
antal_lodstænger_til_trækbånd = Slider(4, range=0..10)  # disabled
forskyd_lodposter_vandret_1_2_profil_høj = Slider(2, range=0..200)  # "Forskyd lodposter vandret (1/2 profil højde)"; disabled
radius_øverste_flange_mm = Slider(200, range=0..200)  # disabled
højde_samlet_bue_mm = Slider(10, range=0..30)  # disabled
forskyder_tagåser_ved_tagfod = Slider(0, range=0..20)  # disabled
længde_af_forskydningsfelt_mm = Slider(18, range=0..75)  # disabled
lodret_højde_sider_mm = Slider(6, range=0..25)  # disabled
yderste_mål_mm = Slider(200, range=0..200)  # disabled
eventuel_scalering = Panel("1")  # disabled
fag_længde = Slider(50, range=0..50)  # disabled
antal_knuder_i_gitter = Slider(24, range=0..100)  # disabled
antal_tagåser = Slider(20, range=0..60)  # disabled
antal_fag = Slider(6, range=0..10)  # disabled
construct_point_9 = ConstructPoint(XCoordinate=0, YCoordinate=0, ZCoordinate=0)  # disabled
construct_point_10 = ConstructPoint(XCoordinate=0, YCoordinate=yderste_mål_mm, ZCoordinate=0)  # disabled
line_7 = Line(StartPoint=construct_point_9, EndPoint=construct_point_10)  # disabled
series_3 = Series(Start=0, Step=fag_længde, Count=antal_fag)  # disabled
unit_x_4 = UnitX(Factor=series_3)  # disabled
move_11 = Move(Geometry=line_7, Motion=unit_x_4)  # -> Geometry, Transform; disabled
multiplication_5 = Multiplication(A=forskyder_knudepunkt_hvor_tværstænger_kr, B=2)  # disabled
surface_divison = Slider(9, range=0..20)  # disabled

# ---- group: Roof structure / Basic geometry, and top flange move to 0,0,x,
# Basic geometry, and top flange move to 0,0,x,
# Then θ, the angle between the radii going to the two points is given by
# θ=2×sin−1(D/2R)
# 
# Hvor D er spænd og R er radius, forudsætter punkter er i linje med hinanden
A = Data(radius_øverste_flange_mm)  # disabled
factor = Data(lodret_højde_sider_mm)  # disabled
B = Data(eventuel_scalering)  # disabled
A_2 = Data(yderste_mål_mm)  # disabled
A_3 = Data(A)  # disabled
factor_2 = Data(factor)  # disabled
B_2 = Data(B)  # disabled
A_4 = Data(A_2)  # disabled
A_5 = Data(A_3)  # disabled
factor_3 = Data(factor_2)  # disabled
B_3 = Data(B_2)  # disabled
A_6 = Data(A_4)  # disabled
multiplication_6 = Multiplication(A=A_5, B=B_3)  # disabled
multiplication_7 = Multiplication(A=A_6, B=B_3)  # disabled
multiplication_8 = Multiplication(A=multiplication_6, B=2)  # disabled
division_7 = Division(A=multiplication_7, B=multiplication_8)  # disabled
arcsine = ArcSine(Value=division_7)  # disabled
construct_point_11 = ConstructPoint(XCoordinate=0, YCoordinate=0, ZCoordinate=0)  # disabled
multiplication_9 = Multiplication(A=arcsine, B=2)  # disabled
arc = Arc(Plane=construct_point_11, Radius=multiplication_6, Angle=multiplication_9)  # -> Arc, Length; disabled
xy_plane_3 = XYPlane(Origin=Point(0, 0, 0))  # disabled
circle = Circle(Plane=construct_point_11, Radius=multiplication_6)  # disabled
rotate = Rotate(Geometry=arc.Arc, Angle=expr("((x/2)*-1)+0.5*pi", multiplication_9), Plane=xy_plane_3)  # -> Geometry, Transform; disabled
yz_plane_4 = YZPlane(Origin=Point(0, 0, 0))  # disabled
rotate_2 = Rotate(Geometry=rotate.Geometry, Angle=1.570796327, Plane=yz_plane_4)  # -> Geometry, Transform; disabled
end_points_2 = EndPoints(Curve=rotate_2.Geometry)  # -> Start, End; disabled
move_12 = Move(Geometry=rotate_2.Geometry, Motion=expr("x*-1", end_points_2.End))  # -> Geometry, Transform; disabled
rotate_3 = Rotate(Geometry=move_12.Geometry, Angle=1.570796327, Plane=xy_plane_3)  # -> Geometry, Transform; disabled
unit_z_6 = UnitZ(Factor=factor_3)  # disabled
flytter_buen_i_z_retning_så_der_kun_arbe = Move(Geometry=rotate_3.Geometry, Motion=unit_z_6)  # -> Geometry, Transform; "Flytter buen i Z retning så der kun arbejdes med positive tal"; disabled
geometry = Data(flytter_buen_i_z_retning_så_der_kun_arbe.Geometry)  # disabled
plane = Data(xy_plane_3)  # disabled
geometry_2 = Data(geometry)  # disabled
plane_2 = Data(plane)  # disabled
geometry_3 = Data(geometry_2)  # disabled
plane_3 = Data(plane_2)  # disabled

# ----
list_length_3 = ListLength(List=move_11.Geometry)  # disabled

# ---- group: Roof structure / Laver top arch i alle grid lines, placeret i positivt xy koordinat sys
# Laver top arch i alle grid lines, placeret i positivt xy koordinat sys
curve = Data(move_11.Geometry)  # disabled
curve_2 = Data(geometry_3)  # disabled
plane_4 = Data(plane_3)  # disabled
curve_3 = Data(curve)  # disabled
curve_4 = Data(curve_2)  # disabled
plane_5 = Data(plane_4)  # disabled
curve_5 = Data(curve_4)  # disabled
plane_6 = Data(plane_5)  # disabled
end_points_3 = EndPoints(Curve=curve_3)  # -> Start, End; disabled
list_item_5 = ListItem(List=end_points_3.End, Index=0, Wrap=True)  # disabled
shift_list_2 = ShiftList(List=end_points_3.End, Shift=1, Wrap=False)  # disabled
distance = Distance(PointA=list_item_5, PointB=shift_list_2)  # disabled
distance_2 = Distance(PointA=end_points_3.End, PointB=shift_list_2)  # disabled
list_length_4 = ListLength(List=distance)  # disabled
subtraction_2 = Subtraction(A=list_length_4, B=2)  # disabled
sub_list = SubList(List=distance, Domain=subtraction_2, Wrap=False)  # -> List, Index; disabled
offset_curve = OffsetCurve(Curve=curve_5, Distance=expr("x*-1", sub_list.List), Plane=plane_6, Corners=1)  # disabled
deconstruct_arc = DeconstructArc(Arc=offset_curve)  # -> BasePlane, Radius, Angle; disabled
arc_2 = Arc(Plane=deconstruct_arc.BasePlane, Radius=deconstruct_arc.Radius, Angle=deconstruct_arc.Angle)  # -> Arc, Length; disabled
base_plane = Data(deconstruct_arc.BasePlane)  # disabled
distance_3 = Data(distance_2)  # disabled
arc_3 = Data(arc_2.Arc)  # disabled
radius = Data(deconstruct_arc.Radius)  # disabled
base_plane_2 = Data(base_plane)  # disabled
distance_4 = Data(distance_3)  # disabled
arc_4 = Data(arc_3)  # disabled
radius_2 = Data(radius)  # disabled
base_plane_3 = Data(base_plane_2)  # disabled
distance_5 = Data(distance_4)  # disabled
arc_5 = Data(arc_4)  # disabled
radius_3 = Data(radius_2)  # disabled

# ----
list_item_6 = ListItem(List=move_11.Geometry, Index=expr("x-1", list_length_3), Wrap=True)  # disabled

# ---- group: Roof structure / Vertical posts side
# Vertical posts side
B_4 = Data(lodret_højde_sider_mm)  # disabled
curve_6 = Data(arc_5)  # disabled
B_5 = Data(B_4)  # disabled
curve_7 = Data(curve_6)  # disabled
B_6 = Data(B_5)  # disabled
curve_8 = Data(curve_7)  # disabled
end_points_4 = EndPoints(Curve=curve_8)  # -> Start, End; disabled
deconstruct_3 = Deconstruct(Point=end_points_4.Start)  # -> XComponent, YComponent, ZComponent; disabled
deconstruct_4 = Deconstruct(Point=end_points_4.End)  # -> XComponent, YComponent, ZComponent; disabled
subtraction_3 = Subtraction(A=deconstruct_3.ZComponent, B=B_6)  # disabled
subtraction_4 = Subtraction(A=deconstruct_4.ZComponent, B=B_6)  # disabled
construct_point_12 = ConstructPoint(XCoordinate=deconstruct_3.XComponent, YCoordinate=deconstruct_3.YComponent, ZCoordinate=subtraction_3)  # disabled
construct_point_13 = ConstructPoint(XCoordinate=deconstruct_4.XComponent, YCoordinate=deconstruct_4.YComponent, ZCoordinate=subtraction_4)  # disabled
line_8 = Line(StartPoint=end_points_4.Start, EndPoint=construct_point_12)  # disabled
line_9 = Line(StartPoint=end_points_4.End, EndPoint=construct_point_13)  # disabled
curve_9 = Curve([line_8, line_9])  # disabled
point = Data(construct_point_12)  # disabled
line_10 = Data(line_8)  # disabled
line_11 = Data(line_9)  # disabled
point_2 = Data(construct_point_13)  # disabled
point_3 = Data(point)  # disabled
line_12 = Data(line_10)  # disabled
line_13 = Data(line_11)  # disabled
point_4 = Data(point_2)  # disabled
point_5 = Data(point_3)  # disabled
line_14 = Data(line_12)  # disabled
line_15 = Data(line_13)  # disabled
point_6 = Data(point_4)  # disabled

# ---- group: Roof structure / Bottom flange
# Bottom flange
factor_4 = Data(højde_samlet_bue_mm)  # disabled
start_point = Data(point_5)  # disabled
end_point = Data(point_6)  # disabled
curve_10 = Data(arc_5)  # disabled
factor_5 = Data(factor_4)  # disabled
start_point_2 = Data(start_point)  # disabled
end_point_2 = Data(end_point)  # disabled
curve_11 = Data(curve_10)  # disabled
factor_6 = Data(factor_5)  # disabled
start_point_3 = Data(start_point_2)  # disabled
end_point_3 = Data(end_point_2)  # disabled
curve_12 = Data(curve_11)  # disabled
unit_z_7 = UnitZ(Factor=factor_6)  # disabled
offset_curve_2 = OffsetCurve(Curve=curve_12, Distance=expr("x*-1", unit_z_7), Corners=1)  # disabled
divide_curve = DivideCurve(Curve=offset_curve_2, Count=3, Kinks=False)  # -> Points, Tangents, Parameters; disabled
deconstruct_arc_2 = DeconstructArc(Arc=offset_curve_2)  # -> BasePlane, Radius, Angle; disabled
line_16 = Line(StartPoint=start_point_3, EndPoint=end_point_3)  # disabled
arc_6 = Arc(Plane=deconstruct_arc_2.BasePlane, Radius=deconstruct_arc_2.Radius, Angle=Domain(0, 6.283185307))  # -> Arc, Length; disabled
curve_line = CurveLine(Curve=arc_6.Arc, Line=line_16)  # -> Points, Params, Count; disabled
deconstruct_5 = Deconstruct(Point=curve_line.Points)  # -> XComponent, YComponent, ZComponent; disabled
sort_list = SortList(Keys=deconstruct_5.YComponent, ValuesValuesA=curve_line.Points)  # -> Keys, ValuesValuesA; disabled
list_item_7 = ListItem(List=sort_list.ValuesValuesA, Index=1, Wrap=True)  # disabled
list_item_8 = ListItem(List=sort_list.ValuesValuesA, Index=0, Wrap=True)  # disabled
list_item_9 = ListItem(List=divide_curve.Points, Index=1, Wrap=True)  # disabled
arc_3pt = Arc3Pt(PointA=list_item_7, PointB=list_item_9, PointC=list_item_8)  # -> Arc, Plane, Radius; disabled
shift_paths = ShiftPaths(Data=arc_3pt.Arc, Offset=-2)  # disabled
i = Data(list_item_7)  # disabled
data_3 = Data(shift_paths)  # disabled
i_2 = Data(list_item_8)  # disabled
i_3 = Data(i)  # disabled
data_4 = Data(data_3)  # disabled
i_4 = Data(i_2)  # disabled
i_5 = Data(i_3)  # disabled
data_5 = Data(data_4)  # disabled
i_6 = Data(i_4)  # disabled

# ---- group: Roof structure / Trækbånd, midter del
# Trækbånd, midter del
B_7 = Data(overgang_trækbånd_i_af_bredde_bue_4)  # disabled
B_8 = Data(placering_trækbånd_i_af_sidehøjden_4)  # disabled
A_7 = Data(lodret_højde_sider_mm)  # disabled
A_8 = Data(yderste_mål_mm)  # disabled
curve_13 = Data(line_14)  # disabled
curve_14 = Data(line_15)  # disabled
B_9 = Data(B_7)  # disabled
B_10 = Data(B_8)  # disabled
A_9 = Data(A_7)  # disabled
A_10 = Data(A_8)  # disabled
curve_15 = Data(curve_13)  # disabled
curve_16 = Data(curve_14)  # disabled
B_11 = Data(B_9)  # disabled
B_12 = Data(B_10)  # disabled
A_11 = Data(A_9)  # disabled
A_12 = Data(A_10)  # disabled
curve_17 = Data(curve_15)  # disabled
curve_18 = Data(curve_16)  # disabled
multiplication_10 = Multiplication(A=A_11, B=B_12)  # disabled
divide_distance_7 = DivideDistance(Curve=curve_18, Distance=multiplication_10)  # -> Points, Tangents, Parameters; disabled
divide_distance_8 = DivideDistance(Curve=curve_17, Distance=multiplication_10)  # -> Points, Tangents, Parameters; disabled
list_item_10 = ListItem(List=divide_distance_7.Points, Index=expr("1", 0), Wrap=True)  # disabled
list_item_11 = ListItem(List=divide_distance_8.Points, Index=expr("1", 0), Wrap=True)  # disabled
deconstruct_6 = Deconstruct(Point=list_item_10)  # -> XComponent, YComponent, ZComponent; disabled
deconstruct_7 = Deconstruct(Point=list_item_11)  # -> XComponent, YComponent, ZComponent; disabled
multiplication_11 = Multiplication(A=A_12, B=B_11)  # disabled
division_8 = Division(A=multiplication_11, B=2)  # disabled
subtraction_5 = Subtraction(A=deconstruct_7.YComponent, B=division_8)  # disabled
addition = Addition(A=deconstruct_6.YComponent, B=division_8)  # disabled
construct_point_14 = ConstructPoint(XCoordinate=deconstruct_7.XComponent, YCoordinate=subtraction_5, ZCoordinate=deconstruct_7.ZComponent)  # disabled
construct_point_15 = ConstructPoint(XCoordinate=deconstruct_6.XComponent, YCoordinate=addition, ZCoordinate=deconstruct_6.ZComponent)  # disabled
line_17 = Line(StartPoint=construct_point_14, EndPoint=construct_point_15)  # disabled
point_7 = Data(construct_point_14)  # disabled
i_7 = Data(list_item_11)  # disabled
line_18 = Data(line_17)  # disabled
i_8 = Data(list_item_10)  # disabled
point_8 = Data(construct_point_15)  # disabled
point_9 = Data(point_7)  # disabled
i_9 = Data(i_7)  # disabled
line_19 = Data(line_18)  # disabled
i_10 = Data(i_8)  # disabled
point_10 = Data(point_8)  # disabled
point_11 = Data(point_9)  # disabled
i_11 = Data(i_9)  # disabled
line_20 = Data(line_19)  # disabled
i_12 = Data(i_10)  # disabled
point_12 = Data(point_10)  # disabled

# ---- group: Roof structure / Trækbånd sider
# Trækbånd sider
distance_6 = Data(forskyd_trækstænger_vandret_ved_vederlag_9)  # disabled
distance_7 = Data(forskyd_trækstænger_vandret_ved_vederlag_10)  # disabled
distance_8 = Data(forskyd_trækstænger_lodret_ved_vederlag_10)  # disabled
distance_9 = Data(forskyd_trækstænger_lodret_ved_vederlag_9)  # disabled
start_point_4 = Data(i_11)  # disabled
start_point_5 = Data(i_12)  # disabled
end_point_4 = Data(point_11)  # disabled
end_point_5 = Data(point_12)  # disabled
distance_10 = Data(distance_6)  # disabled
distance_11 = Data(distance_7)  # disabled
distance_12 = Data(distance_8)  # disabled
distance_13 = Data(distance_9)  # disabled
start_point_6 = Data(start_point_4)  # disabled
start_point_7 = Data(start_point_5)  # disabled
end_point_6 = Data(end_point_4)  # disabled
end_point_7 = Data(end_point_5)  # disabled
distance_14 = Data(distance_10)  # disabled
distance_15 = Data(distance_11)  # disabled
distance_16 = Data(distance_12)  # disabled
distance_17 = Data(distance_13)  # disabled
start_point_8 = Data(start_point_6)  # disabled
start_point_9 = Data(start_point_7)  # disabled
end_point_8 = Data(end_point_6)  # disabled
end_point_9 = Data(end_point_7)  # disabled
distance_18 = Data([distance_16, distance_17])  # disabled
distance_19 = Data([distance_14, distance_15])  # disabled
start_point_10 = Data(start_point_8)  # disabled
start_point_11 = Data(start_point_9)  # disabled
end_point_10 = Data(end_point_8)  # disabled
end_point_11 = Data(end_point_9)  # disabled
line_21 = Line(StartPoint=start_point_11, EndPoint=end_point_11)  # disabled
line_22 = Line(StartPoint=start_point_10, EndPoint=end_point_10)  # disabled
offset_curve_3 = OffsetCurve(Curve=line_21, Distance=expr("x*-1", distance_19), Corners=1)  # disabled
offset_curve_4 = OffsetCurve(Curve=line_21, Distance=expr("x*-1", distance_19), Corners=1)  # disabled
offset_curve_5 = OffsetCurve(Curve=line_21, Distance=distance_19, Corners=1)  # disabled
offset_curve_6 = OffsetCurve(Curve=line_21, Distance=distance_19, Corners=1)  # disabled
offset_curve_7 = OffsetCurve(Curve=line_22, Distance=expr("x*-1", distance_19), Corners=1)  # disabled
offset_curve_8 = OffsetCurve(Curve=line_22, Distance=expr("x*-1", distance_19), Corners=1)  # disabled
offset_curve_9 = OffsetCurve(Curve=line_22, Distance=distance_19, Corners=1)  # disabled
offset_curve_10 = OffsetCurve(Curve=line_22, Distance=distance_19, Corners=1)  # disabled
yz_plane_5 = YZPlane(Origin=Point(0, 0, 0))  # disabled
yz_plane_6 = YZPlane(Origin=Point(0, 0, 0))  # disabled
offset_curve_11 = OffsetCurve(Curve=offset_curve_10, Distance=expr("x*-1", distance_18), Plane=yz_plane_6, Corners=1)  # disabled
offset_curve_12 = OffsetCurve(Curve=offset_curve_6, Distance=expr("x*-1", distance_18), Plane=yz_plane_5, Corners=1)  # disabled
offset_curve_13 = OffsetCurve(Curve=offset_curve_4, Distance=expr("x*-1", distance_18), Plane=yz_plane_5, Corners=1)  # disabled
offset_curve_14 = OffsetCurve(Curve=offset_curve_5, Distance=distance_18, Plane=yz_plane_5, Corners=1)  # disabled
offset_curve_15 = OffsetCurve(Curve=offset_curve_3, Distance=distance_18, Plane=yz_plane_5, Corners=1)  # disabled
offset_curve_16 = OffsetCurve(Curve=offset_curve_8, Distance=expr("x*-1", distance_18), Plane=yz_plane_6, Corners=1)  # disabled
offset_curve_17 = OffsetCurve(Curve=offset_curve_9, Distance=distance_18, Plane=yz_plane_6, Corners=1)  # disabled
offset_curve_18 = OffsetCurve(Curve=offset_curve_7, Distance=distance_18, Plane=yz_plane_6, Corners=1)  # disabled
curve_19 = Curve([offset_curve_11, offset_curve_17, offset_curve_18, offset_curve_16, offset_curve_13, offset_curve_15, offset_curve_14, offset_curve_12])  # disabled
curve_20 = Data(offset_curve_16)  # disabled
curve_21 = Data(offset_curve_18)  # disabled
curve_22 = Data(offset_curve_17)  # disabled
curve_23 = Data(offset_curve_11)  # disabled
curve_24 = Data(curve_19)  # disabled
curve_25 = Data(offset_curve_13)  # disabled
curve_26 = Data(offset_curve_15)  # disabled
curve_27 = Data(offset_curve_14)  # disabled
curve_28 = Data(offset_curve_12)  # disabled
curve_29 = Data(curve_20)  # disabled
curve_30 = Data(curve_21)  # disabled
curve_31 = Data(curve_22)  # disabled
curve_32 = Data(curve_23)  # disabled
curve_33 = Data(curve_24)  # disabled
curve_34 = Data(curve_25)  # disabled
curve_35 = Data(curve_26)  # disabled
curve_36 = Data(curve_27)  # disabled
curve_37 = Data(curve_28)  # disabled
curve_38 = Data(curve_29)  # disabled
curve_39 = Data(curve_30)  # disabled
curve_40 = Data(curve_31)  # disabled
curve_41 = Data(curve_32)  # disabled
curve_42 = Data(curve_33)  # disabled
curve_43 = Data(curve_34)  # disabled
curve_44 = Data(curve_35)  # disabled
curve_45 = Data(curve_36)  # disabled
curve_46 = Data(curve_37)  # disabled
curve_47 = Data(curve_38)  # disabled
curve_48 = Data(curve_39)  # disabled
curve_49 = Data(curve_40)  # disabled
curve_50 = Data(curve_41)  # disabled
curve_51 = Data(curve_42)  # disabled
curve_52 = Data(curve_43)  # disabled
curve_53 = Data(curve_44)  # disabled
curve_54 = Data(curve_45)  # disabled
curve_55 = Data(curve_46)  # disabled

# ---- group: Roof structure / Forskyder ift. flange tykkelse
# Forskyder ift. flange tykkelse
B_13 = Data(forskyd_lodposter_vandret_1_2_profil_høj)  # disabled
B_14 = Data(B_13)  # disabled
B_15 = Data(B_14)  # disabled
simplify_tree = SimplifyTree(Front=False)  # disabled
tree_branch = TreeBranch(Tree=simplify_tree, Path="{0}", MaintainPaths=True)  # disabled
brep_edges = BrepEdges(Brep=tree_branch)  # -> Naked, Interior, NonManifold; disabled
length = Length(Curve=brep_edges.Interior)  # disabled
list_item_12 = ListItem(List=length, Index=1, Wrap=True)  # disabled
division_9 = Division(A=list_item_12, B=2)  # disabled
addition_2 = Addition(A=division_9, B=B_15)  # disabled
integer = Integer(addition_2)  # disabled
integer_2 = Data(integer)  # disabled
integer_3 = Data(integer_2)  # disabled
integer_4 = Data(integer_3)  # disabled

# ---- group: Roof structure / Make sub arches and points for connecting braces
# Make sub arches and points for connecting braces
distance_20 = Data(forskyder_knudepunkt_hvor_tværstænger_kr)  # disabled
B_16 = Data(længde_af_forskydningsfelt_mm)  # disabled
count = Data(antal_knuder_i_gitter)  # disabled
base_curve = Data(data_5)  # disabled
curve_56 = Data(arc_5)  # disabled
curve_57 = Data(data_5)  # disabled
distance_21 = Data(distance_20)  # disabled
B_17 = Data(B_16)  # disabled
count_2 = Data(count)  # disabled
base_curve_2 = Data(base_curve)  # disabled
curve_58 = Data(curve_56)  # disabled
curve_59 = Data(curve_57)  # disabled
distance_22 = Data(distance_21)  # disabled
B_18 = Data(B_17)  # disabled
count_3 = Data(count_2)  # disabled
base_curve_3 = Data(base_curve_2)  # disabled
curve_60 = Data(curve_58)  # disabled
curve_61 = Data(curve_59)  # disabled
curve_domain = CurveDomain(Curve=[curve_61, curve_60])  # -> Curve, Domain; disabled
deconstruct_domain = DeconstructDomain(Domain=curve_domain.Domain)  # -> Start, End; disabled
addition_3 = Addition(A=deconstruct_domain.Start, B=B_18)  # disabled
subtraction_6 = Subtraction(A=deconstruct_domain.End, B=B_18)  # disabled
construct_domain = ConstructDomain(DomainStart=addition_3, DomainEnd=subtraction_6)  # disabled
sub_curve = SubCurve(BaseCurve=[base_curve_3, curve_60], Domain=construct_domain)  # disabled
list_item_13 = ListItem(List=sub_curve, Index=0, Wrap=True)  # disabled
list_item_14 = ListItem(List=sub_curve, Index=expr("1", 0), Wrap=True)  # disabled
offset_curve_19 = OffsetCurve(Curve=list_item_14, Distance=expr("-x", distance_22), Corners=1)  # disabled
offset_curve_20 = OffsetCurve(Curve=list_item_13, Distance=distance_22, Corners=1)  # disabled
divide_curve_2 = DivideCurve(Curve=[offset_curve_20, offset_curve_19], Count=count_3, Kinks=False)  # -> Points, Tangents, Parameters; disabled
parameters = Data(divide_curve_2.Parameters)  # disabled
result = Data(addition_3)  # disabled
domain = Data(curve_domain.Domain)  # disabled
result_2 = Data(subtraction_6)  # disabled
points = Data(divide_curve_2.Points)  # disabled
parameters_2 = Data(parameters)  # disabled
domain_2 = Data(domain)  # disabled
result_3 = Data(result)  # disabled
result_4 = Data(result_2)  # disabled
points_2 = Data(points)  # disabled
parameters_3 = Data(parameters_2)  # disabled
domain_3 = Data(domain_2)  # disabled
result_5 = Data(result_3)  # disabled
result_6 = Data(result_4)  # disabled
points_3 = Data(points_2)  # disabled

# ---- group: Roof structure / horizontal posts side
# horizontal posts side
start_point_12 = Data(point_6)  # disabled
start_point_13 = Data(point_5)  # disabled
end_point_12 = Data(i_6)  # disabled
end_point_13 = Data(i_5)  # disabled
start_point_14 = Data(start_point_12)  # disabled
start_point_15 = Data(start_point_13)  # disabled
end_point_14 = Data(end_point_12)  # disabled
end_point_15 = Data(end_point_13)  # disabled
start_point_16 = Data(start_point_14)  # disabled
start_point_17 = Data(start_point_15)  # disabled
end_point_16 = Data(end_point_14)  # disabled
end_point_17 = Data(end_point_15)  # disabled
line_23 = Line(StartPoint=start_point_17, EndPoint=end_point_17)  # disabled
line_24 = Line(StartPoint=start_point_16, EndPoint=end_point_16)  # disabled
curve_62 = Curve([line_24, line_23])  # disabled
line_25 = Data(line_24)  # disabled
curve_63 = Data(curve_62)  # disabled
line_26 = Data(line_23)  # disabled
line_27 = Data(line_25)  # disabled
curve_64 = Data(curve_63)  # disabled
line_28 = Data(line_26)  # disabled
line_29 = Data(line_27)  # disabled
curve_65 = Data(curve_64)  # disabled
line_30 = Data(line_28)  # disabled

# ---- group: Roof structure / Endeplader
# Endeplader
factor_7 = Data(skaler_stål_plader_til_trækbånd_4)  # disabled
curve_66 = Data(curve_47)  # disabled
curve_67 = Data(curve_48)  # disabled
curve_68 = Data(curve_49)  # disabled
curve_69 = Data(curve_50)  # disabled
curve_70 = Data(curve_52)  # disabled
curve_71 = Data(curve_53)  # disabled
curve_72 = Data(curve_54)  # disabled
curve_73 = Data(curve_55)  # disabled
factor_8 = Data(factor_7)  # disabled
curve_74 = Data(curve_66)  # disabled
curve_75 = Data(curve_67)  # disabled
curve_76 = Data(curve_68)  # disabled
curve_77 = Data(curve_69)  # disabled
curve_78 = Data(curve_70)  # disabled
curve_79 = Data(curve_71)  # disabled
curve_80 = Data(curve_72)  # disabled
curve_81 = Data(curve_73)  # disabled
factor_9 = Data(factor_8)  # disabled
curve_82 = Data(curve_74)  # disabled
curve_83 = Data(curve_75)  # disabled
curve_84 = Data(curve_76)  # disabled
curve_85 = Data(curve_77)  # disabled
curve_86 = Data(curve_78)  # disabled
curve_87 = Data(curve_79)  # disabled
curve_88 = Data(curve_80)  # disabled
curve_89 = Data(curve_81)  # disabled
end_points_5 = EndPoints(Curve=curve_86)  # -> Start, End; disabled
end_points_6 = EndPoints(Curve=curve_89)  # -> Start, End; disabled
end_points_7 = EndPoints(Curve=curve_88)  # -> Start, End; disabled
end_points_8 = EndPoints(Curve=curve_87)  # -> Start, End; disabled
end_points_9 = EndPoints(Curve=curve_82)  # -> Start, End; disabled
end_points_10 = EndPoints(Curve=curve_85)  # -> Start, End; disabled
end_points_11 = EndPoints(Curve=curve_84)  # -> Start, End; disabled
end_points_12 = EndPoints(Curve=curve_83)  # -> Start, End; disabled
point_13 = Point(end_points_6.Start)  # disabled
point_14 = Point(end_points_7.End)  # disabled
point_15 = Point(end_points_8.Start)  # disabled
point_16 = Point(end_points_8.End)  # disabled
point_17 = Point(end_points_7.Start)  # disabled
point_18 = Point(end_points_6.End)  # disabled
point_19 = Point(end_points_5.End)  # disabled
point_20 = Point(end_points_5.Start)  # disabled
point_21 = Point(end_points_10.Start)  # disabled
point_22 = Point(end_points_11.End)  # disabled
point_23 = Point(end_points_12.End)  # disabled
point_24 = Point(end_points_12.Start)  # disabled
point_25 = Point(end_points_11.Start)  # disabled
point_26 = Point(end_points_10.End)  # disabled
point_27 = Point(end_points_9.End)  # disabled
point_28 = Point(end_points_9.Start)  # disabled
entwine_7 = Entwine(Branch00=point_13, Branch01=point_18, FlattenInputs=True)  # disabled
entwine_8 = Entwine(Branch00=point_21, Branch01=point_26, FlattenInputs=True)  # disabled
entwine_9 = Entwine(Branch00=point_17, Branch01=point_14, FlattenInputs=True)  # disabled
entwine_10 = Entwine(Branch00=point_15, Branch01=point_16, FlattenInputs=True)  # disabled
entwine_11 = Entwine(Branch00=point_20, Branch01=point_19, FlattenInputs=True)  # disabled
entwine_12 = Entwine(Branch00=point_25, Branch01=point_22, FlattenInputs=True)  # disabled
entwine_13 = Entwine(Branch00=point_24, Branch01=point_23, FlattenInputs=True)  # disabled
entwine_14 = Entwine(Branch00=point_28, Branch01=point_27, FlattenInputs=True)  # disabled
_4point_surface = _4PointSurface(CornerA=entwine_11, CornerB=entwine_10, CornerC=entwine_9, CornerD=entwine_7)  # disabled
_4point_surface_2 = _4PointSurface(CornerA=entwine_14, CornerB=entwine_13, CornerC=entwine_12, CornerD=entwine_8)  # disabled
area = Area(Geometry=_4point_surface)  # -> Area, Centroid; disabled
area_2 = Area(Geometry=_4point_surface_2)  # -> Area, Centroid; disabled
scale = Scale(Geometry=_4point_surface_2, Center=area_2.Centroid, Factor=graft(factor_9))  # -> Geometry, Transform; disabled
scale_2 = Scale(Geometry=_4point_surface, Center=area.Centroid, Factor=graft(factor_9))  # -> Geometry, Transform; disabled
geometry_4 = Data(scale.Geometry)  # disabled
geometry_5 = Data(scale_2.Geometry)  # disabled
geometry_6 = Data(geometry_4)  # disabled
geometry_7 = Data(geometry_5)  # disabled
geometry_8 = Data(geometry_6)  # disabled
geometry_9 = Data(geometry_7)  # disabled

# ---- group: Roof structure / Lodstænger til trækbånd
# Lodstænger til trækbånd
size = Data(antal_lodstænger_til_trækbånd)  # disabled
start_point_18 = Data(i_11)  # disabled
end_point_18 = Data(i_12)  # disabled
relay = Data(data_5)  # disabled
size_2 = Data(size)  # disabled
start_point_19 = Data(start_point_18)  # disabled
end_point_19 = Data(end_point_18)  # disabled
relay_2 = Data(relay)  # disabled
size_3 = Data(size_2)  # disabled
start_point_20 = Data(start_point_19)  # disabled
end_point_20 = Data(end_point_19)  # disabled
relay_3 = Data(relay_2)  # disabled
line_31 = Line(StartPoint=start_point_20, EndPoint=end_point_20)  # disabled
construct_domain_2 = ConstructDomain(DomainStart=expr("1", 0), DomainEnd=size_3)  # disabled
divide_curve_3 = DivideCurve(Curve=line_31, Count=expr("x+1", size_3), Kinks=False)  # -> Points, Tangents, Parameters; disabled
unit_z_8 = UnitZ(Factor=1)  # disabled
sub_list_2 = SubList(List=divide_curve_3.Points, Domain=construct_domain_2, Wrap=True)  # -> List, Index; disabled
line_sdl = LineSDL(Start=sub_list_2.List, Direction=unit_z_8, Length=1000)  # disabled
curve_90 = Curve(relay_3)  # disabled
curve_line_2 = CurveLine(Curve=curve_90, Line=line_sdl)  # -> flatten(Points), Params, Count; disabled
partition_list = PartitionList(List=curve_line_2.Points, Size=size_3)  # disabled
line_32 = Line(StartPoint=sub_list_2.List, EndPoint=partition_list)  # disabled
line_33 = Data(line_32)  # disabled
line_34 = Data(line_33)  # disabled
line_35 = Data(line_34)  # disabled

# ---- group: walls for stephanbue
start_line = Data(line_7)  # disabled
end_line = Data(list_item_6)  # disabled
number_slider_24 = Slider(32, range=0..50)  # disabled
edge_surface = EdgeSurface(CurveA=end_line, CurveB=start_line)  # disabled
unit_z_9 = UnitZ(Factor=number_slider_24)  # disabled
deconstruct_brep_5 = DeconstructBrep(Brep=edge_surface)  # -> Faces, Edges, Vertices; disabled
move_13 = Move(Geometry=deconstruct_brep_5.Faces, Motion=expr("x*-1", unit_z_9))  # -> Geometry, Transform; disabled
deconstruct_brep_6 = DeconstructBrep(Brep=move_13.Geometry)  # -> Faces, Edges, Vertices; disabled
divide_length_7 = DivideLength(Curve=deconstruct_brep_5.Edges, Length=1)  # -> Points, Tangents, Parameters; disabled
divide_length_8 = DivideLength(Curve=deconstruct_brep_6.Edges, Length=1)  # -> Points, Tangents, Parameters; disabled
line_36 = Line(StartPoint=divide_length_8.Points, EndPoint=divide_length_7.Points)  # disabled
divide_length_9 = DivideLength(Curve=line_36, Length=1)  # -> Points, Tangents, Parameters; disabled

# ---- group: Christmass tree / christmass tree
construct_point_16 = ConstructPoint(XCoordinate=0, YCoordinate=0, ZCoordinate=0)
construct_point_17 = ConstructPoint(XCoordinate=0, YCoordinate=0, ZCoordinate=Slider(103, range=0..150))
line_37 = Line(StartPoint=construct_point_16, EndPoint=construct_point_17)
cone = Cone(Base=PlaneXY(0, 0, 0), Radius=Slider(42, range=0..75), Length=line_37)  # -> Cone, Tip
number_slider_25 = Slider(24, range=0..100)
divide_surface_2 = DivideSurface(Surface=cone.Cone, UCount=number_slider_25, VCount=number_slider_25)  # -> Points, Normals, Parameters
divide_curve_4 = DivideCurve(Curve=line_37, Count="40", Kinks=False)  # -> Points, Tangents, Parameters
random_reduce = RandomReduce(List=flatten(divide_surface_2.Points), Reduction=Slider(312, range=0..1000), Seed=1)
create_rtree = CreateRTree(InputGeometry=divide_curve_4.Points)
rtree_closest_point = RTreeClosestPoint(SearchPoints=random_reduce, RTree=create_rtree)  # -> ClosestPoint, ClosestIndex
list_item_15 = ListItem(List=divide_curve_4.Points, Index=rtree_closest_point.ClosestIndex, Wrap=True)
number_slider_26 = Slider(-6, range=-40..40)
data_6 = Data(rtree_closest_point.ClosestPoint)
trunk = Data(line_37)
deconstruct_8 = Deconstruct(Point=list_item_15)  # -> XComponent, YComponent, ZComponent
construct_point_18 = ConstructPoint(XCoordinate=0, YCoordinate=0, ZCoordinate=0)
data_7 = Data(list_item_15)
unit_z_10 = UnitZ(Factor=number_slider_26)
addition_4 = Addition(A=deconstruct_8.ZComponent, B=number_slider_26)
number_slider_27 = Slider(5, range=0..10)
move_14 = Move(Geometry=trunk, Motion=unit_z_10)  # -> Geometry, Transform
construct_point_19 = ConstructPoint(XCoordinate=deconstruct_8.XComponent, YCoordinate=deconstruct_8.YComponent, ZCoordinate=addition_4)
extend_curve = ExtendCurve(Curve=move_14.Geometry, Type=0, Start=number_slider_27, End=number_slider_27)
line_38 = Line(StartPoint=construct_point_19, EndPoint=random_reduce)
divide_length_10 = DivideLength(Curve=extend_curve, Length=0.5)  # -> Points, Tangents, Parameters

# ----
move_15 = Move(Geometry=line_38, Motion=expr("x*-1", unit_x_3))  # -> Geometry, Transform
move_16 = Move(Geometry=line_38, Motion=expr("x*-1", unit_y_3))  # -> Geometry, Transform
move_17 = Move(Geometry=line_38, Motion=unit_x_3)  # -> Geometry, Transform
move_18 = Move(Geometry=line_38, Motion=expr("x*-1", unit_z_4))  # -> Geometry, Transform
move_19 = Move(Geometry=line_38, Motion=unit_y_3)  # -> Geometry, Transform
move_20 = Move(Geometry=line_38, Motion=unit_z_4)  # -> Geometry, Transform
merge = Merge(
    Data1=move_15.Geometry,
    Data2=move_17.Geometry,
    Data3=move_16.Geometry,
    Data4=move_19.Geometry,
    Data5=move_18.Geometry,
    Data6=move_20.Geometry)
divide_length_11 = DivideLength(Curve=merge, Length=0.5)  # -> Points, Tangents, Parameters

# ---- group: Find nearest point
deconstruct_9 = Deconstruct(Point=flatten(divide_length_11.Points))  # -> XComponent, YComponent, ZComponent
round_6 = Round(Number=deconstruct_9.XComponent)  # -> Nearest, Floor, Ceiling
round_7 = Round(Number=deconstruct_9.YComponent)  # -> Nearest, Floor, Ceiling
round_8 = Round(Number=deconstruct_9.ZComponent)  # -> Nearest, Floor, Ceiling
construct_point_20 = ConstructPoint(XCoordinate=round_6.Nearest, YCoordinate=round_7.Nearest, ZCoordinate=round_8.Nearest)
create_set_2 = CreateSet(List=construct_point_20)  # -> Set, Map

# ----
end_points_13 = EndPoints(Curve=extend_curve)  # -> Start, End
unit_z_11 = UnitZ(Factor=end_points_13.Start)
move_21 = Move(Geometry=create_set_2.Set, Motion=unit_z_11)  # -> Geometry, Transform

# ---- group: Roof structure / Tagåser
# Tagåser
B_19 = Data(forskyder_tagåser_ved_tagfod)  # disabled
count_4 = Data(antal_tagåser)  # disabled
base_curve_4 = Data(arc_5)  # disabled
factor_10 = Data(distance_5)  # disabled
curve_91 = Data(geometry_3)  # disabled
B_20 = Data(B_19)  # disabled
count_5 = Data(count_4)  # disabled
base_curve_5 = Data(base_curve_4)  # disabled
factor_11 = Data(factor_10)  # disabled
curve_92 = Data(curve_91)  # disabled
B_21 = Data(B_20)  # disabled
count_6 = Data(count_5)  # disabled
base_curve_6 = Data(base_curve_5)  # disabled
factor_12 = Data(factor_11)  # disabled
curve_93 = Data(curve_92)  # disabled
curve_domain_2 = CurveDomain(Curve=curve_93)  # -> Curve, Domain; disabled
deconstruct_domain_2 = DeconstructDomain(Domain=curve_domain_2.Domain)  # -> Start, End; disabled
subtraction_7 = Subtraction(A=deconstruct_domain_2.End, B=B_21)  # disabled
addition_5 = Addition(A=deconstruct_domain_2.Start, B=B_21)  # disabled
construct_domain_3 = ConstructDomain(DomainStart=addition_5, DomainEnd=subtraction_7)  # disabled
sub_curve_2 = SubCurve(BaseCurve=[curve_93, base_curve_6], Domain=graft(construct_domain_3))  # disabled
divide_curve_5 = DivideCurve(Curve=sub_curve_2, Count=count_6, Kinks=False)  # -> Points, Tangents, Parameters; disabled
unit_x_5 = UnitX(Factor=factor_12)  # -> graft(UnitVector); disabled
curve_frames = CurveFrames(Curve=base_curve_6, Count=10)  # -> Frames, Parameters; disabled
domain_4 = Data(construct_domain_3)  # disabled
domain_5 = Data(domain_4)  # disabled
domain_6 = Data(domain_5)  # disabled

# ---- group: Roof structure / Sub curve svarende til ydrepunkter for tagåser
# Sub curve svarende til ydrepunkter for tagåser
base_curve_7 = Data(arc_5)  # disabled
domain_7 = Data(domain_6)  # disabled
base_curve_8 = Data(base_curve_7)  # disabled
domain_8 = Data(domain_7)  # disabled
base_curve_9 = Data(base_curve_8)  # disabled
domain_9 = Data(domain_8)  # disabled
sub_curve_3 = SubCurve(BaseCurve=base_curve_9, Domain=graft(domain_9))  # disabled
deconstruct_arc_3 = DeconstructArc(Arc=sub_curve_3)  # -> BasePlane, Radius, Angle; disabled
arc_7 = Arc(Plane=deconstruct_arc_3.BasePlane, Radius=deconstruct_arc_3.Radius, Angle=deconstruct_arc_3.Angle)  # -> Arc, Length; disabled
arc_8 = Data(arc_7.Arc)  # disabled
arc_9 = Data(arc_8)  # disabled
arc_10 = Data(arc_9)  # disabled

# ---- group: Roof structure / lodposter
# lodposter
count_7 = Data(antal_tagåser)  # disabled
distance_23 = Data(integer_4)  # disabled
curve_94 = Data(arc_10)  # disabled
count_8 = Data(count_7)  # disabled
distance_24 = Data(distance_23)  # disabled
curve_95 = Data(curve_94)  # disabled
count_9 = Data(count_8)  # disabled
distance_25 = Data(distance_24)  # disabled
curve_96 = Data(curve_95)  # disabled
panel_8 = Panel("2")  # disabled
panel_9 = Panel("1")  # disabled
divide_curve_6 = DivideCurve(Curve=curve_96, Count=count_9, Kinks=False)  # -> Points, Tangents, Parameters; disabled
list_length_5 = ListLength(List=divide_curve_6.Points)  # disabled
subtraction_8 = Subtraction(A=list_length_5, B=panel_8)  # disabled
construct_domain_4 = ConstructDomain(DomainStart=panel_9, DomainEnd=subtraction_8)  # disabled
panel_10 = Panel("""0
1""")  # disabled
sub_list_3 = SubList(List=divide_curve_6.Points, Domain=construct_domain_4, Wrap=True)  # -> List, Index; disabled
sift_pattern = SiftPattern(List=sub_list_3.List, SiftPattern=panel_10)  # -> Output0, Output1; disabled
point_29 = Point(sift_pattern.Output1)  # disabled
xy_plane_4 = XYPlane(Origin=Point(0, 0, 0))  # disabled
plane_7 = Data(xy_plane_4)  # disabled
points_4 = Data(divide_curve_6.Points)  # disabled
point_30 = Data(point_29)  # disabled
plane_8 = Data(plane_7)  # disabled
points_5 = Data(points_4)  # disabled
point_31 = Data(point_30)  # disabled
plane_9 = Data(plane_8)  # disabled
points_6 = Data(points_5)  # disabled
point_32 = Data(point_31)  # disabled

# ---- group: Roof structure / Tagåser (continued)
_1_x = Data(points_6)  # disabled
_1_x_2 = Data(_1_x)  # disabled
_1_x_3 = Data(_1_x_2)  # disabled
entwine_15 = Entwine(Branch0X=divide_curve_5.Points, Branch1X=_1_x_3, FlattenInputs=False)  # disabled
line_sdl_2 = LineSDL(Start=entwine_15, Direction=curve_frames.Frames, Length=unit_x_5)  # disabled
curve_97 = Curve(line_sdl_2)  # disabled
clean_tree = CleanTree(RemoveNulls=True, RemoveInvalid=True, RemoveEmpty=False, Tree=curve_97)  # disabled
tree = Data(clean_tree)  # disabled
tree_2 = Data(tree)  # disabled
tree_3 = Data(tree_2)  # disabled

# ---- group: Roof structure / Laver 2 grupper med tagåser, hhv. med og uden skråbånd
# Laver 2 grupper med tagåser, hhv. med og uden skråbånd
A_13 = Data(antal_tagåser)  # disabled
list = Data(tree_3)  # disabled
A_14 = Data(A_13)  # disabled
list_2 = Data(list)  # disabled
A_15 = Data(A_14)  # disabled
list_3 = Data(list_2)  # disabled
panel_11 = Panel("0")  # disabled
subtraction_9 = Subtraction(A=A_15, B=1)  # disabled
panel_12 = Panel(A_15)  # disabled
cull_index = CullIndex(List=list_3, Indices=panel_12, Wrap=False)  # disabled
shift_list_3 = ShiftList(List=cull_index, Shift=1, Wrap=False)  # disabled
cull_nth = CullNth(List=shift_list_3, CullFrequency=2)  # disabled
cull_nth_2 = CullNth(List=cull_index, CullFrequency=2)  # disabled

# ---- group: Roof structure (continued)
arc_11 = Arc(Plane=base_plane_3, Radius=radius_3, Angle=Domain(0, 6.283185307))  # -> Arc, Length; disabled
area_3 = Area(Geometry=arc_11.Arc)  # -> Area, Centroid; disabled
line_39 = Line(StartPoint=point_32, EndPoint=area_3.Centroid)  # disabled
line_sdl_3 = LineSDL(Start=point_32, Direction=line_39, Length=højde_samlet_bue_mm)  # disabled

# ---- group: Roof structure / lodposter (continued)
tree_4 = Data(line_sdl_3)  # disabled
tree_5 = Data(tree_4)  # disabled
tree_6 = Data(tree_5)  # disabled
clean_tree_2 = CleanTree(RemoveNulls=True, RemoveInvalid=True, RemoveEmpty=False, Tree=tree_6)  # disabled
clean_tree_3 = CleanTree(RemoveNulls=True, RemoveInvalid=True, RemoveEmpty=False, Tree=tree_6)  # disabled
offset_curve_21 = OffsetCurve(Curve=clean_tree_2, Distance=expr("X*-1", distance_25), Plane=xy_plane_4, Corners=1)  # disabled
offset_curve_22 = OffsetCurve(Curve=clean_tree_2, Distance=distance_25, Plane=xy_plane_4, Corners=1)  # disabled
curve_98 = Data(offset_curve_22)  # disabled
curve_99 = Data(offset_curve_21)  # disabled
curve_100 = Data(curve_98)  # disabled
curve_101 = Data(curve_99)  # disabled
curve_102 = Data(curve_100)  # disabled
curve_103 = Data(curve_101)  # disabled

# ---- group: Roof structure / Skråbånd NY
# Skråbånd NY
distance_26 = Data(integer_4)  # disabled
curve_104 = Data(curve_102)  # disabled
plane_10 = Data(plane_9)  # disabled
curve_105 = Data(curve_103)  # disabled
distance_27 = Data(distance_26)  # disabled
curve_106 = Data(curve_104)  # disabled
plane_11 = Data(plane_10)  # disabled
curve_107 = Data(curve_105)  # disabled
distance_28 = Data(distance_27)  # disabled
curve_108 = Data(curve_106)  # disabled
plane_12 = Data(plane_11)  # disabled
curve_109 = Data(curve_107)  # disabled
offset_curve_23 = OffsetCurve(Curve=curve_108, Distance=expr("-x", distance_28), Plane=plane_12, Corners=1)  # -> flatten(Curve); disabled
offset_curve_24 = OffsetCurve(Curve=curve_109, Distance=expr("x", distance_28), Plane=plane_12, Corners=1)  # -> flatten(Curve); disabled
length_2 = Length(Curve=offset_curve_24)  # disabled
length_3 = Length(Curve=offset_curve_23)  # disabled
end_points_14 = EndPoints(Curve=offset_curve_23)  # -> Start, End; disabled
end_points_15 = EndPoints(Curve=offset_curve_24)  # -> Start, End; disabled
offset_curve_25 = OffsetCurve(Curve=offset_curve_23, Distance=expr("-x", length_3), Plane=plane_12, Corners=1)  # disabled
offset_curve_26 = OffsetCurve(Curve=offset_curve_24, Distance=length_2, Plane=plane_12, Corners=1)  # disabled
end_points_16 = EndPoints(Curve=offset_curve_26)  # -> flatten(Start), End; disabled
end_points_17 = EndPoints(Curve=offset_curve_25)  # -> flatten(Start), End; disabled
line_40 = Line(StartPoint=end_points_16.Start, EndPoint=end_points_15.End)  # disabled
line_41 = Line(StartPoint=end_points_17.Start, EndPoint=end_points_14.End)  # disabled
curve_110 = Curve([line_40, line_41])  # disabled
line_42 = Data(line_41)  # disabled
line_43 = Data(line_40)  # disabled
line_44 = Data(line_42)  # disabled
line_45 = Data(line_43)  # disabled
line_46 = Data(line_44)  # disabled
line_47 = Data(line_45)  # disabled

# ---- group: Roof structure / Makes braces
# Makes braces
tree_7 = Data(points_3)  # disabled
tree_8 = Data(tree_7)  # disabled
tree_9 = Data(tree_8)  # disabled
panel_13 = Panel("{*;0}")  # disabled
simplify_tree_2 = SimplifyTree(Tree=tree_9, Front=False)  # disabled
split_tree = SplitTree(Data=simplify_tree_2, Masks=flatten(panel_13))  # -> Positive, Negative; disabled

# ---- group: Roof structure / Makes braces / Top flange offset points and make first set off braces
# Top flange offset points and make first set off braces
list_4 = Data(split_tree.Negative)  # disabled
list_5 = Data(split_tree.Positive)  # disabled
list_6 = Data(list_4)  # disabled
list_7 = Data(list_5)  # disabled
list_8 = Data(list_6)  # disabled
list_9 = Data(list_7)  # disabled
shift_list_4 = ShiftList(List=list_8, Shift=1, Wrap=False)  # disabled
list_length_6 = ListLength(List=shift_list_4)  # disabled
subtraction_10 = Subtraction(A=list_length_6, B=1)  # disabled
sub_list_4 = SubList(List=shift_list_4, Domain=subtraction_10, Wrap=True)  # -> List, Index; disabled
sub_list_5 = SubList(List=list_9, Domain=subtraction_10, Wrap=False)  # -> List, Index; disabled
line_48 = Line(StartPoint=sub_list_5.List, EndPoint=sub_list_4.List)  # disabled
result_7 = Data(subtraction_10)  # disabled
line_49 = Data(line_48)  # disabled
result_8 = Data(result_7)  # disabled
line_50 = Data(line_49)  # disabled
result_9 = Data(result_8)  # disabled
line_51 = Data(line_50)  # disabled

# ---- group: Roof structure / Makes braces / Bottom flange offset point and make second set of braces
# Bottom flange offset point and make second set of braces
list_10 = Data(split_tree.Negative)  # disabled
domain_10 = Data(result_9)  # disabled
list_11 = Data(split_tree.Positive)  # disabled
list_12 = Data(list_10)  # disabled
domain_11 = Data(domain_10)  # disabled
list_13 = Data(list_11)  # disabled
list_14 = Data(list_12)  # disabled
list_15 = Data(list_13)  # disabled
domain_12 = Data(domain_11)  # disabled
shift_list_5 = ShiftList(List=list_15, Shift=1, Wrap=False)  # disabled
sub_list_6 = SubList(List=list_14, Domain=domain_12, Wrap=True)  # -> List, Index; disabled
sub_list_7 = SubList(List=shift_list_5, Domain=domain_12, Wrap=False)  # -> List, Index; disabled
line_52 = Line(StartPoint=sub_list_7.List, EndPoint=sub_list_6.List)  # disabled
line_53 = Data(line_52)  # disabled
line_54 = Data(line_53)  # disabled
line_55 = Data(line_54)  # disabled

# ---- group: Roof structure / Makes braces (continued)
line_56 = Data(line_55)  # disabled
line_57 = Data(line_55)  # disabled
line_58 = Data(line_51)  # disabled
line_59 = Data(line_51)  # disabled
line_60 = Data(line_56)  # disabled
line_61 = Data(line_57)  # disabled
line_62 = Data(line_58)  # disabled
line_63 = Data(line_59)  # disabled
line_64 = Data(line_60)  # disabled
line_65 = Data(line_61)  # disabled
line_66 = Data(line_62)  # disabled
line_67 = Data(line_63)  # disabled

# ---- group: Roof structure
list_16 = Data(parameters_3)  # disabled
base_curve_10 = Data(data_5)  # disabled
base_curve_11 = Data(arc_5)  # disabled
domain_13 = Data(domain_3)  # disabled
A_16 = Data(result_5)  # disabled
edges = Data(line_30)  # disabled
edges_2 = Data(line_14)  # disabled
A_17 = Data(result_6)  # disabled
C = Data(multiplication_5)  # disabled
edges_3 = Data(line_15)  # disabled
edges_4 = Data(line_29)  # disabled
list_17 = Data(list_16)  # disabled
base_curve_12 = Data(base_curve_10)  # disabled
base_curve_13 = Data(base_curve_11)  # disabled
domain_14 = Data(domain_13)  # disabled
A_18 = Data(A_16)  # disabled
edges_5 = Data(edges)  # disabled
edges_6 = Data(edges_2)  # disabled
A_19 = Data(A_17)  # disabled
C_2 = Data(C)  # disabled
edges_7 = Data(edges_3)  # disabled
edges_8 = Data(edges_4)  # disabled
list_18 = Data(list_17)  # disabled
base_curve_14 = Data(base_curve_12)  # disabled
base_curve_15 = Data(base_curve_13)  # disabled
domain_15 = Data(domain_14)  # disabled
A_20 = Data(A_18)  # disabled
edges_9 = Data(edges_5)  # disabled
edges_10 = Data(edges_6)  # disabled
A_21 = Data(A_19)  # disabled
C_3 = Data(C_2)  # disabled
edges_11 = Data(edges_7)  # disabled
edges_12 = Data(edges_8)  # disabled

# ---- group: Roof structure / Create the initial cross in sub arches, on the sides shear reinforcement fields
# Create the initial cross in sub arches, on the sides shear reinforcement fields
base_curve_16 = Data(base_curve_14)  # disabled
base_curve_17 = Data(base_curve_15)  # disabled
A_22 = Data(A_20)  # disabled
list_19 = Data(list_18)  # disabled
A_23 = Data(A_21)  # disabled
C_4 = Data(C_3)  # disabled
base_curve_18 = Data(base_curve_16)  # disabled
base_curve_19 = Data(base_curve_17)  # disabled
A_24 = Data(A_22)  # disabled
list_20 = Data(list_19)  # disabled
A_25 = Data(A_23)  # disabled
C_5 = Data(C_4)  # disabled
base_curve_20 = Data(base_curve_18)  # disabled
base_curve_21 = Data(base_curve_19)  # disabled
A_26 = Data(A_24)  # disabled
list_21 = Data(list_20)  # disabled
A_27 = Data(A_25)  # disabled
C_6 = Data(C_5)  # disabled
list_item_16 = ListItem(List=list_21, Index=0, Wrap=True)  # disabled
list_item_17 = ListItem(List=list_21, Index=1, Wrap=True)  # disabled
subtraction_11 = Subtraction(A=list_item_17, B=list_item_16)  # disabled
shift_paths_2 = ShiftPaths(Data=subtraction_11, Offset=-1)  # disabled
shift_paths_3 = ShiftPaths(Data=subtraction_11, Offset=-1)  # disabled
addition_6 = Addition(A=A_27, B=shift_paths_2, C=C_6)  # disabled
subtraction_12 = Subtraction(A=A_26, B=shift_paths_3, C=C_6)  # disabled
construct_domain_5 = ConstructDomain(DomainStart=A_26, DomainEnd=subtraction_12)  # disabled
construct_domain_6 = ConstructDomain(DomainStart=A_27, DomainEnd=addition_6)  # disabled
sub_curve_4 = SubCurve(BaseCurve=[base_curve_20, base_curve_21], Domain=construct_domain_6)  # disabled
sub_curve_5 = SubCurve(BaseCurve=[base_curve_20, base_curve_21], Domain=construct_domain_5)  # disabled
curve_111 = Data(sub_curve_5)  # disabled
curve_112 = Data(sub_curve_4)  # disabled
curve_113 = Data(curve_111)  # disabled
curve_114 = Data(curve_112)  # disabled
curve_115 = Data(curve_113)  # disabled
curve_116 = Data(curve_114)  # disabled

# ---- group: Roof structure / create full sub arches for the sides, shear reinforced fields
# create full sub arches for the sides, shear reinforced fields
base_curve_22 = Data(base_curve_14)  # disabled
base_curve_23 = Data(base_curve_15)  # disabled
domain_start = Data(A_21)  # disabled
domain_end = Data(A_20)  # disabled
domain_16 = Data(domain_15)  # disabled
base_curve_24 = Data(base_curve_22)  # disabled
base_curve_25 = Data(base_curve_23)  # disabled
domain_start_2 = Data(domain_start)  # disabled
domain_end_2 = Data(domain_end)  # disabled
domain_17 = Data(domain_16)  # disabled
base_curve_26 = Data(base_curve_24)  # disabled
base_curve_27 = Data(base_curve_25)  # disabled
domain_start_3 = Data(domain_start_2)  # disabled
domain_end_3 = Data(domain_end_2)  # disabled
domain_18 = Data(domain_17)  # disabled
deconstruct_domain_3 = DeconstructDomain(Domain=domain_18)  # -> Start, End; disabled
construct_domain_7 = ConstructDomain(DomainStart=domain_start_3, DomainEnd=deconstruct_domain_3.End)  # disabled
construct_domain_8 = ConstructDomain(DomainStart=deconstruct_domain_3.Start, DomainEnd=domain_end_3)  # disabled
sub_curve_6 = SubCurve(BaseCurve=[base_curve_26, base_curve_27], Domain=construct_domain_8)  # disabled
sub_curve_7 = SubCurve(BaseCurve=[base_curve_26, base_curve_27], Domain=construct_domain_7)  # disabled
curve_117 = Data(sub_curve_6)  # disabled
curve_118 = Data(sub_curve_7)  # disabled
curve_119 = Data(curve_117)  # disabled
curve_120 = Data(curve_118)  # disabled

# ---- group: Roof structure / Makes shear reinforcement fields
# Makes shear reinforcement fields
curve_121 = Data(curve_115)  # disabled
edges_13 = Data(edges_10)  # disabled
edges_14 = Data(edges_9)  # disabled
edges_15 = Data(curve_119)  # disabled
curve_122 = Data(curve_116)  # disabled
edges_16 = Data(edges_11)  # disabled
edges_17 = Data(edges_12)  # disabled
edges_18 = Data(curve_120)  # disabled
curve_123 = Data(curve_121)  # disabled
edges_19 = Data(edges_13)  # disabled
edges_20 = Data(edges_14)  # disabled
edges_21 = Data(edges_15)  # disabled
curve_124 = Data(curve_122)  # disabled
edges_22 = Data(edges_16)  # disabled
edges_23 = Data(edges_17)  # disabled
edges_24 = Data(edges_18)  # disabled
curve_125 = Data(curve_123)  # disabled
edges_25 = Data(edges_20)  # disabled
curve_126 = Data(curve_124)  # disabled
edges_26 = Data(edges_19)  # disabled
edges_27 = Data(edges_23)  # disabled
edges_28 = Data(edges_22)  # disabled
end_points_18 = EndPoints(Curve=curve_125)  # -> Start, End; disabled
end_points_19 = EndPoints(Curve=curve_126)  # -> Start, End; disabled
shift_list_6 = ShiftList(List=end_points_19.End, Shift=1, Wrap=True)  # disabled
shift_list_7 = ShiftList(List=end_points_18.End, Shift=1, Wrap=True)  # disabled
line_68 = Line(StartPoint=end_points_19.Start, EndPoint=shift_list_6)  # disabled
line_69 = Line(StartPoint=end_points_18.Start, EndPoint=shift_list_7)  # disabled
line_line_intersection_karamba3d = LineLineIntersectionKaramba3D(Line=line_68, LimitDistance_m=0.005)  # -> IntersectionPoints, LineSubSegements; disabled
line_line_intersection_karamba3d_2 = LineLineIntersectionKaramba3D(Line=line_69, LimitDistance_m=0.005)  # -> IntersectionPoints, LineSubSegements; disabled
list_item_18 = ListItem(List=line_line_intersection_karamba3d_2.LineSubSegements, Index=1, Wrap=True)  # disabled
list_item_19 = ListItem(List=line_line_intersection_karamba3d.LineSubSegements, Index=0, Wrap=True)  # disabled
boundary_surfaces = BoundarySurfaces(Edges=flatten(edges_21))  # disabled
boundary_surfaces_2 = BoundarySurfaces(Edges=flatten(edges_24))  # disabled
surfaces = Data(boundary_surfaces_2)  # disabled
surfaces_2 = Data(boundary_surfaces)  # disabled
surfaces_3 = Data(surfaces_2)  # disabled
surfaces_4 = Data(surfaces)  # disabled
surfaces_5 = Data(surfaces_3)  # disabled
surfaces_6 = Data(surfaces_4)  # disabled

# ---- group: Roof structure (continued)
surfaces_7 = Data(surfaces_5)  # disabled
surfaces_8 = Data(surfaces_6)  # disabled
surfaces_9 = Data(surfaces_7)  # disabled
surfaces_10 = Data(surfaces_8)  # disabled
surfaces_11 = Data(surfaces_9)  # disabled
surfaces_12 = Data(surfaces_10)  # disabled

# ---- group: Roof structure / Samler Grasshopper geometri, flytter og roterer det til revit grids
# Samler Grasshopper geometri, flytter og roterer det til revit grids
_0_7 = Data(geometry_9)  # disabled
_0_8 = Data(line_35)  # disabled
_0_4 = Data(line_15)  # disabled
relay_trækbånd_plader_side_1 = Data(geometry_8)  # disabled
relay_forskydningsfelter = Data(surfaces_11)  # disabled
relay_forskydningsfelter_2 = Data(surfaces_12)  # disabled
relay_vertical_side_1_post = Data(line_14)  # disabled
relay_trækbånd_midt_del = Data(line_20)  # disabled
relay_lodposter_side_1 = Data(curve_102)  # disabled
relay_lodposter_side_2 = Data(curve_103)  # disabled
relay_skråbånd_side_1 = Data(line_46)  # disabled
relay_skråbånd_side_2 = Data(line_47)  # disabled
relay_horizontal_post = Data(curve_65)  # disabled
relay_trækbånd_sider = Data(curve_51)  # disabled
relay_bottom_flange = Data(data_5)  # disabled
relay_braces_side_1 = Data(line_64)  # disabled
relay_braces_side_1_2 = Data(line_65)  # disabled
relay_braces_side_2 = Data(line_66)  # disabled
relay_braces_side_2_2 = Data(line_67)  # disabled
# Flyt og roter
relay_top_flange = Data(arc_5)  # disabled
relay_tagåser = Data(tree_3)  # disabled
_0_7_2 = Data(_0_7)  # disabled
_0_8_2 = Data(_0_8)  # disabled
_0_4_2 = Data(_0_4)  # disabled
relay_trækbånd_plader_side_1_2 = Data(relay_trækbånd_plader_side_1)  # disabled
relay_forskydningsfelter_3 = Data(relay_forskydningsfelter)  # disabled
relay_forskydningsfelter_4 = Data(relay_forskydningsfelter_2)  # disabled
relay_vertical_side_1_post_2 = Data(relay_vertical_side_1_post)  # disabled
relay_trækbånd_midt_del_2 = Data(relay_trækbånd_midt_del)  # disabled
relay_lodposter_side_1_2 = Data(relay_lodposter_side_1)  # disabled
relay_lodposter_side_2_2 = Data(relay_lodposter_side_2)  # disabled
relay_skråbånd_side_1_2 = Data(relay_skråbånd_side_1)  # disabled
relay_skråbånd_side_2_2 = Data(relay_skråbånd_side_2)  # disabled
relay_horizontal_post_2 = Data(relay_horizontal_post)  # disabled
relay_trækbånd_sider_2 = Data(relay_trækbånd_sider)  # disabled
relay_bottom_flange_2 = Data(relay_bottom_flange)  # disabled
relay_braces_side_1_3 = Data(relay_braces_side_1)  # disabled
relay_braces_side_1_4 = Data(relay_braces_side_1_2)  # disabled
relay_braces_side_2_3 = Data(relay_braces_side_2)  # disabled
relay_braces_side_2_4 = Data(relay_braces_side_2_2)  # disabled
relay_top_flange_2 = Data(relay_top_flange)  # disabled
relay_tagåser_2 = Data(relay_tagåser)  # disabled
_0_8_3 = Data(_0_8_2)  # disabled
relay_trækbånd_midt_del_3 = Data(relay_trækbånd_midt_del_2)  # disabled
relay_lodposter_side_1_3 = Data(relay_lodposter_side_1_2)  # disabled
relay_lodposter_side_2_3 = Data(relay_lodposter_side_2_2)  # disabled
relay_skråbånd_side_1_3 = Data(relay_skråbånd_side_1_2)  # disabled
relay_skråbånd_side_2_3 = Data(relay_skråbånd_side_2_2)  # disabled
relay_trækbånd_sider_3 = Data(relay_trækbånd_sider_2)  # disabled
relay_trækbånd_plader_side_1_3 = Data(relay_trækbånd_plader_side_1_2)  # disabled
relay_forskydningsfelter_5 = Data(relay_forskydningsfelter_3)  # disabled
relay_forskydningsfelter_6 = Data(relay_forskydningsfelter_4)  # disabled
_0_4_3 = Data(_0_4_2)  # disabled
relay_tagåser_3 = Data(relay_tagåser_2)  # disabled
relay_vertical_side_1_post_3 = Data(relay_vertical_side_1_post_2)  # disabled
relay_horizontal_post_3 = Data(relay_horizontal_post_2)  # disabled
relay_bottom_flange_3 = Data(relay_bottom_flange_2)  # disabled
relay_braces_side_1_5 = Data([relay_braces_side_1_3, relay_braces_side_1_4])  # disabled
relay_braces_side_2_5 = Data([relay_braces_side_2_3, relay_braces_side_2_4])  # disabled
relay_top_flange_3 = Data(relay_top_flange_2)  # disabled
relay_forskydningsfelter_7 = Relay([relay_forskydningsfelter_5, relay_forskydningsfelter_6])  # disabled
_0_7_3 = Data(_0_7_2)  # disabled
entwine_16 = Entwine(
    Branch00=relay_skråbånd_side_1_3,
    Branch01=relay_skråbånd_side_2_3,
    Branch02=relay_lodposter_side_1_3,
    Branch03=relay_lodposter_side_2_3,
    Branch04=relay_trækbånd_midt_del_3,
    Branch05=relay_trækbånd_sider_3,
    Branch06=_0_8_3,
    FlattenInputs=True)  # disabled
entwine_17 = Entwine(
    Branch00=relay_top_flange_3,
    Branch01=relay_bottom_flange_3,
    Branch02=relay_horizontal_post_3,
    Branch03=relay_vertical_side_1_post_3,
    Branch04=_0_4_3,
    Branch05=relay_braces_side_1_5,
    Branch06=relay_braces_side_2_5,
    FlattenInputs=True)  # disabled
relay_trækbånd_plader_side_1_4 = Data(relay_trækbånd_plader_side_1_3)  # disabled
relay_forskydningsfelter_8 = Data(relay_forskydningsfelter_7)  # disabled
relay_tagåser_4 = Data(relay_tagåser_3)  # disabled
result_10 = Data(entwine_17)  # disabled
result_11 = Data(entwine_16)  # disabled
_0_7_4 = Data(_0_7_3)  # disabled
relay_trækbånd_plader_side_1_5 = Data(relay_trækbånd_plader_side_1_4)  # disabled
relay_forskydningsfelter_9 = Data(relay_forskydningsfelter_8)  # disabled
relay_tagåser_5 = Data(relay_tagåser_4)  # disabled
result_12 = Data(result_10)  # disabled
result_13 = Data(result_11)  # disabled
_0_7_5 = Data(_0_7_4)  # disabled

# ---- group: Roof structure (continued)
entwine_18 = Entwine(Branch00=relay_trækbånd_plader_side_1_5, Branch01=_0_7_5, FlattenInputs=True)  # disabled
divide_surface_3 = DivideSurface(Surface=relay_forskydningsfelter_9, UCount=expr("x*8", surface_divison), VCount=expr("x*8", surface_divison))  # -> Points, Normals, Parameters; disabled
divide_surface_4 = DivideSurface(Surface=entwine_18, UCount=surface_divison, VCount=surface_divison)  # -> Points, Normals, Parameters; disabled
data_8 = Data(result_12)  # disabled
data_9 = Data([relay_tagåser_5, result_13])  # disabled
divide_length_12 = DivideLength(Curve=data_9, Length=0.5)  # -> Points, Tangents, Parameters; disabled
divide_distance_9 = DivideDistance(Curve=data_8, Distance=0.5)  # -> Points, Tangents, Parameters; disabled
entwine_19 = Entwine(Branch00=divide_surface_4.Points, Branch01=divide_surface_3.Points, FlattenInputs=True)  # disabled

# ----
relay_4 = Relay([divide_distance_9.Points, entwine_19])  # disabled

# ---- group: Christmass tree
divide_length_13 = DivideLength(Curve=line_38, Length=0.5)  # -> Points, Tangents, Parameters
create_set_3 = CreateSet(List=divide_length_11.Points)  # -> Set, Map
data_10 = Data(move_21.Geometry)
deconstruct_10 = Deconstruct(Point=flatten(data_10))  # -> XComponent, YComponent, ZComponent
concatenate_2 = Concatenate(
    Fragment_A="setblock ~",
    Fragment_B=deconstruct_10.XComponent,
    A=" ~",
    B=deconstruct_10.ZComponent,
    C=" ~",
    D=deconstruct_10.YComponent,
    E=" acacia_leaves")

# ----
merge_2 = Merge(Data1=divide_length_13.Points, Data2=divide_length_10.Points)

# ---- group: Christmass tree / christmass tree (continued)
create_set_4 = CreateSet(List=merge_2)  # -> Set, Map

# ----
deconstruct_11 = Deconstruct(Point=flatten(merge_2))  # -> XComponent, YComponent, ZComponent
round_9 = Round(Number=deconstruct_11.XComponent)  # -> Nearest, Floor, Ceiling
round_10 = Round(Number=deconstruct_11.YComponent)  # -> Nearest, Floor, Ceiling
round_11 = Round(Number=deconstruct_11.ZComponent)  # -> Nearest, Floor, Ceiling
construct_point_21 = ConstructPoint(XCoordinate=round_9.Nearest, YCoordinate=round_10.Nearest, ZCoordinate=round_11.Nearest)
create_set_5 = CreateSet(List=construct_point_21)  # -> Set, Map
move_22 = Move(Geometry=create_set_5.Set, Motion=unit_z_11)  # -> Geometry, Transform

# ---- group: Christmass tree (continued)
data_11 = Data(move_22.Geometry)

# ---- group: Christmass tree / Generate .mcfunction setblock command
# Copy paste seems to work for up to 3500 lines.
# Else choose stream content, and stream it to output file next to .gh defination.
# When you open the txt file on your computer you can copy paster more rows.
# ALTERNATIVELY, copy the output file to the MC datapack, change the extension to xxxx.mcfunction
# 
# OBS: der er en maks på ca. 65000 linjer
deconstruct_12 = Deconstruct(Point=flatten(data_11))  # -> XComponent, YComponent, ZComponent
concatenate_3 = Concatenate(
    Fragment_A="setblock ~",
    Fragment_B=deconstruct_12.XComponent,
    A=" ~",
    B=deconstruct_12.ZComponent,
    C=" ~",
    D=deconstruct_12.YComponent,
    E=" acacia_log")

# ---- group: Christmass tree
merge_3 = Merge(Data1=concatenate_2, Data2=concatenate_3)
create_set_6 = CreateSet(List=merge_3)  # -> Set, Map

# ---- group: Christmass tree / Generate .mcfunction setblock command (continued)
copy_paste_this_into_mcfunction_file_2 = Panel(create_set_6.Set)
