# Grasshopper definition MINECRAFT_concepts for gh MineniFy me plugin.gh (Grasshopper 1.0.7)
# plug-ins: MetaHopper, MinenifyMe, LunchBoxML, Human

developed_by = Panel("Daniel Bo Olesen")
# Description: OC Engineering Grasshopper Template.
# Graphic standard seen underneath
# Rightclick a colour and set to standard, there after group and comment on the group
# 
# 
# DESCRIPTION OF THE SCRIPT:
# Script der bruges i hops, oploades til GitHub så der er mulighed for at dele hops med flere brugere, da der bruges et link af http.... typen, hvormed den ikke er bruger bestemt i form af en specifik sti.
# 
# THEORY:
# bla bla.
# 
# INPUT:
# bla bla.
# 
# OUTPUT:
# bla bla.
current_revision_data_and_version = Panel("15.03.2023 - 01.00.00.00")
project = Panel("SagsNr - SagsNavn")
image_sampler = ImageSampler(Filter="Colour", Interpolate=True, Umax=842, Umin=1, Vmax=595, Vmin=1, Wrap=1)
panel = Panel(""" Use shift+ctrl+B to search in BHoM
BHoM bruger Si grundenheder, dvs. meter, newton, Pa osv.""")
# preview
# OBS
# big group
# Revision history: FILL OUT if not managed through .git
# 15.03.2023 - 01.00.00.00 - første udgivelse
# Todos: FILL OUT if not managed through .git
# - Indbyg udbøjning formel
panel_2 = Panel("C:\Users\DBO\AppData\Roaming\.minecraft\saves\Functions test world\datapacks\Minecraft-Datapack-gh\data\ghf\functions")

# ---- group: Modify group colors, scheme colors preset
# Output
# Input
# data
# geometry
group_colors = ValueList({"Output": "184,82,204 (150)", "Input": "56,245,255 (150)", "Data": "128,128,128 (150)", "Geometry": "182,204,102 (150)", "preview": "252,210,159 (150)", "OBS": "255,140,140 (150)", "Big group": "255,255,255 (150)"}, selected="Input")
set_group_properties = SetGroupProperties(Group="Grasshopper.Kernel.Types.GH_ObjectWrapper", Color=group_colors)

# ---- group: Modify all panels
get_objects_of_same_type = GetObjectsOfSameType(Objects=panel)
set_panel_properties = SetPanelProperties(Panel=get_objects_of_same_type, Color=ColourSwatch(SwatchColor=RGB(255, 255, 255)))

# ---- group: Modify line types
# Layout and group design
line_type = ValueList({"Normal": 0, "Faint": 1, "Hidden": 2}, selected="Hidden")
control_wire_display = ControlWireDisplay(WireDisplay=line_type)

# ---- group: Create scripple on group by name
label_groups = LabelGroups(Run=Toggle(True))

# ---- group: Apply best practice to group
best_practicizer = BestPracticizer(Activate=Toggle(True))

# ----
wire_display_toggle = WireDisplayToggle(ShowHiddenWires=Toggle(False))
path_functions_folder = Data(panel_2)
height = Slider(80, range=0..200)
radius = Slider(40, range=0..75)

# ---- group: Air
domain = Domain(Domain(0, 1))  # disabled
number_slider = Slider(32, range=0..100)  # disabled
path_functions_folder_2 = Data(path_functions_folder)
panel_3 = Panel("200")  # disabled
domain_box = DomainBox(Base=PlaneXY(0, 0, 0), X=domain, Y=domain, Z=domain)  # disabled
point = Point(Point(0, 0, 0))  # disabled
panel_4 = Panel("-59")  # disabled
construct_domain = ConstructDomain(DomainStart=panel_4, DomainEnd=panel_3)  # disabled
box_array = BoxArray(Geometry=point, Cell=domain_box, XCount=number_slider, YCount=number_slider, ZCount=construct_domain)  # -> Geometry, Transform; disabled
unit_z = UnitZ(Factor=panel_4)  # disabled
move = Move(Geometry=box_array.Geometry, Motion=unit_z)  # -> Geometry, Transform; disabled
boolean_toggle = BooleanToggle(True)  # disabled
panel_5 = Panel("air")  # disabled
file_path = FilePath(path_functions_folder_2)  # disabled
functiongenerator = FunctionGenerator(Points=move.Geometry, BlockType=panel_5, Path=file_path, FunctionName=panel_5, Run=boolean_toggle)  # -> Points, BlockType, McFunction, Success; disabled

# ----
surface_division_branch_pattern = Slider(24, range=0..100)
random_reduction = Slider(500, range=0..1000)
offset_trunk_vertical = Slider(-6, range=-40..40)
function_name = Panel("christmas_tree")
point_on_trunk_for_branches = Panel("60")
leaves_distance_from_branches = Panel("1")
exstend_trunk_ends = Slider(5, range=0..10)
run_solver_save_function_files = BooleanToggle(True)
construct_point = ConstructPoint(XCoordinate=0, YCoordinate=0, ZCoordinate=0)
construct_point_2 = ConstructPoint(XCoordinate=0, YCoordinate=0, ZCoordinate=height)
unit_z_2 = UnitZ(Factor=offset_trunk_vertical)
line = Line(StartPoint=construct_point, EndPoint=construct_point_2)
cone = Cone(Base=PlaneXY(0, 0, 0), Radius=radius, Length=line)  # -> Cone, Tip
move_2 = Move(Geometry=line, Motion=unit_z_2)  # -> Geometry, Transform
divide_curve = DivideCurve(Curve=line, Count=point_on_trunk_for_branches, Kinks=False)  # -> Points, Tangents, Parameters
divide_surface = DivideSurface(Surface=cone.Cone, UCount=surface_division_branch_pattern, VCount=surface_division_branch_pattern)  # -> Points, Normals, Parameters
extend_curve = ExtendCurve(Curve=move_2.Geometry, Type=0, Start=exstend_trunk_ends, End=exstend_trunk_ends)
create_rtree = CreateRTree(InputGeometry=divide_curve.Points)
random_reduce = RandomReduce(List=flatten(divide_surface.Points), Reduction=random_reduction, Seed=1)
rtree_closest_point = RTreeClosestPoint(SearchPoints=random_reduce, RTree=create_rtree)  # -> ClosestPoint, ClosestIndex
list_item = ListItem(List=divide_curve.Points, Index=rtree_closest_point.ClosestIndex, Wrap=True)
deconstruct = Deconstruct(Point=list_item)  # -> XComponent, YComponent, ZComponent
addition = Addition(A=deconstruct.ZComponent, B=offset_trunk_vertical)
unit_y = UnitY(Factor=leaves_distance_from_branches)
unit_z_3 = UnitZ(Factor=leaves_distance_from_branches)
unit_x = UnitX(Factor=leaves_distance_from_branches)
construct_point_3 = ConstructPoint(XCoordinate=deconstruct.XComponent, YCoordinate=deconstruct.YComponent, ZCoordinate=addition)
line_2 = Line(StartPoint=construct_point_3, EndPoint=random_reduce)
type = Type()  # -> BlockTypes, ItemTypes
move_3 = Move(Geometry=line_2, Motion=expr("x*-1", unit_x))  # -> Geometry, Transform
move_4 = Move(Geometry=line_2, Motion=unit_x)  # -> Geometry, Transform
move_5 = Move(Geometry=line_2, Motion=expr("x*-1", unit_y))  # -> Geometry, Transform
move_6 = Move(Geometry=line_2, Motion=unit_y)  # -> Geometry, Transform
move_7 = Move(Geometry=line_2, Motion=expr("x*-1", unit_z_3))  # -> Geometry, Transform
move_8 = Move(Geometry=line_2, Motion=unit_z_3)  # -> Geometry, Transform
entwine = Entwine(Branch00=line_2, Branch01=extend_curve, FlattenInputs=True)
expression = Expression(x=offset_trunk_vertical, y=exstend_trunk_ends, Expression="+y-x")
match_text = MatchText(Text=type.BlockTypes, Pattern="*leaves*", Case=True)
match_text_2 = MatchText(Text=type.BlockTypes, Pattern="*log*", Case=True)
curvetopoint = CurveToPoint(Curves=entwine)
merge = Merge(
    Data1=move_3.Geometry,
    Data2=move_4.Geometry,
    Data3=move_5.Geometry,
    Data4=move_6.Geometry,
    Data5=move_7.Geometry,
    Data6=move_8.Geometry)
unit_z_4 = UnitZ(Factor=expression)
curvetopoint_2 = CurveToPoint(Curves=merge)
dispatch = Dispatch(List=type.BlockTypes, DispatchPattern=match_text)  # -> ListA, ListB
dispatch_2 = Dispatch(List=type.BlockTypes, DispatchPattern=match_text_2)  # -> ListA, ListB
move_9 = Move(Geometry=flatten(curvetopoint), Motion=unit_z_4)  # -> Geometry, Transform
move_10 = Move(Geometry=flatten(curvetopoint_2), Motion=unit_z_4)  # -> Geometry, Transform
item_selector = ItemSelector(
    dispatch_2.ListA,
    {"acacia_log", "birch_log", "cherry_log", "dark_oak_log", "jungle_log", "mangrove_log", "oak_log", "spruce_log", "stripped_acacia_log", "stripped_birch_log", "stripped_cherry_log", "stripped_dark_oak_log", "stripped_jungle_log", "stripped_mangrove_log", "stripped_oak_log", "stripped_spruce_log"}, selected="birch_log")
item_selector_2 = ItemSelector(
    dispatch.ListA,
    {"acacia_leaves", "azalea_leaves", "birch_leaves", "cherry_leaves", "dark_oak_leaves", "flowering_azalea_leaves", "jungle_leaves", "mangrove_leaves", "oak_leaves", "spruce_leaves"}, selected="acacia_leaves")
data = Data(move_10.Geometry)
data_2 = Data(move_9.Geometry)
path_functions_folder_3 = Data(path_functions_folder)
entwine_2 = Entwine(Branch00=data_2, Branch01=data, FlattenInputs=True)
entwine_3 = Entwine(Branch00=item_selector, Branch01=item_selector_2, FlattenInputs=True)
functiongenerator_2 = FunctionGenerator(
    Points=entwine_2,
    BlockType=entwine_3,
    Path=path_functions_folder_3,
    FunctionName=function_name,
    Run=run_solver_save_function_files)  # -> Points, BlockType, McFunction, Success
makeblocks = MakeBlocks(Points=functiongenerator_2.Points)
list_length = ListLength(List=flatten(functiongenerator_2.Points))
data_3 = Data(list_length)
data_4 = Data(data_3)
function_length = Panel(data_4)
panel_6 = Panel(functiongenerator_2.McFunction)
