# Grasshopper definition REPORT_PterodactylTests.gh (Grasshopper 1.0.7)
# plug-ins: MetaHopper, Pterodactyl, EleFront, Slingshot

developed_by = Panel("Daniel Bo Olesen")
# Description: OC Engineering Grasshopper Template.
# Graphic standard seen underneath
# Rightclick a colour and set to standard, there after group and comment on the group
# 
# 
# DESCRIPTION OF THE SCRIPT:
# Script der bruges i hops, oploades til GitHub så der er mulighed for at dele hops med flere brugere, da der bruges et link af http.... typen, hvormed den ikke er bruger bestemt i form af en specifik sti.
# 
# THEORY:
# bla bla.
# 
# INPUT:
# bla bla.
# 
# OUTPUT:
# bla bla.
current_revision_data_and_version = Panel("15.03.2023 - 01.00.00.00")
project = Panel("SagsNr - SagsNavn")
image_sampler = ImageSampler(Filter="Colour", Interpolate=True, Umax=842, Umin=1, Vmax=595, Vmin=1, Wrap=1)
panel = Panel(""" Use shift+ctrl+B to search in BHoM
BHoM bruger Si grundenheder, dvs. meter, newton, Pa osv.""")

# ---- group: Modify all panels
get_objects_of_same_type = GetObjectsOfSameType(Objects=panel)
set_panel_properties = SetPanelProperties(Panel=get_objects_of_same_type, Color=ColourSwatch(SwatchColor=RGB(255, 255, 255)))

# ---- group: Modify group colors, scheme colors preset
# Output
# Input
# data
group_colors = ValueList({"Output": "184,82,204 (150)", "Input": "56,245,255 (150)", "Data": "128,128,128 (150)", "Geometry": "182,204,102 (150)", "preview": "252,210,159 (150)", "OBS": "255,140,140 (150)", "Big group": "255,255,255 (150)"}, selected="Input")
set_group_properties = SetGroupProperties(Group="Grasshopper.Kernel.Types.GH_ObjectWrapper", Color=group_colors)

# ---- group: Modify line types
# Layout and group design
line_type = ValueList({"Normal": 0, "Faint": 1, "Hidden": 2}, selected="Hidden")
control_wire_display = ControlWireDisplay(WireDisplay=line_type)

# ---- group: Create scripple on group by name
# preview
# OBS
# big group
# Revision history: FILL OUT if not managed through .git
# 15.03.2023 - 01.00.00.00 - første udgivelse
# Todos: FILL OUT if not managed through .git
# - Indbyg udbøjning formel
boolean_toggle = BooleanToggle(True)
label_groups = LabelGroups(Run=boolean_toggle)

# ---- group: Apply best practice to group
# geometry
boolean_toggle_2 = BooleanToggle(True)
best_practicizer = BestPracticizer(Activate=boolean_toggle_2)

# ----
connection_string = ConnectionString(
    CommandTimeout="20",
    ConnectionTimeout="5",
    Connector="MySQL",
    Password="password",
    Port="3306",
    Server="localhost",
    UserID="root")
rdbms_query = RDBMSQuery(ConnectToggle=False, Connector="MySQL")  # -> Exceptions, TableHeadings, TableData
wire_display_toggle = WireDisplayToggle(ShowHiddenWires=Toggle(False))
panel_2 = Panel("""b1
b2
b3
s1
s2
s3
s4""")
panel_3 = Panel("""Søjle længden:
				sin(x) + cos(y) = sin(<x> deg) + cos(<y> deg) \cdot \pi \cdot \frac{2}{3} = <result> kN""")
sphere = Sphere(Base=PlaneXY(0, 0, 0), Radius=Slider(442, range=0..1000))
panel_4 = Panel("""1
2
3
4
5
6
7""")
panel_5 = Panel("""120
250
1520
2152
56852
21
21""")
bake_objects = BakeObjects(Geometry=sphere, Bake=Button())
panel_6 = Panel("""0
1
2""")
panel_7 = Panel("""ID
element
længde""")
panel_8 = Panel("""x
y
result""")
panel_9 = Panel("""45
30
25""")
merge = Merge(Data1=Slider(84, range=0..100), Data2=Slider(22, range=0..100), Data3=Slider(38, range=0..100))
entwine = Entwine(Branch00=panel_4, Branch01=panel_2, Branch02=panel_5, FlattenInputs=True)
file_path = FilePath("C:\Users\DBO\Downloads\testViewport.png")
heading = Heading(Text="Level two chapter", Level=2)
panel_10 = Panel("A building is a structure that provides shelter, comfort, and functionality for its occupants. A building can have various types of structures, such as walls, floors, roofs, doors, windows, stairs, columns, beams, etc. Each structure has a specific purpose and design, depending on the building's location, style, and function.")
page_break = PageBreak()
dynamic_math_block = DynamicMathBlock(Text=panel_3, VariablesSymbols=panel_8, VariablesValues=panel_9)
viewport = Viewport(
    Title="Example",
    ViewportName="Perspective",
    Path=file_path,
    DrawAxes=False,
    DrawGrid=False,
    DrawGridAxes=False,
    TransparentBackground=True)
pie_chart = PieChart(Title="Reaction to Pterodactyl plugin", Categories=["Happy", "Excited", "Holy cow"], Values=merge)
heading_2 = Heading(Text="Some equations", Level=3)
math_block = MathBlock(Text="sin(x) + cos(y) = ?")
table = Table(TableHeadings=panel_7, Alignment=panel_6, DataTree=entwine)
panel_11 = Panel("Dynamic Math Block")
panel_12 = Panel("Math Block")
panel_13 = Panel("A building is a structure that provides shelter, comfort, and functionality for its occupants. A building can have various types of structures, such as walls, floors, roofs, doors, windows, stairs, columns, beams, etc. Each structure has a specific purpose and design, depending on the building's location, style, and function.")
heading_3 = Heading(Text="Level one chapter", Level=1)
page_break_2 = PageBreak()
panel_14 = Panel("""Some common structures in buildings are:

- Walls: Walls are vertical structures that divide the space inside a building and support the weight of the roof and upper floors. Walls can be made of different materials, such as brick, stone, wood, concrete, metal, or glass.
- Floors: Floors are horizontal structures that provide a surface for walking, standing, or placing furniture and equipment. Floors can be made of different materials, such as wood, concrete, tile, carpet, or vinyl.
- Roofs: Roofs are structures that cover the top of a building and protect it from rain, snow, wind, and sunlight. Roofs can have different shapes, such as flat, pitched, curved, or domed. Roofs can be made of different materials, such as shingles, tiles, metal, or thatch.
- Doors: Doors are structures that allow access to or from a building or a room. Doors can have different styles, such as hinged, sliding, folding, or revolving. Doors can be made of different materials, such as wood, metal, glass, or plastic.
- Windows: Windows are structures that allow light and air to enter or exit a building or a room. Windows can have different shapes, such as rectangular, circular, or triangular. Windows can be made of different materials, such as glass, plastic, or wood.
- Stairs: Stairs are structures that allow movement between different levels of a building. Stairs can have different designs, such as straight, curved, spiral, or ladder. Stairs can be made of different materials, such as wood, metal, concrete, or stone.
- Columns: Columns are vertical structures that support the weight of a building or a structure above them. Columns can have different shapes, such as round, square, or polygonal. Columns can be made of different materials, such as stone, concrete, metal, or wood.
- Beams: Beams are horizontal structures that span across a space and support the weight of a structure above them. Beams can have different shapes, such as I-shaped, T-shaped, or L-shaped. Beams can be made of different materials, such as wood, metal, concrete, or steel.""")
horizontal_line = HorizontalLine()
entwine_2 = Entwine(
    Branch00=page_break,
    Branch01=heading,
    Branch02=panel_10,
    Branch03=pie_chart,
    Branch04="Jeg er en viewport",
    Branch05=viewport,
    FlattenInputs=True)  # -> flatten(Result)
merge_2 = Merge(Data1=page_break_2, Data2=heading_2, Data3="This is a beam calculation", Data4=dynamic_math_block, Data5=math_block)
entwine_3 = Entwine(Branch00=heading_3, Branch01=panel_13, Branch02=horizontal_line, Branch03=panel_14, Branch04=table, FlattenInputs=True)  # -> flatten(Result)
dynamic_math_block_2 = DynamicMathBlock(Text="2 \cdot sin(x) + cos(y) = 2 \cdot sin(<x>) + cos(<y>) = ...", VariablesSymbols=["x", "y"], VariablesValues=[1, 2])
entwine_4 = Entwine(Branch00=entwine_3, Branch01=entwine_2, Branch02=merge_2, FlattenInputs=True)  # -> flatten(Result)
math_block_2 = MathBlock(Text="\bold{Euler's \; identity }\\ e^{i \pi} + 1 = 0")
create_report = CreateReport(ReportParts=entwine_4, Title="Report Title", TableOfContents=True, AutoSpacing=False)
https_casual_effects_com_markdeep = Panel("<!-- Markdeep: --><style class=\"fallback\">body{visibility:hidden;white-space:pre;font-family:monospace}</style><script src=\"markdeep.min.js\" charset=\"utf-8\"></script><script src=\"https://morgan3d.github.io/markdeep/latest/markdeep.min.js?\" charset=\"utf-8\"></script><script>window.alreadyProcessedMarkdeep||(document.body.style.visibility=\"visible\")</script>")
file_path_2 = FilePath("C:\Users\DBO\Downloads\PterodactylTest.md")
merge_3 = Merge(Data2=create_report)
save_report = SaveReport(Report=merge_3, Path=file_path_2)
create_report_2 = CreateReport(
    ReportParts=[create_report, https_casual_effects_com_markdeep],
    Title="Report Title",
    TableOfContents=True,
    AutoSpacing=False)
file_path_3 = FilePath("C:\Users\DBO\Downloads\PterodactylTest.md.html")
save_report_2 = SaveReport(Report=create_report_2, Path=file_path_3)
