# Grasshopper definition RIR_Arched roof structure.gh (Grasshopper 1.0.7)
# plug-ins: Rhino.Inside for Autodesk Revit, Karamba3D

# Description: OC Engineering Grasshopper Template.
# Graphic standard seen underneath
# Rightclick a colour and set to standard, there after group and comment on the group
# 
# 
# DESCRIPTION OF THE SCRIPT:
# This script makes a arch truss with cross bracing and roof rafters. It's meant to be run using Rhino.Inside.Revit
# 
# THEORY:
# Nothing special
# 
# INPUT:
# Tons of different possibilities, based on grid lines in revit.
# 
# OUTPUT:
# Full roof structure
current_revision_data_and_version = Panel("20.03.2023 - 01.00.00.00")
developed_by = Panel("Daniel Bo Olesen")
project = Panel("210001 - Openchurch Silkeborgvej 88")
image_sampler = ImageSampler(Filter="Colour", Interpolate=True, Umax=842, Umin=1, Vmax=595, Vmin=1, Wrap=1)
# højden sættes ved tagfoden.
forskyd_lodret_ift_valgte_level = Slider(0, range=-2000..2000)

# ---- group: Trækbånd
# Todos: FILL OUT if not managed through .git
# - TRANSLATE
placering_trækbånd_i_af_sidehøjden = Slider(0.545, range=0..1)
# Revision history: FILL OUT if not managed through .git
# 20.03.2023 - 01.00.00.00 - First public release
overgang_trækbånd_i_af_bredde_bue = Slider(0.145, range=0..1)
skaler_stål_plader_til_trækbånd = Slider(1.45, range=0.1..2)

# ---- group: Trækbånd / hhv. lodret og vandret mål
forskyd_trækstænger_vandret_ved_vederlag = Slider(130, range=0..500)
forskyd_trækstænger_lodret_ved_vederlag = Slider(40, range=0..500)

# ----
# Vælg et af grid der løber langs spærfod
query_grids = QueryGrids()
# Skal være lige antal, der placeres skråbånd på hver anden tagåse på nær de 2 yderste. angiver antal mellemrum, dvs. 20 = 21 tagåser
forskyder_knudepunkt_hvor_tværstænger_kr = Slider(200, range=0..1000)  # "Forskyder knudepunkt hvor tværstænger krydser"
# Vælg grids der skal have spær og tagåser, brug ctrl eller shift for flere. I de 2 yderste fag medtages spærfag ikke
query_grids_2 = QueryGrids()
forskyd_lodposter_vandret_1_2_profil_høj = Slider(38, range=0..200)  # "Forskyd lodposter vandret (1/2 profil højde)"
antal_lodstænger_til_trækbånd = Slider(4, range=0..10)
forskyder_tagåser_ved_tagfod = Slider(150, range=0..800)
længde_af_forskydningsfelt_mm = Slider(1870, range=0..7500)
lodret_højde_sider_mm = Slider(660, range=0..3000)
# Spænd er 18 m
# Radius er 18m
# 
# ca. tjek op på præcise mål
# OBS: Mål er fra elementers centerlinjer.
# 
# Kan justification måske ændres??
# 
# eventuelt offset med en halv dimension
højde_samlet_bue_mm = Slider(800, range=0..2000)
yderste_mål_mm = Slider(17890, range=0..50000)
antal_tagåser = Slider(20, range=0..60)
radius_øverste_flange_mm = Slider(18800, range=0..50000)
antal_knuder_i_gitter = Slider(24, range=0..100)
levels_picker = LevelsPicker(<levels picker referenced from the Revit model>)
eventuel_scalering = Panel("1")
value_picker = ValuePicker(query_grids)
value_picker_2 = ValuePicker(query_grids_2)
kan_bruges_til_sortering = Panel("""0
1
2""")
panel = Panel("""-90
0""")
sort_list = SortList(Keys=kan_bruges_til_sortering, ValuesValuesA=value_picker_2)  # -> Keys, ValuesValuesA
query_grids_3 = QueryGrids()
# Vælg retning på spær, afhænger af grid og indsætnings retning
value_picker_3 = ValuePicker(panel)
# Vælg grid der indsættes spær på
value_picker_4 = ValuePicker(value_picker_2)

# ---- group: Basic geometry, and top flange move to 0,0,x,
# Then θ, the angle between the radii going to the two points is given by
# θ=2×sin−1(D/2R)
# 
# Hvor D er spænd og R er radius, forudsætter punkter er i linje med hinanden
multiplication = Multiplication(A=radius_øverste_flange_mm, B=eventuel_scalering)
multiplication_2 = Multiplication(A=yderste_mål_mm, B=eventuel_scalering)
multiplication_3 = Multiplication(A=multiplication, B=2)
division = Division(A=multiplication_2, B=multiplication_3)
arcsine = ArcSine(Value=division)
construct_point = ConstructPoint(XCoordinate=0, YCoordinate=0, ZCoordinate=0)
multiplication_4 = Multiplication(A=arcsine, B=2)
arc = Arc(Plane=construct_point, Radius=multiplication, Angle=multiplication_4)  # -> Arc, Length
xy_plane = XYPlane(Origin=Point(0, 0, 0))
circle = Circle(Plane=construct_point, Radius=multiplication)
rotate = Rotate(Geometry=arc.Arc, Angle=expr("((x/2)*-1)+0.5*pi", multiplication_4), Plane=xy_plane)  # -> Geometry, Transform
yz_plane = YZPlane(Origin=Point(0, 0, 0))
rotate_2 = Rotate(Geometry=rotate.Geometry, Angle=1.570796327, Plane=yz_plane)  # -> Geometry, Transform
end_points = EndPoints(Curve=rotate_2.Geometry)  # -> Start, End
move = Move(Geometry=rotate_2.Geometry, Motion=expr("x*-1", end_points.End))  # -> Geometry, Transform
rotate_3 = Rotate(Geometry=move.Geometry, Angle=1.570796327, Plane=xy_plane)  # -> Geometry, Transform
unit_z = UnitZ(Factor=lodret_højde_sider_mm)
flytter_buen_i_z_retning_så_der_kun_arbe = Move(Geometry=rotate_3.Geometry, Motion=unit_z)  # -> Geometry, Transform; "Flytter buen i Z retning så der kun arbejdes med positive tal"

# ----
radians = Radians(Degrees=value_picker_3)

# ---- group: Laver top arch i alle grid lines, placeret i positivt xy koordinat sys
element_curve = ElementCurve(Element=sort_list.ValuesValuesA)  # -> Element, Curve
end_points_2 = EndPoints(Curve=element_curve.Curve)  # -> Start, End
list_item = ListItem(List=end_points_2.End, Index=0, Wrap=True)
shift_list = ShiftList(List=end_points_2.End, Shift=1, Wrap=False)
distance = Distance(PointA=list_item, PointB=shift_list)
distance_2 = Distance(PointA=end_points_2.End, PointB=shift_list)
list_length = ListLength(List=distance)
subtraction = Subtraction(A=list_length, B=2)
sub_list = SubList(List=distance, Domain=subtraction, Wrap=False)  # -> List, Index
offset_curve = OffsetCurve(Curve=flytter_buen_i_z_retning_så_der_kun_arbe.Geometry, Distance=expr("x*-1", sub_list.List), Plane=xy_plane, Corners=1)
deconstruct_arc = DeconstructArc(Arc=offset_curve)  # -> BasePlane, Radius, Angle
arc_2 = Arc(Plane=deconstruct_arc.BasePlane, Radius=deconstruct_arc.Radius, Angle=deconstruct_arc.Angle)  # -> Arc, Length

# ----
panel_2 = Panel(element_curve.Element)

# ---- group: Vertical posts side
end_points_3 = EndPoints(Curve=arc_2.Arc)  # -> Start, End
deconstruct = Deconstruct(Point=end_points_3.Start)  # -> XComponent, YComponent, ZComponent
deconstruct_2 = Deconstruct(Point=end_points_3.End)  # -> XComponent, YComponent, ZComponent
subtraction_2 = Subtraction(A=deconstruct.ZComponent, B=lodret_højde_sider_mm)
subtraction_3 = Subtraction(A=deconstruct_2.ZComponent, B=lodret_højde_sider_mm)
construct_point_2 = ConstructPoint(XCoordinate=deconstruct.XComponent, YCoordinate=deconstruct.YComponent, ZCoordinate=subtraction_2)
construct_point_3 = ConstructPoint(XCoordinate=deconstruct_2.XComponent, YCoordinate=deconstruct_2.YComponent, ZCoordinate=subtraction_3)
line = Line(StartPoint=end_points_3.Start, EndPoint=construct_point_2)
line_2 = Line(StartPoint=end_points_3.End, EndPoint=construct_point_3)
curve = Curve([line, line_2])

# ---- group: Bottom flange
unit_z_2 = UnitZ(Factor=højde_samlet_bue_mm)
offset_curve_2 = OffsetCurve(Curve=arc_2.Arc, Distance=expr("x*-1", unit_z_2), Corners=1)
divide_curve = DivideCurve(Curve=offset_curve_2, Count=3, Kinks=False)  # -> Points, Tangents, Parameters
deconstruct_arc_2 = DeconstructArc(Arc=offset_curve_2)  # -> BasePlane, Radius, Angle
line_3 = Line(StartPoint=construct_point_2, EndPoint=construct_point_3)
arc_3 = Arc(Plane=deconstruct_arc_2.BasePlane, Radius=deconstruct_arc_2.Radius, Angle=Domain(0, 6.283185307))  # -> Arc, Length
curve_line = CurveLine(Curve=arc_3.Arc, Line=line_3)  # -> Points, Params, Count
deconstruct_3 = Deconstruct(Point=curve_line.Points)  # -> XComponent, YComponent, ZComponent
sort_list_2 = SortList(Keys=deconstruct_3.YComponent, ValuesValuesA=curve_line.Points)  # -> Keys, ValuesValuesA
list_item_2 = ListItem(List=sort_list_2.ValuesValuesA, Index=1, Wrap=True)
list_item_3 = ListItem(List=sort_list_2.ValuesValuesA, Index=0, Wrap=True)
list_item_4 = ListItem(List=divide_curve.Points, Index=1, Wrap=True)
arc_3pt = Arc3Pt(PointA=list_item_2, PointB=list_item_4, PointC=list_item_3)  # -> Arc, Plane, Radius
shift_paths = ShiftPaths(Data=arc_3pt.Arc, Offset=-2)

# ---- group: Trækbånd, midter del
multiplication_5 = Multiplication(A=lodret_højde_sider_mm, B=placering_trækbånd_i_af_sidehøjden)
divide_distance = DivideDistance(Curve=line_2, Distance=multiplication_5)  # -> Points, Tangents, Parameters
divide_distance_2 = DivideDistance(Curve=line, Distance=multiplication_5)  # -> Points, Tangents, Parameters
list_item_5 = ListItem(List=divide_distance.Points, Index=expr("1", 0), Wrap=True)
list_item_6 = ListItem(List=divide_distance_2.Points, Index=expr("1", 0), Wrap=True)
deconstruct_4 = Deconstruct(Point=list_item_5)  # -> XComponent, YComponent, ZComponent
deconstruct_5 = Deconstruct(Point=list_item_6)  # -> XComponent, YComponent, ZComponent
multiplication_6 = Multiplication(A=yderste_mål_mm, B=overgang_trækbånd_i_af_bredde_bue)
division_2 = Division(A=multiplication_6, B=2)
subtraction_4 = Subtraction(A=deconstruct_5.YComponent, B=division_2)
addition = Addition(A=deconstruct_4.YComponent, B=division_2)
construct_point_4 = ConstructPoint(XCoordinate=deconstruct_5.XComponent, YCoordinate=subtraction_4, ZCoordinate=deconstruct_5.ZComponent)
construct_point_5 = ConstructPoint(XCoordinate=deconstruct_4.XComponent, YCoordinate=addition, ZCoordinate=deconstruct_4.ZComponent)
line_4 = Line(StartPoint=construct_point_4, EndPoint=construct_point_5)

# ----
arc_4 = Arc(Plane=deconstruct_arc.BasePlane, Radius=deconstruct_arc.Radius, Angle=Domain(0, 6.283185307))  # -> Arc, Length
area = Area(Geometry=arc_4.Arc)  # -> Area, Centroid

# ---- group: Trækbånd sider
line_5 = Line(StartPoint=list_item_5, EndPoint=construct_point_5)
line_6 = Line(StartPoint=list_item_6, EndPoint=construct_point_4)
offset_curve_3 = OffsetCurve(Curve=line_5, Distance=expr("x*-1", forskyd_trækstænger_vandret_ved_vederlag), Corners=1)
offset_curve_4 = OffsetCurve(Curve=line_5, Distance=expr("x*-1", forskyd_trækstænger_vandret_ved_vederlag), Corners=1)
offset_curve_5 = OffsetCurve(Curve=line_5, Distance=forskyd_trækstænger_vandret_ved_vederlag, Corners=1)
offset_curve_6 = OffsetCurve(Curve=line_5, Distance=forskyd_trækstænger_vandret_ved_vederlag, Corners=1)
offset_curve_7 = OffsetCurve(Curve=line_6, Distance=expr("x*-1", forskyd_trækstænger_vandret_ved_vederlag), Corners=1)
offset_curve_8 = OffsetCurve(Curve=line_6, Distance=expr("x*-1", forskyd_trækstænger_vandret_ved_vederlag), Corners=1)
offset_curve_9 = OffsetCurve(Curve=line_6, Distance=forskyd_trækstænger_vandret_ved_vederlag, Corners=1)
offset_curve_10 = OffsetCurve(Curve=line_6, Distance=forskyd_trækstænger_vandret_ved_vederlag, Corners=1)
yz_plane_2 = YZPlane(Origin=Point(0, 0, 0))
yz_plane_3 = YZPlane(Origin=Point(0, 0, 0))
offset_curve_11 = OffsetCurve(Curve=offset_curve_10, Distance=expr("x*-1", forskyd_trækstænger_lodret_ved_vederlag), Plane=yz_plane_3, Corners=1)
offset_curve_12 = OffsetCurve(Curve=offset_curve_6, Distance=expr("x*-1", forskyd_trækstænger_lodret_ved_vederlag), Plane=yz_plane_2, Corners=1)
offset_curve_13 = OffsetCurve(Curve=offset_curve_4, Distance=expr("x*-1", forskyd_trækstænger_lodret_ved_vederlag), Plane=yz_plane_2, Corners=1)
offset_curve_14 = OffsetCurve(Curve=offset_curve_5, Distance=forskyd_trækstænger_lodret_ved_vederlag, Plane=yz_plane_2, Corners=1)
offset_curve_15 = OffsetCurve(Curve=offset_curve_3, Distance=forskyd_trækstænger_lodret_ved_vederlag, Plane=yz_plane_2, Corners=1)
offset_curve_16 = OffsetCurve(Curve=offset_curve_8, Distance=expr("x*-1", forskyd_trækstænger_lodret_ved_vederlag), Plane=yz_plane_3, Corners=1)
offset_curve_17 = OffsetCurve(Curve=offset_curve_9, Distance=forskyd_trækstænger_lodret_ved_vederlag, Plane=yz_plane_3, Corners=1)
offset_curve_18 = OffsetCurve(Curve=offset_curve_7, Distance=forskyd_trækstænger_lodret_ved_vederlag, Plane=yz_plane_3, Corners=1)
curve_2 = Curve([offset_curve_11, offset_curve_17, offset_curve_18, offset_curve_16, offset_curve_13, offset_curve_15, offset_curve_14, offset_curve_12])

# ---- group: Make sub arches and points for connecting braces
curve_domain = CurveDomain(Curve=[shift_paths, arc_2.Arc])  # -> Curve, Domain
deconstruct_domain = DeconstructDomain(Domain=curve_domain.Domain)  # -> Start, End
addition_2 = Addition(A=deconstruct_domain.Start, B=længde_af_forskydningsfelt_mm)
subtraction_5 = Subtraction(A=deconstruct_domain.End, B=længde_af_forskydningsfelt_mm)
construct_domain = ConstructDomain(DomainStart=addition_2, DomainEnd=subtraction_5)
sub_curve = SubCurve(BaseCurve=[shift_paths, arc_2.Arc], Domain=construct_domain)
list_item_7 = ListItem(List=sub_curve, Index=0, Wrap=True)
list_item_8 = ListItem(List=sub_curve, Index=expr("1", 0), Wrap=True)
offset_curve_19 = OffsetCurve(Curve=list_item_8, Distance=expr("-x", forskyder_knudepunkt_hvor_tværstænger_kr), Corners=1)
offset_curve_20 = OffsetCurve(Curve=list_item_7, Distance=forskyder_knudepunkt_hvor_tværstænger_kr, Corners=1)
divide_curve_2 = DivideCurve(Curve=[offset_curve_20, offset_curve_19], Count=antal_knuder_i_gitter, Kinks=False)  # -> Points, Tangents, Parameters

# ---- group: horizontal posts side
line_7 = Line(StartPoint=construct_point_2, EndPoint=list_item_2)
line_8 = Line(StartPoint=construct_point_3, EndPoint=list_item_3)
curve_3 = Curve([line_8, line_7])

# ---- group: Endeplader
end_points_4 = EndPoints(Curve=offset_curve_13)  # -> Start, End
end_points_5 = EndPoints(Curve=offset_curve_12)  # -> Start, End
end_points_6 = EndPoints(Curve=offset_curve_14)  # -> Start, End
end_points_7 = EndPoints(Curve=offset_curve_15)  # -> Start, End
end_points_8 = EndPoints(Curve=offset_curve_16)  # -> Start, End
end_points_9 = EndPoints(Curve=offset_curve_11)  # -> Start, End
end_points_10 = EndPoints(Curve=offset_curve_17)  # -> Start, End
end_points_11 = EndPoints(Curve=offset_curve_18)  # -> Start, End
point = Point(end_points_5.Start)
point_2 = Point(end_points_6.End)
point_3 = Point(end_points_7.Start)
point_4 = Point(end_points_7.End)
point_5 = Point(end_points_6.Start)
point_6 = Point(end_points_5.End)
point_7 = Point(end_points_4.End)
point_8 = Point(end_points_4.Start)
point_9 = Point(end_points_9.Start)
point_10 = Point(end_points_10.End)
point_11 = Point(end_points_11.End)
point_12 = Point(end_points_11.Start)
point_13 = Point(end_points_10.Start)
point_14 = Point(end_points_9.End)
point_15 = Point(end_points_8.End)
point_16 = Point(end_points_8.Start)
entwine = Entwine(Branch00=point, Branch01=point_6, FlattenInputs=True)
entwine_2 = Entwine(Branch00=point_9, Branch01=point_14, FlattenInputs=True)
entwine_3 = Entwine(Branch00=point_5, Branch01=point_2, FlattenInputs=True)
entwine_4 = Entwine(Branch00=point_3, Branch01=point_4, FlattenInputs=True)
entwine_5 = Entwine(Branch00=point_8, Branch01=point_7, FlattenInputs=True)
entwine_6 = Entwine(Branch00=point_13, Branch01=point_10, FlattenInputs=True)
entwine_7 = Entwine(Branch00=point_12, Branch01=point_11, FlattenInputs=True)
entwine_8 = Entwine(Branch00=point_16, Branch01=point_15, FlattenInputs=True)
_4point_surface = _4PointSurface(CornerA=entwine_5, CornerB=entwine_4, CornerC=entwine_3, CornerD=entwine)
_4point_surface_2 = _4PointSurface(CornerA=entwine_8, CornerB=entwine_7, CornerC=entwine_6, CornerD=entwine_2)
area_2 = Area(Geometry=_4point_surface)  # -> Area, Centroid
area_3 = Area(Geometry=_4point_surface_2)  # -> Area, Centroid
scale = Scale(Geometry=_4point_surface_2, Center=area_3.Centroid, Factor=graft(skaler_stål_plader_til_trækbånd))  # -> Geometry, Transform
scale_2 = Scale(Geometry=_4point_surface, Center=area_2.Centroid, Factor=graft(skaler_stål_plader_til_trækbånd))  # -> Geometry, Transform

# ---- group: Makes braces
simplify_tree = SimplifyTree(Tree=divide_curve_2.Points, Front=False)
split_tree = SplitTree(Data=simplify_tree, Masks=flatten("{*;0}"))  # -> Positive, Negative

# ---- group: Makes braces / Top flange offset points and make first set off braces
shift_list_2 = ShiftList(List=split_tree.Negative, Shift=1, Wrap=False)
list_length_2 = ListLength(List=shift_list_2)
subtraction_6 = Subtraction(A=list_length_2, B=1)
sub_list_2 = SubList(List=shift_list_2, Domain=subtraction_6, Wrap=True)  # -> List, Index
sub_list_3 = SubList(List=split_tree.Positive, Domain=subtraction_6, Wrap=False)  # -> List, Index
line_9 = Line(StartPoint=sub_list_3.List, EndPoint=sub_list_2.List)

# ---- group: Makes braces / Bottom flange offset point and make second set of braces
shift_list_3 = ShiftList(List=split_tree.Positive, Shift=1, Wrap=False)
sub_list_4 = SubList(List=split_tree.Negative, Domain=subtraction_6, Wrap=True)  # -> List, Index
sub_list_5 = SubList(List=shift_list_3, Domain=subtraction_6, Wrap=False)  # -> List, Index
line_10 = Line(StartPoint=sub_list_5.List, EndPoint=sub_list_4.List)

# ----
multiplication_7 = Multiplication(A=forskyder_knudepunkt_hvor_tværstænger_kr, B=2)

# ---- group: Create the initial cross in sub arches, on the sides shear reinforcement fields
list_item_9 = ListItem(List=divide_curve_2.Parameters, Index=0, Wrap=True)
list_item_10 = ListItem(List=divide_curve_2.Parameters, Index=1, Wrap=True)
subtraction_7 = Subtraction(A=list_item_10, B=list_item_9)
shift_paths_2 = ShiftPaths(Data=subtraction_7, Offset=-1)
shift_paths_3 = ShiftPaths(Data=subtraction_7, Offset=-1)
addition_3 = Addition(A=subtraction_5, B=shift_paths_2, C=multiplication_7)
subtraction_8 = Subtraction(A=addition_2, B=shift_paths_3, C=multiplication_7)
construct_domain_2 = ConstructDomain(DomainStart=addition_2, DomainEnd=subtraction_8)
construct_domain_3 = ConstructDomain(DomainStart=subtraction_5, DomainEnd=addition_3)
sub_curve_2 = SubCurve(BaseCurve=[shift_paths, arc_2.Arc], Domain=construct_domain_3)
sub_curve_3 = SubCurve(BaseCurve=[shift_paths, arc_2.Arc], Domain=construct_domain_2)

# ---- group: Lodstænger til trækbånd
line_11 = Line(StartPoint=list_item_6, EndPoint=list_item_5)
construct_domain_4 = ConstructDomain(DomainStart=expr("1", 0), DomainEnd=antal_lodstænger_til_trækbånd)
divide_curve_3 = DivideCurve(Curve=line_11, Count=expr("x+1", antal_lodstænger_til_trækbånd), Kinks=False)  # -> Points, Tangents, Parameters
unit_z_3 = UnitZ(Factor=1)
sub_list_6 = SubList(List=divide_curve_3.Points, Domain=construct_domain_4, Wrap=True)  # -> List, Index
line_sdl = LineSDL(Start=sub_list_6.List, Direction=unit_z_3, Length=1000)
curve_4 = Curve(shift_paths)
curve_line_2 = CurveLine(Curve=curve_4, Line=line_sdl)  # -> flatten(Points), Params, Count
partition_list = PartitionList(List=curve_line_2.Points, Size=antal_lodstænger_til_trækbånd)
line_12 = Line(StartPoint=sub_list_6.List, EndPoint=partition_list)

# ---- group: create full sub arches for the sides, shear reinforced fields
deconstruct_domain_2 = DeconstructDomain(Domain=curve_domain.Domain)  # -> Start, End
construct_domain_5 = ConstructDomain(DomainStart=subtraction_5, DomainEnd=deconstruct_domain_2.End)
construct_domain_6 = ConstructDomain(DomainStart=deconstruct_domain_2.Start, DomainEnd=addition_2)
sub_curve_4 = SubCurve(BaseCurve=[shift_paths, arc_2.Arc], Domain=construct_domain_6)
sub_curve_5 = SubCurve(BaseCurve=[shift_paths, arc_2.Arc], Domain=construct_domain_5)

# ---- group: Makes shear reinforcement fields
end_points_12 = EndPoints(Curve=sub_curve_2)  # -> Start, End
end_points_13 = EndPoints(Curve=sub_curve_3)  # -> Start, End
shift_list_4 = ShiftList(List=end_points_12.End, Shift=1, Wrap=True)
shift_list_5 = ShiftList(List=end_points_13.End, Shift=1, Wrap=True)
line_13 = Line(StartPoint=end_points_12.Start, EndPoint=shift_list_4)
line_14 = Line(StartPoint=end_points_13.Start, EndPoint=shift_list_5)
line_line_intersection_karamba3d = LineLineIntersectionKaramba3D(Line=line_14, LimitDistance_m=0.005)  # -> IntersectionPoints, LineSubSegements
line_line_intersection_karamba3d_2 = LineLineIntersectionKaramba3D(Line=line_13, LimitDistance_m=0.005)  # -> IntersectionPoints, LineSubSegements
list_item_11 = ListItem(List=line_line_intersection_karamba3d.LineSubSegements, Index=1, Wrap=True)
list_item_12 = ListItem(List=line_line_intersection_karamba3d_2.LineSubSegements, Index=0, Wrap=True)
boundary_surfaces = BoundarySurfaces(Edges=flatten([list_item_12, sub_curve_5, line_2, line_8]))
boundary_surfaces_2 = BoundarySurfaces(Edges=flatten([sub_curve_4, line_7, line, list_item_11]))

# ----
z_justification_ikke_ret = Panel("""Top
Center
Origin
Bottom""")
y_justification_ikke_ret = Panel("""Right
Center
Origin
Left""")
flyt_tagåser = Slider(-25, range=-150..150)
set_extension_skråbånd = Slider(50, range=-500..500)
set_extension_skråbånd_2 = Slider(0, range=-500..500)
fsdfsdf = ValuePicker(z_justification_ikke_ret)
fsdfsdf_2 = ValuePicker(z_justification_ikke_ret)

# ---- group: input Side 1, skråbånd
fsdfsdf_3 = ValuePicker(y_justification_ikke_ret)
fsdfsdf_4 = ValuePicker(z_justification_ikke_ret)

# ----
set_extension_lodstænger_trækbånd = Slider(0, range=-500..500)

fsdfsdf_5 = ValuePicker(z_justification_ikke_ret)

fsdfsdf_6 = ValuePicker(z_justification_ikke_ret)

# ---- group: Input lodposter side 2
fsdfsdf_7 = ValuePicker(y_justification_ikke_ret)

# ----
set_extension_braces = Slider(200, range=-500..500)

# ---- group: Input skråbånd side 2
fsdfsdf_8 = ValuePicker(y_justification_ikke_ret)

# ----
set_extension_sider_del_trækbånd = Slider(60, range=-500..500)
set_extension_midt_del_trækbånd = Slider(90, range=-500..500)

# ---- group: Fælles
built_in_categories = BuiltInCategories("autodesk.revit.category.family:structuralFraming-1.0.0", SearchPattern="structural beam")
category_parameters = CategoryParameters(Category=built_in_categories)

# ---- group: Input skråbånd, fælles
element_type_picker = ElementTypePicker(
    built_in_categories,
    {"Konstruktionstræ - C24 : 45 x 145mm": "5ca0e5e6-d4ae-4a82-aaed-b1437e04bf6f:e49c5e58-d29a-4c1d-8804-90a8e0a510a6-0006c6be", "Konstruktionstræ - C24 : 45 x 195mm": "5ca0e5e6-d4ae-4a82-aaed-b1437e04bf6f:374e7de6-c751-4c8b-8729-d2fda166ad12-00205972", "Konstruktionstræ - C24 : 45 x 245mm": "5ca0e5e6-d4ae-4a82-aaed-b1437e04bf6f:d1ee8fc3-d1d9-47d4-bd34-99b45ed829f0-000b9fc8", "Konstruktionstræ - C24 : 45 x 295mm": "5ca0e5e6-d4ae-4a82-aaed-b1437e04bf6f:a07ebcf2-56a6-4c8a-b025-74aeaa59a2b7-00232e25", "Konstruktionstræ - C24 : 45 x 95mm": "5ca0e5e6-d4ae-4a82-aaed-b1437e04bf6f:e32d8bac-8c95-45b6-bd4f-286ccc275567-002117bb", "Limtræ - GL30c : 140 x 166mm": "5ca0e5e6-d4ae-4a82-aaed-b1437e04bf6f:7567d436-1755-4d0b-85e8-b8ae4ac7e00e-00284d6b", "Limtræ - GL30c : 140 x 200mm": "5ca0e5e6-d4ae-4a82-aaed-b1437e04bf6f:7567d436-1755-4d0b-85e8-b8ae4ac7e00e-00284d6d", "Limtræ - GL30c : 140 x 233mm": "5ca0e5e6-d4ae-4a82-aaed-b1437e04bf6f:7567d436-1755-4d0b-85e8-b8ae4ac7e00e-00284d6f", "Limtræ - GL30c : 140 x 266mm": "5ca0e5e6-d4ae-4a82-aaed-b1437e04bf6f:7567d436-1755-4d0b-85e8-b8ae4ac7e00e-00284d71", "Limtræ - GL30c : 140 x 300mm": "5ca0e5e6-d4ae-4a82-aaed-b1437e04bf6f:7567d436-1755-4d0b-85e8-b8ae4ac7e00e-00284d73", "Limtræ - GL30c : 140 x 315mm": "5ca0e5e6-d4ae-4a82-aaed-b1437e04bf6f:7567d436-1755-4d0b-85e8-b8ae4ac7e00e-00284f6d", "Limtræ - GL30c : 140 x 333mm": "5ca0e5e6-d4ae-4a82-aaed-b1437e04bf6f:7567d436-1755-4d0b-85e8-b8ae4ac7e00e-00284d75", "Limtræ - GL30c : 140 x 360mm": "5ca0e5e6-d4ae-4a82-aaed-b1437e04bf6f:7567d436-1755-4d0b-85e8-b8ae4ac7e00e-00284f6f", "Limtræ - GL30c : 140 x 366mm": "5ca0e5e6-d4ae-4a82-aaed-b1437e04bf6f:7567d436-1755-4d0b-85e8-b8ae4ac7e00e-00284d77", "Limtræ - GL30c : 140 x 400mm": "5ca0e5e6-d4ae-4a82-aaed-b1437e04bf6f:7567d436-1755-4d0b-85e8-b8ae4ac7e00e-00284d79", "Limtræ - GL30c : 65 x 133mm": "5ca0e5e6-d4ae-4a82-aaed-b1437e04bf6f:84d24ac1-70b8-4fae-8208-07e4d8d68360-00284d47", "Limtræ - GL30c : 65 x 166mm": "5ca0e5e6-d4ae-4a82-aaed-b1437e04bf6f:7567d436-1755-4d0b-85e8-b8ae4ac7e00e-00284d67", "Limtræ - GL30c : 65 x 200mm": "5ca0e5e6-d4ae-4a82-aaed-b1437e04bf6f:7567d436-1755-4d0b-85e8-b8ae4ac7e00e-00284d69"}, selected="Konstruktionstræ - C24 : 45 x 145mm")

# ----
built_in_categories_2 = BuiltInCategories("autodesk.revit.category.family:structuralFraming-1.0.0", SearchPattern="structural beam")
element_type_picker_2 = ElementTypePicker(
    built_in_categories_2,
    {"Konstruktionstræ - C24 : 45 x 145mm": "5ca0e5e6-d4ae-4a82-aaed-b1437e04bf6f:e49c5e58-d29a-4c1d-8804-90a8e0a510a6-0006c6be", "Konstruktionstræ - C24 : 45 x 195mm": "5ca0e5e6-d4ae-4a82-aaed-b1437e04bf6f:374e7de6-c751-4c8b-8729-d2fda166ad12-00205972", "Konstruktionstræ - C24 : 45 x 245mm": "5ca0e5e6-d4ae-4a82-aaed-b1437e04bf6f:d1ee8fc3-d1d9-47d4-bd34-99b45ed829f0-000b9fc8", "Konstruktionstræ - C24 : 45 x 295mm": "5ca0e5e6-d4ae-4a82-aaed-b1437e04bf6f:a07ebcf2-56a6-4c8a-b025-74aeaa59a2b7-00232e25", "Konstruktionstræ - C24 : 45 x 95mm": "5ca0e5e6-d4ae-4a82-aaed-b1437e04bf6f:e32d8bac-8c95-45b6-bd4f-286ccc275567-002117bb", "Limtræ - GL30c : 140 x 166mm": "5ca0e5e6-d4ae-4a82-aaed-b1437e04bf6f:7567d436-1755-4d0b-85e8-b8ae4ac7e00e-00284d6b", "Limtræ - GL30c : 140 x 200mm": "5ca0e5e6-d4ae-4a82-aaed-b1437e04bf6f:7567d436-1755-4d0b-85e8-b8ae4ac7e00e-00284d6d", "Limtræ - GL30c : 140 x 233mm": "5ca0e5e6-d4ae-4a82-aaed-b1437e04bf6f:7567d436-1755-4d0b-85e8-b8ae4ac7e00e-00284d6f", "Limtræ - GL30c : 140 x 266mm": "5ca0e5e6-d4ae-4a82-aaed-b1437e04bf6f:7567d436-1755-4d0b-85e8-b8ae4ac7e00e-00284d71", "Limtræ - GL30c : 140 x 300mm": "5ca0e5e6-d4ae-4a82-aaed-b1437e04bf6f:7567d436-1755-4d0b-85e8-b8ae4ac7e00e-00284d73", "Limtræ - GL30c : 140 x 315mm": "5ca0e5e6-d4ae-4a82-aaed-b1437e04bf6f:7567d436-1755-4d0b-85e8-b8ae4ac7e00e-00284f6d", "Limtræ - GL30c : 140 x 333mm": "5ca0e5e6-d4ae-4a82-aaed-b1437e04bf6f:7567d436-1755-4d0b-85e8-b8ae4ac7e00e-00284d75", "Limtræ - GL30c : 140 x 360mm": "5ca0e5e6-d4ae-4a82-aaed-b1437e04bf6f:7567d436-1755-4d0b-85e8-b8ae4ac7e00e-00284f6f", "Limtræ - GL30c : 140 x 366mm": "5ca0e5e6-d4ae-4a82-aaed-b1437e04bf6f:7567d436-1755-4d0b-85e8-b8ae4ac7e00e-00284d77", "Limtræ - GL30c : 140 x 400mm": "5ca0e5e6-d4ae-4a82-aaed-b1437e04bf6f:7567d436-1755-4d0b-85e8-b8ae4ac7e00e-00284d79", "Limtræ - GL30c : 65 x 133mm": "5ca0e5e6-d4ae-4a82-aaed-b1437e04bf6f:84d24ac1-70b8-4fae-8208-07e4d8d68360-00284d47", "Limtræ - GL30c : 65 x 166mm": "5ca0e5e6-d4ae-4a82-aaed-b1437e04bf6f:7567d436-1755-4d0b-85e8-b8ae4ac7e00e-00284d67", "Limtræ - GL30c : 65 x 200mm": "5ca0e5e6-d4ae-4a82-aaed-b1437e04bf6f:7567d436-1755-4d0b-85e8-b8ae4ac7e00e-00284d69"}, selected="Konstruktionstræ - C24 : 45 x 145mm")
element_type_picker_3 = ElementTypePicker(
    built_in_categories_2,
    {"Konstruktionstræ - C24 : 45 x 145mm": "5ca0e5e6-d4ae-4a82-aaed-b1437e04bf6f:e49c5e58-d29a-4c1d-8804-90a8e0a510a6-0006c6be", "Konstruktionstræ - C24 : 45 x 195mm": "5ca0e5e6-d4ae-4a82-aaed-b1437e04bf6f:374e7de6-c751-4c8b-8729-d2fda166ad12-00205972", "Konstruktionstræ - C24 : 45 x 245mm": "5ca0e5e6-d4ae-4a82-aaed-b1437e04bf6f:d1ee8fc3-d1d9-47d4-bd34-99b45ed829f0-000b9fc8", "Konstruktionstræ - C24 : 45 x 295mm": "5ca0e5e6-d4ae-4a82-aaed-b1437e04bf6f:a07ebcf2-56a6-4c8a-b025-74aeaa59a2b7-00232e25", "Konstruktionstræ - C24 : 45 x 95mm": "5ca0e5e6-d4ae-4a82-aaed-b1437e04bf6f:e32d8bac-8c95-45b6-bd4f-286ccc275567-002117bb", "Limtræ - GL30c : 140 x 166mm": "5ca0e5e6-d4ae-4a82-aaed-b1437e04bf6f:7567d436-1755-4d0b-85e8-b8ae4ac7e00e-00284d6b", "Limtræ - GL30c : 140 x 200mm": "5ca0e5e6-d4ae-4a82-aaed-b1437e04bf6f:7567d436-1755-4d0b-85e8-b8ae4ac7e00e-00284d6d", "Limtræ - GL30c : 140 x 233mm": "5ca0e5e6-d4ae-4a82-aaed-b1437e04bf6f:7567d436-1755-4d0b-85e8-b8ae4ac7e00e-00284d6f", "Limtræ - GL30c : 140 x 266mm": "5ca0e5e6-d4ae-4a82-aaed-b1437e04bf6f:7567d436-1755-4d0b-85e8-b8ae4ac7e00e-00284d71", "Limtræ - GL30c : 140 x 300mm": "5ca0e5e6-d4ae-4a82-aaed-b1437e04bf6f:7567d436-1755-4d0b-85e8-b8ae4ac7e00e-00284d73", "Limtræ - GL30c : 140 x 315mm": "5ca0e5e6-d4ae-4a82-aaed-b1437e04bf6f:7567d436-1755-4d0b-85e8-b8ae4ac7e00e-00284f6d", "Limtræ - GL30c : 140 x 333mm": "5ca0e5e6-d4ae-4a82-aaed-b1437e04bf6f:7567d436-1755-4d0b-85e8-b8ae4ac7e00e-00284d75", "Limtræ - GL30c : 140 x 360mm": "5ca0e5e6-d4ae-4a82-aaed-b1437e04bf6f:7567d436-1755-4d0b-85e8-b8ae4ac7e00e-00284f6f", "Limtræ - GL30c : 140 x 366mm": "5ca0e5e6-d4ae-4a82-aaed-b1437e04bf6f:7567d436-1755-4d0b-85e8-b8ae4ac7e00e-00284d77", "Limtræ - GL30c : 140 x 400mm": "5ca0e5e6-d4ae-4a82-aaed-b1437e04bf6f:7567d436-1755-4d0b-85e8-b8ae4ac7e00e-00284d79", "Limtræ - GL30c : 65 x 133mm": "5ca0e5e6-d4ae-4a82-aaed-b1437e04bf6f:84d24ac1-70b8-4fae-8208-07e4d8d68360-00284d47", "Limtræ - GL30c : 65 x 166mm": "5ca0e5e6-d4ae-4a82-aaed-b1437e04bf6f:7567d436-1755-4d0b-85e8-b8ae4ac7e00e-00284d67", "Limtræ - GL30c : 65 x 200mm": "5ca0e5e6-d4ae-4a82-aaed-b1437e04bf6f:7567d436-1755-4d0b-85e8-b8ae4ac7e00e-00284d69"}, selected="Konstruktionstræ - C24 : 45 x 145mm")
element_type_picker_4 = ElementTypePicker(
    built_in_categories_2,
    {"Konstruktionstræ - C24 : 45 x 145mm": "5ca0e5e6-d4ae-4a82-aaed-b1437e04bf6f:e49c5e58-d29a-4c1d-8804-90a8e0a510a6-0006c6be", "Konstruktionstræ - C24 : 45 x 195mm": "5ca0e5e6-d4ae-4a82-aaed-b1437e04bf6f:374e7de6-c751-4c8b-8729-d2fda166ad12-00205972", "Konstruktionstræ - C24 : 45 x 245mm": "5ca0e5e6-d4ae-4a82-aaed-b1437e04bf6f:d1ee8fc3-d1d9-47d4-bd34-99b45ed829f0-000b9fc8", "Konstruktionstræ - C24 : 45 x 295mm": "5ca0e5e6-d4ae-4a82-aaed-b1437e04bf6f:a07ebcf2-56a6-4c8a-b025-74aeaa59a2b7-00232e25", "Konstruktionstræ - C24 : 45 x 95mm": "5ca0e5e6-d4ae-4a82-aaed-b1437e04bf6f:e32d8bac-8c95-45b6-bd4f-286ccc275567-002117bb", "Limtræ - GL30c : 140 x 166mm": "5ca0e5e6-d4ae-4a82-aaed-b1437e04bf6f:7567d436-1755-4d0b-85e8-b8ae4ac7e00e-00284d6b", "Limtræ - GL30c : 140 x 200mm": "5ca0e5e6-d4ae-4a82-aaed-b1437e04bf6f:7567d436-1755-4d0b-85e8-b8ae4ac7e00e-00284d6d", "Limtræ - GL30c : 140 x 233mm": "5ca0e5e6-d4ae-4a82-aaed-b1437e04bf6f:7567d436-1755-4d0b-85e8-b8ae4ac7e00e-00284d6f", "Limtræ - GL30c : 140 x 266mm": "5ca0e5e6-d4ae-4a82-aaed-b1437e04bf6f:7567d436-1755-4d0b-85e8-b8ae4ac7e00e-00284d71", "Limtræ - GL30c : 140 x 300mm": "5ca0e5e6-d4ae-4a82-aaed-b1437e04bf6f:7567d436-1755-4d0b-85e8-b8ae4ac7e00e-00284d73", "Limtræ - GL30c : 140 x 315mm": "5ca0e5e6-d4ae-4a82-aaed-b1437e04bf6f:7567d436-1755-4d0b-85e8-b8ae4ac7e00e-00284f6d", "Limtræ - GL30c : 140 x 333mm": "5ca0e5e6-d4ae-4a82-aaed-b1437e04bf6f:7567d436-1755-4d0b-85e8-b8ae4ac7e00e-00284d75", "Limtræ - GL30c : 140 x 360mm": "5ca0e5e6-d4ae-4a82-aaed-b1437e04bf6f:7567d436-1755-4d0b-85e8-b8ae4ac7e00e-00284f6f", "Limtræ - GL30c : 140 x 366mm": "5ca0e5e6-d4ae-4a82-aaed-b1437e04bf6f:7567d436-1755-4d0b-85e8-b8ae4ac7e00e-00284d77", "Limtræ - GL30c : 140 x 400mm": "5ca0e5e6-d4ae-4a82-aaed-b1437e04bf6f:7567d436-1755-4d0b-85e8-b8ae4ac7e00e-00284d79", "Limtræ - GL30c : 65 x 133mm": "5ca0e5e6-d4ae-4a82-aaed-b1437e04bf6f:84d24ac1-70b8-4fae-8208-07e4d8d68360-00284d47", "Limtræ - GL30c : 65 x 166mm": "5ca0e5e6-d4ae-4a82-aaed-b1437e04bf6f:7567d436-1755-4d0b-85e8-b8ae4ac7e00e-00284d67", "Limtræ - GL30c : 65 x 200mm": "5ca0e5e6-d4ae-4a82-aaed-b1437e04bf6f:7567d436-1755-4d0b-85e8-b8ae4ac7e00e-00284d69"}, selected="Konstruktionstræ - C24 : 45 x 145mm")
element_type_picker_5 = ElementTypePicker(
    built_in_categories_2,
    {"Konstruktionstræ - C24 : 45 x 145mm": "5ca0e5e6-d4ae-4a82-aaed-b1437e04bf6f:e49c5e58-d29a-4c1d-8804-90a8e0a510a6-0006c6be", "Konstruktionstræ - C24 : 45 x 195mm": "5ca0e5e6-d4ae-4a82-aaed-b1437e04bf6f:374e7de6-c751-4c8b-8729-d2fda166ad12-00205972", "Konstruktionstræ - C24 : 45 x 245mm": "5ca0e5e6-d4ae-4a82-aaed-b1437e04bf6f:d1ee8fc3-d1d9-47d4-bd34-99b45ed829f0-000b9fc8", "Konstruktionstræ - C24 : 45 x 295mm": "5ca0e5e6-d4ae-4a82-aaed-b1437e04bf6f:a07ebcf2-56a6-4c8a-b025-74aeaa59a2b7-00232e25", "Konstruktionstræ - C24 : 45 x 95mm": "5ca0e5e6-d4ae-4a82-aaed-b1437e04bf6f:e32d8bac-8c95-45b6-bd4f-286ccc275567-002117bb", "Limtræ - GL30c : 140 x 166mm": "5ca0e5e6-d4ae-4a82-aaed-b1437e04bf6f:7567d436-1755-4d0b-85e8-b8ae4ac7e00e-00284d6b", "Limtræ - GL30c : 140 x 200mm": "5ca0e5e6-d4ae-4a82-aaed-b1437e04bf6f:7567d436-1755-4d0b-85e8-b8ae4ac7e00e-00284d6d", "Limtræ - GL30c : 140 x 233mm": "5ca0e5e6-d4ae-4a82-aaed-b1437e04bf6f:7567d436-1755-4d0b-85e8-b8ae4ac7e00e-00284d6f", "Limtræ - GL30c : 140 x 266mm": "5ca0e5e6-d4ae-4a82-aaed-b1437e04bf6f:7567d436-1755-4d0b-85e8-b8ae4ac7e00e-00284d71", "Limtræ - GL30c : 140 x 300mm": "5ca0e5e6-d4ae-4a82-aaed-b1437e04bf6f:7567d436-1755-4d0b-85e8-b8ae4ac7e00e-00284d73", "Limtræ - GL30c : 140 x 315mm": "5ca0e5e6-d4ae-4a82-aaed-b1437e04bf6f:7567d436-1755-4d0b-85e8-b8ae4ac7e00e-00284f6d", "Limtræ - GL30c : 140 x 333mm": "5ca0e5e6-d4ae-4a82-aaed-b1437e04bf6f:7567d436-1755-4d0b-85e8-b8ae4ac7e00e-00284d75", "Limtræ - GL30c : 140 x 360mm": "5ca0e5e6-d4ae-4a82-aaed-b1437e04bf6f:7567d436-1755-4d0b-85e8-b8ae4ac7e00e-00284f6f", "Limtræ - GL30c : 140 x 366mm": "5ca0e5e6-d4ae-4a82-aaed-b1437e04bf6f:7567d436-1755-4d0b-85e8-b8ae4ac7e00e-00284d77", "Limtræ - GL30c : 140 x 400mm": "5ca0e5e6-d4ae-4a82-aaed-b1437e04bf6f:7567d436-1755-4d0b-85e8-b8ae4ac7e00e-00284d79", "Limtræ - GL30c : 65 x 133mm": "5ca0e5e6-d4ae-4a82-aaed-b1437e04bf6f:84d24ac1-70b8-4fae-8208-07e4d8d68360-00284d47", "Limtræ - GL30c : 65 x 166mm": "5ca0e5e6-d4ae-4a82-aaed-b1437e04bf6f:7567d436-1755-4d0b-85e8-b8ae4ac7e00e-00284d67", "Limtræ - GL30c : 65 x 200mm": "5ca0e5e6-d4ae-4a82-aaed-b1437e04bf6f:7567d436-1755-4d0b-85e8-b8ae4ac7e00e-00284d69"}, selected="Konstruktionstræ - C24 : 45 x 145mm")
element_type_picker_6 = ElementTypePicker(
    built_in_categories_2,
    {"Konstruktionstræ - C24 : 45 x 145mm": "5ca0e5e6-d4ae-4a82-aaed-b1437e04bf6f:e49c5e58-d29a-4c1d-8804-90a8e0a510a6-0006c6be", "Konstruktionstræ - C24 : 45 x 195mm": "5ca0e5e6-d4ae-4a82-aaed-b1437e04bf6f:374e7de6-c751-4c8b-8729-d2fda166ad12-00205972", "Konstruktionstræ - C24 : 45 x 245mm": "5ca0e5e6-d4ae-4a82-aaed-b1437e04bf6f:d1ee8fc3-d1d9-47d4-bd34-99b45ed829f0-000b9fc8", "Konstruktionstræ - C24 : 45 x 295mm": "5ca0e5e6-d4ae-4a82-aaed-b1437e04bf6f:a07ebcf2-56a6-4c8a-b025-74aeaa59a2b7-00232e25", "Konstruktionstræ - C24 : 45 x 95mm": "5ca0e5e6-d4ae-4a82-aaed-b1437e04bf6f:e32d8bac-8c95-45b6-bd4f-286ccc275567-002117bb", "Limtræ - GL30c : 140 x 166mm": "5ca0e5e6-d4ae-4a82-aaed-b1437e04bf6f:7567d436-1755-4d0b-85e8-b8ae4ac7e00e-00284d6b", "Limtræ - GL30c : 140 x 200mm": "5ca0e5e6-d4ae-4a82-aaed-b1437e04bf6f:7567d436-1755-4d0b-85e8-b8ae4ac7e00e-00284d6d", "Limtræ - GL30c : 140 x 233mm": "5ca0e5e6-d4ae-4a82-aaed-b1437e04bf6f:7567d436-1755-4d0b-85e8-b8ae4ac7e00e-00284d6f", "Limtræ - GL30c : 140 x 266mm": "5ca0e5e6-d4ae-4a82-aaed-b1437e04bf6f:7567d436-1755-4d0b-85e8-b8ae4ac7e00e-00284d71", "Limtræ - GL30c : 140 x 300mm": "5ca0e5e6-d4ae-4a82-aaed-b1437e04bf6f:7567d436-1755-4d0b-85e8-b8ae4ac7e00e-00284d73", "Limtræ - GL30c : 140 x 315mm": "5ca0e5e6-d4ae-4a82-aaed-b1437e04bf6f:7567d436-1755-4d0b-85e8-b8ae4ac7e00e-00284f6d", "Limtræ - GL30c : 140 x 333mm": "5ca0e5e6-d4ae-4a82-aaed-b1437e04bf6f:7567d436-1755-4d0b-85e8-b8ae4ac7e00e-00284d75", "Limtræ - GL30c : 140 x 360mm": "5ca0e5e6-d4ae-4a82-aaed-b1437e04bf6f:7567d436-1755-4d0b-85e8-b8ae4ac7e00e-00284f6f", "Limtræ - GL30c : 140 x 366mm": "5ca0e5e6-d4ae-4a82-aaed-b1437e04bf6f:7567d436-1755-4d0b-85e8-b8ae4ac7e00e-00284d77", "Limtræ - GL30c : 140 x 400mm": "5ca0e5e6-d4ae-4a82-aaed-b1437e04bf6f:7567d436-1755-4d0b-85e8-b8ae4ac7e00e-00284d79", "Limtræ - GL30c : 65 x 133mm": "5ca0e5e6-d4ae-4a82-aaed-b1437e04bf6f:84d24ac1-70b8-4fae-8208-07e4d8d68360-00284d47", "Limtræ - GL30c : 65 x 166mm": "5ca0e5e6-d4ae-4a82-aaed-b1437e04bf6f:7567d436-1755-4d0b-85e8-b8ae4ac7e00e-00284d67", "Limtræ - GL30c : 65 x 200mm": "5ca0e5e6-d4ae-4a82-aaed-b1437e04bf6f:7567d436-1755-4d0b-85e8-b8ae4ac7e00e-00284d69"}, selected="Konstruktionstræ - C24 : 45 x 145mm")
element_type_picker_7 = ElementTypePicker(
    built_in_categories_2,
    {"Konstruktionstræ - C24 : 45 x 145mm": "5ca0e5e6-d4ae-4a82-aaed-b1437e04bf6f:e49c5e58-d29a-4c1d-8804-90a8e0a510a6-0006c6be", "Konstruktionstræ - C24 : 45 x 195mm": "5ca0e5e6-d4ae-4a82-aaed-b1437e04bf6f:374e7de6-c751-4c8b-8729-d2fda166ad12-00205972", "Konstruktionstræ - C24 : 45 x 245mm": "5ca0e5e6-d4ae-4a82-aaed-b1437e04bf6f:d1ee8fc3-d1d9-47d4-bd34-99b45ed829f0-000b9fc8", "Konstruktionstræ - C24 : 45 x 295mm": "5ca0e5e6-d4ae-4a82-aaed-b1437e04bf6f:a07ebcf2-56a6-4c8a-b025-74aeaa59a2b7-00232e25", "Konstruktionstræ - C24 : 45 x 95mm": "5ca0e5e6-d4ae-4a82-aaed-b1437e04bf6f:e32d8bac-8c95-45b6-bd4f-286ccc275567-002117bb", "Limtræ - GL30c : 140 x 166mm": "5ca0e5e6-d4ae-4a82-aaed-b1437e04bf6f:7567d436-1755-4d0b-85e8-b8ae4ac7e00e-00284d6b", "Limtræ - GL30c : 140 x 200mm": "5ca0e5e6-d4ae-4a82-aaed-b1437e04bf6f:7567d436-1755-4d0b-85e8-b8ae4ac7e00e-00284d6d", "Limtræ - GL30c : 140 x 233mm": "5ca0e5e6-d4ae-4a82-aaed-b1437e04bf6f:7567d436-1755-4d0b-85e8-b8ae4ac7e00e-00284d6f", "Limtræ - GL30c : 140 x 266mm": "5ca0e5e6-d4ae-4a82-aaed-b1437e04bf6f:7567d436-1755-4d0b-85e8-b8ae4ac7e00e-00284d71", "Limtræ - GL30c : 140 x 300mm": "5ca0e5e6-d4ae-4a82-aaed-b1437e04bf6f:7567d436-1755-4d0b-85e8-b8ae4ac7e00e-00284d73", "Limtræ - GL30c : 140 x 315mm": "5ca0e5e6-d4ae-4a82-aaed-b1437e04bf6f:7567d436-1755-4d0b-85e8-b8ae4ac7e00e-00284f6d", "Limtræ - GL30c : 140 x 333mm": "5ca0e5e6-d4ae-4a82-aaed-b1437e04bf6f:7567d436-1755-4d0b-85e8-b8ae4ac7e00e-00284d75", "Limtræ - GL30c : 140 x 360mm": "5ca0e5e6-d4ae-4a82-aaed-b1437e04bf6f:7567d436-1755-4d0b-85e8-b8ae4ac7e00e-00284f6f", "Limtræ - GL30c : 140 x 366mm": "5ca0e5e6-d4ae-4a82-aaed-b1437e04bf6f:7567d436-1755-4d0b-85e8-b8ae4ac7e00e-00284d77", "Limtræ - GL30c : 140 x 400mm": "5ca0e5e6-d4ae-4a82-aaed-b1437e04bf6f:7567d436-1755-4d0b-85e8-b8ae4ac7e00e-00284d79", "Limtræ - GL30c : 65 x 133mm": "5ca0e5e6-d4ae-4a82-aaed-b1437e04bf6f:84d24ac1-70b8-4fae-8208-07e4d8d68360-00284d47", "Limtræ - GL30c : 65 x 166mm": "5ca0e5e6-d4ae-4a82-aaed-b1437e04bf6f:7567d436-1755-4d0b-85e8-b8ae4ac7e00e-00284d67", "Limtræ - GL30c : 65 x 200mm": "5ca0e5e6-d4ae-4a82-aaed-b1437e04bf6f:7567d436-1755-4d0b-85e8-b8ae4ac7e00e-00284d69"}, selected="Konstruktionstræ - C24 : 45 x 145mm")
entwine_9 = Entwine(
    Branch00=element_type_picker_7,
    Branch01=element_type_picker_4,
    Branch02=element_type_picker_5,
    Branch03=element_type_picker_6,
    Branch04=element_type_picker_3,
    Branch05=element_type_picker_2,
    FlattenInputs=True)

# ---- group: Tagåser
curve_domain_2 = CurveDomain(Curve=flytter_buen_i_z_retning_så_der_kun_arbe.Geometry)  # -> Curve, Domain
deconstruct_domain_3 = DeconstructDomain(Domain=curve_domain_2.Domain)  # -> Start, End
subtraction_9 = Subtraction(A=deconstruct_domain_3.End, B=forskyder_tagåser_ved_tagfod)
addition_4 = Addition(A=deconstruct_domain_3.Start, B=forskyder_tagåser_ved_tagfod)
construct_domain_7 = ConstructDomain(DomainStart=addition_4, DomainEnd=subtraction_9)
sub_curve_6 = SubCurve(BaseCurve=[flytter_buen_i_z_retning_så_der_kun_arbe.Geometry, arc_2.Arc], Domain=graft(construct_domain_7))
divide_curve_4 = DivideCurve(Curve=sub_curve_6, Count=antal_tagåser, Kinks=False)  # -> Points, Tangents, Parameters
unit_x = UnitX(Factor=distance_2)  # -> graft(UnitVector)
curve_frames = CurveFrames(Curve=arc_2.Arc, Count=10)  # -> Frames, Parameters

# ---- group: Sub curve svarende til ydrepunkter for tagåser
sub_curve_7 = SubCurve(BaseCurve=arc_2.Arc, Domain=graft(construct_domain_7))
deconstruct_arc_3 = DeconstructArc(Arc=sub_curve_7)  # -> BasePlane, Radius, Angle
arc_5 = Arc(Plane=deconstruct_arc_3.BasePlane, Radius=deconstruct_arc_3.Radius, Angle=deconstruct_arc_3.Angle)  # -> Arc, Length

# ---- group: lodposter
divide_curve_5 = DivideCurve(Curve=arc_5.Arc, Count=antal_tagåser, Kinks=False)  # -> Points, Tangents, Parameters
list_length_3 = ListLength(List=divide_curve_5.Points)
subtraction_10 = Subtraction(A=list_length_3, B="2")
construct_domain_8 = ConstructDomain(DomainStart="1", DomainEnd=subtraction_10)
panel_3 = Panel("""0
1""")
sub_list_7 = SubList(List=divide_curve_5.Points, Domain=construct_domain_8, Wrap=True)  # -> List, Index
sift_pattern = SiftPattern(List=sub_list_7.List, SiftPattern=panel_3)  # -> Output0, Output1
point_17 = Point(sift_pattern.Output1)
xy_plane_2 = XYPlane(Origin=Point(0, 0, 0))

# ---- group: Tagåser (continued)
entwine_10 = Entwine(Branch0X=divide_curve_4.Points, Branch1X=divide_curve_5.Points, FlattenInputs=False)
line_sdl_2 = LineSDL(Start=entwine_10, Direction=curve_frames.Frames, Length=unit_x)
curve_5 = Curve(line_sdl_2)
clean_tree = CleanTree(RemoveNulls=True, RemoveInvalid=True, RemoveEmpty=False, Tree=curve_5)

# ----
line_15 = Line(StartPoint=point_17, EndPoint=area.Centroid)
line_sdl_3 = LineSDL(Start=point_17, Direction=line_15, Length=højde_samlet_bue_mm)

# ---- group: Laver 2 grupper med tagåser, hhv. med og uden skråbånd
subtraction_11 = Subtraction(A=antal_tagåser, B=1)
panel_4 = Panel(["0", antal_tagåser])
cull_index = CullIndex(List=clean_tree, Indices=panel_4, Wrap=False)
shift_list_6 = ShiftList(List=cull_index, Shift=1, Wrap=False)
cull_nth = CullNth(List=shift_list_6, CullFrequency=2)
cull_nth_2 = CullNth(List=cull_index, CullFrequency=2)

# ---- group: lodposter (continued)
clean_tree_2 = CleanTree(RemoveNulls=True, RemoveInvalid=True, RemoveEmpty=False, Tree=line_sdl_3)
clean_tree_3 = CleanTree(RemoveNulls=True, RemoveInvalid=True, RemoveEmpty=False, Tree=line_sdl_3)

# ---- group: Vandret og lodret flytnings vector. flyt grashopper geometri til revit grids
# Knude til flytning, lodret
# Knude til flytning, vandret
category_parameters_2 = CategoryParameters(Category=levels_picker)
value_picker_5 = ValuePicker(category_parameters_2)
line_line_intersection_karamba3d_3 = LineLineIntersectionKaramba3D(Line=[value_picker, value_picker_4], LimitDistance_m=0.005)  # -> IntersectionPoints, LineSubSegements
element_parameter = ElementParameter(Element=levels_picker, Parameter=value_picker_5)  # -> Element, Value
subtraction_12 = Subtraction(A=element_parameter.Value, B=lodret_højde_sider_mm)
yderste_punkt_i_grid_system_flyt_hertil = Panel(line_line_intersection_karamba3d_3.IntersectionPoints)
deconstruct_6 = Deconstruct(Point=yderste_punkt_i_grid_system_flyt_hertil)  # -> XComponent, YComponent, ZComponent
panel_5 = Panel("Knude til Rotation")

# ----
addition_5 = Addition(A=subtraction_12, B=forskyd_lodret_ift_valgte_level)

# ---- group: Vandret og lodret flytnings vector. flyt grashopper geometri til revit grids (continued)
panel_6 = Panel(addition_5)
construct_point_6 = ConstructPoint(XCoordinate=deconstruct_6.XComponent, YCoordinate=deconstruct_6.YComponent, ZCoordinate=panel_6)

# ---- group: Tagåser revit / Flyt og roter
rotate_4 = Rotate(Geometry=clean_tree, Angle=radians, Plane=PlaneXY(0, 0, 0))  # -> Geometry, Transform
move_2 = Move(Geometry=rotate_4.Geometry, Motion=construct_point_6)  # -> Geometry, Transform

# ---- group: Samler Grasshopper geometri, flytter og roterer det til revit grids
relay_forskydningsfelter = Relay([boundary_surfaces_2, boundary_surfaces])
entwine_11 = Entwine(
    Branch00=arc_2.Arc,
    Branch01=shift_paths,
    Branch02=curve_3,
    Branch03=line,
    Branch04=line_2,
    Branch05=line_10,
    Branch06=line_9,
    Branch07=relay_forskydningsfelter,
    FlattenInputs=True)

# ---- group: Samler Grasshopper geometri, flytter og roterer det til revit grids / Flyt og roter
rotate_5 = Rotate(Geometry=entwine_11, Angle=radians, Plane=PlaneXY(0, 0, 0))  # -> Geometry, Transform
move_3 = Move(Geometry=rotate_5.Geometry, Motion=construct_point_6)  # -> Geometry, Transform

# ---- group: Samler Grasshopper geometri, flytter og roterer det til revit grids (continued)
explode_tree = ExplodeTree(Data=move_3.Geometry)  # -> Branch0, Branch1, Branch2, Branch3, Branch4, Branch5, Branch6, Branch7

# ---- group: Tagåser input revit
fsdfsdf_9 = ValuePicker(z_justification_ikke_ret)

# ---- group: Indput Stålplader trækbånd revit
location_line_side_2_input_0 = Panel("3")
location_line_side_1_input_0 = Panel("2")

# ---- group: Input top flange revit
fsdfsdf_10 = ValuePicker(z_justification_ikke_ret)

# ---- group: Input bottom flange revit
fsdfsdf_11 = ValuePicker(z_justification_ikke_ret)

# ---- group: Input vertical side 1 post flange revit
fsdfsdf_12 = ValuePicker(y_justification_ikke_ret)

# ---- group: Input vertical side 2 post flange revit
fsdfsdf_13 = ValuePicker(y_justification_ikke_ret)

# ---- group: Input horizontal flange revit
fsdfsdf_14 = ValuePicker(z_justification_ikke_ret)

# ---- group: Input lodposter, fælles
rotation_profiler = Panel("90")

# ---- group: Fælles, rotation
built_in_categories_3 = BuiltInCategories("autodesk.revit.category.family:structuralFraming-1.0.0", SearchPattern="structural beam")
category_parameters_3 = CategoryParameters(Category=built_in_categories_3)
value_picker_6 = ValuePicker(category_parameters_3, SearchPattern="rotation")
radians_2 = Radians(Degrees=rotation_profiler)

# ---- group: Input lodposter, fælles (continued)
element_type_picker_8 = ElementTypePicker(
    built_in_categories_3,
    {"Konstruktionstræ - C24 : 45 x 145mm": "5ca0e5e6-d4ae-4a82-aaed-b1437e04bf6f:e49c5e58-d29a-4c1d-8804-90a8e0a510a6-0006c6be", "Konstruktionstræ - C24 : 45 x 195mm": "5ca0e5e6-d4ae-4a82-aaed-b1437e04bf6f:374e7de6-c751-4c8b-8729-d2fda166ad12-00205972", "Konstruktionstræ - C24 : 45 x 245mm": "5ca0e5e6-d4ae-4a82-aaed-b1437e04bf6f:d1ee8fc3-d1d9-47d4-bd34-99b45ed829f0-000b9fc8", "Konstruktionstræ - C24 : 45 x 295mm": "5ca0e5e6-d4ae-4a82-aaed-b1437e04bf6f:a07ebcf2-56a6-4c8a-b025-74aeaa59a2b7-00232e25", "Konstruktionstræ - C24 : 45 x 95mm": "5ca0e5e6-d4ae-4a82-aaed-b1437e04bf6f:e32d8bac-8c95-45b6-bd4f-286ccc275567-002117bb", "Limtræ - GL30c : 140 x 166mm": "5ca0e5e6-d4ae-4a82-aaed-b1437e04bf6f:7567d436-1755-4d0b-85e8-b8ae4ac7e00e-00284d6b", "Limtræ - GL30c : 140 x 200mm": "5ca0e5e6-d4ae-4a82-aaed-b1437e04bf6f:7567d436-1755-4d0b-85e8-b8ae4ac7e00e-00284d6d", "Limtræ - GL30c : 140 x 233mm": "5ca0e5e6-d4ae-4a82-aaed-b1437e04bf6f:7567d436-1755-4d0b-85e8-b8ae4ac7e00e-00284d6f", "Limtræ - GL30c : 140 x 266mm": "5ca0e5e6-d4ae-4a82-aaed-b1437e04bf6f:7567d436-1755-4d0b-85e8-b8ae4ac7e00e-00284d71", "Limtræ - GL30c : 140 x 300mm": "5ca0e5e6-d4ae-4a82-aaed-b1437e04bf6f:7567d436-1755-4d0b-85e8-b8ae4ac7e00e-00284d73", "Limtræ - GL30c : 140 x 315mm": "5ca0e5e6-d4ae-4a82-aaed-b1437e04bf6f:7567d436-1755-4d0b-85e8-b8ae4ac7e00e-00284f6d", "Limtræ - GL30c : 140 x 333mm": "5ca0e5e6-d4ae-4a82-aaed-b1437e04bf6f:7567d436-1755-4d0b-85e8-b8ae4ac7e00e-00284d75", "Limtræ - GL30c : 140 x 360mm": "5ca0e5e6-d4ae-4a82-aaed-b1437e04bf6f:7567d436-1755-4d0b-85e8-b8ae4ac7e00e-00284f6f", "Limtræ - GL30c : 140 x 366mm": "5ca0e5e6-d4ae-4a82-aaed-b1437e04bf6f:7567d436-1755-4d0b-85e8-b8ae4ac7e00e-00284d77", "Limtræ - GL30c : 140 x 400mm": "5ca0e5e6-d4ae-4a82-aaed-b1437e04bf6f:7567d436-1755-4d0b-85e8-b8ae4ac7e00e-00284d79", "Limtræ - GL30c : 65 x 133mm": "5ca0e5e6-d4ae-4a82-aaed-b1437e04bf6f:84d24ac1-70b8-4fae-8208-07e4d8d68360-00284d47", "Limtræ - GL30c : 65 x 166mm": "5ca0e5e6-d4ae-4a82-aaed-b1437e04bf6f:7567d436-1755-4d0b-85e8-b8ae4ac7e00e-00284d67", "Limtræ - GL30c : 65 x 200mm": "5ca0e5e6-d4ae-4a82-aaed-b1437e04bf6f:7567d436-1755-4d0b-85e8-b8ae4ac7e00e-00284d69"}, selected="Konstruktionstræ - C24 : 45 x 145mm")

# ---- group: input lodstænger trækbånd revit
fsdfsdf_15 = ValuePicker(y_justification_ikke_ret)

# ---- group: Input brases 2 side revit
fsdfsdf_16 = ValuePicker(y_justification_ikke_ret)

# ---- group: Input brases 1 side revit
fsdfsdf_17 = ValuePicker(y_justification_ikke_ret)

# ---- group: input midt del trækbånd revit
fsdfsdf_18 = ValuePicker(y_justification_ikke_ret)

# ---- group: input sider trækbånd revit
fsdfsdf_19 = ValuePicker(y_justification_ikke_ret)

# ---- group: bottom flange revit
built_in_categories_4 = BuiltInCategories("autodesk.revit.category.family:structuralFraming-1.0.0", SearchPattern="structural beam")

# ---- group: Input bottom flange revit (continued)
element_type_picker_9 = ElementTypePicker(
    built_in_categories_4,
    {"Konstruktionstræ - C24 : 45 x 145mm": "5ca0e5e6-d4ae-4a82-aaed-b1437e04bf6f:e49c5e58-d29a-4c1d-8804-90a8e0a510a6-0006c6be", "Konstruktionstræ - C24 : 45 x 195mm": "5ca0e5e6-d4ae-4a82-aaed-b1437e04bf6f:374e7de6-c751-4c8b-8729-d2fda166ad12-00205972", "Konstruktionstræ - C24 : 45 x 245mm": "5ca0e5e6-d4ae-4a82-aaed-b1437e04bf6f:d1ee8fc3-d1d9-47d4-bd34-99b45ed829f0-000b9fc8", "Konstruktionstræ - C24 : 45 x 295mm": "5ca0e5e6-d4ae-4a82-aaed-b1437e04bf6f:a07ebcf2-56a6-4c8a-b025-74aeaa59a2b7-00232e25", "Konstruktionstræ - C24 : 45 x 95mm": "5ca0e5e6-d4ae-4a82-aaed-b1437e04bf6f:e32d8bac-8c95-45b6-bd4f-286ccc275567-002117bb", "Limtræ - GL30c : 140 x 166mm": "5ca0e5e6-d4ae-4a82-aaed-b1437e04bf6f:7567d436-1755-4d0b-85e8-b8ae4ac7e00e-00284d6b", "Limtræ - GL30c : 140 x 200mm": "5ca0e5e6-d4ae-4a82-aaed-b1437e04bf6f:7567d436-1755-4d0b-85e8-b8ae4ac7e00e-00284d6d", "Limtræ - GL30c : 140 x 233mm": "5ca0e5e6-d4ae-4a82-aaed-b1437e04bf6f:7567d436-1755-4d0b-85e8-b8ae4ac7e00e-00284d6f", "Limtræ - GL30c : 140 x 266mm": "5ca0e5e6-d4ae-4a82-aaed-b1437e04bf6f:7567d436-1755-4d0b-85e8-b8ae4ac7e00e-00284d71", "Limtræ - GL30c : 140 x 300mm": "5ca0e5e6-d4ae-4a82-aaed-b1437e04bf6f:7567d436-1755-4d0b-85e8-b8ae4ac7e00e-00284d73", "Limtræ - GL30c : 140 x 315mm": "5ca0e5e6-d4ae-4a82-aaed-b1437e04bf6f:7567d436-1755-4d0b-85e8-b8ae4ac7e00e-00284f6d", "Limtræ - GL30c : 140 x 333mm": "5ca0e5e6-d4ae-4a82-aaed-b1437e04bf6f:7567d436-1755-4d0b-85e8-b8ae4ac7e00e-00284d75", "Limtræ - GL30c : 140 x 360mm": "5ca0e5e6-d4ae-4a82-aaed-b1437e04bf6f:7567d436-1755-4d0b-85e8-b8ae4ac7e00e-00284f6f", "Limtræ - GL30c : 140 x 366mm": "5ca0e5e6-d4ae-4a82-aaed-b1437e04bf6f:7567d436-1755-4d0b-85e8-b8ae4ac7e00e-00284d77", "Limtræ - GL30c : 140 x 400mm": "5ca0e5e6-d4ae-4a82-aaed-b1437e04bf6f:7567d436-1755-4d0b-85e8-b8ae4ac7e00e-00284d79", "Limtræ - GL30c : 65 x 133mm": "5ca0e5e6-d4ae-4a82-aaed-b1437e04bf6f:84d24ac1-70b8-4fae-8208-07e4d8d68360-00284d47", "Limtræ - GL30c : 65 x 166mm": "5ca0e5e6-d4ae-4a82-aaed-b1437e04bf6f:7567d436-1755-4d0b-85e8-b8ae4ac7e00e-00284d67", "Limtræ - GL30c : 65 x 200mm": "5ca0e5e6-d4ae-4a82-aaed-b1437e04bf6f:7567d436-1755-4d0b-85e8-b8ae4ac7e00e-00284d69"}, selected="Konstruktionstræ - C24 : 45 x 145mm")

# ---- group: bottom flange revit (continued)
add_structural_beam = AddStructuralBeam(Curve=explode_tree.Branch1, Type=element_type_picker_9, ReferenceLevel=levels_picker, TrackingMode=2)

# ---- group: bottom flange revit / Sætter justification
category_parameters_4 = CategoryParameters(Category=built_in_categories_4)
value_picker_7 = ValuePicker(category_parameters_4, SearchPattern="z justi")
item_index = ItemIndex(List=z_justification_ikke_ret, Item=fsdfsdf_11)
element_parameter_2 = ElementParameter(Element=add_structural_beam, Parameter=value_picker_7, Value=item_index)  # -> Element, Value

# ---- group: horizontal flange revit
built_in_categories_5 = BuiltInCategories("autodesk.revit.category.family:structuralFraming-1.0.0", SearchPattern="structural beam")

# ---- group: Input horizontal flange revit (continued)
element_type_picker_10 = ElementTypePicker(
    built_in_categories_5,
    {"Konstruktionstræ - C24 : 45 x 145mm": "5ca0e5e6-d4ae-4a82-aaed-b1437e04bf6f:e49c5e58-d29a-4c1d-8804-90a8e0a510a6-0006c6be", "Konstruktionstræ - C24 : 45 x 195mm": "5ca0e5e6-d4ae-4a82-aaed-b1437e04bf6f:374e7de6-c751-4c8b-8729-d2fda166ad12-00205972", "Konstruktionstræ - C24 : 45 x 245mm": "5ca0e5e6-d4ae-4a82-aaed-b1437e04bf6f:d1ee8fc3-d1d9-47d4-bd34-99b45ed829f0-000b9fc8", "Konstruktionstræ - C24 : 45 x 295mm": "5ca0e5e6-d4ae-4a82-aaed-b1437e04bf6f:a07ebcf2-56a6-4c8a-b025-74aeaa59a2b7-00232e25", "Konstruktionstræ - C24 : 45 x 95mm": "5ca0e5e6-d4ae-4a82-aaed-b1437e04bf6f:e32d8bac-8c95-45b6-bd4f-286ccc275567-002117bb", "Limtræ - GL30c : 140 x 166mm": "5ca0e5e6-d4ae-4a82-aaed-b1437e04bf6f:7567d436-1755-4d0b-85e8-b8ae4ac7e00e-00284d6b", "Limtræ - GL30c : 140 x 200mm": "5ca0e5e6-d4ae-4a82-aaed-b1437e04bf6f:7567d436-1755-4d0b-85e8-b8ae4ac7e00e-00284d6d", "Limtræ - GL30c : 140 x 233mm": "5ca0e5e6-d4ae-4a82-aaed-b1437e04bf6f:7567d436-1755-4d0b-85e8-b8ae4ac7e00e-00284d6f", "Limtræ - GL30c : 140 x 266mm": "5ca0e5e6-d4ae-4a82-aaed-b1437e04bf6f:7567d436-1755-4d0b-85e8-b8ae4ac7e00e-00284d71", "Limtræ - GL30c : 140 x 300mm": "5ca0e5e6-d4ae-4a82-aaed-b1437e04bf6f:7567d436-1755-4d0b-85e8-b8ae4ac7e00e-00284d73", "Limtræ - GL30c : 140 x 315mm": "5ca0e5e6-d4ae-4a82-aaed-b1437e04bf6f:7567d436-1755-4d0b-85e8-b8ae4ac7e00e-00284f6d", "Limtræ - GL30c : 140 x 333mm": "5ca0e5e6-d4ae-4a82-aaed-b1437e04bf6f:7567d436-1755-4d0b-85e8-b8ae4ac7e00e-00284d75", "Limtræ - GL30c : 140 x 360mm": "5ca0e5e6-d4ae-4a82-aaed-b1437e04bf6f:7567d436-1755-4d0b-85e8-b8ae4ac7e00e-00284f6f", "Limtræ - GL30c : 140 x 366mm": "5ca0e5e6-d4ae-4a82-aaed-b1437e04bf6f:7567d436-1755-4d0b-85e8-b8ae4ac7e00e-00284d77", "Limtræ - GL30c : 140 x 400mm": "5ca0e5e6-d4ae-4a82-aaed-b1437e04bf6f:7567d436-1755-4d0b-85e8-b8ae4ac7e00e-00284d79", "Limtræ - GL30c : 65 x 133mm": "5ca0e5e6-d4ae-4a82-aaed-b1437e04bf6f:84d24ac1-70b8-4fae-8208-07e4d8d68360-00284d47", "Limtræ - GL30c : 65 x 166mm": "5ca0e5e6-d4ae-4a82-aaed-b1437e04bf6f:7567d436-1755-4d0b-85e8-b8ae4ac7e00e-00284d67", "Limtræ - GL30c : 65 x 200mm": "5ca0e5e6-d4ae-4a82-aaed-b1437e04bf6f:7567d436-1755-4d0b-85e8-b8ae4ac7e00e-00284d69"}, selected="Konstruktionstræ - C24 : 45 x 145mm")

# ---- group: horizontal flange revit (continued)
add_structural_beam_2 = AddStructuralBeam(Curve=explode_tree.Branch2, Type=element_type_picker_10, ReferenceLevel=levels_picker, TrackingMode=2)

# ---- group: horizontal flange revit / Sætter justification
category_parameters_5 = CategoryParameters(Category=built_in_categories_5)
value_picker_8 = ValuePicker(category_parameters_5, SearchPattern="z justi")
item_index_2 = ItemIndex(List=z_justification_ikke_ret, Item=fsdfsdf_14)
element_parameter_3 = ElementParameter(Element=add_structural_beam_2, Parameter=value_picker_8, Value=item_index_2)  # -> Element, Value

# ---- group: Top flange revit
built_in_categories_6 = BuiltInCategories("autodesk.revit.category.family:structuralFraming-1.0.0", SearchPattern="structural beam")

# ---- group: Input top flange revit (continued)
element_type_picker_11 = ElementTypePicker(
    built_in_categories_6,
    {"Konstruktionstræ - C24 : 45 x 145mm": "5ca0e5e6-d4ae-4a82-aaed-b1437e04bf6f:e49c5e58-d29a-4c1d-8804-90a8e0a510a6-0006c6be", "Konstruktionstræ - C24 : 45 x 195mm": "5ca0e5e6-d4ae-4a82-aaed-b1437e04bf6f:374e7de6-c751-4c8b-8729-d2fda166ad12-00205972", "Konstruktionstræ - C24 : 45 x 245mm": "5ca0e5e6-d4ae-4a82-aaed-b1437e04bf6f:d1ee8fc3-d1d9-47d4-bd34-99b45ed829f0-000b9fc8", "Konstruktionstræ - C24 : 45 x 295mm": "5ca0e5e6-d4ae-4a82-aaed-b1437e04bf6f:a07ebcf2-56a6-4c8a-b025-74aeaa59a2b7-00232e25", "Konstruktionstræ - C24 : 45 x 95mm": "5ca0e5e6-d4ae-4a82-aaed-b1437e04bf6f:e32d8bac-8c95-45b6-bd4f-286ccc275567-002117bb", "Limtræ - GL30c : 140 x 166mm": "5ca0e5e6-d4ae-4a82-aaed-b1437e04bf6f:7567d436-1755-4d0b-85e8-b8ae4ac7e00e-00284d6b", "Limtræ - GL30c : 140 x 200mm": "5ca0e5e6-d4ae-4a82-aaed-b1437e04bf6f:7567d436-1755-4d0b-85e8-b8ae4ac7e00e-00284d6d", "Limtræ - GL30c : 140 x 233mm": "5ca0e5e6-d4ae-4a82-aaed-b1437e04bf6f:7567d436-1755-4d0b-85e8-b8ae4ac7e00e-00284d6f", "Limtræ - GL30c : 140 x 266mm": "5ca0e5e6-d4ae-4a82-aaed-b1437e04bf6f:7567d436-1755-4d0b-85e8-b8ae4ac7e00e-00284d71", "Limtræ - GL30c : 140 x 300mm": "5ca0e5e6-d4ae-4a82-aaed-b1437e04bf6f:7567d436-1755-4d0b-85e8-b8ae4ac7e00e-00284d73", "Limtræ - GL30c : 140 x 315mm": "5ca0e5e6-d4ae-4a82-aaed-b1437e04bf6f:7567d436-1755-4d0b-85e8-b8ae4ac7e00e-00284f6d", "Limtræ - GL30c : 140 x 333mm": "5ca0e5e6-d4ae-4a82-aaed-b1437e04bf6f:7567d436-1755-4d0b-85e8-b8ae4ac7e00e-00284d75", "Limtræ - GL30c : 140 x 360mm": "5ca0e5e6-d4ae-4a82-aaed-b1437e04bf6f:7567d436-1755-4d0b-85e8-b8ae4ac7e00e-00284f6f", "Limtræ - GL30c : 140 x 366mm": "5ca0e5e6-d4ae-4a82-aaed-b1437e04bf6f:7567d436-1755-4d0b-85e8-b8ae4ac7e00e-00284d77", "Limtræ - GL30c : 140 x 400mm": "5ca0e5e6-d4ae-4a82-aaed-b1437e04bf6f:7567d436-1755-4d0b-85e8-b8ae4ac7e00e-00284d79", "Limtræ - GL30c : 65 x 133mm": "5ca0e5e6-d4ae-4a82-aaed-b1437e04bf6f:84d24ac1-70b8-4fae-8208-07e4d8d68360-00284d47", "Limtræ - GL30c : 65 x 166mm": "5ca0e5e6-d4ae-4a82-aaed-b1437e04bf6f:7567d436-1755-4d0b-85e8-b8ae4ac7e00e-00284d67", "Limtræ - GL30c : 65 x 200mm": "5ca0e5e6-d4ae-4a82-aaed-b1437e04bf6f:7567d436-1755-4d0b-85e8-b8ae4ac7e00e-00284d69"}, selected="Konstruktionstræ - C24 : 45 x 145mm")

# ---- group: Top flange revit (continued)
add_structural_beam_3 = AddStructuralBeam(Curve=explode_tree.Branch0, Type=element_type_picker_11, ReferenceLevel=levels_picker, TrackingMode=2)
# ---- group: Top flange revit / Sætter justification
category_parameters_6 = CategoryParameters(Category=built_in_categories_6)
value_picker_9 = ValuePicker(category_parameters_6, SearchPattern="z justi")
item_index_3 = ItemIndex(List=z_justification_ikke_ret, Item=fsdfsdf_10)
element_parameter_4 = ElementParameter(Element=add_structural_beam_3, Parameter=value_picker_9, Value=item_index_3)  # -> Element, Value

# ---- group: Forskyder ift. flange tykkelse
element_geometry = ElementGeometry(Elements=element_parameter_4.Element, DetailLevel=3)
simplify_tree_2 = SimplifyTree(Tree=element_geometry, Front=False)
tree_branch = TreeBranch(Tree=simplify_tree_2, Path="{0}", MaintainPaths=True)
brep_edges = BrepEdges(Brep=tree_branch)  # -> Naked, Interior, NonManifold
length = Length(Curve=brep_edges.Interior)
list_item_13 = ListItem(List=length, Index=1, Wrap=True)
division_3 = Division(A=list_item_13, B=2)
addition_6 = Addition(A=division_3, B=forskyd_lodposter_vandret_1_2_profil_høj)
integer = Integer(addition_6)

# ---- group: lodposter (continued)
offset_curve_21 = OffsetCurve(Curve=clean_tree_2, Distance=expr("X*-1", integer), Plane=xy_plane_2, Corners=1)
offset_curve_22 = OffsetCurve(Curve=clean_tree_2, Distance=integer, Plane=xy_plane_2, Corners=1)

# ---- group: Skråbånd NY
offset_curve_23 = OffsetCurve(Curve=offset_curve_22, Distance=expr("-x", integer), Plane=xy_plane_2, Corners=1)  # -> flatten(Curve)
offset_curve_24 = OffsetCurve(Curve=offset_curve_21, Distance=expr("x", integer), Plane=xy_plane_2, Corners=1)  # -> flatten(Curve)
length_2 = Length(Curve=offset_curve_24)
length_3 = Length(Curve=offset_curve_23)
end_points_14 = EndPoints(Curve=offset_curve_23)  # -> Start, End
end_points_15 = EndPoints(Curve=offset_curve_24)  # -> Start, End
offset_curve_25 = OffsetCurve(Curve=offset_curve_23, Distance=expr("-x", length_3), Plane=xy_plane_2, Corners=1)
offset_curve_26 = OffsetCurve(Curve=offset_curve_24, Distance=length_2, Plane=xy_plane_2, Corners=1)
end_points_16 = EndPoints(Curve=offset_curve_26)  # -> flatten(Start), End
end_points_17 = EndPoints(Curve=offset_curve_25)  # -> flatten(Start), End
line_16 = Line(StartPoint=end_points_16.Start, EndPoint=end_points_15.End)
line_17 = Line(StartPoint=end_points_17.Start, EndPoint=end_points_14.End)
curve_6 = Curve([line_16, line_17])

# ---- group: Roterer tagåser så de er vinkelret på bue
perp_frame = PerpFrame(Curve=clean_tree_3, Parameter=0.5)
horizontal_frame = HorizontalFrame(Curve=line_16, Parameter=0.5)
perp_frame_2 = PerpFrame(Curve=line_16, Parameter=0.5)
horizontal_frame_2 = HorizontalFrame(Curve=clean_tree_3, Parameter=0.5)
angle = Angle(VectorA=perp_frame, VectorB=horizontal_frame_2)  # -> Angle, Reflex
angle_2 = Angle(VectorA=perp_frame_2, VectorB=horizontal_frame)  # -> Angle, Reflex
category_parameters_7 = CategoryParameters(Category=built_in_categories)
degrees = Degrees(Radians=angle_2.Angle)  # -> flatten(Degrees)
degrees_2 = Degrees(Radians=angle.Angle)  # -> flatten(Degrees)
value_picker_10 = ValuePicker(category_parameters_7, SearchPattern="rota")
subtraction_13 = Subtraction(A=135, B=degrees)
multiplication_8 = Multiplication(A=subtraction_13, B=2)
subtraction_14 = Subtraction(A=degrees_2, B=multiplication_8)

# ----
inspect_element = InspectElement(Element=element_parameter_4.Element)  # -> ConstraintsReferenceLevel, ConstraintsStartLevelOffset, ConstraintsEndLevelOffset, ConstraintsCrossSectionRotation, Volume, Length, ElevationAtBottom, ElevationAtTop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

# ---- group: Samler Grasshopper geometri, flytter og roterer det til revit grids (continued)
entwine_12 = Entwine(
    Branch00=line_17,
    Branch01=line_16,
    Branch02=offset_curve_22,
    Branch03=offset_curve_21,
    Branch04=line_4,
    Branch05=curve_2,
    Branch06=scale.Geometry,
    Branch07=scale_2.Geometry,
    Branch08=line_12,
    FlattenInputs=True)

# ---- group: Samler Grasshopper geometri, flytter og roterer det til revit grids / Flyt og roter
rotate_6 = Rotate(Geometry=entwine_12, Angle=radians, Plane=PlaneXY(0, 0, 0))  # -> Geometry, Transform
move_4 = Move(Geometry=rotate_6.Geometry, Motion=construct_point_6)  # -> Geometry, Transform

# ---- group: Samler Grasshopper geometri, flytter og roterer det til revit grids (continued)
explode_tree_2 = ExplodeTree(Data=move_4.Geometry)  # -> Branch0, Branch1, Branch2, Branch3, Branch4, Branch5, Branch6, Branch7, Branch8

# ---- group: vertical side 1 post flange revit
built_in_categories_7 = BuiltInCategories("autodesk.revit.category.family:structuralFraming-1.0.0", SearchPattern="structural beam")
category_parameters_8 = CategoryParameters(Category=built_in_categories_7)
value_picker_11 = ValuePicker(category_parameters_8, SearchPattern="rotation")
radians_3 = Radians(Degrees="90")

# ---- group: Input vertical side 1 post flange revit (continued)
element_type_picker_12 = ElementTypePicker(
    built_in_categories_7,
    {"Konstruktionstræ - C24 : 45 x 145mm": "5ca0e5e6-d4ae-4a82-aaed-b1437e04bf6f:e49c5e58-d29a-4c1d-8804-90a8e0a510a6-0006c6be", "Konstruktionstræ - C24 : 45 x 195mm": "5ca0e5e6-d4ae-4a82-aaed-b1437e04bf6f:374e7de6-c751-4c8b-8729-d2fda166ad12-00205972", "Konstruktionstræ - C24 : 45 x 245mm": "5ca0e5e6-d4ae-4a82-aaed-b1437e04bf6f:d1ee8fc3-d1d9-47d4-bd34-99b45ed829f0-000b9fc8", "Konstruktionstræ - C24 : 45 x 295mm": "5ca0e5e6-d4ae-4a82-aaed-b1437e04bf6f:a07ebcf2-56a6-4c8a-b025-74aeaa59a2b7-00232e25", "Konstruktionstræ - C24 : 45 x 95mm": "5ca0e5e6-d4ae-4a82-aaed-b1437e04bf6f:e32d8bac-8c95-45b6-bd4f-286ccc275567-002117bb", "Limtræ - GL30c : 140 x 166mm": "5ca0e5e6-d4ae-4a82-aaed-b1437e04bf6f:7567d436-1755-4d0b-85e8-b8ae4ac7e00e-00284d6b", "Limtræ - GL30c : 140 x 200mm": "5ca0e5e6-d4ae-4a82-aaed-b1437e04bf6f:7567d436-1755-4d0b-85e8-b8ae4ac7e00e-00284d6d", "Limtræ - GL30c : 140 x 233mm": "5ca0e5e6-d4ae-4a82-aaed-b1437e04bf6f:7567d436-1755-4d0b-85e8-b8ae4ac7e00e-00284d6f", "Limtræ - GL30c : 140 x 266mm": "5ca0e5e6-d4ae-4a82-aaed-b1437e04bf6f:7567d436-1755-4d0b-85e8-b8ae4ac7e00e-00284d71", "Limtræ - GL30c : 140 x 300mm": "5ca0e5e6-d4ae-4a82-aaed-b1437e04bf6f:7567d436-1755-4d0b-85e8-b8ae4ac7e00e-00284d73", "Limtræ - GL30c : 140 x 315mm": "5ca0e5e6-d4ae-4a82-aaed-b1437e04bf6f:7567d436-1755-4d0b-85e8-b8ae4ac7e00e-00284f6d", "Limtræ - GL30c : 140 x 333mm": "5ca0e5e6-d4ae-4a82-aaed-b1437e04bf6f:7567d436-1755-4d0b-85e8-b8ae4ac7e00e-00284d75", "Limtræ - GL30c : 140 x 360mm": "5ca0e5e6-d4ae-4a82-aaed-b1437e04bf6f:7567d436-1755-4d0b-85e8-b8ae4ac7e00e-00284f6f", "Limtræ - GL30c : 140 x 366mm": "5ca0e5e6-d4ae-4a82-aaed-b1437e04bf6f:7567d436-1755-4d0b-85e8-b8ae4ac7e00e-00284d77", "Limtræ - GL30c : 140 x 400mm": "5ca0e5e6-d4ae-4a82-aaed-b1437e04bf6f:7567d436-1755-4d0b-85e8-b8ae4ac7e00e-00284d79", "Limtræ - GL30c : 65 x 133mm": "5ca0e5e6-d4ae-4a82-aaed-b1437e04bf6f:84d24ac1-70b8-4fae-8208-07e4d8d68360-00284d47", "Limtræ - GL30c : 65 x 166mm": "5ca0e5e6-d4ae-4a82-aaed-b1437e04bf6f:7567d436-1755-4d0b-85e8-b8ae4ac7e00e-00284d67", "Limtræ - GL30c : 65 x 200mm": "5ca0e5e6-d4ae-4a82-aaed-b1437e04bf6f:7567d436-1755-4d0b-85e8-b8ae4ac7e00e-00284d69"}, selected="Konstruktionstræ - C24 : 45 x 145mm")

# ---- group: vertical side 1 post flange revit (continued)
add_structural_beam_4 = AddStructuralBeam(Curve=explode_tree.Branch3, Type=element_type_picker_12, ReferenceLevel=levels_picker, TrackingMode=2)
# FIX FIX FIX, Skal opdeles z just. passer kun en side
element_parameter_5 = ElementParameter(Element=add_structural_beam_4, Parameter=value_picker_11, Value=radians_3)  # -> Element, Value

# ---- group: vertical side 1 post flange revit / Sætter justification
category_parameters_9 = CategoryParameters(Category=built_in_categories_7)
value_picker_12 = ValuePicker(category_parameters_9, SearchPattern="y justi")
value_picker_13 = ValuePicker(category_parameters_9, SearchPattern="z justi")
item_index_4 = ItemIndex(List=y_justification_ikke_ret, Item=fsdfsdf_12)
item_index_5 = ItemIndex(List=z_justification_ikke_ret, Item=fsdfsdf)
element_parameter_6 = ElementParameter(Element=element_parameter_5.Element, Parameter=value_picker_13, Value=item_index_5)  # -> Element, Value
element_parameter_7 = ElementParameter(Element=element_parameter_6.Element, Parameter=value_picker_12, Value=item_index_4)  # -> Element, Value

# ---- group: vertical side 2 post flange revit
built_in_categories_8 = BuiltInCategories("autodesk.revit.category.family:structuralFraming-1.0.0", SearchPattern="structural beam")
category_parameters_10 = CategoryParameters(Category=built_in_categories_8)
value_picker_14 = ValuePicker(category_parameters_10, SearchPattern="rotation")
radians_4 = Radians(Degrees="90")

# ---- group: Input vertical side 2 post flange revit (continued)
element_type_picker_13 = ElementTypePicker(
    built_in_categories_8,
    {"Konstruktionstræ - C24 : 45 x 145mm": "5ca0e5e6-d4ae-4a82-aaed-b1437e04bf6f:e49c5e58-d29a-4c1d-8804-90a8e0a510a6-0006c6be", "Konstruktionstræ - C24 : 45 x 195mm": "5ca0e5e6-d4ae-4a82-aaed-b1437e04bf6f:374e7de6-c751-4c8b-8729-d2fda166ad12-00205972", "Konstruktionstræ - C24 : 45 x 245mm": "5ca0e5e6-d4ae-4a82-aaed-b1437e04bf6f:d1ee8fc3-d1d9-47d4-bd34-99b45ed829f0-000b9fc8", "Konstruktionstræ - C24 : 45 x 295mm": "5ca0e5e6-d4ae-4a82-aaed-b1437e04bf6f:a07ebcf2-56a6-4c8a-b025-74aeaa59a2b7-00232e25", "Konstruktionstræ - C24 : 45 x 95mm": "5ca0e5e6-d4ae-4a82-aaed-b1437e04bf6f:e32d8bac-8c95-45b6-bd4f-286ccc275567-002117bb", "Limtræ - GL30c : 140 x 166mm": "5ca0e5e6-d4ae-4a82-aaed-b1437e04bf6f:7567d436-1755-4d0b-85e8-b8ae4ac7e00e-00284d6b", "Limtræ - GL30c : 140 x 200mm": "5ca0e5e6-d4ae-4a82-aaed-b1437e04bf6f:7567d436-1755-4d0b-85e8-b8ae4ac7e00e-00284d6d", "Limtræ - GL30c : 140 x 233mm": "5ca0e5e6-d4ae-4a82-aaed-b1437e04bf6f:7567d436-1755-4d0b-85e8-b8ae4ac7e00e-00284d6f", "Limtræ - GL30c : 140 x 266mm": "5ca0e5e6-d4ae-4a82-aaed-b1437e04bf6f:7567d436-1755-4d0b-85e8-b8ae4ac7e00e-00284d71", "Limtræ - GL30c : 140 x 300mm": "5ca0e5e6-d4ae-4a82-aaed-b1437e04bf6f:7567d436-1755-4d0b-85e8-b8ae4ac7e00e-00284d73", "Limtræ - GL30c : 140 x 315mm": "5ca0e5e6-d4ae-4a82-aaed-b1437e04bf6f:7567d436-1755-4d0b-85e8-b8ae4ac7e00e-00284f6d", "Limtræ - GL30c : 140 x 333mm": "5ca0e5e6-d4ae-4a82-aaed-b1437e04bf6f:7567d436-1755-4d0b-85e8-b8ae4ac7e00e-00284d75", "Limtræ - GL30c : 140 x 360mm": "5ca0e5e6-d4ae-4a82-aaed-b1437e04bf6f:7567d436-1755-4d0b-85e8-b8ae4ac7e00e-00284f6f", "Limtræ - GL30c : 140 x 366mm": "5ca0e5e6-d4ae-4a82-aaed-b1437e04bf6f:7567d436-1755-4d0b-85e8-b8ae4ac7e00e-00284d77", "Limtræ - GL30c : 140 x 400mm": "5ca0e5e6-d4ae-4a82-aaed-b1437e04bf6f:7567d436-1755-4d0b-85e8-b8ae4ac7e00e-00284d79", "Limtræ - GL30c : 65 x 133mm": "5ca0e5e6-d4ae-4a82-aaed-b1437e04bf6f:84d24ac1-70b8-4fae-8208-07e4d8d68360-00284d47", "Limtræ - GL30c : 65 x 166mm": "5ca0e5e6-d4ae-4a82-aaed-b1437e04bf6f:7567d436-1755-4d0b-85e8-b8ae4ac7e00e-00284d67", "Limtræ - GL30c : 65 x 200mm": "5ca0e5e6-d4ae-4a82-aaed-b1437e04bf6f:7567d436-1755-4d0b-85e8-b8ae4ac7e00e-00284d69"}, selected="Konstruktionstræ - C24 : 45 x 145mm")

# ---- group: vertical side 2 post flange revit (continued)
add_structural_beam_5 = AddStructuralBeam(Curve=explode_tree.Branch4, Type=element_type_picker_13, ReferenceLevel=levels_picker, TrackingMode=2)
element_parameter_8 = ElementParameter(Element=add_structural_beam_5, Parameter=value_picker_14, Value=radians_4)  # -> Element, Value

# ---- group: vertical side 2 post flange revit / Sætter justification
category_parameters_11 = CategoryParameters(Category=built_in_categories_8)
value_picker_15 = ValuePicker(category_parameters_11, SearchPattern="y justi")
value_picker_16 = ValuePicker(category_parameters_11, SearchPattern="z justi")
item_index_6 = ItemIndex(List=y_justification_ikke_ret, Item=fsdfsdf_13)
item_index_7 = ItemIndex(List=z_justification_ikke_ret, Item=fsdfsdf_2)
element_parameter_9 = ElementParameter(Element=element_parameter_8.Element, Parameter=value_picker_16, Value=item_index_7)  # -> Element, Value
element_parameter_10 = ElementParameter(Element=element_parameter_9.Element, Parameter=value_picker_15, Value=item_index_6)  # -> Element, Value

# ---- group: Side 1 skråbånd, justification
add_structural_beam_6 = AddStructuralBeam(Curve=explode_tree_2.Branch0, Type=element_type_picker, ReferenceLevel=levels_picker, TrackingMode=2)
value_picker_17 = ValuePicker(category_parameters, SearchPattern="y justi")
item_index_8 = ItemIndex(List=y_justification_ikke_ret, Item=fsdfsdf_3)
radians_5 = Radians(Degrees=subtraction_14)

# ---- group: Side 1 skråbånd, justification / Sætter justification
value_picker_18 = ValuePicker(category_parameters, SearchPattern="z justi")
item_index_9 = ItemIndex(List=z_justification_ikke_ret, Item=fsdfsdf_4)
element_parameter_11 = ElementParameter(Element=add_structural_beam_6, Parameter=value_picker_18, Value=item_index_9)  # -> Element, Value

# ---- group: Side 1 skråbånd, justification (continued)
element_parameter_12 = ElementParameter(Element=element_parameter_11.Element, Parameter=value_picker_17, Value=item_index_8)  # -> Element, Value
element_parameter_13 = ElementParameter(Element=element_parameter_12.Element, Parameter=value_picker_10, Value=radians_5)  # -> Element, Value

# ---- group: lodstænger trækbånd revit
built_in_categories_9 = BuiltInCategories("autodesk.revit.category.family:structuralFraming-1.0.0", SearchPattern="structural beam")

# ---- group: input lodstænger trækbånd revit (continued)
element_type_picker_14 = ElementTypePicker(
    built_in_categories_9,
    {"Konstruktionstræ - C24 : 45 x 145mm": "5ca0e5e6-d4ae-4a82-aaed-b1437e04bf6f:e49c5e58-d29a-4c1d-8804-90a8e0a510a6-0006c6be", "Konstruktionstræ - C24 : 45 x 195mm": "5ca0e5e6-d4ae-4a82-aaed-b1437e04bf6f:374e7de6-c751-4c8b-8729-d2fda166ad12-00205972", "Konstruktionstræ - C24 : 45 x 245mm": "5ca0e5e6-d4ae-4a82-aaed-b1437e04bf6f:d1ee8fc3-d1d9-47d4-bd34-99b45ed829f0-000b9fc8", "Konstruktionstræ - C24 : 45 x 295mm": "5ca0e5e6-d4ae-4a82-aaed-b1437e04bf6f:a07ebcf2-56a6-4c8a-b025-74aeaa59a2b7-00232e25", "Konstruktionstræ - C24 : 45 x 95mm": "5ca0e5e6-d4ae-4a82-aaed-b1437e04bf6f:e32d8bac-8c95-45b6-bd4f-286ccc275567-002117bb", "Limtræ - GL30c : 140 x 166mm": "5ca0e5e6-d4ae-4a82-aaed-b1437e04bf6f:7567d436-1755-4d0b-85e8-b8ae4ac7e00e-00284d6b", "Limtræ - GL30c : 140 x 200mm": "5ca0e5e6-d4ae-4a82-aaed-b1437e04bf6f:7567d436-1755-4d0b-85e8-b8ae4ac7e00e-00284d6d", "Limtræ - GL30c : 140 x 233mm": "5ca0e5e6-d4ae-4a82-aaed-b1437e04bf6f:7567d436-1755-4d0b-85e8-b8ae4ac7e00e-00284d6f", "Limtræ - GL30c : 140 x 266mm": "5ca0e5e6-d4ae-4a82-aaed-b1437e04bf6f:7567d436-1755-4d0b-85e8-b8ae4ac7e00e-00284d71", "Limtræ - GL30c : 140 x 300mm": "5ca0e5e6-d4ae-4a82-aaed-b1437e04bf6f:7567d436-1755-4d0b-85e8-b8ae4ac7e00e-00284d73", "Limtræ - GL30c : 140 x 315mm": "5ca0e5e6-d4ae-4a82-aaed-b1437e04bf6f:7567d436-1755-4d0b-85e8-b8ae4ac7e00e-00284f6d", "Limtræ - GL30c : 140 x 333mm": "5ca0e5e6-d4ae-4a82-aaed-b1437e04bf6f:7567d436-1755-4d0b-85e8-b8ae4ac7e00e-00284d75", "Limtræ - GL30c : 140 x 360mm": "5ca0e5e6-d4ae-4a82-aaed-b1437e04bf6f:7567d436-1755-4d0b-85e8-b8ae4ac7e00e-00284f6f", "Limtræ - GL30c : 140 x 366mm": "5ca0e5e6-d4ae-4a82-aaed-b1437e04bf6f:7567d436-1755-4d0b-85e8-b8ae4ac7e00e-00284d77", "Limtræ - GL30c : 140 x 400mm": "5ca0e5e6-d4ae-4a82-aaed-b1437e04bf6f:7567d436-1755-4d0b-85e8-b8ae4ac7e00e-00284d79", "Limtræ - GL30c : 65 x 133mm": "5ca0e5e6-d4ae-4a82-aaed-b1437e04bf6f:84d24ac1-70b8-4fae-8208-07e4d8d68360-00284d47", "Limtræ - GL30c : 65 x 166mm": "5ca0e5e6-d4ae-4a82-aaed-b1437e04bf6f:7567d436-1755-4d0b-85e8-b8ae4ac7e00e-00284d67", "Limtræ - GL30c : 65 x 200mm": "5ca0e5e6-d4ae-4a82-aaed-b1437e04bf6f:7567d436-1755-4d0b-85e8-b8ae4ac7e00e-00284d69"}, selected="Konstruktionstræ - C24 : 45 x 145mm")

# ---- group: lodstænger trækbånd revit (continued)
add_structural_beam_7 = AddStructuralBeam(Curve=explode_tree_2.Branch8, Type=element_type_picker_14, ReferenceLevel=levels_picker, TrackingMode=2)

# ---- group: lodstænger trækbånd revit / Sætter justification
category_parameters_12 = CategoryParameters(Category=built_in_categories_9)
value_picker_19 = ValuePicker(category_parameters_12, SearchPattern="y justi")
item_index_10 = ItemIndex(List=y_justification_ikke_ret, Item=fsdfsdf_15)
element_parameter_14 = ElementParameter(Element=add_structural_beam_7, Parameter=value_picker_19, Value=item_index_10)  # -> Element, Value

# ---- group: lodstænger trækbånd revit / Extension
value_picker_20 = ValuePicker(category_parameters_12, SearchPattern="extension")
value_picker_21 = ValuePicker(category_parameters_12, SearchPattern="extension")
element_parameter_15 = ElementParameter(Element=element_parameter_14.Element, Parameter=value_picker_20, Value=set_extension_lodstænger_trækbånd)  # -> Element, Value
element_parameter_16 = ElementParameter(Element=element_parameter_15.Element, Parameter=value_picker_21, Value=set_extension_lodstænger_trækbånd)  # -> Element, Value

# ---- group: Side 2 skråbånd, justification
add_structural_beam_8 = AddStructuralBeam(Curve=explode_tree_2.Branch1, Type=element_type_picker, ReferenceLevel=levels_picker, TrackingMode=2)
value_picker_22 = ValuePicker(category_parameters, SearchPattern="y justi")
item_index_11 = ItemIndex(List=y_justification_ikke_ret, Item=fsdfsdf_8)
radians_6 = Radians(Degrees=expr("-x", subtraction_14))

# ---- group: Side 2 skråbånd, justification / Sætter justification
value_picker_23 = ValuePicker(category_parameters, SearchPattern="z justi")
item_index_12 = ItemIndex(List=z_justification_ikke_ret, Item=fsdfsdf_6)
element_parameter_17 = ElementParameter(Element=add_structural_beam_8, Parameter=value_picker_23, Value=item_index_12)  # -> Element, Value

# ---- group: Side 2 skråbånd, justification (continued)
element_parameter_18 = ElementParameter(Element=element_parameter_17.Element, Parameter=value_picker_22, Value=item_index_11)  # -> Element, Value
element_parameter_19 = ElementParameter(Element=element_parameter_18.Element, Parameter=value_picker_10, Value=radians_6)  # -> Element, Value

# ---- group: Stålplader trækbånd side 1 revit
built_in_categories_10 = BuiltInCategories("autodesk.revit.category.local:walls-1.0.0", SearchPattern="walls")

# ---- group: Indput Stålplader trækbånd revit (continued)
element_type_picker_15 = ElementTypePicker(
    built_in_categories_10,
    {"Basic Wall : 011 Generic Wall_500": "5ca0e5e6-d4ae-4a82-aaed-b1437e04bf6f:6f708569-14dd-429e-9d15-24cf1c2f7ba6-00277cd5", "Basic Wall : 108 mursten/ 80 luft / 100 Leca": "5ca0e5e6-d4ae-4a82-aaed-b1437e04bf6f:937387b7-311b-4189-a980-234f76f42894-00274101", "Basic Wall : 200, 25 puds / 150 Leca / 25 puds": "5ca0e5e6-d4ae-4a82-aaed-b1437e04bf6f:24773d21-6643-4f53-b151-8a534b1e13ac-00281dab", "Basic Wall : 225, 25 puds / 150 Leca / 50 polystyren": "5ca0e5e6-d4ae-4a82-aaed-b1437e04bf6f:a8b3c61d-f09f-447f-b1da-ff7990f0f13e-00281697", "Basic Wall : 325, 25 puds / 300 beton": "5ca0e5e6-d4ae-4a82-aaed-b1437e04bf6f:9a8577e0-28c0-48f0-93d6-b065869252f7-002824bc", "Basic Wall : 350, 25 puds / 300 beton / 25 puds": "5ca0e5e6-d4ae-4a82-aaed-b1437e04bf6f:9a8577e0-28c0-48f0-93d6-b065869252f7-0028249c", "Basic Wall : Beton - Insitu Udfyldning 588": "5ca0e5e6-d4ae-4a82-aaed-b1437e04bf6f:6f708569-14dd-429e-9d15-24cf1c2f7ba6-00277ffc", "Basic Wall : Beton - Insitu Udfyldning 588 - Fundament": "5ca0e5e6-d4ae-4a82-aaed-b1437e04bf6f:6f708569-14dd-429e-9d15-24cf1c2f7ba6-00278161", "Basic Wall : Exterior - Block on Mtl. Stud": "5ca0e5e6-d4ae-4a82-aaed-b1437e04bf6f:4d24d0d6-38f1-47b8-a376-b40c6432dad5-0000d50a", "Basic Wall : Exterior - Brick on Mtl. Stud": "5ca0e5e6-d4ae-4a82-aaed-b1437e04bf6f:e3e052f9-0156-11d5-9301-0000863f27ad-0000018d", "Basic Wall : _DK  Væg beton, 150 150": "5ca0e5e6-d4ae-4a82-aaed-b1437e04bf6f:6f708569-14dd-429e-9d15-24cf1c2f7ba6-00278030", "Basic Wall : _DK  Væg beton, 200 mm 200:1717": "5ca0e5e6-d4ae-4a82-aaed-b1437e04bf6f:6f708569-14dd-429e-9d15-24cf1c2f7ba6-00277ff9", "Basic Wall : _DK  Væg gips, stålskelet, 30dB/BS30/2 lag 95 mm 95": "5ca0e5e6-d4ae-4a82-aaed-b1437e04bf6f:6f708569-14dd-429e-9d15-24cf1c2f7ba6-00278038", "Basic Wall : _DK  Væg gips, stålskelet, 52dB/BS60/4 lag 145 mm 145": "5ca0e5e6-d4ae-4a82-aaed-b1437e04bf6f:6f708569-14dd-429e-9d15-24cf1c2f7ba6-00278034", "Basic Wall : _DK  Væg letbeton, 100 mm 100": "5ca0e5e6-d4ae-4a82-aaed-b1437e04bf6f:6f708569-14dd-429e-9d15-24cf1c2f7ba6-00277ffa", "Basic Wall : _DK  Ydervæg, beton, 396": "5ca0e5e6-d4ae-4a82-aaed-b1437e04bf6f:6f708569-14dd-429e-9d15-24cf1c2f7ba6-00278091", "Basic Wall : _DK  Ydervæg, let, 338 238": "5ca0e5e6-d4ae-4a82-aaed-b1437e04bf6f:6f708569-14dd-429e-9d15-24cf1c2f7ba6-00278033", "Basic Wall : _DK  Ydervæg, let, 387": "5ca0e5e6-d4ae-4a82-aaed-b1437e04bf6f:6f708569-14dd-429e-9d15-24cf1c2f7ba6-0027808f", "Basic Wall : _DK  Ydervæg, tegl/Beton, 588, 108/180 588": "5ca0e5e6-d4ae-4a82-aaed-b1437e04bf6f:6f708569-14dd-429e-9d15-24cf1c2f7ba6-00278031", "Basic Wall : isolering 145 mm": "5ca0e5e6-d4ae-4a82-aaed-b1437e04bf6f:0f9160a4-e12b-4c2b-82ba-a1e1e44d0b67-0027feea", "Basic Wall : isolering 95 mm": "5ca0e5e6-d4ae-4a82-aaed-b1437e04bf6f:0f9160a4-e12b-4c2b-82ba-a1e1e44d0b67-00280e99", "Curtain Wall : 226 Int. Curtain Wall with Mullions_33_Glass 20": "5ca0e5e6-d4ae-4a82-aaed-b1437e04bf6f:6f708569-14dd-429e-9d15-24cf1c2f7ba6-00277e8d"}, selected="Basic Wall : 011 Generic Wall_500")

# ---- group: Stålplader trækbånd side 2 revit
built_in_categories_11 = BuiltInCategories("autodesk.revit.category.local:walls-1.0.0", SearchPattern="walls")
add_wall_profile = AddWallProfile(
    Profile=graft(explode_tree_2.Branch7),
    Type=element_type_picker_15,
    LocationLine=location_line_side_2_input_0,
    TrackingMode=2)

# ---- group: Stålplader trækbånd side 1 revit (continued)
add_wall_profile_2 = AddWallProfile(
    Profile=graft(explode_tree_2.Branch6),
    Type=element_type_picker_15,
    LocationLine=location_line_side_1_input_0,
    TrackingMode=2)

# ---- group: lodposter , justification
add_structural_beam_9 = AddStructuralBeam(
    Curve=flatten([explode_tree_2.Branch3, explode_tree_2.Branch2]),
    Type=element_type_picker_8,
    ReferenceLevel=levels_picker,
    TrackingMode=2)
value_picker_24 = ValuePicker(category_parameters_3, SearchPattern="y justi")
item_index_13 = ItemIndex(List=y_justification_ikke_ret, Item=fsdfsdf_7)
element_parameter_20 = ElementParameter(Element=add_structural_beam_9, Parameter=value_picker_6, Value=radians_2)  # -> Element, Value

# ---- group: lodposter , justification / Sætter justification
value_picker_25 = ValuePicker(category_parameters_3, SearchPattern="z justi")
item_index_14 = ItemIndex(List=z_justification_ikke_ret, Item=fsdfsdf_5)
element_parameter_21 = ElementParameter(Element=element_parameter_20.Element, Parameter=value_picker_25, Value=item_index_14)  # -> Element, Value

# ---- group: lodposter , justification (continued)
element_parameter_22 = ElementParameter(Element=element_parameter_21.Element, Parameter=value_picker_24, Value=item_index_13)  # -> Element, Value

# ---- group: Tagåser revit
built_in_categories_12 = BuiltInCategories("autodesk.revit.category.family:structuralFraming-1.0.0", SearchPattern="structural beam")
integer_2 = Integer(flyt_tagåser)

# ---- group: Tagåser input revit (continued)
element_type_picker_16 = ElementTypePicker(
    built_in_categories_12,
    {"Konstruktionstræ - C24 : 45 x 145mm": "5ca0e5e6-d4ae-4a82-aaed-b1437e04bf6f:e49c5e58-d29a-4c1d-8804-90a8e0a510a6-0006c6be", "Konstruktionstræ - C24 : 45 x 195mm": "5ca0e5e6-d4ae-4a82-aaed-b1437e04bf6f:374e7de6-c751-4c8b-8729-d2fda166ad12-00205972", "Konstruktionstræ - C24 : 45 x 245mm": "5ca0e5e6-d4ae-4a82-aaed-b1437e04bf6f:d1ee8fc3-d1d9-47d4-bd34-99b45ed829f0-000b9fc8", "Konstruktionstræ - C24 : 45 x 295mm": "5ca0e5e6-d4ae-4a82-aaed-b1437e04bf6f:a07ebcf2-56a6-4c8a-b025-74aeaa59a2b7-00232e25", "Konstruktionstræ - C24 : 45 x 95mm": "5ca0e5e6-d4ae-4a82-aaed-b1437e04bf6f:e32d8bac-8c95-45b6-bd4f-286ccc275567-002117bb", "Limtræ - GL30c : 140 x 166mm": "5ca0e5e6-d4ae-4a82-aaed-b1437e04bf6f:7567d436-1755-4d0b-85e8-b8ae4ac7e00e-00284d6b", "Limtræ - GL30c : 140 x 200mm": "5ca0e5e6-d4ae-4a82-aaed-b1437e04bf6f:7567d436-1755-4d0b-85e8-b8ae4ac7e00e-00284d6d", "Limtræ - GL30c : 140 x 233mm": "5ca0e5e6-d4ae-4a82-aaed-b1437e04bf6f:7567d436-1755-4d0b-85e8-b8ae4ac7e00e-00284d6f", "Limtræ - GL30c : 140 x 266mm": "5ca0e5e6-d4ae-4a82-aaed-b1437e04bf6f:7567d436-1755-4d0b-85e8-b8ae4ac7e00e-00284d71", "Limtræ - GL30c : 140 x 300mm": "5ca0e5e6-d4ae-4a82-aaed-b1437e04bf6f:7567d436-1755-4d0b-85e8-b8ae4ac7e00e-00284d73", "Limtræ - GL30c : 140 x 315mm": "5ca0e5e6-d4ae-4a82-aaed-b1437e04bf6f:7567d436-1755-4d0b-85e8-b8ae4ac7e00e-00284f6d", "Limtræ - GL30c : 140 x 333mm": "5ca0e5e6-d4ae-4a82-aaed-b1437e04bf6f:7567d436-1755-4d0b-85e8-b8ae4ac7e00e-00284d75", "Limtræ - GL30c : 140 x 360mm": "5ca0e5e6-d4ae-4a82-aaed-b1437e04bf6f:7567d436-1755-4d0b-85e8-b8ae4ac7e00e-00284f6f", "Limtræ - GL30c : 140 x 366mm": "5ca0e5e6-d4ae-4a82-aaed-b1437e04bf6f:7567d436-1755-4d0b-85e8-b8ae4ac7e00e-00284d77", "Limtræ - GL30c : 140 x 400mm": "5ca0e5e6-d4ae-4a82-aaed-b1437e04bf6f:7567d436-1755-4d0b-85e8-b8ae4ac7e00e-00284d79", "Limtræ - GL30c : 65 x 133mm": "5ca0e5e6-d4ae-4a82-aaed-b1437e04bf6f:84d24ac1-70b8-4fae-8208-07e4d8d68360-00284d47", "Limtræ - GL30c : 65 x 166mm": "5ca0e5e6-d4ae-4a82-aaed-b1437e04bf6f:7567d436-1755-4d0b-85e8-b8ae4ac7e00e-00284d67", "Limtræ - GL30c : 65 x 200mm": "5ca0e5e6-d4ae-4a82-aaed-b1437e04bf6f:7567d436-1755-4d0b-85e8-b8ae4ac7e00e-00284d69"}, selected="Konstruktionstræ - C24 : 45 x 145mm")

# ---- group: brases 2 side revit
built_in_categories_13 = BuiltInCategories("autodesk.revit.category.family:structuralFraming-1.0.0", SearchPattern="structural beam")

# ---- group: Input brases 2 side revit (continued)
element_type_picker_17 = ElementTypePicker(
    built_in_categories_13,
    {"Konstruktionstræ - C24 : 45 x 145mm": "5ca0e5e6-d4ae-4a82-aaed-b1437e04bf6f:e49c5e58-d29a-4c1d-8804-90a8e0a510a6-0006c6be", "Konstruktionstræ - C24 : 45 x 195mm": "5ca0e5e6-d4ae-4a82-aaed-b1437e04bf6f:374e7de6-c751-4c8b-8729-d2fda166ad12-00205972", "Konstruktionstræ - C24 : 45 x 245mm": "5ca0e5e6-d4ae-4a82-aaed-b1437e04bf6f:d1ee8fc3-d1d9-47d4-bd34-99b45ed829f0-000b9fc8", "Konstruktionstræ - C24 : 45 x 295mm": "5ca0e5e6-d4ae-4a82-aaed-b1437e04bf6f:a07ebcf2-56a6-4c8a-b025-74aeaa59a2b7-00232e25", "Konstruktionstræ - C24 : 45 x 95mm": "5ca0e5e6-d4ae-4a82-aaed-b1437e04bf6f:e32d8bac-8c95-45b6-bd4f-286ccc275567-002117bb", "Limtræ - GL30c : 140 x 166mm": "5ca0e5e6-d4ae-4a82-aaed-b1437e04bf6f:7567d436-1755-4d0b-85e8-b8ae4ac7e00e-00284d6b", "Limtræ - GL30c : 140 x 200mm": "5ca0e5e6-d4ae-4a82-aaed-b1437e04bf6f:7567d436-1755-4d0b-85e8-b8ae4ac7e00e-00284d6d", "Limtræ - GL30c : 140 x 233mm": "5ca0e5e6-d4ae-4a82-aaed-b1437e04bf6f:7567d436-1755-4d0b-85e8-b8ae4ac7e00e-00284d6f", "Limtræ - GL30c : 140 x 266mm": "5ca0e5e6-d4ae-4a82-aaed-b1437e04bf6f:7567d436-1755-4d0b-85e8-b8ae4ac7e00e-00284d71", "Limtræ - GL30c : 140 x 300mm": "5ca0e5e6-d4ae-4a82-aaed-b1437e04bf6f:7567d436-1755-4d0b-85e8-b8ae4ac7e00e-00284d73", "Limtræ - GL30c : 140 x 315mm": "5ca0e5e6-d4ae-4a82-aaed-b1437e04bf6f:7567d436-1755-4d0b-85e8-b8ae4ac7e00e-00284f6d", "Limtræ - GL30c : 140 x 333mm": "5ca0e5e6-d4ae-4a82-aaed-b1437e04bf6f:7567d436-1755-4d0b-85e8-b8ae4ac7e00e-00284d75", "Limtræ - GL30c : 140 x 360mm": "5ca0e5e6-d4ae-4a82-aaed-b1437e04bf6f:7567d436-1755-4d0b-85e8-b8ae4ac7e00e-00284f6f", "Limtræ - GL30c : 140 x 366mm": "5ca0e5e6-d4ae-4a82-aaed-b1437e04bf6f:7567d436-1755-4d0b-85e8-b8ae4ac7e00e-00284d77", "Limtræ - GL30c : 140 x 400mm": "5ca0e5e6-d4ae-4a82-aaed-b1437e04bf6f:7567d436-1755-4d0b-85e8-b8ae4ac7e00e-00284d79", "Limtræ - GL30c : 65 x 133mm": "5ca0e5e6-d4ae-4a82-aaed-b1437e04bf6f:84d24ac1-70b8-4fae-8208-07e4d8d68360-00284d47", "Limtræ - GL30c : 65 x 166mm": "5ca0e5e6-d4ae-4a82-aaed-b1437e04bf6f:7567d436-1755-4d0b-85e8-b8ae4ac7e00e-00284d67", "Limtræ - GL30c : 65 x 200mm": "5ca0e5e6-d4ae-4a82-aaed-b1437e04bf6f:7567d436-1755-4d0b-85e8-b8ae4ac7e00e-00284d69"}, selected="Konstruktionstræ - C24 : 45 x 145mm")

# ---- group: brases 2 side revit (continued)
add_structural_beam_10 = AddStructuralBeam(Curve=explode_tree.Branch6, Type=element_type_picker_17, ReferenceLevel=levels_picker, TrackingMode=2)

# ---- group: brases 2 side revit / Sætter justification
category_parameters_13 = CategoryParameters(Category=built_in_categories_13)
value_picker_26 = ValuePicker(category_parameters_13, SearchPattern="y justi")
item_index_15 = ItemIndex(List=y_justification_ikke_ret, Item=fsdfsdf_16)
element_parameter_23 = ElementParameter(Element=add_structural_beam_10, Parameter=value_picker_26, Value=item_index_15)  # -> Element, Value

# ---- group: brases 2 side revit / Extension
value_picker_27 = ValuePicker(category_parameters_13, SearchPattern="extension")
value_picker_28 = ValuePicker(category_parameters_13, SearchPattern="extension")
element_parameter_24 = ElementParameter(Element=element_parameter_23.Element, Parameter=value_picker_27, Value=set_extension_braces)  # -> Element, Value
element_parameter_25 = ElementParameter(Element=element_parameter_24.Element, Parameter=value_picker_28, Value=set_extension_braces)  # -> Element, Value

# ---- group: brases 1 side revit
built_in_categories_14 = BuiltInCategories("autodesk.revit.category.family:structuralFraming-1.0.0", SearchPattern="structural beam")

# ---- group: Input brases 1 side revit (continued)
element_type_picker_18 = ElementTypePicker(
    built_in_categories_14,
    {"Konstruktionstræ - C24 : 45 x 145mm": "5ca0e5e6-d4ae-4a82-aaed-b1437e04bf6f:e49c5e58-d29a-4c1d-8804-90a8e0a510a6-0006c6be", "Konstruktionstræ - C24 : 45 x 195mm": "5ca0e5e6-d4ae-4a82-aaed-b1437e04bf6f:374e7de6-c751-4c8b-8729-d2fda166ad12-00205972", "Konstruktionstræ - C24 : 45 x 245mm": "5ca0e5e6-d4ae-4a82-aaed-b1437e04bf6f:d1ee8fc3-d1d9-47d4-bd34-99b45ed829f0-000b9fc8", "Konstruktionstræ - C24 : 45 x 295mm": "5ca0e5e6-d4ae-4a82-aaed-b1437e04bf6f:a07ebcf2-56a6-4c8a-b025-74aeaa59a2b7-00232e25", "Konstruktionstræ - C24 : 45 x 95mm": "5ca0e5e6-d4ae-4a82-aaed-b1437e04bf6f:e32d8bac-8c95-45b6-bd4f-286ccc275567-002117bb", "Limtræ - GL30c : 140 x 166mm": "5ca0e5e6-d4ae-4a82-aaed-b1437e04bf6f:7567d436-1755-4d0b-85e8-b8ae4ac7e00e-00284d6b", "Limtræ - GL30c : 140 x 200mm": "5ca0e5e6-d4ae-4a82-aaed-b1437e04bf6f:7567d436-1755-4d0b-85e8-b8ae4ac7e00e-00284d6d", "Limtræ - GL30c : 140 x 233mm": "5ca0e5e6-d4ae-4a82-aaed-b1437e04bf6f:7567d436-1755-4d0b-85e8-b8ae4ac7e00e-00284d6f", "Limtræ - GL30c : 140 x 266mm": "5ca0e5e6-d4ae-4a82-aaed-b1437e04bf6f:7567d436-1755-4d0b-85e8-b8ae4ac7e00e-00284d71", "Limtræ - GL30c : 140 x 300mm": "5ca0e5e6-d4ae-4a82-aaed-b1437e04bf6f:7567d436-1755-4d0b-85e8-b8ae4ac7e00e-00284d73", "Limtræ - GL30c : 140 x 315mm": "5ca0e5e6-d4ae-4a82-aaed-b1437e04bf6f:7567d436-1755-4d0b-85e8-b8ae4ac7e00e-00284f6d", "Limtræ - GL30c : 140 x 333mm": "5ca0e5e6-d4ae-4a82-aaed-b1437e04bf6f:7567d436-1755-4d0b-85e8-b8ae4ac7e00e-00284d75", "Limtræ - GL30c : 140 x 360mm": "5ca0e5e6-d4ae-4a82-aaed-b1437e04bf6f:7567d436-1755-4d0b-85e8-b8ae4ac7e00e-00284f6f", "Limtræ - GL30c : 140 x 366mm": "5ca0e5e6-d4ae-4a82-aaed-b1437e04bf6f:7567d436-1755-4d0b-85e8-b8ae4ac7e00e-00284d77", "Limtræ - GL30c : 140 x 400mm": "5ca0e5e6-d4ae-4a82-aaed-b1437e04bf6f:7567d436-1755-4d0b-85e8-b8ae4ac7e00e-00284d79", "Limtræ - GL30c : 65 x 133mm": "5ca0e5e6-d4ae-4a82-aaed-b1437e04bf6f:84d24ac1-70b8-4fae-8208-07e4d8d68360-00284d47", "Limtræ - GL30c : 65 x 166mm": "5ca0e5e6-d4ae-4a82-aaed-b1437e04bf6f:7567d436-1755-4d0b-85e8-b8ae4ac7e00e-00284d67", "Limtræ - GL30c : 65 x 200mm": "5ca0e5e6-d4ae-4a82-aaed-b1437e04bf6f:7567d436-1755-4d0b-85e8-b8ae4ac7e00e-00284d69"}, selected="Konstruktionstræ - C24 : 45 x 145mm")

# ---- group: brases 1 side revit (continued)
add_structural_beam_11 = AddStructuralBeam(Curve=explode_tree.Branch5, Type=element_type_picker_18, ReferenceLevel=levels_picker, TrackingMode=2)

# ---- group: brases 1 side revit / Sætter justification
category_parameters_14 = CategoryParameters(Category=built_in_categories_14)
value_picker_29 = ValuePicker(category_parameters_14, SearchPattern="y justi")
item_index_16 = ItemIndex(List=y_justification_ikke_ret, Item=fsdfsdf_17)
element_parameter_26 = ElementParameter(Element=add_structural_beam_11, Parameter=value_picker_29, Value=item_index_16)  # -> Element, Value

# ---- group: brases 1 side revit / Extension
value_picker_30 = ValuePicker(category_parameters_14, SearchPattern="extension")
value_picker_31 = ValuePicker(category_parameters_14, SearchPattern="extension")
element_parameter_27 = ElementParameter(Element=element_parameter_26.Element, Parameter=value_picker_30, Value=set_extension_braces)  # -> Element, Value
element_parameter_28 = ElementParameter(Element=element_parameter_27.Element, Parameter=value_picker_31, Value=set_extension_braces)  # -> Element, Value

# ---- group: Tagåser revit / Roterer tagåser så de er vinkelret på bue
relay = Relay([arc_2.Arc, flytter_buen_i_z_retning_så_der_kun_arbe.Geometry])
horizontal_frames = HorizontalFrames(Curve=relay, Count=antal_tagåser)  # -> Frames, Parameters
perp_frames = PerpFrames(Curve=relay, Count=antal_tagåser, Align=True)  # -> Frames, Parameters
angle_3 = Angle(VectorA=perp_frames.Frames, VectorB=horizontal_frames.Frames)  # -> Angle, Reflex
category_parameters_15 = CategoryParameters(Category=built_in_categories_12)
simplify_tree_3 = SimplifyTree(Tree=angle_3.Angle, Front=False)
value_picker_32 = ValuePicker(category_parameters_15, SearchPattern="rota")
tree_branch_2 = TreeBranch(Tree=simplify_tree_3, Path="{0}", MaintainPaths=True)
degrees_3 = Degrees(Radians=tree_branch_2)
radians_7 = Radians(Degrees=expr("x*-1+90", degrees_3))

# ---- group: midt del trækbånd revit
built_in_categories_15 = BuiltInCategories("autodesk.revit.category.family:structuralFraming-1.0.0", SearchPattern="structural beam")

# ---- group: input midt del trækbånd revit (continued)
element_type_picker_19 = ElementTypePicker(
    built_in_categories_15,
    {"Konstruktionstræ - C24 : 45 x 145mm": "5ca0e5e6-d4ae-4a82-aaed-b1437e04bf6f:e49c5e58-d29a-4c1d-8804-90a8e0a510a6-0006c6be", "Konstruktionstræ - C24 : 45 x 195mm": "5ca0e5e6-d4ae-4a82-aaed-b1437e04bf6f:374e7de6-c751-4c8b-8729-d2fda166ad12-00205972", "Konstruktionstræ - C24 : 45 x 245mm": "5ca0e5e6-d4ae-4a82-aaed-b1437e04bf6f:d1ee8fc3-d1d9-47d4-bd34-99b45ed829f0-000b9fc8", "Konstruktionstræ - C24 : 45 x 295mm": "5ca0e5e6-d4ae-4a82-aaed-b1437e04bf6f:a07ebcf2-56a6-4c8a-b025-74aeaa59a2b7-00232e25", "Konstruktionstræ - C24 : 45 x 95mm": "5ca0e5e6-d4ae-4a82-aaed-b1437e04bf6f:e32d8bac-8c95-45b6-bd4f-286ccc275567-002117bb", "Limtræ - GL30c : 140 x 166mm": "5ca0e5e6-d4ae-4a82-aaed-b1437e04bf6f:7567d436-1755-4d0b-85e8-b8ae4ac7e00e-00284d6b", "Limtræ - GL30c : 140 x 200mm": "5ca0e5e6-d4ae-4a82-aaed-b1437e04bf6f:7567d436-1755-4d0b-85e8-b8ae4ac7e00e-00284d6d", "Limtræ - GL30c : 140 x 233mm": "5ca0e5e6-d4ae-4a82-aaed-b1437e04bf6f:7567d436-1755-4d0b-85e8-b8ae4ac7e00e-00284d6f", "Limtræ - GL30c : 140 x 266mm": "5ca0e5e6-d4ae-4a82-aaed-b1437e04bf6f:7567d436-1755-4d0b-85e8-b8ae4ac7e00e-00284d71", "Limtræ - GL30c : 140 x 300mm": "5ca0e5e6-d4ae-4a82-aaed-b1437e04bf6f:7567d436-1755-4d0b-85e8-b8ae4ac7e00e-00284d73", "Limtræ - GL30c : 140 x 315mm": "5ca0e5e6-d4ae-4a82-aaed-b1437e04bf6f:7567d436-1755-4d0b-85e8-b8ae4ac7e00e-00284f6d", "Limtræ - GL30c : 140 x 333mm": "5ca0e5e6-d4ae-4a82-aaed-b1437e04bf6f:7567d436-1755-4d0b-85e8-b8ae4ac7e00e-00284d75", "Limtræ - GL30c : 140 x 360mm": "5ca0e5e6-d4ae-4a82-aaed-b1437e04bf6f:7567d436-1755-4d0b-85e8-b8ae4ac7e00e-00284f6f", "Limtræ - GL30c : 140 x 366mm": "5ca0e5e6-d4ae-4a82-aaed-b1437e04bf6f:7567d436-1755-4d0b-85e8-b8ae4ac7e00e-00284d77", "Limtræ - GL30c : 140 x 400mm": "5ca0e5e6-d4ae-4a82-aaed-b1437e04bf6f:7567d436-1755-4d0b-85e8-b8ae4ac7e00e-00284d79", "Limtræ - GL30c : 65 x 133mm": "5ca0e5e6-d4ae-4a82-aaed-b1437e04bf6f:84d24ac1-70b8-4fae-8208-07e4d8d68360-00284d47", "Limtræ - GL30c : 65 x 166mm": "5ca0e5e6-d4ae-4a82-aaed-b1437e04bf6f:7567d436-1755-4d0b-85e8-b8ae4ac7e00e-00284d67", "Limtræ - GL30c : 65 x 200mm": "5ca0e5e6-d4ae-4a82-aaed-b1437e04bf6f:7567d436-1755-4d0b-85e8-b8ae4ac7e00e-00284d69"}, selected="Konstruktionstræ - C24 : 45 x 145mm")

# ---- group: midt del trækbånd revit (continued)
add_structural_beam_12 = AddStructuralBeam(Curve=explode_tree_2.Branch4, Type=element_type_picker_19, ReferenceLevel=levels_picker, TrackingMode=2)

# ---- group: midt del trækbånd revit / Sætter justification
category_parameters_16 = CategoryParameters(Category=built_in_categories_15)
value_picker_33 = ValuePicker(category_parameters_16, SearchPattern="y justi")
item_index_17 = ItemIndex(List=y_justification_ikke_ret, Item=fsdfsdf_18)
element_parameter_29 = ElementParameter(Element=add_structural_beam_12, Parameter=value_picker_33, Value=item_index_17)  # -> Element, Value

# ---- group: midt del trækbånd revit / Extension
value_picker_34 = ValuePicker(category_parameters_16, SearchPattern="extension")
value_picker_35 = ValuePicker(category_parameters_16, SearchPattern="extension")
element_parameter_30 = ElementParameter(Element=element_parameter_29.Element, Parameter=value_picker_34, Value=set_extension_midt_del_trækbånd)  # -> Element, Value
element_parameter_31 = ElementParameter(Element=element_parameter_30.Element, Parameter=value_picker_35, Value=set_extension_midt_del_trækbånd)  # -> Element, Value

# ---- group: Extension
value_picker_36 = ValuePicker(category_parameters_16, SearchPattern="extension")
value_picker_37 = ValuePicker(category_parameters_16, SearchPattern="extension")
element_parameter_32 = ElementParameter(
    Element=[element_parameter_19.Element, element_parameter_13.Element],
    Parameter=value_picker_37,
    Value=set_extension_skråbånd)  # -> Element, Value
element_parameter_33 = ElementParameter(Element=element_parameter_32.Element, Parameter=value_picker_36, Value=set_extension_skråbånd_2)  # -> Element, Value

# ---- group: sider trækbånd revit
built_in_categories_16 = BuiltInCategories("autodesk.revit.category.family:structuralFraming-1.0.0", SearchPattern="structural beam")

# ---- group: input sider trækbånd revit (continued)
element_type_picker_20 = ElementTypePicker(
    built_in_categories_16,
    {"Konstruktionstræ - C24 : 45 x 145mm": "5ca0e5e6-d4ae-4a82-aaed-b1437e04bf6f:e49c5e58-d29a-4c1d-8804-90a8e0a510a6-0006c6be", "Konstruktionstræ - C24 : 45 x 195mm": "5ca0e5e6-d4ae-4a82-aaed-b1437e04bf6f:374e7de6-c751-4c8b-8729-d2fda166ad12-00205972", "Konstruktionstræ - C24 : 45 x 245mm": "5ca0e5e6-d4ae-4a82-aaed-b1437e04bf6f:d1ee8fc3-d1d9-47d4-bd34-99b45ed829f0-000b9fc8", "Konstruktionstræ - C24 : 45 x 295mm": "5ca0e5e6-d4ae-4a82-aaed-b1437e04bf6f:a07ebcf2-56a6-4c8a-b025-74aeaa59a2b7-00232e25", "Konstruktionstræ - C24 : 45 x 95mm": "5ca0e5e6-d4ae-4a82-aaed-b1437e04bf6f:e32d8bac-8c95-45b6-bd4f-286ccc275567-002117bb", "Limtræ - GL30c : 140 x 166mm": "5ca0e5e6-d4ae-4a82-aaed-b1437e04bf6f:7567d436-1755-4d0b-85e8-b8ae4ac7e00e-00284d6b", "Limtræ - GL30c : 140 x 200mm": "5ca0e5e6-d4ae-4a82-aaed-b1437e04bf6f:7567d436-1755-4d0b-85e8-b8ae4ac7e00e-00284d6d", "Limtræ - GL30c : 140 x 233mm": "5ca0e5e6-d4ae-4a82-aaed-b1437e04bf6f:7567d436-1755-4d0b-85e8-b8ae4ac7e00e-00284d6f", "Limtræ - GL30c : 140 x 266mm": "5ca0e5e6-d4ae-4a82-aaed-b1437e04bf6f:7567d436-1755-4d0b-85e8-b8ae4ac7e00e-00284d71", "Limtræ - GL30c : 140 x 300mm": "5ca0e5e6-d4ae-4a82-aaed-b1437e04bf6f:7567d436-1755-4d0b-85e8-b8ae4ac7e00e-00284d73", "Limtræ - GL30c : 140 x 315mm": "5ca0e5e6-d4ae-4a82-aaed-b1437e04bf6f:7567d436-1755-4d0b-85e8-b8ae4ac7e00e-00284f6d", "Limtræ - GL30c : 140 x 333mm": "5ca0e5e6-d4ae-4a82-aaed-b1437e04bf6f:7567d436-1755-4d0b-85e8-b8ae4ac7e00e-00284d75", "Limtræ - GL30c : 140 x 360mm": "5ca0e5e6-d4ae-4a82-aaed-b1437e04bf6f:7567d436-1755-4d0b-85e8-b8ae4ac7e00e-00284f6f", "Limtræ - GL30c : 140 x 366mm": "5ca0e5e6-d4ae-4a82-aaed-b1437e04bf6f:7567d436-1755-4d0b-85e8-b8ae4ac7e00e-00284d77", "Limtræ - GL30c : 140 x 400mm": "5ca0e5e6-d4ae-4a82-aaed-b1437e04bf6f:7567d436-1755-4d0b-85e8-b8ae4ac7e00e-00284d79", "Limtræ - GL30c : 65 x 133mm": "5ca0e5e6-d4ae-4a82-aaed-b1437e04bf6f:84d24ac1-70b8-4fae-8208-07e4d8d68360-00284d47", "Limtræ - GL30c : 65 x 166mm": "5ca0e5e6-d4ae-4a82-aaed-b1437e04bf6f:7567d436-1755-4d0b-85e8-b8ae4ac7e00e-00284d67", "Limtræ - GL30c : 65 x 200mm": "5ca0e5e6-d4ae-4a82-aaed-b1437e04bf6f:7567d436-1755-4d0b-85e8-b8ae4ac7e00e-00284d69"}, selected="Konstruktionstræ - C24 : 45 x 145mm")

# ---- group: sider trækbånd revit (continued)
add_structural_beam_13 = AddStructuralBeam(Curve=explode_tree_2.Branch5, Type=element_type_picker_20, ReferenceLevel=levels_picker, TrackingMode=2)

# ---- group: sider trækbånd revit / Sætter justification
category_parameters_17 = CategoryParameters(Category=built_in_categories_16)
value_picker_38 = ValuePicker(category_parameters_17, SearchPattern="y justi")
item_index_18 = ItemIndex(List=y_justification_ikke_ret, Item=fsdfsdf_19)
element_parameter_34 = ElementParameter(Element=add_structural_beam_13, Parameter=value_picker_38, Value=item_index_18)  # -> Element, Value

# ---- group: sider trækbånd revit / Extension
value_picker_39 = ValuePicker(category_parameters_17, SearchPattern="extension")
value_picker_40 = ValuePicker(category_parameters_17, SearchPattern="extension")
element_parameter_35 = ElementParameter(Element=element_parameter_34.Element, Parameter=value_picker_39, Value=set_extension_sider_del_trækbånd)  # -> Element, Value
element_parameter_36 = ElementParameter(Element=element_parameter_35.Element, Parameter=value_picker_40, Value=set_extension_sider_del_trækbånd)  # -> Element, Value

# ---- group: Forskydningsfelter revit
built_in_categories_17 = BuiltInCategories("autodesk.revit.category.local:walls-1.0.0", SearchPattern="walls")

# ---- group: Indput forskydningsfelter revit
element_type_picker_21 = ElementTypePicker(
    built_in_categories_17,
    {"Basic Wall : 011 Generic Wall_500": "5ca0e5e6-d4ae-4a82-aaed-b1437e04bf6f:6f708569-14dd-429e-9d15-24cf1c2f7ba6-00277cd5", "Basic Wall : 108 mursten/ 80 luft / 100 Leca": "5ca0e5e6-d4ae-4a82-aaed-b1437e04bf6f:937387b7-311b-4189-a980-234f76f42894-00274101", "Basic Wall : 200, 25 puds / 150 Leca / 25 puds": "5ca0e5e6-d4ae-4a82-aaed-b1437e04bf6f:24773d21-6643-4f53-b151-8a534b1e13ac-00281dab", "Basic Wall : 225, 25 puds / 150 Leca / 50 polystyren": "5ca0e5e6-d4ae-4a82-aaed-b1437e04bf6f:a8b3c61d-f09f-447f-b1da-ff7990f0f13e-00281697", "Basic Wall : 325, 25 puds / 300 beton": "5ca0e5e6-d4ae-4a82-aaed-b1437e04bf6f:9a8577e0-28c0-48f0-93d6-b065869252f7-002824bc", "Basic Wall : 350, 25 puds / 300 beton / 25 puds": "5ca0e5e6-d4ae-4a82-aaed-b1437e04bf6f:9a8577e0-28c0-48f0-93d6-b065869252f7-0028249c", "Basic Wall : Beton - Insitu Udfyldning 588": "5ca0e5e6-d4ae-4a82-aaed-b1437e04bf6f:6f708569-14dd-429e-9d15-24cf1c2f7ba6-00277ffc", "Basic Wall : Beton - Insitu Udfyldning 588 - Fundament": "5ca0e5e6-d4ae-4a82-aaed-b1437e04bf6f:6f708569-14dd-429e-9d15-24cf1c2f7ba6-00278161", "Basic Wall : Exterior - Block on Mtl. Stud": "5ca0e5e6-d4ae-4a82-aaed-b1437e04bf6f:4d24d0d6-38f1-47b8-a376-b40c6432dad5-0000d50a", "Basic Wall : Exterior - Brick on Mtl. Stud": "5ca0e5e6-d4ae-4a82-aaed-b1437e04bf6f:e3e052f9-0156-11d5-9301-0000863f27ad-0000018d", "Basic Wall : _DK  Væg beton, 150 150": "5ca0e5e6-d4ae-4a82-aaed-b1437e04bf6f:6f708569-14dd-429e-9d15-24cf1c2f7ba6-00278030", "Basic Wall : _DK  Væg beton, 200 mm 200:1717": "5ca0e5e6-d4ae-4a82-aaed-b1437e04bf6f:6f708569-14dd-429e-9d15-24cf1c2f7ba6-00277ff9", "Basic Wall : _DK  Væg gips, stålskelet, 30dB/BS30/2 lag 95 mm 95": "5ca0e5e6-d4ae-4a82-aaed-b1437e04bf6f:6f708569-14dd-429e-9d15-24cf1c2f7ba6-00278038", "Basic Wall : _DK  Væg gips, stålskelet, 52dB/BS60/4 lag 145 mm 145": "5ca0e5e6-d4ae-4a82-aaed-b1437e04bf6f:6f708569-14dd-429e-9d15-24cf1c2f7ba6-00278034", "Basic Wall : _DK  Væg letbeton, 100 mm 100": "5ca0e5e6-d4ae-4a82-aaed-b1437e04bf6f:6f708569-14dd-429e-9d15-24cf1c2f7ba6-00277ffa", "Basic Wall : _DK  Ydervæg, beton, 396": "5ca0e5e6-d4ae-4a82-aaed-b1437e04bf6f:6f708569-14dd-429e-9d15-24cf1c2f7ba6-00278091", "Basic Wall : _DK  Ydervæg, let, 338 238": "5ca0e5e6-d4ae-4a82-aaed-b1437e04bf6f:6f708569-14dd-429e-9d15-24cf1c2f7ba6-00278033", "Basic Wall : _DK  Ydervæg, let, 387": "5ca0e5e6-d4ae-4a82-aaed-b1437e04bf6f:6f708569-14dd-429e-9d15-24cf1c2f7ba6-0027808f", "Basic Wall : _DK  Ydervæg, tegl/Beton, 588, 108/180 588": "5ca0e5e6-d4ae-4a82-aaed-b1437e04bf6f:6f708569-14dd-429e-9d15-24cf1c2f7ba6-00278031", "Basic Wall : isolering 145 mm": "5ca0e5e6-d4ae-4a82-aaed-b1437e04bf6f:0f9160a4-e12b-4c2b-82ba-a1e1e44d0b67-0027feea", "Basic Wall : isolering 95 mm": "5ca0e5e6-d4ae-4a82-aaed-b1437e04bf6f:0f9160a4-e12b-4c2b-82ba-a1e1e44d0b67-00280e99", "Curtain Wall : 226 Int. Curtain Wall with Mullions_33_Glass 20": "5ca0e5e6-d4ae-4a82-aaed-b1437e04bf6f:6f708569-14dd-429e-9d15-24cf1c2f7ba6-00277e8d"}, selected="Basic Wall : 011 Generic Wall_500")

# ---- group: Forskydningsfelter revit (continued)
# EVENTUELT TILFØJ,
# Lav som 2 felt, med modsat justification. Så skal kryds domæne rettes
add_wall_profile_3 = AddWallProfile(Profile=graft(explode_tree.Branch7), Type=element_type_picker_21, TrackingMode=2)

# ---- group: Tagåser revit / Sætter justification
category_parameters_18 = CategoryParameters(Category=built_in_categories_12)
value_picker_41 = ValuePicker(category_parameters_18, SearchPattern="z justi")
item_index_19 = ItemIndex(List=z_justification_ikke_ret, Item=fsdfsdf_9)

# ---- group: Tagåser revit (continued)
value_picker_42 = ValuePicker(category_parameters_18, SearchPattern="offset")
add_structural_beam_14 = AddStructuralBeam(Curve=move_2.Geometry, Type=element_type_picker_16, ReferenceLevel=levels_picker, TrackingMode=2)

# ---- group: Tagåser revit / Sætter justification (continued)
element_parameter_37 = ElementParameter(Element=add_structural_beam_14, Parameter=value_picker_41, Value=item_index_19)  # -> Element, Value

# ---- group: Tagåser revit / Roterer tagåser så de er vinkelret på bue (continued)
element_parameter_38 = ElementParameter(Element=element_parameter_37.Element, Parameter=value_picker_32, Value=radians_7)  # -> Element, Value

# ---- group: Tagåser revit (continued)
element_parameter_39 = ElementParameter(Element=element_parameter_38.Element, Parameter=value_picker_42, Value=integer_2)  # -> Element, Value
