# Grasshopper definition STRUCTURAL ANALYSIS_Arch without tension bar.gh (Grasshopper 1.0.7)
# plug-ins: Karamba3D

udviklet_af = Panel("Daniel Bo Olesen")
# Beskrivelse: OC Engineering Grasshopper Template.
# Grafisk standard ses herunder.
# Højre klik på farve og sæt den til standard, grupper herefter og sæt kommentarer på gruppen.
# 
# 
# BESKRIVELSE AF SCRIPT:
# Structural arch calculation using karamba3d
# 
# TEORI:
# bla bla.
# 
# INPUT:
# bla bla.
# 
# OUTPUT:
# bla bla.
gældende_udgivelsesdato_og_version = Panel("20.03.2023 - 01.00.00.00")
# Tilføjelser ændringer der kan implementeres: - Groups etc. to match template.
# - quality assurance
revisions_historik = Panel("20.03.2023 - 01.00.00.00 - første udgivelse offentligt")
projekt = Panel("SagsNr - SagsNavn")
image_sampler = ImageSampler(Filter="Colour", Interpolate=True, Umax=842, Umin=1, Vmax=595, Vmin=1, Wrap=1)
spænd_m = Slider(18, range=0..25)
# Spænd er 18 m
# Radius er 18m
# Set rhino unit to m in settings
radius_m = Slider(18, range=0..25)
multiplication = Multiplication(A=radius_m, B=2)
# Then θ, the angle between the radii going to the two points is given by
# θ=2×sin−1(D/2R)
# 
# Hvor D er spænd og R er radius, forudsætter punkter er i linje med hinanden
division = Division(A=spænd_m, B=multiplication)
arcsine = ArcSine(Value=division)
construct_point = ConstructPoint(XCoordinate=0, YCoordinate=0, ZCoordinate=0)
multiplication_2 = Multiplication(A=arcsine, B=2)
arc = Arc(Plane=construct_point, Radius=expr("x*1000", radius_m), Angle=multiplication_2)  # -> Arc, Length
circle = Circle(Plane=construct_point, Radius=radius_m)
xy_plane = XYPlane(Origin=Point(0, 0, 0))
rotate = Rotate(Geometry=arc.Arc, Angle=multiplication_2, Plane=xy_plane)  # -> Geometry, Transform
divide_curve = DivideCurve(Curve=rotate.Geometry, Count="8", Kinks=False)  # -> Points, Tangents, Parameters
shift_list = ShiftList(List=divide_curve.Points, Shift=1, Wrap=True)
unit_y = UnitY(Factor=1)
line = Line(StartPoint=divide_curve.Points, EndPoint=shift_list)
material_properties_karamba3d = MaterialPropertiesKaramba3D(
    FamilyOfMaterial="Steel",
    Name="S235",
    YoungsModulus_kN_cm2=21000,
    InPlaneShearModulus_kN_cm2=8076,
    TransverseShearModulus_kN_cm2=8076,
    SpecificWeight_kN_m3=78.5,
    CoefficientOfThermalExpansion_1_C=1.2e-05,
    TensileStrength_kN_cm2=23.5,
    CompressiveStrength_kN_cm2=-23.5,
    StrengthHypothesis="MISES",
    mode="Isotrop")
end_points = EndPoints(Curve=rotate.Geometry)  # -> Start, End
panel = Panel("80")
panel_2 = Panel("30")
panel_3 = Panel("15")
xy_plane_2 = XYPlane(Origin=Point(0, 0, 0))
panel_4 = Panel("2")
panel_5 = Panel("0")
cross_section_karamba3d = CrossSectionKaramba3D(
    FamilyNameOfCrossSection="DefaultCroSec",
    Height_cm=10,
    UpperFlangeWidth_cm=5,
    LowerFlangeWidth_cm=5,
    UpperFlangeThickness_cm=0.4,
    LowerFlangeThickness_cm=0.4,
    SidewallsThickness_cm=0.4,
    FilletRadius_cm=0.6,
    mode="Box")
material_selection_karamba3d = MaterialSelectionKaramba3D(menu=[dropdown(2), dropdown(2)])
line_to_beam_karamba3d = LineToBeamKaramba3D(
    Line=line,
    New=True,
    Remove=True,
    LimitDistance_m=0.005,
    Bending=True,
    SetBucklingLength=True,
    ToPolylineMaxAngle=0.03,
    ToPolylineTolerance=0.01,
    ToPolylineMaxEdgeLength=0.25)  # -> Element, Points, Info
support_karamba3d = SupportKaramba3D(PosInd=[end_points.End, end_points.Start], PlaneOfReference=xy_plane_2, menu=[buttons(on, on, on, on, on, on)])
beam_loads_karamba3d = BeamLoadsKaramba3D(LoadCase="0", ForceVector=unit_y, TPosition=Slider(0.5, range=0..5), mode="Concentrated", menu=[buttons(on, off)])
assemble_model_karamba3d = AssembleModelKaramba3D(Elem=line_to_beam_karamba3d.Element, Support=support_karamba3d, Load=beam_loads_karamba3d, LimitDistance_m=0.005)  # -> Model, Info, Mass_kg, CenterOfGravity, LoadCaseNames
analyze_karamba3d = AnalyzeKaramba3D(Model=assemble_model_karamba3d.Model)  # -> CalculatedModel, MaximumDisplacement_cm, ResultingForceOfGravity_kN, ElasticEnergyChange_kNm
model_view_karamba3d = ModelViewKaramba3D(Model=analyze_karamba3d.CalculatedModel, ResultFactors=1, ResultCase=-1)  # -> Model, DeformedMesh, DeformedAxes, DeformedModel
beam_view_karamba3d = BeamViewKaramba3D(Model=analyze_karamba3d.CalculatedModel)  # -> Model, MeshesOfRenderedBeams, DeformedBeamAxes, LegendColors, LegendTags
