# Grasshopper definition STRUCTURAL ANALYSIS_Straight stair BHoM to RSA.gh (Grasshopper 1.0.7)
# plug-ins: BH.UI.Grasshopper, MetaHopper, Human, LunchBox

developed_by = Panel("Daniel Bo Olesen")
# Description: OC Engineering Grasshopper Template.
# Graphic standard seen underneath
# Rightclick a colour and set to standard, there after group and comment on the group
# 
# 
# DESCRIPTION OF THE SCRIPT:
# Script der bruges i hops, oploades til GitHub så der er mulighed for at dele hops med flere brugere, da der bruges et link af http.... typen, hvormed den ikke er bruger bestemt i form af en specifik sti.
# 
# THEORY:
# bla bla.
# 
# INPUT:
# bla bla.
# 
# OUTPUT:
# bla bla.
# Output
# Input
# data
# geometry
# preview
# OBS
# big group
# Revision history: FILL OUT if not managed through .git
# 15.03.2023 - 01.00.00.00 - første udgivelse
# Todos: FILL OUT if not managed through .git
# - Indbyg udbøjning formel
current_revision_data_and_version = Panel("15.03.2023 - 01.00.00.00")
project = Panel("SagsNr - SagsNavn")
image_sampler = ImageSampler(Filter="Colour", Interpolate=True, Umax=842, Umin=1, Vmax=595, Vmin=1, Wrap=1)
# GH TOOLS
panel = Panel(""" Use shift+ctrl+B to search in BHoM
BHoM bruger Si grundenheder, dvs. meter, newton, Pa osv.""")

# ---- group: Modify all panels
get_objects_of_same_type = GetObjectsOfSameType(Objects=panel)
set_panel_properties = SetPanelProperties(Panel=get_objects_of_same_type, Color=ColourSwatch(SwatchColor=RGB(255, 255, 255)))

# ----
wire_display_toggle = WireDisplayToggle(ShowHiddenWires=Toggle(False))

# ---- group: RSA Settings
designcode_steel = DesignCode_Steel(
    {"Default": 0, "BS5950": 1, "BS5950_2000": 2, "BS_EN_1993_1_2005_NA_2008_A1_2014": 3, "ANSI_AISC_360_10": 4}, selected="BS_EN_1993_1_2005_NA_2008_A1_2014",
    Component="BH.oM.Adapters.Robot.DesignCode_Steel",
    Selection=3)
materialdb = MaterialDB(
    {"American": 0, "British": 1, "Eurocode": 2}, selected="Eurocode",
    Component="BH.oM.Adapters.Robot.MaterialDB",
    Selection=2)
savebeforeclose = BooleanToggle(False)
sectiondb = SectionDB({"UKST": 0, "AISC": 1}, selected="UKST", Component="BH.oM.Adapters.Robot.SectionDB", Selection=0)
designcode_steel_2 = Data(designcode_steel)
savebeforeclose_2 = Data(savebeforeclose)
materialdb_2 = Data(materialdb)
sectiondb_2 = Data(sectiondb)

# ---- group: OPEN/CLOSE RSA
# CONNECTORS
open_activate_rsa = BooleanToggle(False)
close_rsa = BooleanToggle(False)
open_activate_rsa_2 = Data(open_activate_rsa)
close_rsa_2 = Data(close_rsa)

# ---- group: Revit adaptor
familyloadsettings = FamilyLoadSettings(OverwriteFamily=True, OverwriteParameterValues=True, Component="{ .FamilyLoadSettings")
mappingsettings = MappingSettings(Component="{ .MappingSettings")
connectionsettings = ConnectionSettings(PushPort=14128, PullPort=14129, MaxMinutesToWait=10, Component="{ .ConnectionSettings")
revitsettings = RevitSettings(
    ConnectionSettings=connectionsettings,
    FamilyLoadSettings=familyloadsettings,
    MappingSettings=mappingsettings,
    DistanceTolerance=1e-06,
    AngleTolerance=1e-06,
    Component="BH.oM.Adapters.Revit.Settings.RevitSettings")
revitadapter = RevitAdapter(RevitSettings=revitsettings, Active=Toggle(True), Component="{ ..ctor")

# ----
close = Close(SaveBeforeClose=Toggle(False), Component="BH.oM.Adapter.Commands.Close")
execute = Execute(Adapter=revitadapter, Command=close, Active=Toggle(False), Component="{ .Execute")  # -> Output, Success
heigh_of_sidebars_over_steps_surface = Panel("0.00")
actual_step_depth = Panel("0.3")
heigh_sidebars_over_steps = Data(heigh_of_sidebars_over_steps_surface)

# ---- group: Element, Big studs
name_element_big_studs = Data("Lodposter")
rotation_degree = Slider(0, range=0..180)

# ---- group: Element, Big studs / Releases, element 2
fixconstraint6dof = FixConstraint6DOF(Name="Pinned", Component="{ .FixConstraint6DOF")
pinconstraint6dof = PinConstraint6DOF(Name="Fixed", Component="{ .PinConstraint6DOF")
barreleasepinpin = BarReleasePinPin(Name="PinPin", Component="{ .BarReleasePinPin")
barreleasefixfix = BarReleaseFixFix(Name="FixFix", Component="{ .BarReleaseFixFix")
barreleasepinslip = BarReleasePinSlip(Name="PinSlip", Component="{ .BarReleasePinSlip")
barrelease = BarRelease(StartRelease=fixconstraint6dof, EndRelease=pinconstraint6dof, Component="BH.oM.Structure.Constraints.BarRelease")
pinslip = Data(barreleasepinslip)
fixfix = Data(barreleasefixfix)
pinpin = Data(barreleasepinpin)
release = Data(barrelease)

# ---- group: Element, surface steps
loadpanelsupportconditions = LoadPanelSupportConditions(
    {"AllSides": 0, "ThreeSides": 1, "TwoSides": 2, "TwoAdjacentSides": 3, "OneSide": 4, "Cantilever": 5, "Auto": 6}, selected="TwoSides",
    Component="BH.oM.Structure.SurfaceProperties.LoadPanelSupportConditions",
    Selection=2)
name_element = Data("Trin og repos")

# ---- group: helper beams for steps surface / Releases, element 2
barreleasefixfix_2 = BarReleaseFixFix(Name="FixFix", Component="{ .BarReleaseFixFix")
barreleasepinpin_2 = BarReleasePinPin(Name="PinPin", Component="{ .BarReleasePinPin")
barreleasepinslip_2 = BarReleasePinSlip(Name="PinSlip", Component="{ .BarReleasePinSlip")
fixfix_2 = Data(barreleasefixfix_2)
pinpin_2 = Data(barreleasepinpin_2)
pinslip_2 = Data(barreleasepinslip_2)
release_2 = Data(pinpin_2)  # disabled

# ---- group: helper beams for steps surface
name_of_element_helper_beams = Data("steps support beams")
steel = Steel(
    {"S235": 0, "S275": 1, "S355": 2, "S450": 3}, selected="S235",
    Component="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",
    Selection=0)
steel_2 = Data(steel)

# ---- group: Column Supports
fixconstraint6dof_2 = FixConstraint6DOF(Component="{ .FixConstraint6DOF")
pinconstraint6dof_2 = PinConstraint6DOF(Component="{ .PinConstraint6DOF")
fixed = Data(fixconstraint6dof_2)
pinned = Data(pinconstraint6dof_2)
name_of_support = Data("SøjleUnderstoetning")
support = Data(fixed)

# ---- group: Supports along wall
skew_part_number_of_fixed_places_in_wall = Slider(5, range=0..15)  # "Skew part, Number of fixed places in wall, eg. supports"
top_part_number_of_fixed_places_in_wall = Slider(2, range=0..15)  # "Top part, Number of fixed places in wall, eg. supports"
doftype = DOFType(
    {"Free": 0, "Fixed": 1, "FixedNegative": 2, "FixedPositive": 3, "Spring": 4, "SpringNegative": 5, "SpringPositive": 6, "SpringRelative": 7, "SpringRelativeNegative": 8, "SpringRelativePositive": 9, "NonLinear": 10, "Friction": 11, "Damped": 12, "Gap": 13}, selected="Fixed",
    Component="BH.oM.Structure.Constraints.DOFType",
    Selection=1)
constraint6dof = Constraint6DOF(
    Name="Locked x",
    TranslationX=doftype,
    TranslationY="{ \"_t\" : \"System.Enum\", \"TypeName\" : { \"_t\" : \"System.Type\", \"Name\" : \"BH.oM.Structure.Constraints.DOFType\", \"_bhomVersion\" : \"6.2\" }, \"Value\" : \"Free\", \"_bhomVersion\" : \"6.2\" }",
    TranslationZ="{ \"_t\" : \"System.Enum\", \"TypeName\" : { \"_t\" : \"System.Type\", \"Name\" : \"BH.oM.Structure.Constraints.DOFType\", \"_bhomVersion\" : \"6.2\" }, \"Value\" : \"Free\", \"_bhomVersion\" : \"6.2\" }",
    Component="BH.oM.Structure.Constraints.Constraint6DOF")
skew_part_number_of_fixed_places_in_wall_2 = Data(skew_part_number_of_fixed_places_in_wall)  # "Skew part, Number of fixed places in wall, eg. supports"
top_part_number_of_fixed_places_in_wall_2 = Data(top_part_number_of_fixed_places_in_wall)  # "Top part, Number of fixed places in wall, eg. supports"
name_of_support_2 = Data("vanger understoetning væg")
support_2 = Data(constraint6dof)

# ---- group: Element, Columns / Bar Releases
barreleasefixfix_3 = BarReleaseFixFix(Name="FixFix", Component="{ .BarReleaseFixFix")
barreleasepinpin_3 = BarReleasePinPin(Name="PinPin", Component="{ .BarReleasePinPin")
barreleasepinslip_3 = BarReleasePinSlip(Name="PinSlip", Component="{ .BarReleasePinSlip")
pinpin_3 = Data(barreleasepinpin_3)
fixfix_3 = Data(barreleasefixfix_3)
pinslip_3 = Data(barreleasepinslip_3)
release_3 = Data(pinpin_3)

# ---- group: Sidebar Supports
fixconstraint6dof_3 = FixConstraint6DOF(Component="{ .FixConstraint6DOF")
pinconstraint6dof_3 = PinConstraint6DOF(Component="{ .PinConstraint6DOF")
pinned_2 = Data(pinconstraint6dof_3)
fixed_2 = Data(fixconstraint6dof_3)
name_of_support_3 = Data("vanger understoetning bund")
support_3 = Data(pinned_2)

# ---- group: Element, Columns
# OBJECTS SET-UP, BHoM
panel_2 = Panel("Søjle")
name_on_column = Data(panel_2)

# ---- group: Element, subrailing studs / Releases
barreleasefixfix_4 = BarReleaseFixFix(Name="FixFix", Component="{ .BarReleaseFixFix")
barreleasepinpin_4 = BarReleasePinPin(Name="PinPin", Component="{ .BarReleasePinPin")
barreleasepinslip_4 = BarReleasePinSlip(Name="PinSlip", Component="{ .BarReleasePinSlip")
fixfix_4 = Data(barreleasefixfix_4)
pinpin_4 = Data(barreleasepinpin_4)
pinslip_4 = Data(barreleasepinslip_4)
release_4 = Data(pinpin_4)

# ---- group: Element, subrailings
name_elements_subrailing = Data("haandliste lille")
steel_3 = Steel(
    {"S235": 0, "S275": 1, "S355": 2, "S450": 3}, selected="S235",
    Component="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",
    Selection=0)
steel_4 = Data(steel_3)

# ---- group: BHoM object, structural loads / Lastkombinationer
# Lastkombinationer
k_fi = ValueList({"CC1": 0.9, "CC2": 1, "CC3": 1.1}, selected="CC3")

# ---- group: Element, sidebars / Releases, sidebars
barreleasefixfix_5 = BarReleaseFixFix(Name="FixFix", Component="{ .BarReleaseFixFix")
barreleasepinpin_5 = BarReleasePinPin(Name="PinPin", Component="{ .BarReleasePinPin")
barreleasepinslip_5 = BarReleasePinSlip(Name="PinSlip", Component="{ .BarReleasePinSlip")
fixfix_5 = Data(barreleasefixfix_5)
pinpin_5 = Data(barreleasepinpin_5)
pinslip_5 = Data(barreleasepinslip_5)
release_5 = Data(pinpin_5)  # disabled

# ---- group: Element, subrailings / Releases 2
barreleasefixfix_6 = BarReleaseFixFix(Name="FixFix", Component="{ .BarReleaseFixFix")
barreleasepinpin_6 = BarReleasePinPin(Name="PinPin", Component="{ .BarReleasePinPin")
barreleasepinslip_6 = BarReleasePinSlip(Name="PinSlip", Component="{ .BarReleasePinSlip")
fixfix_6 = Data(barreleasefixfix_6)
pinpin_6 = Data(barreleasepinpin_6)
pinslip_6 = Data(barreleasepinslip_6)
release_6 = Data(pinpin_6)

# ---- group: Element, subrailing studs
name_element_subrailings_studs = Data("balustre")
steel_5 = Steel(
    {"S235": 0, "S275": 1, "S355": 2, "S450": 3}, selected="S235",
    Component="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",
    Selection=0)
steel_6 = Data(steel_5)

# ---- group: Element, top railings / Releases
barreleasefixfix_7 = BarReleaseFixFix(Name="FixFix", Component="{ .BarReleaseFixFix")
barreleasepinpin_7 = BarReleasePinPin(Name="PinPin", Component="{ .BarReleasePinPin")
barreleasepinslip_7 = BarReleasePinSlip(Name="PinSlip", Component="{ .BarReleasePinSlip")
pinpin_7 = Data(barreleasepinpin_7)
fixfix_7 = Data(barreleasefixfix_7)
pinslip_7 = Data(barreleasepinslip_7)
release_7 = Data(pinpin_7)  # disabled

# ---- group: Element, sidebars
name_of_sidebars = Data("vanger")
steel_7 = Steel(
    {"S235": 0, "S275": 1, "S355": 2, "S450": 3}, selected="S235",
    Component="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",
    Selection=0)

# ---- group: BHoM object, structural loads / Last typer/cases / Last typer
# Last typer/cases
# Use superDead for dead load in RSA
panel_3 = Panel("""DL1
Nyttelast
Snelast
Vindlast
Seismisklast
Ulykkeslast
Islast""")
loadnature = LoadNature(
    {"Dead": 0, "SuperDead": 1, "Live": 2, "Wind": 3, "Seismic": 4, "Temperature": 5, "Snow": 6, "Accidental": 7, "Prestress": 8, "Notional": 9, "Other": 10}, selected="SuperDead",
    Component="BH.oM.Structure.Loads.LoadNature",
    Selection=1)
loadnature_2 = LoadNature(
    {"Dead": 0, "SuperDead": 1, "Live": 2, "Wind": 3, "Seismic": 4, "Temperature": 5, "Snow": 6, "Accidental": 7, "Prestress": 8, "Notional": 9, "Other": 10}, selected="Seismic",
    Component="BH.oM.Structure.Loads.LoadNature",
    Selection=4)
loadnature_3 = LoadNature(
    {"Dead": 0, "SuperDead": 1, "Live": 2, "Wind": 3, "Seismic": 4, "Temperature": 5, "Snow": 6, "Accidental": 7, "Prestress": 8, "Notional": 9, "Other": 10}, selected="Live",
    Component="BH.oM.Structure.Loads.LoadNature",
    Selection=2)
loadnature_4 = LoadNature(
    {"Dead": 0, "SuperDead": 1, "Live": 2, "Wind": 3, "Seismic": 4, "Temperature": 5, "Snow": 6, "Accidental": 7, "Prestress": 8, "Notional": 9, "Other": 10}, selected="Snow",
    Component="BH.oM.Structure.Loads.LoadNature",
    Selection=6)
loadnature_5 = LoadNature(
    {"Dead": 0, "SuperDead": 1, "Live": 2, "Wind": 3, "Seismic": 4, "Temperature": 5, "Snow": 6, "Accidental": 7, "Prestress": 8, "Notional": 9, "Other": 10}, selected="Wind",
    Component="BH.oM.Structure.Loads.LoadNature",
    Selection=3)
loadnature_6 = LoadNature(
    {"Dead": 0, "SuperDead": 1, "Live": 2, "Wind": 3, "Seismic": 4, "Temperature": 5, "Snow": 6, "Accidental": 7, "Prestress": 8, "Notional": 9, "Other": 10}, selected="Accidental",
    Component="BH.oM.Structure.Loads.LoadNature",
    Selection=7)
loadnature_7 = LoadNature(
    {"Dead": 0, "SuperDead": 1, "Live": 2, "Wind": 3, "Seismic": 4, "Temperature": 5, "Snow": 6, "Accidental": 7, "Prestress": 8, "Notional": 9, "Other": 10}, selected="Other",
    Component="BH.oM.Structure.Loads.LoadNature",
    Selection=10)
loadnature_8 = Data(loadnature)
loadnature_9 = Data(loadnature_3)
loadnature_10 = Data(loadnature_4)
loadnature_11 = Data(loadnature_5)
loadnature_12 = Data(loadnature_2)
loadnature_13 = Data(loadnature_6)
loadnature_14 = Data(loadnature_7)
name = Data(panel_3)

# ---- group: Element, top railings
name_element_railings = Data("haandliste")
steel_8 = Steel(
    {"S235": 0, "S275": 1, "S355": 2, "S450": 3}, selected="S235",
    Component="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",
    Selection=0)
steel_9 = Data(steel_8)

# ---- group: helper beams for steps surface / Profil, element 2
panel_4 = Panel("support bar")
height = Slider(0.08, range=0..0.8)
width_m = Slider(0.01, range=0..0.1)

# ---- group: Element, subrailing studs / Profil
diameter = Slider(0.014, range=0..0.8)
panel_5 = Panel("Circular solid tube small")

# ---- group: Element, top railings / Profil
thickness = Slider(0.005, range=0..0.1)
panel_6 = Panel("Circular hollow tube big")
diameter_2 = Slider(0.05, range=0..0.8)

# ---- group: Element, sidebars / Profil, sidebars
height_2 = Slider(0.27, range=0..0.8)
width_m_2 = Slider(0.01, range=0..0.1)
name_profile = Data("Flat steel bar")
width_m_3 = Data(width_m_2)
steel_10 = Data(steel_7)
height_3 = Data(height_2)

# ---- group: Element, subrailings / Profil
thickness_2 = Slider(0.005, range=0..0.1)
diameter_3 = Slider(0.03, range=0..0.8)
panel_7 = Panel("Circular hollow tube medium")

# ---- group: Element, Columns / Bar Profil
rhs = RHS(
    {"RHS50x30x3.2": 0, "RHS50x30x3.6": 1, "RHS50x30x4.0": 2, "RHS50x30x5.0": 3, "RHS50x30x6.3": 4, "RHS60x40x3.2": 5, "RHS60x40x3.6": 6, "RHS60x40x4.0": 7, "RHS60x40x5.0": 8, "RHS60x40x6.3": 9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}, selected="RHS50x30x3.2",
    Component="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",
    Selection=0)
he = HE(
    {"HE 1000 M": 0, "HE 1000 B": 1, "HE 1000 A": 2, "HE 900 M": 3, "HE 900 B": 4, "HE 900 A": 5, "HE 800 M": 6, "HE 800 B": 7, "HE 800 A": 8, "HE 700 M": 9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}, selected="HE 1000 M",
    Component="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",
    Selection=0)
steel_11 = Steel(
    {"S235": 0, "S275": 1, "S355": 2, "S450": 3}, selected="S235",
    Component="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",
    Selection=0)
ipe = IPE(
    {"IPE 600": 0, "IPE 550": 1, "IPE 500": 2, "IPE 450": 3, "IPE 400": 4, "IPE 360": 5, "IPE 330": 6, "IPE 300": 7, "IPE 270": 8, "IPE 240": 9, "IPE 220": 10, "IPE 200": 11, "IPE 180": 12, "IPE 160": 13, "IPE 140": 14, "IPE 120": 15, "IPE 100": 16, "IPE 80": 17}, selected="IPE 500",
    Component="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",
    Selection=2)
upe = UPE(
    {"UPE 330": 0, "UPE 300": 1, "UPE 270": 2, "UPE 240": 3, "UPE 220": 4, "UPE 200": 5, "UPE 180": 6, "UPE 160": 7, "UPE 140": 8, "UPE 120": 9, "UPE 100": 10, "UPE 80": 11}, selected="UPE 330",
    Component="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",
    Selection=0)
shs = SHS(
    {"SHS40x40x3.2": 0, "SHS40x40x3.6": 1, "SHS40x40x4.0": 2, "SHS40x40x5.0": 3, "SHS40x40x6.3": 4, "SHS50x50x3.2": 5, "SHS50x50x3.6": 6, "SHS50x50x4.0": 7, "SHS50x50x5.0": 8, "SHS50x50x6.3": 9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}, selected="SHS80x80x4.0": 26,
    Component="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",
    Selection=26)
steel_12 = Data(steel_11)
profil = Data(shs)

# ---- group: Element, Big studs / Profil, element 2
steel_13 = Steel(
    {"S235": 0, "S275": 1, "S355": 2, "S450": 3}, selected="S235",
    Component="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",
    Selection=0)
height_4 = Slider(0.06, range=0..0.8)
width_m_4 = Slider(0.01, range=0..0.1)
panel_8 = Panel("Flat steel stud")
steel_14 = Data(steel_13)

# ---- group: BHoM object, structural loads / Last typer/cases / Last typer (case)
d1 = Data(loadnature_8)
d2 = Data(loadnature_9)
d3 = Data(loadnature_10)
d4 = Data(loadnature_11)
d5 = Data(loadnature_12)
d6 = Data(loadnature_13)
d7 = Data(loadnature_14)
names = Data(name)
list_length = ListLength(List=names)
merge = Merge(Data1=d1, Data2=d2, Data3=d3, Data4=d4, Data5=d5, Data6=d6, Data7=d7)
series = Series(Start=1, Step=1, Count=list_length)
loadcase = Loadcase(Name=names, Nature=merge, Number=series, Component="BH.oM.Structure.Loads.Loadcase")
explode = Explode(Object=loadcase, Component="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")  # -> Name, Nature, Number, BHoM_Guid, Fragments, Tags, CustomData
bhom_loadtypes = Data(loadcase)
loadtypename = Data(explode.Name)

# ---- group: BHoM object, structural loads / Lastkombinationer / Last kombination 2
vælg_lasttype = Data(loadtypename)
vælg_lasttype_2 = ItemSelector(
    vælg_lasttype,
    {"DL1", "Nyttelast", "Snelast", "Vindlast", "Seismisklast", "Ulykkeslast", "Islast"}, selected=["DL1", "Nyttelast"])
panel_9 = Panel("""1.0
1.5""")
multiplication = Multiplication(A=k_fi, B=panel_9)
panel_10 = Panel(multiplication)
valgte_lasttyper = Data(vælg_lasttype_2)
last_komb_navn = Data("Dom q")
last_komb_nr = Data("11")
faktorer = Data(panel_10)

# ---- group: BHoM object, structural loads / Lastkombinationer / Last kombination 1
vælg_lasttype_3 = Data(loadtypename)
vælg_lasttype_4 = ItemSelector(
    vælg_lasttype_3,
    {"DL1", "Nyttelast", "Snelast", "Vindlast", "Seismisklast", "Ulykkeslast", "Islast"}, selected=["DL1", "Nyttelast"])
panel_11 = Panel("""1.2
1.0""")
multiplication_2 = Multiplication(A=k_fi, B=panel_11)
panel_12 = Panel(multiplication_2)
valgte_lasttyper_2 = Data(vælg_lasttype_4)
last_komb_navn_2 = Data("Dom G")
last_komb_nr_2 = Data("10")
faktorer_2 = Data(panel_12)

# ---- group: BHoM object, structural loads / Lastkombinationer / last kombination 2
bhom_lasttyper = Data(bhom_loadtypes)
lastkomb_nr = Data(last_komb_nr)
name_2 = Data(last_komb_navn)
alle_lasttyper_navne = Data(panel_3)
factors = Data(faktorer)
valgte_last_typer_navne = Data(valgte_lasttyper)
member_index = MemberIndex(Set=alle_lasttyper_navne, Member=valgte_last_typer_navne)  # -> Index, Count
shift_paths = ShiftPaths(Data=member_index.Index, Offset=-1)
list_item = ListItem(List=bhom_lasttyper, Index=shift_paths, Wrap=True)
loadcombination = LoadCombination(
    Name=name_2,
    Number=lastkomb_nr,
    Cases=list_item,
    Factors=factors,
    ExcludeZeroFactorCases=True,
    Component="{ .LoadCombination")
comb_2 = Data(loadcombination)

# ---- group: BHoM object, structural loads / Lastkombinationer / last kombination 1
bhom_lasttyper_2 = Data(bhom_loadtypes)
lastkomb_nr_2 = Data(last_komb_nr_2)
alle_lasttyper_navne_2 = Data(panel_3)
valgte_last_typer_navne_2 = Data(valgte_lasttyper_2)
name_3 = Data(last_komb_navn_2)
factors_2 = Data(faktorer_2)
member_index_2 = MemberIndex(Set=alle_lasttyper_navne_2, Member=valgte_last_typer_navne_2)  # -> Index, Count
shift_paths_2 = ShiftPaths(Data=member_index_2.Index, Offset=-1)
list_item_2 = ListItem(List=bhom_lasttyper_2, Index=shift_paths_2, Wrap=True)
loadcombination_2 = LoadCombination(
    Name=name_3,
    Number=lastkomb_nr_2,
    Cases=list_item_2,
    Factors=factors_2,
    ExcludeZeroFactorCases=True,
    Component="{ .LoadCombination")
comb_1 = Data(loadcombination_2)

# ----
heigh_sidebars_over_steps_2 = Data(heigh_sidebars_over_steps)

# ---- group: Column foundation size REVIT
height_foundation = Panel("0.4")
concrete = Concrete(
    {"C12/15": 0, "C16/20": 1, "C20/25": 2, "C25/30": 3, "C30/37": 4, "C35/45": 5, "C40/50": 6, "C45/55": 7, "C50/60": 8, "C55/67": 9, "C60/75": 10, "C70/85": 11, "C80/95": 12, "C90/105": 13}, selected="C25/30",
    Component="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",
    Selection=3)
width_foundation = Panel("0.4")
depth_foundation = Panel("1.2")
height_foundation_2 = Data(height_foundation)
width_foundation_2 = Data(width_foundation)
depth_foundation_2 = Data(depth_foundation)
concrete_2 = Data(concrete)

# ----
heigh_sidebars_over_steps_3 = Data(heigh_sidebars_over_steps_2)
width_flange_m = Data(width_m_3)
unit_z = UnitZ(Factor=expr("x*-1", heigh_sidebars_over_steps_3))

# ---- group: For revit floor making steps surface
# When using floors map it an excisting floor en REVIT
# 
# Feature request made to make families on push
# https://github.com/BHoM/Revit_Toolkit/issues/1318
# 
# Familie names should be without spaces
panel_13 = Panel("Staal_5mm")
revit_family_steps = Data(panel_13)

# ----
unit_y = UnitY(Factor=expr("x*0.5", width_flange_m))
unit_x = UnitX(Factor=expr("x*0.5", width_flange_m))

# ---- group: Modify group colors, scheme colors preset
group_colors = ValueList({"Output": "184,82,204 (150)", "Input": "56,245,255 (150)", "Data": "128,128,128 (150)", "Geometry": "182,204,102 (150)", "preview": "252,210,159 (150)", "OBS": "255,140,140 (150)", "Big group": "255,255,255 (150)"}, selected="Input")
set_group_properties = SetGroupProperties(Group="Grasshopper.Kernel.Types.GH_ObjectWrapper", Color=group_colors)

# ---- group: Modify line types
# Layout and group design
line_type = ValueList({"Normal": 0, "Faint": 1, "Hidden": 2}, selected="Hidden")
control_wire_display = ControlWireDisplay(WireDisplay=line_type, AllObjects_Object=[steps_surface_4, revit_family_steps_2])

# ---- group: Create scripple on group by name
label_groups = LabelGroups(Run=Toggle(True))

# ---- group: Apply best practice to group
best_practicizer = BestPracticizer(Activate=Toggle(True))

# ----
steeldesigncode = Data(designcode_steel_2)
sectiondatabase = Data(sectiondb_2)
materialdatabase = Data(materialdb_2)
active = Data(close_rsa_2)
savebeforeclose_3 = Data(savebeforeclose_2)
active_2 = Data(open_activate_rsa_2)

# ---- group: Adaptor, connects to and initiate robot
databasesettings = DatabaseSettings(
    MaterialDatabase=materialdatabase,
    SectionDatabase=sectiondatabase,
    SteelDesignCode=steeldesigncode,
    Component="BH.oM.Adapters.Robot.DatabaseSettings")
robotconfig = RobotConfig(
    AdvancedSettings="{ \"_t\" : \"BH.oM.Adapters.Robot.AdvancedSettings\", \"readBarsByQuery\" : false, \"readNodesByQuery\" : false, \"BHoM_Guid\" : \"e24b4d1d-c0a7-440e-84bb-91a955be535a\", \"Name\" : \"\", \"Fragments\" : [], \"Tags\" : [], \"CustomData\" : { }, \"_bhomVersion\" : \"6.2\" }",
    DatabaseSettings=databasesettings,
    InteractiveSettings="{ \"_t\" : \"BH.oM.Adapters.Robot.InteractiveSettings\", \"IsInteractive\" : false, \"IsVisible\" : true, \"BHoM_Guid\" : \"b2458cad-84c6-4c2c-afdd-a2fbc9e98cfd\", \"Name\" : \"\", \"Fragments\" : [], \"Tags\" : [], \"CustomData\" : { }, \"_bhomVersion\" : \"6.2\" }",
    Component="BH.oM.Adapters.Robot.RobotConfig")
robotadapter = RobotAdapter(RobotConfig=robotconfig, Active=active_2, Component="{ ..ctor")

# ---- group: Close RSA
exit = Exit(SaveBeforeClose=savebeforeclose_3, Component="BH.oM.Adapter.Commands.Exit")
execute_2 = Execute(Adapter=robotadapter, Command=exit, Active=active, Component="{ .Execute")  # -> Output, Success

# ----
robotadaptor = Data(robotadapter)

# ---- group: Execute to run analyse command
analyse = Analyse(Component="BH.oM.Adapter.Commands.Analyse")
execute_3 = Execute(Adapter=robotadaptor, Command=analyse, Active=Toggle(False), Component="{ .Execute")  # -> Output, Success

# ----
# Step height maksimum 0.18 m, if it's a danish staircase in a common access way, in some cases 0.21m can be accepted
# For the staircase to feel good walking on aim at 2*stepheight+one depth = 0.63m.
# In kids and elderly homes, result should be around 0.59-0.61m.
# for military facilities and sportfacilities it can be 0.63-0.65m
# Common access ways resulting step depth needs to be minimum 0.28m. 0.25m for domestic housing.
# Common access ways resulting step depth needs to be minimum 0.28m. 0.25m for domestic housing.
# For common access ways the distance between vertical studs are maximum 89mm (free distance), so a bar size can be subtracted.
# 120 should be the maksimum in consideration to kids, bars should be stiff (with not alot of flex)
panel_14 = Panel("https://bygningsreglementet.dk/Tekniske-bestemmelser/02/Krav/57")
# GEOMETRY, GH
panel_15 = Panel("input in m")
max_length_between_big_vertical_studs = Slider(1.27, range=0..2.5)
max_length_between_smal_vertical_studs = Slider(0.134, range=0..2.5)
max_step_height = Slider(0.185, range=0..0.5)
sub_railing_height = Slider(0.69, range=0..2)
railing_height = Slider(1, range=0..2)
platform_depth = Slider(1.89, range=0..10)
height_5 = Slider(2.7, range=0..10)
length = Slider(6, range=0..10)
width = Slider(1.62, range=0..10)
bottom_step = BooleanToggle(False)
max_length_between_big_vertical_studs_2 = Data(max_length_between_big_vertical_studs)
max_length_between_smal_vertical_studs_2 = Data(max_length_between_smal_vertical_studs)
desired_step_height = Data(max_step_height)
sub_railing_height_2 = Data(sub_railing_height)
platform_depth_2 = Data(platform_depth)
railing_height_2 = Data(railing_height)
bottom_step_2 = Data(bottom_step)
height_6 = Data(height_5)
width_2 = Data(width)
length_2 = Data(length)

# ---- group: Sub railing, parallel with handrail
railing_height_3 = Data(railing_height_2)
height_sidebar_profile = Data(height_3)
multiplication_3 = Multiplication(A=height_sidebar_profile, B="0.5")
addition = Addition(A=railing_height_3, B=multiplication_3)
total_railing_height_from_center_sidebar = Data(addition)
half_sidebar_height = Data(multiplication_3)
unit_z_2 = UnitZ(Factor=half_sidebar_height)
subrailing_height = Data(sub_railing_height_2)
railing_height_4 = Data(railing_height_2)
unit_z_3 = UnitZ(Factor=expr("x*0.5", subrailing_height))
unit_z_4 = UnitZ(Factor=expr("x*0.5", railing_height_4))
subtraction = Subtraction(A=unit_z_4, B=unit_z_3)
addition_2 = Addition(A=unit_z_4, B=unit_z_3)
addition_3 = Addition(A=subtraction, B=unit_z_2)
addition_4 = Addition(A=addition_2, B=unit_z_2)

# ---- group: Small vertical studs
desired_small_stud_spacing = Data(max_length_between_smal_vertical_studs_2)

# ---- group: Main railing, corner studs and top rail
desired_big_stud_spacing = Data(max_length_between_big_vertical_studs_2)
railing_height_5 = Data(total_railing_height_from_center_sidebar)
unit_z_5 = UnitZ(Factor=railing_height_5)

# ---- group: steps surface actual size for revit
width_helper_beams = Data(width_m)
width_sidebar_profile = Data(width_m_3)
actual_step_depth_2 = Data(actual_step_depth)
expression = Expression(flangebredde=width_sidebar_profile, stepSideWidth=width_helper_beams, Expression="flangebredde*0.5+stepSideWidth*0.5")
construct_point = ConstructPoint(XCoordinate=0, YCoordinate=0, ZCoordinate=0)
construct_point_2 = ConstructPoint(XCoordinate=0, YCoordinate=actual_step_depth_2, ZCoordinate=0)
line = Line(StartPoint=construct_point, EndPoint=construct_point_2)
unit_y_2 = UnitY(Factor=expr("x*-0.5", actual_step_depth_2))

# ---- group: Steps
desired_step_height_2 = Data(desired_step_height)
bottom_step_3 = Data(bottom_step_2)
height_7 = Data(height_6)
division = Division(A=height_7, B=desired_step_height_2)
steps = Panel(division)
round = Round(Number=division)  # -> Nearest, Floor, Ceiling
division_2 = Division(A=height_7, B=round.Ceiling)
expression_2 = Expression(x=bottom_step_3, Expression="if(x=true,0,1)")
xy_plane = XYPlane(Origin=Point(0, 0, 0))
panel_16 = Panel("Steps")
resulting_step_height = Data(division_2)

# ----
resulting_step_height_2 = Data(resulting_step_height)
resulting_step_height_3 = Panel(resulting_step_height_2)

# ---- group: Basic geometry
platform_depth_3 = Data(platform_depth_2)
width_x_coordinate = Data(width_2)
height_z_coordinate = Data(height_6)
length_3 = Data(length_2)
subtraction_2 = Subtraction(A=length_3, B=platform_depth_3)
construct_point_3 = ConstructPoint(XCoordinate=0, YCoordinate=length_3, ZCoordinate=height_z_coordinate)
construct_point_4 = ConstructPoint(XCoordinate=0, YCoordinate=length_3, ZCoordinate=0)
construct_point_5 = ConstructPoint(XCoordinate=width_x_coordinate, YCoordinate=length_3, ZCoordinate=height_z_coordinate)
construct_point_6 = ConstructPoint(XCoordinate=width_x_coordinate, YCoordinate=subtraction_2, ZCoordinate=height_z_coordinate)
construct_point_7 = ConstructPoint(XCoordinate=width_x_coordinate, YCoordinate=0, ZCoordinate=0)
construct_point_8 = ConstructPoint(XCoordinate=0, YCoordinate=subtraction_2, ZCoordinate=0)
construct_point_9 = ConstructPoint(XCoordinate=0, YCoordinate=0, ZCoordinate=0)
construct_point_10 = ConstructPoint(XCoordinate=0, YCoordinate=subtraction_2, ZCoordinate=height_z_coordinate)
construct_point_11 = ConstructPoint(XCoordinate=width_x_coordinate, YCoordinate=length_3, ZCoordinate=height_z_coordinate)
construct_point_12 = ConstructPoint(XCoordinate=width_x_coordinate, YCoordinate=length_3, ZCoordinate=0)
point = Data(construct_point_10)
point_2 = Data(construct_point_3)
point_3 = Data(construct_point_6)
point_4 = Data(construct_point_5)

# ---- group: Basic geometry / Sidebars horizontal
start_point = Data(construct_point_3)
start_point_2 = Data(construct_point_10)
start_point_3 = Data(construct_point_5)
end_point = Data(construct_point_6)
line_2 = Line(StartPoint=start_point_2, EndPoint=start_point)
line_3 = Line(StartPoint=start_point_3, EndPoint=end_point)
line_4 = Line(StartPoint=start_point, EndPoint=start_point_3)
line_5 = Data(line_4)
line_6 = Data(line_2)
line_7 = Data(line_3)

# ---- group: Basic geometry / Sidebars skew
start_point_4 = Data(construct_point_9)
start_point_5 = Data(construct_point_7)
end_point_2 = Data(construct_point_10)
end_point_3 = Data(construct_point_6)
line_8 = Line(StartPoint=start_point_4, EndPoint=end_point_2)
line_9 = Line(StartPoint=start_point_5, EndPoint=end_point_3)
line_10 = Data(line_8)
line_11 = Data(line_9)

# ---- group: Platform with loads
corner_d = Data(point_3)
corner_a = Data(point)
corner_c = Data(point_4)
corner_b = Data(point_2)
_4point_surface = _4PointSurface(CornerA=corner_a, CornerB=corner_b, CornerC=corner_c, CornerD=corner_d)
platform_surface = Data(_4point_surface)

# ---- group: Platform actual size for revit
corner_d_2 = Data(corner_d)
corner_a_2 = Data(corner_a)
offset_distance_towards_center = Data(expression)
corner_c_2 = Data(corner_c)
corner_b_2 = Data(corner_b)
deconstruct = Deconstruct(Point=corner_b_2)  # -> XComponent, YComponent, ZComponent
deconstruct_2 = Deconstruct(Point=corner_c_2)  # -> XComponent, YComponent, ZComponent
deconstruct_3 = Deconstruct(Point=corner_a_2)  # -> XComponent, YComponent, ZComponent
deconstruct_4 = Deconstruct(Point=corner_d_2)  # -> XComponent, YComponent, ZComponent
addition_5 = Addition(A=deconstruct_3.XComponent, B=offset_distance_towards_center)
subtraction_3 = Subtraction(A=deconstruct_2.XComponent, B=offset_distance_towards_center)
subtraction_4 = Subtraction(A=deconstruct_2.YComponent, B=offset_distance_towards_center)
addition_6 = Addition(A=deconstruct.XComponent, B=offset_distance_towards_center)
subtraction_5 = Subtraction(A=deconstruct.YComponent, B=offset_distance_towards_center)
subtraction_6 = Subtraction(A=deconstruct_4.XComponent, B=offset_distance_towards_center)
construct_point_13 = ConstructPoint(XCoordinate=subtraction_6, YCoordinate=deconstruct_4.YComponent, ZCoordinate=deconstruct_4.ZComponent)
construct_point_14 = ConstructPoint(XCoordinate=addition_6, YCoordinate=subtraction_5, ZCoordinate=deconstruct.ZComponent)
construct_point_15 = ConstructPoint(XCoordinate=addition_5, YCoordinate=deconstruct_3.YComponent, ZCoordinate=deconstruct_3.ZComponent)
construct_point_16 = ConstructPoint(XCoordinate=subtraction_3, YCoordinate=subtraction_4, ZCoordinate=deconstruct_2.ZComponent)
_4point_surface_2 = _4PointSurface(CornerA=construct_point_15, CornerB=construct_point_14, CornerC=construct_point_16, CornerD=construct_point_13)
platform_surface_2 = Data(_4point_surface_2)

# ---- group: Basic geometry / Column
line_12 = Line(StartPoint=construct_point_8, EndPoint=construct_point_10)  # disabled
line_13 = Line(StartPoint=construct_point_4, EndPoint=construct_point_3)
line_14 = Line(StartPoint=construct_point_12, EndPoint=construct_point_11)

# ---- group: Basic geometry / All sidebars
merge_2 = Merge(Data1=line_5, Data2=line_6, Data3=line_7, Data4=line_10, Data5=line_11)

# ---- group: Basic geometry (continued)
sidebar_with_steps_2 = Data(line_11)
sidebar_with_steps_1 = Data(line_10)
column = Data([line_13, line_12, line_14])
all_sidebars = Data(merge_2)

# ---- group: Steps (continued)
sidebar_2 = Data(sidebar_with_steps_2)
sidebar_1 = Data(sidebar_with_steps_1)
entwine = Entwine(Branch00=sidebar_1, Branch01=sidebar_2, FlattenInputs=True)
divide_curve = DivideCurve(Curve=entwine, Count=round.Nearest, Kinks=False)  # -> Points, Tangents, Parameters
shift_paths_3 = ShiftPaths(Data=divide_curve.Points, Offset=-1)
list_length_2 = ListLength(List=shift_paths_3)
construct_domain = ConstructDomain(DomainStart=expression_2, DomainEnd=expr("x-2", list_length_2))
project_along = ProjectAlong(Geometry=divide_curve.Points, Plane=xy_plane, Direction=Vector(0, 0, -1))  # -> Geometry, Transform
sub_list = SubList(List=divide_curve.Points, Domain=construct_domain, Wrap=False)  # -> List, Index
explode_tree = ExplodeTree(Data=sub_list.List)  # -> _0000, _0100
shift_paths_4 = ShiftPaths(Data=project_along.Geometry, Offset=-2)
list_item_3 = ListItem(List=shift_paths_4, Index=0, Wrap=True)
list_item_4 = ListItem(List=shift_paths_4, Index=1, Wrap=True)
line_15 = Line(StartPoint=explode_tree._0000, EndPoint=explode_tree._0100)
distance = Distance(PointA=list_item_3, PointB=list_item_4)
resulting_step_depth = Data(distance)
steps_line = Data(line_15)

# ---- group: steps surface actual size for revit (continued)
base = Data(steps_line)
end_points = EndPoints(Curve=base)  # -> Start, End
deconstruct_5 = Deconstruct(Point=end_points.End)  # -> XComponent, YComponent, ZComponent
deconstruct_6 = Deconstruct(Point=end_points.Start)  # -> XComponent, YComponent, ZComponent
subtraction_7 = Subtraction(A=deconstruct_5.XComponent, B=expression)
addition_7 = Addition(A=deconstruct_6.XComponent, B=expression)
construct_point_17 = ConstructPoint(XCoordinate=subtraction_7, YCoordinate=deconstruct_5.YComponent, ZCoordinate=deconstruct_5.ZComponent)
construct_point_18 = ConstructPoint(XCoordinate=addition_7, YCoordinate=deconstruct_6.YComponent, ZCoordinate=deconstruct_6.ZComponent)
line_16 = Line(StartPoint=construct_point_18, EndPoint=construct_point_17)
extrude_along = ExtrudeAlong(Base=line_16, Curve=line)
move = Move(Geometry=extrude_along, Motion=unit_y_2)  # -> Geometry, Transform
steps_surface = Data(extrude_along)

# ---- group: steps surface with loads
resulting_step_depth_2 = Data(resulting_step_depth)
steps_line_2 = Data(steps_line)
construct_point_19 = ConstructPoint(XCoordinate=0, YCoordinate=resulting_step_depth_2, ZCoordinate=0)
construct_point_20 = ConstructPoint(XCoordinate=0, YCoordinate=0, ZCoordinate=0)
line_17 = Line(StartPoint=construct_point_20, EndPoint=construct_point_19)
unit_y_3 = UnitY(Factor=expr("x*-0.5", resulting_step_depth_2))
extrude_along_2 = ExtrudeAlong(Base=steps_line_2, Curve=line_17)
move_2 = Move(Geometry=extrude_along_2, Motion=unit_y_3)  # -> Geometry, Transform
steps_surface_2 = Data(move_2.Geometry)

# ----
merge_3 = Merge(Data1=platform_surface, Data2=steps_surface_2)
merge_4 = Merge(Data1=platform_surface_2, Data2=steps_surface)

# ---- group: Element, surface steps
loadapplication = Data(loadpanelsupportconditions)
name_4 = Data(name_element)
surface = Data(merge_3)
surface_2 = Data(surface)
name_5 = Data(name_4)
loadapplication_2 = Data(loadapplication)
loadingpanelproperty = LoadingPanelProperty(
    Name=name_5,
    LoadApplication=loadapplication_2,
    ReferenceEdge=1,
    Component="BH.oM.Structure.SurfaceProperties.LoadingPanelProperty")
panel_17 = Panel(Surface=surface_2, Property=loadingpanelproperty, Name=name_5, Tolerance=1e-06, Component="{ .Panel")
bhom_panel = Data(panel_17)
bhom_panel_2 = Data(bhom_panel)

# ---- group: BHoM object, structural loads / Loads / Area uniform load
bhom_objects_with_the_load = Data(bhom_panel_2)
vælg_lasttype_5 = Data(loadtypename)
bhom_objects_with_the_load_2 = Data(flatten(bhom_objects_with_the_load))
z_positiv_opadgående = Slider(-250, range=-10000..10000)
x_positiv_opadgående = Slider(0, range=-10000..10000)
y_positiv_mod_højre = Slider(0, range=-10000..10000)
vælg_lasttype_6 = ItemSelector(vælg_lasttype_5, {"DL1", "Nyttelast", "Snelast", "Vindlast", "Seismisklast", "Ulykkeslast", "Islast"}, selected="DL1")
loadaxis = LoadAxis({"Global": 0, "Local": 1}, selected="Global", Component="BH.oM.Structure.Loads.LoadAxis", Selection=0)
projected = BooleanToggle(False)
number = Number(expr("x*10^-3", z_positiv_opadgående))
kn_m_2 = Panel(number)
z_positiv_opadgående_2 = Data(z_positiv_opadgående)
x_positiv_opadgående_2 = Data(x_positiv_opadgående)
y_positiv_mod_højre_2 = Data(y_positiv_mod_højre)
vælg_lasttype_7 = Data(vælg_lasttype_6)
projected_2 = Data(projected)
navn = Data("Gk trin og platform")
loadaxis_2 = Data(loadaxis)
bhom_objects_with_the_load_3 = Data(bhom_objects_with_the_load_2)
x_positiv_opadgående_3 = Data(x_positiv_opadgående_2)
z_positiv_opadgående_3 = Data(z_positiv_opadgående_2)
y_positiv_mod_højre_3 = Data(y_positiv_mod_højre_2)
vælg_lasttype_8 = Data(vælg_lasttype_7)
projected_3 = Data(projected_2)
loadaxis_3 = Data(loadaxis_2)
navn_2 = Data(navn)

bhom_objects_with_the_load_4 = Data(bhom_panel_2)
vælg_lasttype_9 = Data(loadtypename)
bhom_objects_with_the_load_5 = Data(flatten(bhom_objects_with_the_load_4))
x_positiv_opadgående_4 = Slider(0, range=-10000..10000)
y_positiv_mod_højre_4 = Slider(0, range=-10000..10000)
z_positiv_opadgående_4 = Slider(-3000, range=-10000..10000)
vælg_lasttype_10 = ItemSelector(
    vælg_lasttype_9,
    {"DL1", "Nyttelast", "Snelast", "Vindlast", "Seismisklast", "Ulykkeslast", "Islast"}, selected="Nyttelast")
loadaxis_4 = LoadAxis({"Global": 0, "Local": 1}, selected="Global", Component="BH.oM.Structure.Loads.LoadAxis", Selection=0)
projected_4 = BooleanToggle(False)
number_2 = Number(expr("x*10^-3", z_positiv_opadgående_4))
kn_m_2_2 = Panel(number_2)
z_positiv_opadgående_5 = Data(z_positiv_opadgående_4)
x_positiv_opadgående_5 = Data(x_positiv_opadgående_4)
y_positiv_mod_højre_5 = Data(y_positiv_mod_højre_4)
vælg_lasttype_11 = Data(vælg_lasttype_10)
projected_5 = Data(projected_4)
navn_3 = Data("qk trin og platform")
loadaxis_5 = Data(loadaxis_4)
bhom_objects_with_the_load_6 = Data(bhom_objects_with_the_load_5)
x_positiv_opadgående_6 = Data(x_positiv_opadgående_5)
z_positiv_opadgående_6 = Data(z_positiv_opadgående_5)
y_positiv_mod_højre_6 = Data(y_positiv_mod_højre_5)
vælg_lasttype_12 = Data(vælg_lasttype_11)
projected_6 = Data(projected_5)
loadaxis_6 = Data(loadaxis_5)
navn_4 = Data(navn_3)

# ---- group: helper beams for step surface, RSA
name_profile_2 = Data(panel_4)
brep = Data(merge_3)
steel_15 = Data(steel_2)
release_8 = Data(release_2)
name_of_element = Data(name_of_element_helper_beams)
profile_height = Data(height)
profile_width = Data(width_m)
brep_edges = BrepEdges(Brep=brep)  # -> Naked, Interior, NonManifold
concatenate = Concatenate(Fragment_A=name_profile_2, Fragment_B=" - ", A=profile_height, B="m(d), ", C=profile_width, D="m(t)")
steelrectanglesection = SteelRectangleSection(Height=profile_height, Width=profile_width, CornerRadius=0, Name=concatenate, Component="{ .SteelRectangleSection")
end_points_2 = EndPoints(Curve=brep_edges.Naked)  # -> Start, End
setpropertyvalue = SetPropertyValue(Obj=steelrectanglesection, PropName="Material", Value=steel_15, Component="{ .SetPropertyValue")
bar = Bar(
    StartNode=end_points_2.Start,
    EndNode=end_points_2.End,
    SectionProperty=setpropertyvalue,
    OrientationAngle=0,
    Release=release_8,
    FEAType="{ \"_t\" : \"System.Enum\", \"TypeName\" : { \"_t\" : \"System.Type\", \"Name\" : \"BH.oM.Structure.Elements.BarFEAType\", \"_bhomVersion\" : \"6.2\" }, \"Value\" : \"Flexural\", \"_bhomVersion\" : \"6.2\" }",
    Name=name_of_element,
    Component="BH.oM.Structure.Elements.Bar")
bhom_helper_beams_steps = Data(bar)

# ---- group: Support along wall, RSA
support_4 = Data(support_2)
curve_skew_part = Data(sidebar_with_steps_2)
count_skew_part = Data(skew_part_number_of_fixed_places_in_wall_2)
name_of_support_4 = Data(name_of_support_2)
curve_top_part = Data(line_7)
count_top_part = Data(top_part_number_of_fixed_places_in_wall_2)
divide_curve_2 = DivideCurve(Curve=curve_skew_part, Count=count_skew_part, Kinks=False)  # -> Points, Tangents, Parameters
divide_curve_3 = DivideCurve(Curve=curve_top_part, Count=count_top_part, Kinks=False)  # -> Points, Tangents, Parameters
sort_duplicate_points = SortDuplicatePoints(Points=[divide_curve_2.Points, divide_curve_3.Points])  # -> UniquePoints, Indices
list_length_3 = ListLength(List=sort_duplicate_points.UniquePoints)
construct_domain_2 = ConstructDomain(DomainStart=1, DomainEnd=list_length_3)
sub_list_2 = SubList(List=sort_duplicate_points.UniquePoints, Domain=construct_domain_2, Wrap=False)  # -> List, Index
node = Node(Position=sub_list_2.List, Support=support_4, Name=name_of_support_4, Component="BH.oM.Structure.Elements.Node")
bhom_support = Data(node)

# ---- group: Sidebar supports, RSA
sidebar_with_steps_2_2 = Data(sidebar_with_steps_2)
sidebar_with_steps_1_2 = Data(sidebar_with_steps_1)
name_of_support_5 = Data(name_of_support_3)
support_5 = Data(support_3)
end_points_3 = EndPoints(Curve=sidebar_with_steps_1_2)  # -> Start, End
end_points_4 = EndPoints(Curve=sidebar_with_steps_2_2)  # -> Start, End
node_2 = Node(
    Position=[end_points_3.Start, end_points_4.Start],
    Support=support_5,
    Name=name_of_support_5,
    Component="BH.oM.Structure.Elements.Node")
bhom_support_2 = Data(node_2)

# ---- group: Element, Column, RSA
curve = Data(column)
profil_2 = Data(profil)
value = Data(steel_12)
release_9 = Data(release_3)
name_6 = Data(name_on_column)
end_points_5 = EndPoints(Curve=curve)  # -> Start, End
setpropertyvalue_2 = SetPropertyValue(Obj=profil_2, PropName="Material", Value=value, Component="{ .SetPropertyValue")
bar_2 = Bar(
    StartNode=end_points_5.Start,
    EndNode=end_points_5.End,
    SectionProperty=setpropertyvalue_2,
    OrientationAngle=0,
    Release=release_9,
    FEAType="{ \"_t\" : \"System.Enum\", \"TypeName\" : { \"_t\" : \"System.Type\", \"Name\" : \"BH.oM.Structure.Elements.BarFEAType\", \"_bhomVersion\" : \"6.2\" }, \"Value\" : \"Flexural\", \"_bhomVersion\" : \"6.2\" }",
    Name=name_6,
    Component="BH.oM.Structure.Elements.Bar")
bhom_column = Data(bar_2)

# ---- group: Element, sidebars RSA
height_profile = Data(height_3)
curve_2 = Data(all_sidebars)
name_profile_3 = Data(name_profile)
name_of_sidebars_2 = Data(name_of_sidebars)
release_10 = Data(release_5)
width_3 = Data(width_m_3)
steel_16 = Data(steel_10)
concatenate_2 = Concatenate(Fragment_A=name_profile_3, Fragment_B=" - ", A=height_profile, B="m(h), ", C=width_3, D="m(t)")
steelrectanglesection_2 = SteelRectangleSection(Height=height_profile, Width=width_3, CornerRadius=0, Name=concatenate_2, Component="{ .SteelRectangleSection")
end_points_6 = EndPoints(Curve=curve_2)  # -> Start, End
setpropertyvalue_3 = SetPropertyValue(Obj=steelrectanglesection_2, PropName="Material", Value=steel_16, Component="{ .SetPropertyValue")
bar_3 = Bar(
    StartNode=end_points_6.Start,
    EndNode=end_points_6.End,
    SectionProperty=setpropertyvalue_3,
    OrientationAngle=0,
    Release=release_10,
    FEAType="{ \"_t\" : \"System.Enum\", \"TypeName\" : { \"_t\" : \"System.Type\", \"Name\" : \"BH.oM.Structure.Elements.BarFEAType\", \"_bhomVersion\" : \"6.2\" }, \"Value\" : \"Flexural\", \"_bhomVersion\" : \"6.2\" }",
    Name=name_of_sidebars_2,
    Component="BH.oM.Structure.Elements.Bar")
bhom_sidebars = Data(bar_3)

# ---- group: Column supports, RSA
name_of_support_6 = Data(name_of_support)
support_6 = Data(support)
position = Data(end_points_5.Start)
node_3 = Node(Position=position, Support=support_6, Name=name_of_support_6, Component="BH.oM.Structure.Elements.Node")
bhom_support_3 = Data(node_3)

# ---- group: BHoM object, structural loads / Loads
# Loads
bhom_objects_with_the_load_7 = Data(bhom_objects_with_the_load_6)

# ---- group: BHoM object, structural loads / Loads / Area uniform load
last_typer_bhom_list = Data(bhom_loadtypes)
alle_last_typer_navne = Data(panel_3)
load_type = Data(vælg_lasttype_12)
x = Data(x_positiv_opadgående_6)
name_7 = Data(navn_4)
y = Data(y_positiv_mod_højre_6)
projected_7 = Data(projected_6)
z = Data(z_positiv_opadgående_6)
axis = Data(loadaxis_6)
member_index_3 = MemberIndex(Set=alle_last_typer_navne, Member=load_type)  # -> Index, Count
list_item_5 = ListItem(List=last_typer_bhom_list, Index=member_index_3.Index, Wrap=True)
vector = Vector(X=x, Y=y, Z=z, Component="{ .Vector")
areauniformlydistributedload = AreaUniformlyDistributedLoad(
    Loadcase=list_item_5,
    Pressure=vector,
    Objects=bhom_objects_with_the_load_7,
    Axis=axis,
    Projected=projected_7,
    Name=name_7,
    Component="{ .AreaUniformlyDistributedLoad")
areaudl = Data(areauniformlydistributedload)

# ---- group: Revit Steps sides
distance_move = Data(height)
steps_surface_3 = Data(merge_4)
heigh_sidebars_over_steps_4 = Data(heigh_sidebars_over_steps_2)
bhom_helper_studs = Data(bhom_helper_beams_steps)
framingelement = FramingElement(
    Bar=bhom_helper_studs,
    StructuralUsage="{ \"_t\" : \"System.Enum\", \"TypeName\" : { \"_t\" : \"System.Type\", \"Name\" : \"BH.oM.Structure.Elements.StructuralUsage1D\", \"_bhomVersion\" : \"6.2\" }, \"Value\" : \"Beam\", \"_bhomVersion\" : \"6.2\" }",
    Component="{ .FramingElement")
unit_z_6 = UnitZ(Factor=heigh_sidebars_over_steps_4)
brep_edges_2 = BrepEdges(Brep=steps_surface_3)  # -> Naked, Interior, NonManifold
unit_z_7 = UnitZ(Factor=expr("x*-0.5", distance_move))
subtraction_8 = Subtraction(A=unit_z_7, B=unit_z_6)
revit_helper_studs = Data(framingelement)
move_3 = Move(Geometry=brep_edges_2.Naked, Motion=subtraction_8)  # -> Geometry, Transform
setgeometry = SetGeometry(FramingElement=revit_helper_studs, Curve=move_3.Geometry, Component="{ .SetGeometry")
revit_steps_sides = Data(setgeometry)

# ----
column_2 = Data(bhom_column)

# ---- group: Revit sidebars
height_sidebar_profile_2 = Data(height_3)
bhom_sidebars_2 = Data(bhom_sidebars)
framingelement_2 = FramingElement(
    Bar=bhom_sidebars_2,
    StructuralUsage="{ \"_t\" : \"System.Enum\", \"TypeName\" : { \"_t\" : \"System.Type\", \"Name\" : \"BH.oM.Structure.Elements.StructuralUsage1D\", \"_bhomVersion\" : \"6.2\" }, \"Value\" : \"Beam\", \"_bhomVersion\" : \"6.2\" }",
    Component="{ .FramingElement")
unit_z_8 = UnitZ(Factor=expr("x*-0.5", height_sidebar_profile_2))
move_4 = Move(Geometry=framingelement_2, Motion=unit_z_8)  # -> Geometry, Transform
setgeometry_2 = SetGeometry(FramingElement=framingelement_2, Curve=move_4.Geometry, Component="{ .SetGeometry")
revit_sidebars = Data(setgeometry_2)

# ----
explode_2 = Explode(Object=column_2, Component="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")
explode_3 = Explode(Object=explode_2, Component="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")
explode_4 = Explode(Object=explode_3, Component="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")  # -> Height, Width
create_set = CreateSet(List=explode_4.Height)  # -> Set, Map
create_set_2 = CreateSet(List=explode_4.Width)  # -> Set, Map
unit_x_2 = UnitX(Factor=expr("x*0.5", create_set.Set))
unit_y_4 = UnitY(Factor=expr("x*-0.5", create_set_2.Set))
addition_8 = Addition(A=unit_x, B=unit_x_2)
subtraction_9 = Subtraction(A=unit_y_4, B=unit_y)

# ---- group: Revit columns
bhom_column_2 = Data(bhom_column)
framingelement_3 = FramingElement(
    Bar=bhom_column_2,
    StructuralUsage="{ \"_t\" : \"System.Enum\", \"TypeName\" : { \"_t\" : \"System.Type\", \"Name\" : \"BH.oM.Structure.Elements.StructuralUsage1D\", \"_bhomVersion\" : \"6.2\" }, \"Value\" : \"Beam\", \"_bhomVersion\" : \"6.2\" }",
    Component="{ .FramingElement")
move_5 = Move(Geometry=framingelement_3, Motion=subtraction_9)  # -> Geometry, Transform
list_item_6 = ListItem(List=move_5.Geometry, Index=1, Wrap=False)
list_item_7 = ListItem(List=move_5.Geometry, Index=0, Wrap=False)
move_6 = Move(Geometry=list_item_6, Motion=expr("x*-1", addition_8))  # -> Geometry, Transform
move_7 = Move(Geometry=list_item_7, Motion=addition_8)  # -> Geometry, Transform
merge_5 = Merge(Data1=move_7.Geometry, Data2=move_6.Geometry)
setgeometry_3 = SetGeometry(FramingElement=framingelement_3, Curve=merge_5, Component="{ .SetGeometry")
revit_column = Data(setgeometry_3)

# ----
resulting_step_depth_3 = Data(resulting_step_depth)
all_sidebars_2 = Data(all_sidebars)
resulting_step_depth_4 = Panel(resulting_step_depth_3)
sides_with_railing = ItemSelector(
    all_sidebars_2,
    {"Line(L:1.62 mm)", "Line(L:1.89 mm)", "Line(L:1.89 mm)", "Line(L:4.91753 mm)", "Line(L:4.91753 mm)"}, selected=["Line(L:1.62 mm)", "Line(L:1.89 mm)", "Line(L:4.91753 mm)"])
expression_3 = Expression(z=resulting_step_height_3, y=resulting_step_depth_4, Expression="2*z+y")
expression_4 = Expression(x=expression_3, Expression="if(x<0.62,\"Fejl\",If(x>0.64,\"Fejl\",\"OK\"))")
should_be_0_63 = Panel(expression_3)
sides_with_railing_2 = Data(sides_with_railing)
control = Panel(expression_4)

# ---- group: Main railing, corner studs and top rail (continued)
curves_with_railing = Data(sides_with_railing_2)
project_along_2 = ProjectAlong(Geometry=curves_with_railing, Plane=PlaneXY(0, 0, 0), Direction=Vector(0, 0, -1))  # -> Geometry, Transform
length_4 = Length(Curve=project_along_2.Geometry)
division_3 = Division(A=length_4, B=desired_big_stud_spacing)
panel_18 = Panel(length_4)
round_2 = Round(Number=division_3)  # -> Nearest, Floor, Ceiling
division_4 = Division(A=length_4, B=round_2.Ceiling)
move_8 = Move(Geometry=curves_with_railing, Motion=unit_z_5)  # -> Geometry, Transform
number_of_divisions = Panel(round_2.Ceiling)
divide_curve_4 = DivideCurve(Curve=curves_with_railing, Count=number_of_divisions, Kinks=False)  # -> Points, Tangents, Parameters
divide_curve_5 = DivideCurve(Curve=move_8.Geometry, Count=number_of_divisions, Kinks=False)  # -> Points, Tangents, Parameters
sort_duplicate_points_2 = SortDuplicatePoints(Points=divide_curve_5.Points)  # -> UniquePoints, Indices
sort_duplicate_points_3 = SortDuplicatePoints(Points=divide_curve_4.Points)  # -> UniquePoints, Indices
line_18 = Line(StartPoint=sort_duplicate_points_3.UniquePoints, EndPoint=sort_duplicate_points_2.UniquePoints)
shift_paths_5 = ShiftPaths(Data=line_18, Offset=-1)
sort_duplicate_curves = SortDuplicateCurves(Curves=shift_paths_5)  # -> UniqueCurves, Indices
resulting_big_stud_spacing_horizontal_me = Data(division_4)  # "Resulting big stud spacing, horizontal measure"
number_of_big_divisions = Data(number_of_divisions)
big_corner_studs = Data(sort_duplicate_curves.UniqueCurves)
toprail = Data(move_8.Geometry)

# ---- group: Sub railing, parallel with handrail (continued)
number_of_big_divisions_2 = Data(number_of_big_divisions)
curves_with_railing_2 = Data(sides_with_railing_2)
move_9 = Move(Geometry=curves_with_railing_2, Motion=addition_4)  # -> Geometry, Transform
move_10 = Move(Geometry=curves_with_railing_2, Motion=addition_3)  # -> Geometry, Transform
divide_domain = DivideDomain(Domain=move_9.Geometry, Count=number_of_big_divisions_2)
graft_tree = GraftTree(Tree=move_9.Geometry, IncludeEmptyLists=True, IncludeNullItems=True)
divide_domain_2 = DivideDomain(Domain=move_10.Geometry, Count=number_of_big_divisions_2)
graft_tree_2 = GraftTree(Tree=move_10.Geometry, IncludeEmptyLists=True, IncludeNullItems=True)
sub_curve = SubCurve(BaseCurve=graft_tree, Domain=divide_domain)
sub_curve_2 = SubCurve(BaseCurve=graft_tree_2, Domain=divide_domain_2)
sub_railing_bottom = Data(sub_curve_2)
sub_railing_top = Data(sub_curve)

# ---- group: Small vertical studs (continued)
sub_railing_top_2 = Data(sub_railing_top)
sub_railing_bottom_2 = Data(sub_railing_bottom)
project_along_3 = ProjectAlong(Geometry=sub_railing_top_2, Plane=PlaneXY(0, 0, 0), Direction=Vector(0, 0, -1))  # -> Geometry, Transform
length_5 = Length(Curve=project_along_3.Geometry)
division_5 = Division(A=length_5, B=desired_small_stud_spacing)
round_3 = Round(Number=division_5)  # -> Nearest, Floor, Ceiling
division_6 = Division(A=length_5, B=round_3.Ceiling)
number_of_divisions_2 = Panel(round_3.Ceiling)
divide_curve_6 = DivideCurve(Curve=sub_railing_top_2, Count=number_of_divisions_2, Kinks=False)  # -> Points, Tangents, Parameters
divide_curve_7 = DivideCurve(Curve=sub_railing_bottom_2, Count=number_of_divisions_2, Kinks=False)  # -> Points, Tangents, Parameters
sort_duplicate_points_4 = SortDuplicatePoints(Points=divide_curve_7.Points)  # -> UniquePoints, Indices
sort_duplicate_points_5 = SortDuplicatePoints(Points=divide_curve_6.Points)  # -> UniquePoints, Indices
line_19 = Line(StartPoint=sort_duplicate_points_5.UniquePoints, EndPoint=sort_duplicate_points_4.UniquePoints)
list_length_4 = ListLength(List=line_19)
construct_domain_3 = ConstructDomain(DomainStart=1, DomainEnd=expr("x-2", list_length_4))
resulting_small_stud_spacing_horozontal = Data(division_6)  # "Resulting small stud spacing, horozontal measure"
sub_list_3 = SubList(List=line_19, Domain=construct_domain_3, Wrap=False)  # -> List, Index
small_vertical_studs = Data(sub_list_3.List)

# ----
resulting_small_stud_spacing_horozontal_2 = Data(resulting_small_stud_spacing_horozontal)  # "Resulting small stud spacing, horozontal measure"
resulting_big_stud_spacing_horizontal_me_2 = Data(resulting_big_stud_spacing_horizontal_me)  # "Resulting big stud spacing, horizontal measure"
resulting_stud_spacing_horozontal_measur = Panel(resulting_small_stud_spacing_horozontal_2)  # "Resulting stud spacing, horozontal measure"
resulting_stud_spacing_horozontal_measur_2 = Panel(resulting_big_stud_spacing_horizontal_me_2)  # "Resulting stud spacing, horozontal measure"

# ---- group: Element, subrailing studs
name_element_subrailings_studs_2 = Data(name_element_subrailings_studs)
curve_subrailing_studs = Data(flatten(small_vertical_studs))
release_11 = Data(release_4)
steel_17 = Data(steel_6)
name_profile_4 = Data(panel_5)
diameter_4 = Data(diameter)
concatenate_3 = Concatenate(Fragment_A=name_profile_4, Fragment_B=" - ", A=diameter_4, B="m(d)")
end_points_7 = EndPoints(Curve=curve_subrailing_studs)  # -> Start, End
steelcircularsection = SteelCircularSection(Diameter=diameter_4, Name=concatenate_3, Component="{ .SteelCircularSection")
setpropertyvalue_4 = SetPropertyValue(Obj=steelcircularsection, PropName="Material", Value=steel_17, Component="{ .SetPropertyValue")
bar_4 = Bar(
    StartNode=end_points_7.End,
    EndNode=end_points_7.Start,
    SectionProperty=setpropertyvalue_4,
    OrientationAngle=0,
    Release=release_11,
    FEAType="{ \"_t\" : \"System.Enum\", \"TypeName\" : { \"_t\" : \"System.Type\", \"Name\" : \"BH.oM.Structure.Elements.BarFEAType\", \"_bhomVersion\" : \"6.2\" }, \"Value\" : \"Flexural\", \"_bhomVersion\" : \"6.2\" }",
    Name=name_element_subrailings_studs_2,
    Component="BH.oM.Structure.Elements.Bar")
bhom_subrailing_studs = Data(bar_4)

# ---- group: Element, top railings
name_element_2 = Data(name_element_railings)
steel_18 = Data(steel_9)
name_profile_5 = Data(panel_6)
release_12 = Data(release_7)
thickness_profile = Data(thickness)
curve_railings = Data(toprail)
diameter_profile = Data(diameter_2)
concatenate_4 = Concatenate(Fragment_A=name_profile_5, Fragment_B=" - ", A=diameter_profile, B="m(d), ", C=thickness_profile, D="m(t)")
end_points_8 = EndPoints(Curve=curve_railings)  # -> Start, End
steeltubesection = SteelTubeSection(Diameter=diameter_profile, Thickness=thickness_profile, Name=concatenate_4, Component="{ .SteelTubeSection")
setpropertyvalue_5 = SetPropertyValue(Obj=steeltubesection, PropName="Material", Value=steel_18, Component="{ .SetPropertyValue")
bar_5 = Bar(
    StartNode=end_points_8.Start,
    EndNode=end_points_8.End,
    SectionProperty=setpropertyvalue_5,
    OrientationAngle=0,
    Release=release_12,
    FEAType="{ \"_t\" : \"System.Enum\", \"TypeName\" : { \"_t\" : \"System.Type\", \"Name\" : \"BH.oM.Structure.Elements.BarFEAType\", \"_bhomVersion\" : \"6.2\" }, \"Value\" : \"Flexural\", \"_bhomVersion\" : \"6.2\" }",
    Name=name_element_2,
    Component="BH.oM.Structure.Elements.Bar")
bhom_top_railing = Data(bar_5)

# ---- group: BHoM object, structural loads / Loads / line uniform load
vælg_lasttype_13 = Data(loadtypename)
bhom_objects_with_the_load_8 = Data(flatten(bhom_top_railing))
x_positiv_opadgående_7 = Slider(500, range=-10000..10000)
y_positiv_mod_højre_7 = Slider(0, range=-10000..10000)
z_positiv_opadgående_7 = Slider(0, range=-10000..10000)
vælg_lasttype_14 = ItemSelector(
    vælg_lasttype_13,
    {"DL1", "Nyttelast", "Snelast", "Vindlast", "Seismisklast", "Ulykkeslast", "Islast"}, selected="Nyttelast")
loadaxis_7 = LoadAxis({"Global": 0, "Local": 1}, selected="Global", Component="BH.oM.Structure.Loads.LoadAxis", Selection=0)
projected_8 = BooleanToggle(False)
number_3 = Number(expr("x*10^-3", z_positiv_opadgående_7))
panel_19 = Panel(number_3)
z_positiv_opadgående_8 = Data(z_positiv_opadgående_7)
x_positiv_opadgående_8 = Data(x_positiv_opadgående_7)
y_positiv_mod_højre_8 = Data(y_positiv_mod_højre_7)
vælg_lasttype_15 = Data(vælg_lasttype_14)
projected_9 = Data(projected_8)
navn_5 = Data("Vandret qK")
loadaxis_8 = Data(loadaxis_7)

# ---- group: BHoM object, structural loads
# BHoM object, structural loads and members
bhom_objects_with_the_load_9 = Data(bhom_objects_with_the_load_8)
bhom_objects_with_the_load_10 = Data(bhom_objects_with_the_load_3)

# ---- group: Element type 2, big studs
width_profile = Data(width_m_4)
release_13 = Data(release)
height_profile_2 = Data(height_4)
name_profile_6 = Data(panel_8)
steel_19 = Data(steel_14)
curve_big_studs = Data(big_corner_studs)
name_element_3 = Data(name_element_big_studs)
rotation_degrees = Data(rotation_degree)
concatenate_5 = Concatenate(Fragment_A=name_profile_6, Fragment_B=" - ", A=height_profile_2, B="m(d), ", C=width_profile, D="m(t)")
end_points_9 = EndPoints(Curve=curve_big_studs)  # -> Start, End
steelrectanglesection_3 = SteelRectangleSection(Height=height_profile_2, Width=width_profile, CornerRadius=0, Name=concatenate_5, Component="{ .SteelRectangleSection")
radians = Radians(Degrees=rotation_degrees)
setpropertyvalue_6 = SetPropertyValue(Obj=steelrectanglesection_3, PropName="Material", Value=steel_19, Component="{ .SetPropertyValue")
bar_6 = Bar(
    StartNode=end_points_9.Start,
    EndNode=end_points_9.End,
    SectionProperty=setpropertyvalue_6,
    OrientationAngle=radians,
    Release=release_13,
    FEAType="{ \"_t\" : \"System.Enum\", \"TypeName\" : { \"_t\" : \"System.Type\", \"Name\" : \"BH.oM.Structure.Elements.BarFEAType\", \"_bhomVersion\" : \"6.2\" }, \"Value\" : \"Flexural\", \"_bhomVersion\" : \"6.2\" }",
    Name=name_element_3,
    Component="BH.oM.Structure.Elements.Bar")
bhom_big_studs = Data(bar_6)

# ---- group: Element, subrailings
name_element_subrailings = Data(name_elements_subrailing)
curve_subrailing_top = Data(sub_railing_top)
name_profile_7 = Data(panel_7)
curve_subrailing_top_2 = Data(sub_railing_bottom)
release_14 = Data(release_6)
diameter_profile_2 = Data(diameter_3)
thickness_profile_2 = Data(thickness_2)
steel_20 = Data(steel_4)
merge_6 = Merge(Data1=curve_subrailing_top, Data2=curve_subrailing_top_2)
concatenate_6 = Concatenate(Fragment_A=name_profile_7, Fragment_B=" - ", A=diameter_profile_2, B="m(d), ", C=thickness_profile_2, D="m(t)")
end_points_10 = EndPoints(Curve=merge_6)  # -> Start, End
steeltubesection_2 = SteelTubeSection(Diameter=diameter_profile_2, Thickness=thickness_profile_2, Name=concatenate_6, Component="{ .SteelTubeSection")
setpropertyvalue_7 = SetPropertyValue(Obj=steeltubesection_2, PropName="Material", Value=steel_20, Component="{ .SetPropertyValue")
bar_7 = Bar(
    StartNode=end_points_10.Start,
    EndNode=end_points_10.End,
    SectionProperty=setpropertyvalue_7,
    OrientationAngle=0,
    Release=release_14,
    FEAType="{ \"_t\" : \"System.Enum\", \"TypeName\" : { \"_t\" : \"System.Type\", \"Name\" : \"BH.oM.Structure.Elements.BarFEAType\", \"_bhomVersion\" : \"6.2\" }, \"Value\" : \"Flexural\", \"_bhomVersion\" : \"6.2\" }",
    Name=name_element_subrailings,
    Component="BH.oM.Structure.Elements.Bar")
bhom_sub_subrailing = Data(bar_7)

# ---- group: BHoM object, structural loads / Loads / line uniform load
last_typer_bhom_list_2 = Data(bhom_loadtypes)
alle_last_typer_navne_2 = Data(panel_3)
name_8 = Data(navn_5)
load_type_2 = Data(vælg_lasttype_15)
z_2 = Data(z_positiv_opadgående_8)
axis_2 = Data(loadaxis_8)
projected_10 = Data(projected_9)
x_2 = Data(x_positiv_opadgående_8)
y_2 = Data(y_positiv_mod_højre_8)
member_index_4 = MemberIndex(Set=alle_last_typer_navne_2, Member=load_type_2)  # -> Index, Count
bhomgroup = BHoMGroup(Elements=bhom_objects_with_the_load_9, DownCast=True, Component="{ .BHoMGroup")
vector_2 = Vector(X=x_2, Y=y_2, Z=z_2, Component="{ .Vector")
list_item_8 = ListItem(List=last_typer_bhom_list_2, Index=member_index_4.Index, Wrap=True)
baruniformlydistributedload = BarUniformlyDistributedLoad(
    Force=vector_2,
    Moment="{ \"_t\" : \"BH.oM.Geometry.Vector\", \"X\" : 0.0, \"Y\" : 0.0, \"Z\" : 0.0, \"_bhomVersion\" : \"6.2\" }",
    Loadcase=list_item_8,
    Objects=bhomgroup,
    Axis=axis_2,
    Projected=projected_10,
    Name=name_8,
    Component="BH.oM.Structure.Loads.BarUniformlyDistributedLoad")
lineudl = Data(baruniformlydistributedload)

# ---- group: BHoM object, structural loads / Loads / Area uniform load
last_typer_bhom_list_3 = Data(bhom_loadtypes)
alle_last_typer_navne_3 = Data(panel_3)
load_type_3 = Data(vælg_lasttype_8)
x_3 = Data(x_positiv_opadgående_3)
name_9 = Data(navn_2)
y_3 = Data(y_positiv_mod_højre_3)
z_3 = Data(z_positiv_opadgående_3)
projected_11 = Data(projected_3)
axis_3 = Data(loadaxis_3)
member_index_5 = MemberIndex(Set=alle_last_typer_navne_3, Member=load_type_3)  # -> Index, Count
list_item_9 = ListItem(List=last_typer_bhom_list_3, Index=member_index_5.Index, Wrap=True)
vector_3 = Vector(X=x_3, Y=y_3, Z=z_3, Component="{ .Vector")
areauniformlydistributedload_2 = AreaUniformlyDistributedLoad(
    Loadcase=list_item_9,
    Pressure=vector_3,
    Objects=bhom_objects_with_the_load_10,
    Axis=axis_3,
    Projected=projected_11,
    Name=name_9,
    Component="{ .AreaUniformlyDistributedLoad")
areaudl_2 = Data(areauniformlydistributedload_2)

# ---- group: Revit sub railing studs
bhom_sub_railing_studs = Data(bhom_subrailing_studs)
height_sidebar_profile_3 = Data(height_3)
framingelement_4 = FramingElement(
    Bar=bhom_sub_railing_studs,
    StructuralUsage="{ \"_t\" : \"System.Enum\", \"TypeName\" : { \"_t\" : \"System.Type\", \"Name\" : \"BH.oM.Structure.Elements.StructuralUsage1D\", \"_bhomVersion\" : \"6.2\" }, \"Value\" : \"Beam\", \"_bhomVersion\" : \"6.2\" }",
    Component="{ .FramingElement")
unit_z_9 = UnitZ(Factor=expr("x*-0.5", height_sidebar_profile_3))
move_11 = Move(Geometry=framingelement_4, Motion=unit_z_9)  # -> Geometry, Transform
setgeometry_4 = SetGeometry(FramingElement=framingelement_4, Curve=move_11.Geometry, Component="{ .SetGeometry")
revit_sub_railing_studs = Data(setgeometry_4)

# ---- group: Revit sub railing
height_sidebar_profile_4 = Data(height_3)
bhom_sub_railing = Data(bhom_sub_subrailing)
framingelement_5 = FramingElement(
    Bar=bhom_sub_railing,
    StructuralUsage="{ \"_t\" : \"System.Enum\", \"TypeName\" : { \"_t\" : \"System.Type\", \"Name\" : \"BH.oM.Structure.Elements.StructuralUsage1D\", \"_bhomVersion\" : \"6.2\" }, \"Value\" : \"Beam\", \"_bhomVersion\" : \"6.2\" }",
    Component="{ .FramingElement")
unit_z_10 = UnitZ(Factor=expr("x*-0.5", height_sidebar_profile_4))
move_12 = Move(Geometry=framingelement_5, Motion=unit_z_10)  # -> Geometry, Transform
setgeometry_5 = SetGeometry(FramingElement=framingelement_5, Curve=move_12.Geometry, Component="{ .SetGeometry")
revit_sub_railing = Data(setgeometry_5)

# ---- group: Revit top railing
height_sidebar_profile_5 = Data(height_3)
bhom_top_railing_2 = Data(bhom_top_railing)
framingelement_6 = FramingElement(
    Bar=bhom_top_railing_2,
    StructuralUsage="{ \"_t\" : \"System.Enum\", \"TypeName\" : { \"_t\" : \"System.Type\", \"Name\" : \"BH.oM.Structure.Elements.StructuralUsage1D\", \"_bhomVersion\" : \"6.2\" }, \"Value\" : \"Beam\", \"_bhomVersion\" : \"6.2\" }",
    Component="{ .FramingElement")
unit_z_11 = UnitZ(Factor=expr("x*-0.5", height_sidebar_profile_5))
move_13 = Move(Geometry=framingelement_6, Motion=unit_z_11)  # -> Geometry, Transform
setgeometry_6 = SetGeometry(FramingElement=framingelement_6, Curve=move_13.Geometry, Component="{ .SetGeometry")
revit_top_railing = Data(setgeometry_6)

# ---- group: Revit big studs
height_sidebar_profile_6 = Data(height_3)
bhom_big_studs_2 = Data(bhom_big_studs)
framingelement_7 = FramingElement(
    Bar=bhom_big_studs_2,
    StructuralUsage="{ \"_t\" : \"System.Enum\", \"TypeName\" : { \"_t\" : \"System.Type\", \"Name\" : \"BH.oM.Structure.Elements.StructuralUsage1D\", \"_bhomVersion\" : \"6.2\" }, \"Value\" : \"Beam\", \"_bhomVersion\" : \"6.2\" }",
    Component="{ .FramingElement")
unit_z_12 = UnitZ(Factor=expr("x*-0.5", height_sidebar_profile_6))
move_14 = Move(Geometry=framingelement_7, Motion=unit_z_12)  # -> Geometry, Transform
setgeometry_7 = SetGeometry(FramingElement=framingelement_7, Curve=move_14.Geometry, Component="{ .SetGeometry")
revit_big_studs = Data(setgeometry_7)

# ---- group: ROBOT (RSA ELEMENTS)
# INITIAL PUSH/PULL
columns = Data(bhom_column)
column_supports = Data(bhom_support_3)
sidebars = Data(bhom_sidebars)
sidebar_supports = Data(bhom_support_2)
along_sidebar_support = Data(bhom_support)
top_railing = Data(bhom_top_railing)
top_subrailing = Data(bhom_sub_subrailing)
subrailing_studs = Data(bhom_subrailing_studs)
railing_studs = Data(bhom_big_studs)
steps_and_platform = Data(bhom_panel_2)
bhom_helper_beams_steps_2 = Data(bhom_helper_beams_steps)
merge_7 = Merge(
    Data1=columns,
    Data2=column_supports,
    Data3=sidebars,
    Data4=sidebar_supports,
    Data5=along_sidebar_support,
    Data6=top_railing,
    Data7=top_subrailing,
    Data8=subrailing_studs,
    Data9=railing_studs,
    Data10=steps_and_platform,
    Data11=bhom_helper_beams_steps_2)
bhom_objects_structural_members = Data(merge_7)

# ---- group: RSA LOAD
loadtypes = Data(bhom_loadtypes)
dl_area = Data(areaudl_2)
qk_area = Data(areaudl)
qk_line = Data(lineudl)
comb1 = Data(comb_1)
comb2 = Data(comb_2)
merge_8 = Merge(Data1=loadtypes, Data2=comb1, Data3=comb2, Data4=dl_area, Data5=qk_area, Data6=qk_line)
structural_loads = Data(merge_8)

# ---- group: Push initial objects to robot
elements = Data(bhom_objects_structural_members)
loads_etc = Data(structural_loads)
adapter = Data(robotadaptor)
pushtype = PushType(
    {"FullPush": 0, "CreateOnly": 1, "CreateNonExisting": 2, "UpdateOnly": 3, "UpdateOrCreateOnly": 4, "DeleteThenCreate": 5, "AdapterDefault": 6}, selected="FullPush",
    Component="BH.oM.Adapter.PushType",
    Selection=0)
entwine_2 = Entwine(Branch00=elements, Branch01=loads_etc, FlattenInputs=True)
boolean_toggle = BooleanToggle(True)
push = Push(Adapter=adapter, Objects=flatten(entwine_2), PushType=pushtype, Active=Button(), Component="{ .Push")  # -> Objects, Success
success = Data(push.Success)

# ---- group: Revit foundations
supports = Data(bhom_support_3)
width_foundation_3 = Data(width_foundation_2)
support_7 = Data(bhom_support_2)
concrete_3 = Data(concrete_2)
depth_foundation_3 = Data(depth_foundation_2)
height_foundation_3 = Data(height_foundation_2)
name_10 = Data(name_of_support)
unit_z_13 = UnitZ(Factor=expr("x*-1", depth_foundation_3))
concatenate_7 = Concatenate(Fragment_A=height_foundation_3, A="m(h) x ", Fragment_B=width_foundation_3, B="m(b) x", C=depth_foundation_3, D="m(d)")
rectangleprofile = RectangleProfile(Height=height_foundation_3, Width=width_foundation_3, CornerRadius=0, Component="{ .RectangleProfile")
material = Material(Density=nan, Name=concrete_3, Component="BH.oM.Physical.Materials.Material")
constantframingproperty = ConstantFramingProperty(
    Profile=rectangleprofile,
    Material=material,
    OrientationAngle=0,
    Name=concatenate_7,
    Component="{ .ConstantFramingProperty")

# ----
unit_y_5 = UnitY(Factor=expr("x*0.5", width_foundation_3))
move_15 = Move(Geometry=support_7, Motion=unit_y_5)  # -> Geometry, Transform
move_16 = Move(Geometry=supports, Motion=subtraction_9)  # -> Geometry, Transform
list_item_10 = ListItem(List=move_16.Geometry, Index=1, Wrap=False)
list_item_11 = ListItem(List=move_16.Geometry, Index=0, Wrap=False)
move_17 = Move(Geometry=list_item_11, Motion=addition_8)  # -> Geometry, Transform
move_18 = Move(Geometry=list_item_10, Motion=expr("x*-1", addition_8))  # -> Geometry, Transform
merge_9 = Merge(Data1=move_17.Geometry, Data2=move_18.Geometry)

# ---- group: Revit foundations (continued)
location = Data([merge_9, move_15.Geometry])
move_19 = Move(Geometry=location, Motion=unit_z_13)  # -> Geometry, Transform
line_20 = Line(StartPoint=location, EndPoint=move_19.Geometry)
column_3 = Column(Location=line_20, Property=constantframingproperty, Name=name_10, Component="BH.oM.Physical.Elements.Column")
revit_foundations = Data(column_3)

# ---- group: Revit steps and platform
steps_surface_4 = Data(merge_4)
revit_family_steps_2 = Data(revit_family_steps)

# ----
move_20 = Move(Geometry=steps_surface_4, Motion=unit_z)  # -> Geometry, Transform

# ---- group: Revit steps and platform (continued)
floor = Floor(
    Location=move_20.Geometry,
    Construction="{ \"_t\" : \"BH.oM.Physical.Constructions.Construction\", \"Layers\" : [], \"BHoM_Guid\" : \"ac00a33e-08a5-497b-8c39-c8deace42dcc\", \"Name\" : \"\", \"Fragments\" : [], \"Tags\" : [], \"CustomData\" : { }, \"_bhomVersion\" : \"6.2\" }",
    Offset="{ \"_t\" : \"System.Enum\", \"TypeName\" : { \"_t\" : \"System.Type\", \"Name\" : \"BH.oM.Physical.Elements.Offset\", \"_bhomVersion\" : \"6.2\" }, \"Value\" : \"Centre\", \"_bhomVersion\" : \"6.2\" }",
    Name=revit_family_steps_2,
    Component="BH.oM.Physical.Elements.Floor")
revit_steps_and_platform = Data(floor)

# ---- group: REVIT ELEMENTS
revit_column_2 = Data(revit_column)
revit_foundations_2 = Data(revit_foundations)
revit_sub_railing_2 = Data(revit_sub_railing)
revit_sidebars_2 = Data(revit_sidebars)
revit_subrailing_studs = Data(revit_sub_railing_studs)
revit_steps_sides_2 = Data(revit_steps_sides)
revit_steps_and_platform_2 = Data(revit_steps_and_platform)
revit_top_railing_2 = Data(revit_top_railing)
revit_big_studs_2 = Data(revit_big_studs)
merge_10 = Merge(
    Data1=revit_column_2,
    Data2=revit_foundations_2,
    Data3=revit_sidebars_2,
    Data4=revit_subrailing_studs,
    Data5=flatten(revit_sub_railing_2),
    Data6=revit_top_railing_2,
    Data7=revit_big_studs_2,
    Data8=flatten(revit_steps_and_platform_2),
    Data9=flatten(revit_steps_sides_2))
elements_2 = Data(merge_10)

# ---- group: Push initial objects to revit
elements_3 = Data(elements_2)
adapter_2 = Data(revitadapter)
boolean_toggle_2 = BooleanToggle(True)
entwine_3 = Entwine(Branch00=elements_3, FlattenInputs=True)
pushtype_2 = PushType(
    {"FullPush": 0, "CreateOnly": 1, "CreateNonExisting": 2, "UpdateOnly": 3, "UpdateOrCreateOnly": 4, "DeleteThenCreate": 5, "AdapterDefault": 6}, selected="AdapterDefault",
    Component="BH.oM.Adapter.PushType",
    Selection=6)
push_2 = Push(Adapter=adapter_2, Objects=entwine_3, PushType=pushtype_2, Active=Button(), Component="{ .Push")  # -> Objects, Success

# ---- group: ROBOT code groups and buckling lengths
# To MAKE the analysis work correctly, you need to set buckling length etc. in robot. Eg. setup each member type to work as exspected.
# OBS, eventuel bracing mm. skal indstilles i robot?
# OBS, på hvor mange elementer der modelleres, kan give en uhensigtmæssig fordeling af laster.
explode_5 = Explode(Object=flatten(bhom_objects_structural_members), Component="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")  # -> StartNode, EndNode, SectionProperty, OrientationAngle, Release, FEAType, Support, Offset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
create_set_3 = CreateSet(List=explode_5.Name)  # -> Set, Map
panel_20 = Panel(create_set_3.Set)
list_length_5 = ListLength(List=panel_20)
series_2 = Series(Start=500, Step=1, Count=list_length_5)

# ---- group: ROBOT code groups and buckling lengths / Push codegroups or design groups to RSA
add_bars_to_codegroup_and_apply_type = Button()
steel_21 = Steel(
    {"S235": 0, "S275": 1, "S355": 2, "S450": 3}, selected="S235",
    Component="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",
    Selection=0)
panel_21 = Panel(panel_20)
# OBJECTS ADJUST/DETAIL
createtype = CreateType(Component="BH.oM.Structure.Elements.Bar")
filterrequest = FilterRequest(Type=createtype, Component="{ .FilterRequest")
adapter_3 = Data(robotadaptor)
pull = Pull(
    Adapter=adapter_3,
    Request=filterrequest,
    PullType="{ \"_t\" : \"System.Enum\", \"TypeName\" : { \"_t\" : \"System.Type\", \"Name\" : \"BH.oM.Adapter.PullType\", \"_bhomVersion\" : \"6.2\" }, \"Value\" : \"AdapterDefault\", \"_bhomVersion\" : \"6.2\" }",
    Active=success,
    Component="{ .Pull")
group_number = Panel(series_2)
filterby = FilterBy(
    Objects=pull,
    PropertyName="Name",
    Value=panel_21,
    IgnoreStringCase=False,
    ExactStringMatch=True,
    Component="{ .FilterBy")
explode_6 = Explode(Object=filterby, Component="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")  # -> StartNode, EndNode, SectionProperty, OrientationAngle, Release, FEAType, Support, Offset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
match_text = MatchText(Text=explode_6.Fragments, Pattern="*RobotId", Case=True)
item_index = ItemIndex(List=match_text, Item="True")
list_item_12 = ListItem(List=explode_6.Fragments, Index=item_index, Wrap=True)
pushtype_3 = PushType(
    {"FullPush": 0, "CreateOnly": 1, "CreateNonExisting": 2, "UpdateOnly": 3, "UpdateOrCreateOnly": 4, "DeleteThenCreate": 5, "AdapterDefault": 6}, selected="FullPush",
    Component="BH.oM.Adapter.PushType",
    Selection=0)

# ---- group: ROBOT code groups and buckling lengths / Creates Member type in RSA
panel_22 = Panel(panel_20)
framingelementdesignproperties = FramingElementDesignProperties(
    EulerBucklingLengthCoefficientY=1,
    EulerBucklingLengthCoefficientZ=1,
    MemberLengthY=1,
    MemberLengthZ=1,
    MemberLengthYIsRelative=True,
    MemberLengthZIsRelative=True,
    Name=panel_22,
    Component="BH.oM.Adapters.Robot.FramingElementDesignProperties")
entwine_4 = Entwine(Branch00=framingelementdesignproperties, FlattenInputs=True)
setpropertyvalue_8 = SetPropertyValue(Obj=filterby, PropName="Fragments", Value=graft(framingelementdesignproperties), Component="{ .SetPropertyValue")

# ---- group: ROBOT code groups and buckling lengths (continued)
graft_tree_3 = GraftTree(Tree=group_number, IncludeEmptyLists=True, IncludeNullItems=True)
graft_tree_4 = GraftTree(Tree=panel_21, IncludeEmptyLists=True, IncludeNullItems=True)
explode_7 = Explode(Object=list_item_12, Component="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")
shift_paths_6 = ShiftPaths(Data=explode_7, Offset=-1)
panel_23 = Panel(explode_6.CustomData)

# ---- group: ROBOT code groups and buckling lengths / Push codegroups or design groups to RSA (continued)
designgroup = DesignGroup(
    Number=graft_tree_3,
    MaterialName=steel_21,
    MemberIds=shift_paths_6,
    Name=graft_tree_4,
    Component="BH.oM.Adapters.Robot.DesignGroup")

# ---- group: ROBOT code groups and buckling lengths (continued)
entwine_5 = Entwine(Branch00=designgroup, FlattenInputs=True)

# ---- group: ROBOT code groups and buckling lengths / Push codegroups or design groups to RSA (continued)
push_3 = Push(
    Adapter=robotadaptor,
    Objects=flatten(entwine_5),
    PushType=pushtype_3,
    Active=add_bars_to_codegroup_and_apply_type,
    Component="{ .Push")  # -> Objects, Success

# ---- group: ROBOT code groups and buckling lengths (continued)
push_4 = Push(
    Adapter=robotadaptor,
    Objects=flatten(setpropertyvalue_8),
    PushType=pushtype_3,
    Active=push_3.Success,
    Component="{ .Push")  # -> Objects, Success
